# Grasshopper definition 01p_loft_curves.gh (Grasshopper 1.0.8)
# Copyright: © SYD 2022
# Copyright: © 2023 SYD all rights reserved

stem_factor = Number()
project = Text()
fetch_o = Object()
chine_width_mm = Number()
straight_f = B()
transom_srf = Item()
ts = TextSettings()
sinkage = Factor()
chine_angle = Number()
chine_angle_2 = Number(chine_angle)
object = ModelObject(FetchO=fetch_o)  # -> ModPtsO, Geometry, Name
Z = UnitZ(Sinkage=expr("-x", sinkage))
chine_width_mm_2 = Number(expr("x*10", chine_width_mm))
abs = Absolute(Value=chine_angle_2)
move = Move(Geometry=object.Geometry, Motion=Z)  # -> SunkPoints, Transform
stem_factor_2 = Number(stem_factor)
trig = TriangleTrigonometry(Beta=degrees(90), Gamma=degrees(abs), ALength=chine_width_mm_2)  # -> Alpha, Beta, Gamma, ALength, BLength, CLength
larger = LargerThan(FirstNumber=chine_angle_2, SecondNumber=0)  # -> LargerThan, OrEqualTo
smaller = SmallerThan(FirstNumber=chine_angle_2, SecondNumber=0)  # -> SmallerThan, OrEqualTo

# ---- group: Transom to trim
null = NullItem(Item=transom_srf)  # -> NullFlags, InvalidFlags, Description
bool = Boolean(null.NullFlags)

# ----
object_2 = ModelObject(Geometry=move.SunkPoints, Name=object.Name)  # -> Object, Name
trim = TextTrim(Project=project, Start=True, End=True)
dispatch = Dispatch(List=trig.CLength, DispatchPattern=larger.LargerThan)  # -> ListA, ListB
neg = Negative(Value=dispatch.ListA)
tmatch = MatchText(Text=object_2.Name, Pattern="*bPt", Case=True)
tmatch_2 = MatchText(Text=object_2.Name, Pattern="*ePt", Case=True)
tmatch_3 = MatchText(Text=object_2.Name, Pattern="*Ht", Case=True)
tmatch_4 = MatchText(Text=object_2.Name, Pattern="*aPt", Case=True)
clean = CleanTree(RemoveNulls=True, RemoveInvalid=True, RemoveEmpty=False, Tree=[dispatch.ListB, neg])
dispatch_2 = Dispatch(List=object_2.Object, DispatchPattern=tmatch)  # -> ListA, ListB
dispatch_3 = Dispatch(List=object_2.Object, DispatchPattern=tmatch_2)  # -> ListA, ListB
dispatch_4 = Dispatch(List=object_2.Object, DispatchPattern=tmatch_3)  # -> ListA, ListB
dispatch_5 = Dispatch(List=object_2.Object, DispatchPattern=tmatch_4)  # -> ListA, ListB

# ---- group: Seperate Pts
item = ListItem(List=dispatch_2.ListA, Index=0, Wrap=False)  # -> Item, Item1, Item2, Item3
item_2 = ListItem(List=dispatch_3.ListA, Index=0, Wrap=True)  # -> Item, Item1, Item2, Item3, Item4

# ----
pdecon = Deconstruct(Point=item.Item1)  # -> XComponent, YComponent, ZComponent
pdecon_2 = Deconstruct(Point=item.Item2)  # -> XComponent, YComponent, ZComponent
subtraction = Subtraction(A=pdecon.ZComponent, B=pdecon_2.ZComponent)

# ---- group: Aligh all stern points for flat transom
pdecon_3 = Deconstruct(Point=[item.Item1, item.Item2, item.Item3])  # -> XComponent, YComponent, ZComponent
sort = SortList(Keys=pdecon_3.XComponent)  # -> Keys, ValuesA
item_3 = ListItem(List=sort.Keys, Index=0, Wrap=True)
pt = ConstructPoint(XCoordinate=item_3, YCoordinate=pdecon_3.YComponent, ZCoordinate=pdecon_3.ZComponent)
object_3 = ModelObject(Object=[item.Item1, item.Item2, item.Item3])  # -> Object, Name
# Control Curves
pt_2 = Point(item.Item1)
object_4 = ModelObject(Geometry=pt, Name=object_3.Name)
item_4 = ListItem(List=object_4, Index=0, Wrap=True)  # -> Item, Item1, Item2

# ----
ln = Line(StartPoint=item.Item, EndPoint=dispatch_5.ListA)
X = UnitX(Factor=1)
line = LineSDL(Start=dispatch_4.ListA, Direction=unitize(X), Length=100000)
sort_2 = SortList(Keys=pdecon_3.YComponent)  # -> reverse(Keys), ValuesA
sort_3 = SortList(Keys=pdecon_3.YComponent)  # -> reverse(Keys), ValuesA
llx = LineLine(Line1=ln, Line2=line)  # -> ParamA, ParamB, PointA, PointB
object_5 = ModelObject(item_2.Item4)
chine_height = Integer(clean)
chine_width = Integer(chine_width_mm_2)
chine_transm_bpt = ModelObject(item_4.Item)
item_5 = ListItem(List=sort_2.Keys, Index=0, Wrap=True)
item_6 = ListItem(List=sort_3.Keys, Index=0, Wrap=True)
chine_stem_bpt = ModelObject(llx.PointA)
stem_sheer_bpt = ModelObject(item.Item)
expression = Expression(BOA=item_5, Cw=chine_width, Expression="(BOA-Cw)/BOA")
expression_2 = Expression(d=subtraction, Ch=chine_height, Expression="(d-Ch)/d")
vec2pt = Vector2Pt(PointA=chine_stem_bpt, PointB=item_2.Item1, Unitize=False)  # -> Vector, Length
vec2pt_2 = Vector2Pt(PointA=item.Item2, PointB=item_2.Item3, Unitize=False)  # -> Vector, Length
vec2pt_3 = Vector2Pt(PointA=item.Item, PointB=dispatch_5.ListA, Unitize=False)  # -> Vector, Length
vec2pt_4 = Vector2Pt(PointA=item.Item3, PointB=item_2.Item4, Unitize=False)  # -> Vector, Length
vec2pt_5 = Vector2Pt(PointA=stem_sheer_bpt, PointB=item_2.Item, Unitize=False)  # -> Vector, Length
multiplication = Multiplication(A=vec2pt_4.Length, StraightF=straight_f)
Y = UnitY(Factor=expr("-x*10", chine_width_mm_2))
expression_3 = Expression(v=vec2pt_4.Vector, Expression="{v.x,v.y,0}")
devec = DeconstructVector(Vector=vec2pt_4.Vector)  # -> XComponent, YComponent, ZComponent
vec = VectorXYZ(XComponent=devec.XComponent, YComponent=devec.YComponent, ZComponent=0)  # -> Vector, Length
amp = Amplitude(Vector=expression_3, Amplitude=multiplication)
move_2 = Move(Geometry=chine_transm_bpt, Motion=Y)  # -> InnerChineTrnsmEPt, Transform
bzspan = BezierSpan(StartPoint=stem_sheer_bpt, StartTangent=vec2pt_5.Vector, EndPoint=item.Item3, EndTangent=vec2pt_4.Vector)  # -> SheerLine, Length, Domain
bzspan_2 = BezierSpan(StartPoint=chine_stem_bpt, StartTangent=vec2pt.Vector, EndPoint=chine_transm_bpt, EndTangent=amp)  # -> ChineOuter, Length, Domain

# ---- group: Scale inner chine line
pdecon_4 = Deconstruct(Point=dispatch_4.ListA)  # -> XComponent, YComponent, ZComponent
pt_3 = ConstructPoint(XCoordinate=0, YCoordinate=0, ZCoordinate=pdecon_4.ZComponent)
xy = XYPlane(Origin=pt_3)
scale_nu = ScaleNU(Geometry=bzspan_2.ChineOuter, Plane=PlaneXY(0, 0, 0), ScaleX=1, ScaleY=expression, ScaleZ=1)  # -> ChineInner, Transform
scale_nu_2 = ScaleNU(Geometry=scale_nu.ChineInner, Plane=xy, ScaleX=1, ScaleY=1, ScaleZ=expression_2)  # -> ChineInner, Transform

# ----
vdis = VectorDisplay(BowAngle=chine_stem_bpt, Vector=vec2pt_3.Vector)
vdis_2 = VectorDisplay(KeelAngle=item.Item2, Vector=vec2pt_2.Vector)
vdis_3 = VectorDisplay(ChineBowA=chine_stem_bpt, Vector=vec2pt.Vector)
vdis_4 = VectorDisplay(TransomSheerA=item.Item3, Vector=vec2pt_4.Vector)
vdis_5 = VectorDisplay(ChineA=chine_transm_bpt, Vector=amp)
vdis_6 = VectorDisplay(InnerChineA=move_2.InnerChineTrnsmEPt, Vector=amp)

end = EndPoints(Curve=scale_nu_2.ChineInner)  # -> Start, End
vec2pt_6 = Vector2Pt(Unitize=False)  # -> Vector, Length
bzspan_3 = BezierSpan(StartPoint=end.Start, StartTangent=vec2pt_3.Vector, EndPoint=item.Item2, EndTangent=vec2pt_2.Vector)  # -> KeelLine, Length, Domain
pt_4 = Point(end.Start)
as_text = AnnotationTextSettings(TextSettings=ts)  # -> TextSettings, TextHeight

# ---- group: Display / End points
cluster = Cluster(pt=dispatch_4.ListA)

# ----
debrep = DeconstructBrep(Transom=transom_srf)  # -> Faces, Edges, Vertices
stbd_srf = StbdSrf(B=debrep.Faces)
debrep_2 = DeconstructBrep(Brep=stbd_srf)  # -> Faces, Edges, Vertices
pdecon_5 = Deconstruct(Point=debrep_2.Vertices)  # -> XComponent, YComponent, ZComponent
sort_4 = SortList(Keys=pdecon_5.XComponent)  # -> Keys, ValuesA
O = Object(object_2.Object)

# ---- group: Display
entwine = Entwine(
    Branch00=bzspan.SheerLine,
    Branch01=bzspan_2.ChineOuter,
    Branch02=scale_nu_2.ChineInner,
    Branch03=bzspan_3.KeelLine,
    FlattenInputs=True)  # -> flatten(Result)
object_6 = ModelObject(Geometry=chine_stem_bpt, Name="Chine Stem bPt")
end_pts = ModelObject([item_2.Item, item_2.Item1, item_2.Item2, item_2.Item4, item_2.Item3])
base_pts = ModelObject([item.Item, item_4.Item, item_4.Item1, item_4.Item2, object_6])
layers = QueryModelLayers(Name="G-hull-ctrl", AutoUpdateState=True)
layers_2 = QueryModelLayers(Name="G-anno-text", AutoUpdateState=True)
panel = Panel("G-anno")
panel_2 = Panel("""0 Bilge intersect Ht
1 Chine intersect Ht""")
cluster_2 = Cluster_2(cntrl_pt_o=flatten(base_pts), ts=ts)  # -> te, N, ad
cluster_3 = Cluster_2(cntrl_pt_o=end_pts, ts=ts)  # -> te, N, ad
cluster_4 = Cluster_2(cntrl_pt_o=dispatch_5.ListA, ts=ts)  # -> te, N, ad
display = DisplayAttributes(DisplayColour=ColourSwatch(SwatchColor=RGB(123, 182, 186)))
display_2 = DisplayAttributes(DisplayColour=ColourSwatch(SwatchColor=RGB(149, 96, 209)))
display_3 = DisplayAttributes(DisplayColour=ColourSwatch(SwatchColor=RGB(157, 176, 209)))
display_4 = DisplayAttributes(DisplayColour=ColourSwatch(SwatchColor=RGB(192, 145, 204)))
display_5 = DisplayAttributes(DisplayColour=ColourSwatch(SwatchColor=RGB(214, 156, 156)))
object_7 = ModelObject(Geometry=cluster_2.te, Name=cluster_2.N, Layer=layers_2)
object_8 = ModelObject(Geometry=cluster_3.te, Name=cluster_3.N, Layer=layers_2)
object_9 = ModelObject(Geometry=cluster_4.te, Name=cluster_4.N, Layer=layers_2)

# ---- group: Display / Loft curves
midpt = CurveMiddle(Curve=entwine)
panel_3 = Panel("""Sheer Crv
Chine Inner Crv
Chine Outer Crv
Bilge Crv""")
pl_origin = PlaneOrigin(Base=[PlaneXZ(0, 0, 0), PlaneXY(0, 0, 0), PlaneYZ(0, 0, 0)], Origin=graft(midpt))
text_entity = TextEntity(Plane=pl_origin, Text=graft(panel_3), TextSettings=ts)
display_6 = DisplayAttributes(DisplayColour=[ColourSwatch(SwatchColor=RGB(153, 201, 166)), ColourSwatch(SwatchColor=RGB(207, 201, 143)), ColourSwatch(SwatchColor=RGB(118, 214, 144))])  # -> Display, DisplayColour, DisplayMode
object_10 = ModelObject(Geometry=text_entity, Name=panel_3, Layer=layers_2)
object_11 = ModelObject(Geometry=entwine, Name=panel_3, Layer=layers)

# ----
object_12 = ModelObject(Object=object_11)  # -> Object, Name
panel_4 = Panel(object_12.Name)
item_7 = ListItem(List=flatten(object_12.Object), Index=0, Wrap=True)  # -> Item, Item1, Item2, Item3
sheer_crv = Curve(item_7.Item)
inner_chine_crv = Curve(flatten(item_7.Item2))
keel_crv = Curve(item_7.Item3)
chine_crv = Curve(item_7.Item1)
flip = FlipCurve(Curve=inner_chine_crv, Guide=keel_crv)  # -> Curve, Flag
loft = Loft(
    Curves=flatten([flip.Curve, keel_crv]),
    Options={Adjust=False, Closed=False, LoftEnds=0, LoftSimp=0, LoftType=0, Rebuild=10, Refit=0.01})

# ---- group: Does V cross the CL?
sec = BrepPlane(Brep=loft, Plane=Plane(origin=(0, 0, 0), x=(0, 0, 1), y=(1, 0, 0)))  # -> Curves, Points
null_2 = NullItem(Item=sec.Curves)  # -> NullFlags, InvalidFlags, Description
dispatch_6 = Dispatch(List=loft, DispatchPattern=null_2.NullFlags)  # -> ListA, ListB
srfsplit = SurfaceSplit(Surface=dispatch_6.ListB, Curves=sec.Curves)
area = Area(Geometry=srfsplit)  # -> Area, Centroid
# Surfaces
sort_5 = SortList(Keys=area.Area, ValuesA=srfsplit)  # -> Keys, ValuesA
item_8 = ListItem(List=reverse(sort_5.ValuesA), Index=0, Wrap=True)
clean_2 = CleanTree(RemoveNulls=True, RemoveInvalid=True, RemoveEmpty=True, Tree=[dispatch_6.ListA, item_8])

# ---- group: Stem / Chine flat
mirror = Mirror(Geometry=inner_chine_crv, Plane=PlaneXZ(0, 0, 0))  # -> Geometry, Transform
mirror_2 = Mirror(Geometry=chine_crv, Plane=PlaneXZ(0, 0, 0))  # -> Geometry, Transform

# ----
layers_3 = QueryModelLayers(Name=panel, AutoUpdateState=True)

# ---- group: Vector lines
move_3 = Move(Geometry=chine_transm_bpt, Motion=amp)  # -> Geometry, Transform
object_13 = ModelObject(Object=dispatch_2.ListA)  # -> Object, Name
merge = Merge(Data1=item.Item, Data2=item.Item1, Data3=item.Item2, Data4=item.Item3, Data5=chine_stem_bpt)
merge_2 = Merge(Data1=item_2.Item, Data2=move_3.Geometry, Data3=item_2.Item3, Data4=item_2.Item4, Data5=item_2.Item1)
rep = ReplaceText(Text=object_13.Name, Find="bPt", Replace="Vect", RecursiveReplace=False)
as_arrows = AnnotationArrowSettings(Arrow1=0, Arrow2=8, ArrowSize=as_text.TextHeight, FitArrow=1, LeaderArrow=0, LeaderArrowSize=0)  # -> ArrowSettings, Arrow1, Arrow2, ArrowSize, FitArrow, DimensionInline, LeaderArrow, LeaderArrowSize
aligned_dimension = AlignedDimension(PointA=merge, PointB=merge_2, TextOverride=" ", ArrowSettings=as_arrows.ArrowSettings)  # -> AlignedDimension, PointA, PointB, Offset
aligned_dimension_2 = AlignedDimension(PointA=item.Item, PointB=dispatch_5.ListA, TextOverride=" ", ArrowSettings=as_arrows.ArrowSettings)  # -> AlignedDimension, PointA, PointB, Offset
object_14 = ModelObject(Geometry=aligned_dimension.AlignedDimension, Name=rep, Layer=layers_3, Display=display_2)  # -> CntrlVectorO, Geometry, Name, Layer, Visibility, Display, Drafting, Render

# ----
panel_5 = Panel(merge)
panel_6 = Panel(merge_2)

# ---- group: Display (continued)
object_15 = ModelObject(Geometry=cluster, Name=panel_2, Layer=layers_3)
object_16 = ModelObject(Geometry=aligned_dimension_2.AlignedDimension, Name="Bow Angle V", Layer=layers_3, Display=display_2)
object_17 = ModelObject(Geometry=cluster_2.ad, Name=cluster_2.N, Layer=layers_3)
object_18 = ModelObject(Geometry=cluster_3.ad, Name=cluster_3.N, Layer=layers_3)
object_19 = ModelObject(Geometry=cluster_4.ad, Name=cluster_4.N, Layer=layers_3)

# ----
chine = Loft(
    Curves=flatten([chine_crv, inner_chine_crv]),
    Options={Adjust=False, Closed=False, LoftEnds=0, LoftSimp=0, LoftType=2, Rebuild=10, Refit=0.01})
loft_2 = Loft(
    Curves=[chine_crv, sheer_crv],
    Options={Adjust=False, Closed=False, LoftEnds=0, LoftSimp=0, LoftType=0, Rebuild=10, Refit=0.01})
v_hull_srf = Surface(clean_2)
dispatch_7 = Dispatch(List=flatten(loft_2), DispatchPattern=bool)  # -> ListA, ListB
dispatch_8 = Dispatch(List=flatten(chine), DispatchPattern=bool)  # -> ListA, ListB
dispatch_9 = Dispatch(List=flatten(v_hull_srf), DispatchPattern=bool)  # -> ListA, ListB
cntrl_vector_o = Object([object_14.CntrlVectorO, object_16])
mark_pt_o = Object([object_18, object_17, object_19, object_15, object_9, object_8, object_7])
loft_crv_o = Object([object_11, object_10])

# ---- group: Stem
edges = BrepEdges(Brep=clean_2)  # -> Naked, Interior, NonManifold
mirror_3 = Mirror(Geometry=sheer_crv, Plane=PlaneXZ(0, 0, 0))  # -> Geometry, Transform
item_9 = ListItem(List=edges.Naked, Index=Slider(1, range=0..4), Wrap=True)
mirror_4 = Mirror(Geometry=item_9, Plane=PlaneXZ(0, 0, 0))  # -> Geometry, Transform
flip_2 = FlipCurve(Curve=item_9)  # -> Curve, Flag
flip_3 = FlipCurve(Curve=sheer_crv)  # -> Curve, Flag
flip_4 = FlipCurve(Curve=chine_crv)  # -> Curve, Flag
flip_5 = FlipCurve(Curve=inner_chine_crv)  # -> Curve, Flag
cluster_5 = Cluster_3(f=stem_factor_2, crv_1=mirror_4.Geometry, crv_2=flip_2.Curve)
cluster_6 = Cluster_3(f=stem_factor_2, crv_1=mirror.Geometry, crv_2=flip_5.Curve)
cluster_7 = Cluster_3(f=stem_factor_2, crv_1=mirror_2.Geometry, crv_2=flip_4.Curve)
cluster_8 = Cluster_3(f=stem_factor_2, crv_1=mirror_3.Geometry, crv_2=flip_3.Curve)
mirror_5 = Mirror(Geometry=keel_crv, Plane=PlaneXZ(0, 0, 0))  # -> Geometry, Transform
loft_3 = Loft(
    Curves=[cluster_8, cluster_7],
    Options={Adjust=False, Closed=False, LoftEnds=0, LoftSimp=0, LoftType=0, Rebuild=10, Refit=0.01})
loft_4 = Loft(
    Curves=[cluster_6, cluster_7],
    Options={Adjust=False, Closed=False, LoftEnds=0, LoftSimp=0, LoftType=0, Rebuild=10, Refit=0.01})

# ----
loft_5 = Loft(
    Curves=[mirror_3.Geometry, sheer_crv],
    Options={Adjust=False, Closed=False, LoftEnds=0, LoftSimp=0, LoftType=0, Rebuild=10, Refit=0.01})
debrep_3 = DeconstructBrep(Brep=loft_5)  # -> Faces, Edges, Vertices
flip_6 = FlipCurve(Curve=mirror_5.Geometry)  # -> Curve, Flag
item_10 = ListItem(List=debrep_3.Edges, Index=0, Wrap=True)
loft_6 = Loft(
    Curves=flatten([cluster_8, item_10]),
    Options={Adjust=False, Closed=False, LoftEnds=0, LoftSimp=0, LoftType=0, Rebuild=10, Refit=0.01})
stbd_srf_2 = StbdSrf(B=loft_5)

# ---- group: Stem (continued)
edgesrf = EdgeSurface(CurveA=keel_crv, CurveB=flip_6.Curve, CurveC=cluster_6, CurveD=cluster_5)

# ----
stbd_srf_3 = StbdSrf(B=loft_6)
stbd_srf_4 = StbdSrf(B=edgesrf)
stbd_srf_5 = StbdSrf(B=loft_3)
stbd_srf_6 = StbdSrf(B=loft_4)
dispatch_10 = Dispatch(List=flatten(stbd_srf_4), DispatchPattern=bool)  # -> ListA, ListB
dispatch_11 = Dispatch(List=flatten(stbd_srf_2), DispatchPattern=bool)  # -> ListA, ListB

# ---- group: Trimmed transom
clean_3 = CleanTree(
    RemoveNulls=True,
    RemoveInvalid=True,
    RemoveEmpty=True,
    Tree=flatten([dispatch_10.ListA, dispatch_9.ListA, dispatch_7.ListA, dispatch_11.ListA, dispatch_8.ListA]))  # -> flatten(Tree)
join = BrepJoin(Breps=clean_3)  # -> Breps, Closed
mirror_6 = Mirror(Geometry=join.Breps, Plane=PlaneXZ(0, 0, 0))  # -> Geometry, Transform
join_2 = BrepJoin(Breps=flatten([mirror_6.Geometry, join.Breps]))  # -> Breps, Closed
capex = CapHolesEx(Brep=join_2.Breps)  # -> Brep, Caps, Solid
debrep_4 = DeconstructBrep(Brep=capex.Brep)  # -> Faces, Edges, Vertices
item_11 = ListItem(List=debrep_4.Faces, Index=Slider(16, range=0..16), Wrap=False)

# ----
split_larger = SplitLarger(surface=[dispatch_10.ListB, dispatch_9.ListB, dispatch_7.ListB, dispatch_11.ListB, dispatch_8.ListB], brep=stbd_srf)  # -> srf_2, larger_srf_2, smaller_srf_2, cutting_crv
clean_4 = CleanTree(RemoveNulls=True, RemoveInvalid=True, RemoveEmpty=True, Tree=split_larger.larger_srf_2)
split_larger_2 = SplitLarger(surface=stbd_srf, T=split_larger.cutting_crv)  # -> srf_2, larger_srf_2, smaller_srf_2, cutting_crv
item_12 = ListItem(List=flatten(clean_4), Index=0, Wrap=False)  # -> Item, Item1, Item2, Item3, Item4
near_cl = NearCL(srf=[split_larger_2.larger_srf_2, split_larger_2.smaller_srf_2])
stem_srf = Surface(item_12.Item)
v_hull_srf_2 = Surface(item_12.Item1)
tops_srf = Surface(item_12.Item2)
deck_srf = Surface(item_12.Item3)
chinef_srf = Surface(item_12.Item4)
chinef_srf_2 = Surface(split_larger_2.larger_srf_2)
stbd_srf_7 = StbdSrf(B=[item_11, near_cl])
stem_v_hull = Surface([dispatch_10.ListA, stem_srf, stbd_srf_6])
chine_flat_stbd = Surface([chinef_srf, dispatch_8.ListA])
v_hull_stbd = Surface(flatten([v_hull_srf_2, dispatch_9.ListA]))
stem_tops = Surface(stbd_srf_5)
topsides_stbd = Surface([dispatch_7.ListA, tops_srf])
deck_stbd = Surface([dispatch_11.ListA, deck_srf, stbd_srf_3])
join_3 = BrepJoin(Breps=[stem_tops, stem_v_hull])  # -> StemStbd, Closed
join_4 = BrepJoin(Breps=[stbd_srf_7, v_hull_stbd, chine_flat_stbd, topsides_stbd, deck_stbd, join_3.StemStbd])  # -> Breps, Closed
mirror_7 = Mirror(Geometry=join_4.Breps, Plane=Plane(origin=(0, 0, 0), x=(0, 0, 1), y=(1, 0, 0)))  # -> Geometry, Transform
join_5 = BrepJoin(Breps=[join_4.Breps, mirror_7.Geometry])  # -> Vessel, Closed

# ---- group: Close holes
edges_2 = BrepEdges(Brep=join_5.Vessel)  # -> Naked, Interior, NonManifold; disabled

# ----
lng = ListLength(List=edges_2.Naked)  # disabled
larger_2 = LargerThan(FirstNumber=lng, SecondNumber=0)  # -> LargerThan, OrEqualTo; disabled
dispatch_12 = Dispatch(List=edges_2.Naked, DispatchPattern=larger_2.LargerThan)  # -> ListA, ListB; disabled

# ---- group: Close holes (continued)
join_6 = JoinCurves(Curves=dispatch_12.ListA, Preserve=False)  # disabled
patch = Patch(Curves=join_6, Spans=20, Flexibility=100, Trim=True)  # disabled
mirror_8 = Mirror(Geometry=patch, Plane=Plane(origin=(0, 0, 0), x=(0, 0, 1), y=(1, 0, 0)))  # -> Geometry, Transform; disabled

# ----
join_7 = BrepJoin(Breps=flatten([chine_flat_stbd, mirror_8.Geometry]))  # -> Breps, Closed; disabled

join_8 = BrepJoin(Breps=flatten([join_5.Vessel, mirror_8.Geometry, patch]))  # -> Vessel, Closed
panel_7 = Panel("""Deck stbd
Topsides stbd
Chine flat stbd
V-hull stbd
Transom stbd
Stem tops
Stem v-hull""")
capex_2 = CapHolesEx(Brep=flatten(join_8.Vessel))  # -> Brep, Caps, Solid
layers_4 = QueryModelLayers(Name="G-hull", AutoUpdateState=True)
object_20 = ModelObject(Geometry=capex_2.Brep, ProjectName=trim, Layer=layers_4)
object_21 = ModelObject(
    Geometry=flatten([deck_stbd, topsides_stbd, chine_flat_stbd, v_hull_stbd, stbd_srf_7, stem_tops, stem_v_hull]),
    Name=panel_7,
    Layer=layers_4)

half_hull_o = Object(object_21)
vessel_o = Object(object_20)
S = Solid(capex_2.Solid)

# ==== cluster Cluster
pt = ClusterInput()
X = UnitX(Factor=[-1000, 1000])
pt_2 = Point(pt)
move = Move(Geometry=graft(pt_2), Motion=X)  # -> Geometry, Transform
dispatch = Dispatch(List=move.Geometry, DispatchPattern=[True, False])  # -> ListA, ListB
ln = Line(StartPoint=dispatch.ListA, EndPoint=dispatch.ListB)  # -> flatten(Line)
L = ClusterOutput(ln)

# ==== cluster Cluster_2
cntrl_pt_o = ClusterInput()
ts = ClusterInput()
object = ModelObject(CntrlPtO=cntrl_pt_o)  # -> Object, Geometry, Name
pl_origin = PlaneOrigin(Base=[PlaneXZ(0, 0, 0), PlaneXY(0, 0, 0), PlaneYZ(0, 0, 0)], Origin=graft(object.Geometry))
as_text = AnnotationTextSettings(TextSettings=ts)  # -> TextSettings, TextHeight

# ---- group: Upgraded : Text Dot
annotation_dot = AnnotationDot(Location=object.Geometry, PrimaryText="+", TextHeight=expr("x*4", as_text.TextHeight))

# ----
text_entity = TextEntity(Plane=pl_origin, Text=graft(object.Name), TextSettings=as_text.TextSettings)
te = ClusterOutput(text_entity)
N = ClusterOutput(object.Name)
ad = ClusterOutput(annotation_dot)

# ==== cluster Cluster_3
f = ClusterInput()
crv_2 = ClusterInput()
crv_1 = ClusterInput()
end = EndPoints(Curve=crv_1)  # -> Start, End
end_2 = EndPoints(Curve=crv_2)  # -> Start, End
flip = FlipCurve(Curve=crv_2)  # -> Curve, Flag
eval = EvaluateCurve(Curve=crv_1, Parameter=0.0001)  # -> Point, Tangent, Angle
eval_2 = EvaluateCurve(Curve=flip.Curve, Parameter=0.0001)  # -> Point, Tangent, Angle
pdecon = Deconstruct(Point=end.End)  # -> XComponent, YComponent, ZComponent
pdecon_2 = Deconstruct(Point=end.Start)  # -> XComponent, YComponent, ZComponent
vec2pt = Vector2Pt(PointA=eval.Point, PointB=end.Start, Unitize=True)  # -> Vector, Length
vec2pt_2 = Vector2Pt(PointA=eval_2.Point, PointB=end_2.End, Unitize=True)  # -> Vector, Length
eval_3 = Evaluate(F="if(ABS(x)<ABS(y),ABS(x)*f,ABS(y)*f)", x=pdecon_2.YComponent, y=pdecon.YComponent, f=f)
multiplication = Multiplication(A=vec2pt.Vector, Mult=eval_3)
multiplication_2 = Multiplication(A=vec2pt_2.Vector, Mult=eval_3)
bzspan = BezierSpan(StartPoint=end.Start, StartTangent=multiplication, EndPoint=end_2.End, EndTangent=multiplication_2)  # -> Curve, Length, Domain
C = ClusterOutput(bzspan.Curve)

# ==== cluster StbdSrf
B = ClusterInput()
sec = BrepPlane(Brep=flatten(B), Plane=Plane(origin=(0, 0, 0), x=(0, 0, 1), y=(1, 0, 0)))  # -> simplify(Curves), Points
flatten = FlattenTree(Tree=B, Path="{0}")  # -> graft(Tree)
srfsplit = SurfaceSplit(Surface=flatten, Curves=sec.Curves)  # -> flatten(Fragments)
area = Area(Geometry=flatten(srfsplit))  # -> Area, Centroid
pdecon = Deconstruct(Point=area.Centroid)  # -> XComponent, YComponent, ZComponent
larger = LargerThan(FirstNumber=pdecon.YComponent, SecondNumber=0)  # -> LargerThan, OrEqualTo
dispatch = Dispatch(List=srfsplit, DispatchPattern=larger.LargerThan)  # -> ListA, ListB
stbd_srf = Surface(dispatch.ListA)
stbd_srf_2 = ClusterOutput(stbd_srf)

# ==== cluster SplitLarger
brep = ClusterInput()
T = ClusterInput()
surface = ClusterInput()
join = BrepJoin(Breps=brep)  # -> Breps, Closed
bbx = BrepBrep(Surface=graft(surface), CuttingSrf=join.Breps)  # -> Curves, Points
clean = CleanTree(RemoveNulls=True, RemoveInvalid=True, RemoveEmpty=True, Tree=[bbx.Curves, T])
join_2 = JoinCurves(Curves=flatten(clean), Preserve=False)
srfsplit = SurfaceSplit(Surface=graft(surface), CuttingCrv=clean)  # -> simplify(Fragments)
area = Area(Geometry=srfsplit)  # -> Area, Centroid
pdecon = Deconstruct(Point=area.Centroid)  # -> XComponent, YComponent, ZComponent; disabled
sort = SortList(Keys=area.Area, ValuesA=srfsplit)  # -> Keys, reverse(ValuesA)
sort_2 = SortList(Keys=pdecon.YComponent, ValuesA=srfsplit)  # -> Keys, ValuesA; disabled
short = ShortestList(ListB=surface, TrimMode=2)  # -> ListA, ListB
cull_i = CullIndex(List=sort.ValuesA, Indices=[1, 2, 3], Wrap=False)
cull_i_2 = CullIndex(List=sort.ValuesA, Indices=0, Wrap=False)
join_3 = JoinCurves(Curves=join_2, Preserve=False)
srf = Surface(short.ListB)
larger_srf = Surface(cull_i)
smaller_srf = Surface(cull_i_2)
srf_2 = ClusterOutput(srf)
larger_srf_2 = ClusterOutput(larger_srf)
smaller_srf_2 = ClusterOutput(smaller_srf)
cutting_crv = ClusterOutput(join_3)

# ==== cluster NearCL
srf = ClusterInput()
srf_2 = Surface(srf)
area = Area(Geometry=srf_2)  # -> Area, Centroid
pdecon = Deconstruct(Point=area.Centroid)  # -> XComponent, YComponent, ZComponent
abs = Absolute(Value=pdecon.YComponent)
dispatch = Dispatch(List=abs, DispatchPattern=[True, False])  # -> ListA, ListB
smaller = SmallerThan(FirstNumber=dispatch.ListA, SecondNumber=dispatch.ListB)  # -> SmallerThan, OrEqualTo
not = GateNot(A=smaller.SmallerThan)
dispatch_2 = Dispatch(List=srf_2, DispatchPattern=[smaller.SmallerThan, not])  # -> ListA, ListB
A = ClusterOutput(dispatch_2.ListA)
