# Grasshopper definition bimini_hardware.gh (Grasshopper 1.0.8)
# Copyright: © 2023 SYD all rights reserved

rail_height = Factor()
platform = Brep()
offset = Distance()
radius = Radius()
wires = BrepWireframe(Platform=platform, Density=-1)
join = JoinCurves(Curves=wires, Preserve=False)
Z = UnitZ(Factor=expr("-x", "1960"))
dispatch = Dispatch(List=join, DispatchPattern=[True, False])  # -> ListA, ListB
offset_2 = OffsetCurve(Curve=dispatch.ListA, Distance=offset, Plane=PlaneXY(0, 0, 0), Corners=1)
Z_2 = UnitZ(Factor=rail_height)
subtraction = Subtraction(A="1960", B=rail_height)
move = Move(Geometry=offset_2, Motion=Z)  # -> Geometry, Transform
Z_3 = UnitZ(Factor=expr("-x", subtraction))
move_2 = Move(Geometry=offset_2, Motion=Z_3)  # -> Geometry, Transform
extr = Extrude(Base=offset_2, Direction=Z_3)
extr_2 = Extrude(Base=move.Geometry, Direction=Z_2)
pipe = Pipe(Curve=move_2.Geometry, Radius=radius, Caps=0)
display = DisplayAttributes(IsocurveDensity=-1)
layers = QueryModelLayers(Name="Q-deck-canvas", AutoUpdateState=True)
layers_2 = QueryModelLayers(Name="C-glss", AutoUpdateState=True)
layers_3 = QueryModelLayers(Name="Q-deck-SS", AutoUpdateState=True)
object = ModelObject(Geometry=extr, Name="Bimini awning", Layer=layers, Display=display)
object_2 = ModelObject(Geometry=extr_2, Name="Bimini glass", Layer=layers_2, Display=display)
object_3 = ModelObject(Geometry=pipe, Name="Bimini rail", Layer=layers_3, Display=display)
O = Object(object)
O_2 = Object(object_2)
O_3 = Object(object_3)
C = Curve(offset_2)
