# Grasshopper definition bimini_top.gh (Grasshopper 1.0.8)
# Copyright: © 2023 SYD all rights reserved

relay = Relay()
C = Curve()
D = Distance()
D_2 = Distance()
D_3 = Distance()
wires = BrepWireframe(Brep=relay, Density=-1)
offset = OffsetCurve(Curve=C, Distance=expr("-x", D), Corners=1)
offset_2 = OffsetSurface(Surface=relay, Distance=D_2, Retrim=True)
offset_3 = OffsetSurface(Surface=relay, Distance=D_3, Retrim=True)
join = JoinCurves(Curves=wires, Preserve=False)
project = Project(Curve=offset, Brep=offset_3, Direction=Vector(0, 0, 1))
project_2 = Project(Curve=offset, Brep=offset_2, Direction=Vector(0, 0, 1))
srfsplit = SurfaceSplit(Surface=offset_2, Curves=project_2)
srfsplit_2 = SurfaceSplit(Surface=offset_3, Curves=project)
area = Area(Geometry=srfsplit)  # -> Area, Centroid
area_2 = Area(Geometry=srfsplit_2)  # -> Area, Centroid
sort = SortList(Keys=area.Area, ValuesA=srfsplit)  # -> Keys, ValuesA
sort_2 = SortList(Keys=area_2.Area, ValuesA=srfsplit_2)  # -> Keys, reverse(ValuesA)
item = ListItem(List=sort.ValuesA, Index=0, Wrap=True)
item_2 = ListItem(List=sort_2.ValuesA, Index=0, Wrap=True)
wires_2 = BrepWireframe(Brep=item, Density=-1)
wires_3 = BrepWireframe(Brep=item_2, Density=-1)
wires_4 = BrepWireframe(Brep=relay, Density=-1)
join_2 = JoinCurves(Curves=wires_2, Preserve=False)
join_3 = JoinCurves(Curves=wires_3, Preserve=False)
join_4 = JoinCurves(Curves=wires_4, Preserve=False)
len = Length(Curve=join_2)
len_2 = Length(Curve=join_3)
sort_3 = SortList(Keys=len, ValuesA=join_2)  # -> Keys, reverse(ValuesA)
sort_4 = SortList(Keys=len_2, ValuesA=join_3)  # -> Keys, reverse(ValuesA)
item_3 = ListItem(List=sort_3.ValuesA, Index=0, Wrap=True)  # -> Item, Item1
item_4 = ListItem(List=sort_4.ValuesA, Index=0, Wrap=True)  # -> Item, Item1
item_5 = ListItem(List=join_4, Index=0, Wrap=True)  # -> Item, Item1
loft = Loft(
    Curves=flatten([item_4.Item, item_3.Item1]),
    Options={Adjust=False, Closed=False, LoftEnds=0, LoftSimp=0, LoftType=0, Rebuild=10, Refit=0.01})
loft_2 = Loft(
    Curves=flatten([item_5.Item, item_3.Item]),
    Options={Adjust=False, Closed=False, LoftEnds=0, LoftSimp=0, LoftType=0, Rebuild=10, Refit=0.01})
join_5 = BrepJoin(Breps=flatten([relay, item, item_2, loft, loft_2]))  # -> SphereBrep, Closed
layers = QueryModelLayers(Name="C-deck-bimini", AutoUpdateState=True)
display = DisplayAttributes(IsocurveDensity=-1)
object = ModelObject(Geometry=join_5.SphereBrep, Name="Bimini", Layer=layers, Display=display)  # -> SphereBrepO, Geometry, Name, Layer, Visibility, Display, Drafting, Render
sphere_brep_o = Object(object.SphereBrepO)
sphere_brep = Breps(join_5.SphereBrep)
