# Grasshopper definition calculate_hydrostatics.gh (Grasshopper 1.0.8)
# Copyright: © SYD 2022
# Copyright: © 2023 SYD all rights reserved
# plug-ins: Pufferfish

hh_o = Object()
hulls = Brep()
density = Number()
ts = TextSettings()
hulls_2 = Brep(hulls)
object = ModelObject(Object=hh_o)  # -> Object, Geometry, Name
density_2 = Number(density)
lng = ListLength(List=hulls_2)
debrep = DeconstructBrep(Brep=object.Geometry)  # -> Faces, Edges, Vertices
item = ListItem(List=hulls_2, Index=0, Wrap=True)

# ---- group: Immersed hull
join = BrepJoin(Breps=flatten(debrep.Faces))  # -> Breps, Closed
xy = XYPlane(Origin=Point(0, 0, 0))
sec = BrepPlane(Brep=join.Breps, Plane=xy)  # -> Curves, Points
debrep_2 = DeconstructBrep(Brep=join.Breps)  # -> Faces, Edges, Vertices
mirror = Mirror(Geometry=sec.Curves, Plane=Plane(origin=(0, 0, 0), x=(0, 0, 1), y=(1, 0, 0)))  # -> Geometry, Transform
srfsplit = SurfaceSplit(Surface=debrep_2.Faces, Curves=sec.Curves)
join_2 = JoinCurves(Curves=flatten([sec.Curves, mirror.Geometry]), Preserve=False)
area = Area(Geometry=srfsplit)  # -> Area, Centroid
pdecon = Deconstruct(Point=area.Centroid)  # -> XComponent, YComponent, ZComponent
larger = LargerThan(FirstNumber=pdecon.ZComponent, SecondNumber=0)  # -> LargerThan, OrEqualTo
clscrv = CloseCurve(Curve=join_2, CloseType=0, Bulge=0.5, Tolerance=0)  # -> Closed, R
dispatch = Dispatch(List=srfsplit, DispatchPattern=larger.OrEqualTo)  # -> ListA, ListB
boundary = BoundarySurfaces(Edges=clscrv.Closed)
mirror_2 = Mirror(Geometry=dispatch.ListB, Plane=Plane(origin=(0, 0, 0), x=(0, 0, 1), y=(1, 0, 0)))  # -> Geometry, Transform
srf = Surface(dispatch.ListA)
srf_2 = Surface(dispatch.ListB)
bounding_box = BoundingBox(vessel=hulls_2)
join_3 = BrepJoin(Breps=flatten([mirror_2.Geometry, dispatch.ListB, boundary]))  # -> Breps, Closed
sint = SolidIntersection(BrepsA=graft(hulls_2), BrepsB=graft(bounding_box))
capex = CapHolesEx(Brep=join_3.Breps)  # -> ImmersedHull, Caps, Solid

# ----
single_hull = Brep(item)
item_2 = ListItem(List=flatten(object.Geometry), Index=Slider(4, range=0..10), Wrap=True)

# ---- group: Vessel
mirror_3 = Mirror(Geometry=join.Breps, Plane=Plane(origin=(0, 0, 0), x=(0, 0, 1), y=(1, 0, 0)))  # -> Geometry, Transform
join_4 = BrepJoin(Breps=[mirror_3.Geometry, join.Breps])  # -> Breps, Closed

# ---- group: Does V cross the CL?
sec_2 = BrepPlane(Brep=item_2, Plane=Plane(origin=(0, 0, 0), x=(0, 0, 1), y=(1, 0, 0)))  # -> Curves, Points
null = NullItem(Item=sec_2.Curves)  # -> NullFlags, InvalidFlags, Description
dispatch_2 = Dispatch(List=item_2, DispatchPattern=null.NullFlags)  # -> ListA, ListB
srfsplit_2 = SurfaceSplit(Surface=dispatch_2.ListB, Curves=sec_2.Curves)
area_2 = Area(Geometry=srfsplit_2)  # -> Area, Centroid
sort = SortList(Keys=area_2.Area, ValuesA=srfsplit_2)  # -> Keys, ValuesA
item_3 = ListItem(List=reverse(sort.ValuesA), Index=0, Wrap=True)
clean = CleanTree(RemoveNulls=True, RemoveInvalid=True, RemoveEmpty=True, Tree=flatten([dispatch_2.ListA, item_3]))

# ----
Z = UnitZ(Factor=-2000)
extr = Extrude(Base=join_2, Direction=Z)
cap = CapHoles(Brep=extr)
combine = CombineData(Input0=join_4.Breps, Input1=hulls_2)  # -> Result, Index
xy_2 = XYPlane(Origin=Point(0, 0, 0))
sec_3 = BrepPlane(Brep=combine.Result, Plane=xy_2)  # -> Curves, Points
clscrv_2 = CloseCurve(Curve=sec_3.Curves, CloseType=0, Bulge=0.5, Tolerance=0)  # -> Closed, R
below_chine_srf = Surface(clean)
box_corners = BoxCorners(Box=below_chine_srf)  # -> CornerA, CornerB, CornerC, CornerD, CornerE, CornerF, CornerG, CornerH
dist = Distance(PointA=box_corners.CornerA, PointB=box_corners.CornerB)
combine_2 = CombineData(Input0=capex.ImmersedHull, Input1=sint)  # -> Result, Index
multiplication = Multiplication(A=dist, B="0.249")
X = UnitX(Factor=1)
item_4 = ListItem(List=flatten(combine_2.Result), Index=0, Wrap=True)
contour = Contour(Shape=below_chine_srf, Point=box_corners.CornerD, Direction=X, Distance=multiplication)  # -> flatten(Contours)
boundary_2 = BoundarySurfaces(Edges=clscrv_2.Closed)

# ---- group: First & last Pt
debrep_3 = DeconstructBrep(Brep=item_4)  # -> Faces, Edges, Vertices
pdecon_2 = Deconstruct(Point=debrep_3.Vertices)  # -> XComponent, YComponent, ZComponent
sort_2 = SortList(Keys=pdecon_2.XComponent, ValuesA=debrep_3.Vertices)  # -> Keys, ValuesA
item_5 = ListItem(List=sort_2.ValuesA, Index=[0, -1], Wrap=True)
dispatch_3 = Dispatch(List=item_5, DispatchPattern=[True, False])  # -> ListA, ListB

# ----
item_6 = ListItem(List=contour, Index=0, Wrap=True)  # -> Item, Item1, Item2, Item3

# ---- group: Bounding Rect
bounding_box_2 = BoundingBox(vessel=capex.ImmersedHull)
combine_3 = CombineData(Input0=bounding_box_2, Input1=bounding_box)  # -> Result, Index
debox = DeconstructBox(Box=combine_3.Result)  # -> Plane, X, Y, Z
dedomain = DeconstructDomain(Domain=debox.X)  # -> Start, End
expression = Expression(s=dedomain.Start, e=dedomain.End, Expression="Round(e-s)")

# ----
end = EndPoints(Curve=[item_6.Item3, item_6.Item])  # -> Start, End
vec2pt = Vector2Pt(PointA=end.Start, PointB=end.End, Unitize=False)  # -> Vector, Length
Y = UnitY(Factor=1)
abs = Absolute(Value=vec2pt.Vector)
item_7 = ListItem(List=flatten(clscrv_2.Closed), Index=0, Wrap=True)
vdis = VectorDisplay(Anchor=end.End, Vector=abs)
angle = Angle(VectorA=abs, VectorB=Y)  # -> reverse(Angle), Reflex
deg = Degrees(Radians=angle.Angle)  # -> expr("Round(x)", Degrees)
ln = Line(StartPoint=end.Start, EndPoint=end.End)
item_8 = ListItem(List=expression, Index=0, Wrap=True)
dispatch_4 = Dispatch(List=deg, DispatchPattern=[True, False])  # -> DeadriseTransom, Deadrise25Aft
midpt = CurveMiddle(Curve=ln)
pdecon_3 = Deconstruct(Point=dispatch_3.ListB)  # -> XComponent, YComponent, ZComponent
null_2 = NullItem(Item=dispatch_4.DeadriseTransom)  # -> NullFlags, InvalidFlags, Description
null_3 = NullItem(Item=dispatch_4.Deadrise25Aft)  # -> NullFlags, InvalidFlags, Description
pt = ConstructPoint(XCoordinate=pdecon_3.XComponent, YCoordinate=0, ZCoordinate=0)

# ---- group: SAC
number_slider = Slider(4, range=1..5, expression="x*10")
expression_2 = Expression(L=item_8, C=number_slider, Expression="Floor(L/C)")
pdecon_4 = Deconstruct(Point=dispatch_3.ListA)  # -> XComponent, YComponent, ZComponent
contour_2 = Contour(Shape=item_4, Point=dispatch_3.ListA, Direction=Vector(1, 0, 0), Distance=expression_2)  # -> flatten(Contours)
area_3 = Area(Geometry=contour_2)  # -> flatten(Area), Centroid
series = Series(Start=pdecon_4.XComponent, Step=expression_2, Count=expr("x-3", number_slider))
lng_2 = ListLength(List=contour_2)
pt_2 = ConstructPoint(XCoordinate=series, YCoordinate=expr("x/100", flatten([Slider(0, range=0..100), area_3.Area])), ZCoordinate=0)
sort_3 = SortList(Keys=area_3.Area)  # -> Keys, ValuesA
split = SplitList(List=pt_2, Index=expr("x+1", lng_2))  # -> ListA, ListB
item_9 = ListItem(List=reverse(sort_3.Keys), Index=0, Wrap=True)
entwine = Entwine(Branch01=split.ListA, Branch02=pt, FlattenInputs=True)  # -> flatten(SACPts)
amax = Number(expr("Round(x/1e6,3)", item_9))
intcrv = Interpolate(Vertices=entwine, Degree=1, Periodic=False, KnotStyle=1)  # -> flatten(Curve), Length, Domain

# ----
p_n_c = PickNChoose(Pattern=null_2.NullFlags, Stream0=dispatch_4.DeadriseTransom, Stream1="N/A")
p_n_c_2 = PickNChoose(Pattern=null_3.NullFlags, Stream0=dispatch_4.Deadrise25Aft, Stream1="N/A")
expression_3 = Expression(A=dispatch_4.DeadriseTransom, Expression="Format(\"Deadrise @ transom: {0}º\", A)")
expression_4 = Expression(A=dispatch_4.Deadrise25Aft, Expression="Format(\"Deadrise @ 25% aft: {0}º\", A)")
merge = Merge(Data1=expression_3, Data2=expression_4)
as_text = AnnotationTextSettings(TextSettings=ts)  # -> TextSettings, Font, TextHeight
entry_angle = EntryAngle(B=combine.Result)  # -> loc, entry_angle, A, wl
bbox = BoundingBox(Content=hulls_2, Plane=PlaneXY(0, 0, 0))  # -> Box, Box_2
as_text_2 = AnnotationTextSettings(Font=as_text.Font, TextHeight=expr("x*2", as_text.TextHeight), ViewOriented=False)
debox_2 = DeconstructBox(Box=bbox.Box)  # -> Plane, X, Y, Z
item_10 = ListItem(List=flatten(entry_angle.entry_angle), Index=0, Wrap=True)
pl_origin = PlaneOrigin(Base=[PlaneXY(0, 0, 0), PlaneYZ(0, 0, 0), Plane(origin=(0, 0, 0), x=(0, 0, 1), y=(1, 0, 0))], Origin=entry_angle.loc)
dedomain_2 = DeconstructDomain(Domain=debox_2.X)  # -> Start, End
dedomain_3 = DeconstructDomain(Domain=debox_2.Y)  # -> Start, End
dedomain_4 = DeconstructDomain(Domain=debox_2.Z)  # -> Start, End
panel = Panel("Centre of Bouyancy @ Datum")
expression_5 = Expression(x=dedomain_2.Start, y=dedomain_2.End, Expression="Round((y-x)/1e3,3)")
expression_6 = Expression(x=dedomain_3.Start, y=dedomain_3.End, Expression="Round((y-x)/1e3,3)")
expression_7 = Expression(x=dedomain_4.Start, y=dedomain_4.End, Expression="Round((y-x)/1e3,3)")
text_entity = TextEntity(Plane=graft(pl_origin), Text=entry_angle.entry_angle, TextSettings=ts)  # -> flatten(TextEntity)
layers = QueryModelLayers(Name="M-anno", AutoUpdateState=True)
layers_2 = QueryModelLayers(Name="H-cond-00", AutoUpdateState=True)
text_entity_2 = TextEntity(Plane=midpt, Text=merge, TextSettings=ts)  # -> TextEntity, Plane, Text, TextSettings
panel_2 = Panel("""LcB
VcB
WPA
LcF
WSA
Amax
DeadriseQ
DeadriseT""")
object_2 = ModelObject(Geometry=text_entity, Name="Entry Angle", Layer=layers)
object_3 = ModelObject(Geometry=intcrv.Curve, Name="SA curve", Layer=layers_2)
object_4 = ModelObject(Geometry=contour_2, Name="Wet secs", Layer=layers_2)
object_5 = ModelObject(Geometry=[text_entity_2.TextEntity, ln], Name="Deadrise Angle", Layer=layers)
panel_3 = Panel("""Volume
CoB
LWL
WPA
LcF
WSA
Amax""")
panel_4 = Panel("""/LOA
/BOA
/D""")
panel_5 = Panel("""/Vol
/LcB%
/LwL
/EntryA
/Displ""")
entwine_2 = Entwine(Branch00=expression_5, Branch01=expression_6, Branch02=expression_7, FlattenInputs=True)
nullrep = ReplaceNulls(Items=entwine_2, Replacements="N/A")  # -> Items, Count
concat = Concatenate(FragmentA="/", FragmentB=panel_2)
txt = Text(nullrep.Items)
merge_2 = Merge(Data1=graft(panel_4), Data2=txt)  # -> simplify(Result)
sac_o = Object(object_3)
A = Area(area_3.Area)
entry_a_o = Object([object_2, object_5])
sections_o = Object(object_4)

# ---- group: Principal Characteristics
wpa = Surface(clscrv_2.Closed)
area_4 = Area(Geometry=wpa)  # -> expr("Round(x/1e6,2)", Area), Centroid
area_5 = Area(Geometry=combine_2.Result)  # -> expr("Round(x/1e6,1)", Area), Centroid
item_11 = ListItem(List=flatten(area_4.Centroid), Index=0, Wrap=True)
pdecon_5 = Deconstruct(Point=item_11)  # -> expr("x/1e3", XComponent), YComponent, ZComponent
item_12 = ListItem(List=flatten(pdecon_5.XComponent), Index=0, Wrap=True)
volume = Volume(Geometry=combine_2.Result)  # -> expr("x/1e9", VolM3), Centroid
lwl_m = Number(expr("Round(x/1e3,2)", item_8))

# ----
ma = MassAddition(Input=flatten(area_4.Area))  # -> Result, PartialResults
ma_2 = MassAddition(Input=flatten(area_5.Area))  # -> Result, PartialResults

# ---- group: LcB
x_tremez = Extremes(Curve=item_7, Plane=PlaneYZ(0, 0, 0))  # -> Highest, Lowest
pdecon_6 = Deconstruct(Point=x_tremez.Lowest)  # -> XComponent, YComponent, ZComponent
pdecon_7 = Deconstruct(Point=x_tremez.Highest)  # -> XComponent, YComponent, ZComponent
min = Minimum(A=pdecon_6.XComponent, B=pdecon_7.XComponent)
item_13 = ListItem(List=flatten(volume.Centroid), Index=0, Wrap=True)
ma_3 = MassAddition(Input=flatten(volume.VolM3))  # -> Result, PartialResults
pdecon_8 = Deconstruct(Point=item_13)  # -> XComponent, YComponent, expr("Round(x/1e3,3)", ZComponent)
expression_8 = Expression(x=pdecon_8.XComponent, y=min, Expression="Round((x-y)/1e3,2)")
item_14 = ListItem(List=flatten(pdecon_8.ZComponent), Index=0, Wrap=True)
expression_9 = Expression(x=expression_8, y=lwl_m, Expression="x/y*100")

# ---- group: Principal Characteristics (continued)
subtraction = Subtraction(A=ma_2.Result, B=ma.Result)
cob = Point(item_13)

# ----
panel_6 = Panel(subtraction)
expression_10 = Expression(V=ma_3.Result, D=density_2, Expression="Round(V*D,1)")
concat_2 = Concatenate(Vol="Vol ", B=ma_3.Result, m3="m3 / LcB ", A=expression_9, aft="% aft / LwL ", C=lwl_m, m_up="m >")
pl_origin_2 = PlaneOrigin(Base=[PlaneXY(0, 0, 0), PlaneYZ(0, 0, 0), Plane(origin=(0, 0, 0), x=(0, 0, 1), y=(1, 0, 0))], Origin=graft(cob))

# ---- group: Upgraded : Text Dot
annotation_dot = AnnotationDot(Location=cob, PrimaryText="^", TextHeight=as_text.TextHeight)

# ----
text_entity_3 = TextEntity(Plane=pl_origin_2, Text=concat_2, TextSettings=as_text_2)
concat_3 = Concatenate(FragmentA="Displ", FragmentB=expression_10, FragmentC="kg", JoinSeparator=" ")
concat_4 = Concatenate(FragmentA="Lwl ", FragmentB=lwl_m, FragmentC="m")
concat_5 = Concatenate(FragmentA="LCB ", FragmentB=expression_9, FragmentC="%")
concat_6 = Concatenate(FragmentA="Vol ", FragmentB=ma_3.Result, FragmentC="m3")
object_6 = ModelObject(Geometry=flatten([text_entity_3, annotation_dot]), Name=panel, Layer=layers)
entwine_3 = Entwine(Branch00=concat_6, Branch01=concat_5, Branch02=concat_4, Branch03=item_10, Branch04=concat_3, FlattenInputs=True)
entwine_4 = Entwine(
    Branch00=expression_8,
    Branch01=pdecon_8.ZComponent,
    Branch02=ma.Result,
    Branch03=pdecon_5.XComponent,
    Branch04=subtraction,
    Branch05=amax,
    Branch06=p_n_c_2,
    Branch07=p_n_c,
    FlattenInputs=True)
object_7 = ModelObject(Geometry=cob, Name=panel, Layer=layers_2)
entwine_5 = Entwine(
    Branch00=ma_3.Result,
    Branch01=cob,
    Branch02=lwl_m,
    Branch03=ma.Result,
    Branch04=item_11,
    Branch05=subtraction,
    Branch06=amax,
    FlattenInputs=True)
entwine_6 = Entwine(
    Branch00=ma_3.Result,
    Branch01=expression_9,
    Branch02=lwl_m,
    Branch03=entry_angle.A,
    Branch04=expression_10,
    FlattenInputs=True)
item_15 = ListItem(List=entwine_5, Index=0, Wrap=True)
concat_7 = Concatenate(FragmentA=graft(panel_2), FragmentB=entwine_4, JoinSeparator=" ")
u_text = UserText(Content=object_7, Keys=panel_3, Values=flatten(entwine_5), UserTextMode=1)  # -> CentreO, Keys, Values
item_16 = ListItem(List=entwine_6, Index=0, Wrap=entwine_6)
nullrep_2 = ReplaceNulls(Items=entwine_6, Replacements="N/A")  # -> Items, Count
nullrep_3 = ReplaceNulls(Items=entwine_4, Replacements="N/A")  # -> Items, Count
txt_2 = Text(nullrep_2.Items)
txt_3 = Text(nullrep_3.Items)
merge_3 = Merge(Data1=graft(panel_5), Data2=txt_2)  # -> simplify(Result)
merge_4 = Merge(Data1=graft(concat), Data2=txt_3)  # -> simplify(Result)
entwine_7 = Entwine(Branch0X=merge_2, Branch1X=merge_3, Branch2X=merge_4, FlattenInputs=False)
osc = Result(entwine_7)
basic_stats = Result(entwine_3)
stats = Result(concat_7)
title_o = Object(object_6)
centre_o = Content(u_text.CentreO)
panel_7 = Panel(entwine_3)
panel_8 = Panel(concat_7)
panel_9 = Panel(entwine_7)

# ==== cluster EntryAngle
B = ClusterInput()
X = UnitX(Factor=1)

# ---- group: Entry angle
sec = BrepPlane(Brep=B, Plane=PlaneXY(0, 0, 0))  # -> reparameterize(Curves), Points
curvepoint = PointOnCurve(sec.Curves, parameter=0.152)

# ----
pcx = CurvePlane(Curve=sec.Curves, Plane=Plane(origin=(0, 0, 0), x=(0, 0, 1), y=(1, 0, 0)))  # -> flatten(Points), ParamsC, ParamsP
pdecon = Deconstruct(Point=pcx.Points)  # -> XComponent, YComponent, ZComponent
sort = SortList(Keys=pdecon.XComponent, ValuesA=pcx.Points)  # -> Keys, ValuesA
item = ListItem(List=sort.ValuesA, Index=0, Wrap=True)

# ---- group: Entry angle (continued)
ln = Line(StartPoint=item, EndPoint=curvepoint)
angle = Angle(VectorA=X, VectorB=ln, Plane=PlaneXY(0, 0, 0))  # -> Angle, Reflex
midpt = CurveMiddle(Curve=ln)
dispatch = Dispatch(List=midpt, DispatchPattern=[True, False])  # -> ListA, ListB

# ----
sort_2 = SortList(Keys=[angle.Angle, angle.Reflex], ValuesA=[angle.Angle, angle.Reflex])  # -> Keys, ValuesA
item_2 = ListItem(List=sort_2.ValuesA, Index=0, Wrap=True)

# ---- group: Entry angle (continued)
deg = Degrees(Radians=item_2)  # -> expr("Round(x,1)", Degrees)
expression = Expression(T="entry angle", A=deg, Expression="Format(\"{1}º {0}\", T, A)")

# ----
loc = ClusterOutput(dispatch.ListA)
entry_angle = ClusterOutput(expression)
wl = ClusterOutput([sec.Curves, ln])
A = ClusterOutput(deg)

# ==== cluster BoundingBox: Generate bounding box around vessel

# ---- group: G
vessel = ClusterInput()

# ----
bbox = BoundingBox(Content=vessel, Plane=PlaneXY(0, 0, 0))  # -> Box, Box_2
scale = Scale(Geometry=bbox.Box, Center=Point(0, 0, 0), Factor=1.1)  # -> Geometry, Transform
movetoplane = MoveToPlane(Geometry=scale.Geometry, Plane=PlaneXY(0, 0, 0), Above=True, Below=True)  # -> Geometry, Transform
mirror = Mirror(Geometry=movetoplane.Geometry, Plane=PlaneXY(0, 0, 0))  # -> Geometry, Transform
G = ClusterOutput(mirror.Geometry)
