# Grasshopper definition cambered_deck_srf.gh (Grasshopper 1.0.8)
# Copyright: © SYD 2022

relay = Relay()
relay_2 = Relay()
relay_3 = Relay()
camber = B()
number_slider = Slider(35, range=0..100)
ext = ExtendCurve(Curve=relay_2, Type=2, Start=expr("-x", number_slider), End=0)
ext_2 = ExtendCurve(Curve=relay_3, Type=2, Start=expr("-x", number_slider), End=0)
number_slider_2 = Slider(113, range=0..1000)
tweencrv = TweenCurve(CurveA=relay_2, CurveB=relay_3, Factor=0.5, BlendType=0)
divdist = DivideDistance(Curve=tweencrv, Distance=number_slider_2)  # -> Points, Tangents, Parameters
divdist_2 = DivideDistance(Curve=[ext_2, ext], Distance=number_slider_2)  # -> Points, Tangents, Parameters
cull_i = CullIndex(List=divdist_2.Points, Indices="-1", Wrap=True)
flip = FlipMatrix(Data=divdist.Points)
flip_2 = FlipMatrix(Data=cull_i)
dispatch = Dispatch(List=flip_2, DispatchPattern=[True, False])  # -> ListA, ListB
dist = Distance(PointA=dispatch.ListA, PointB=dispatch.ListB)
cull_i_2 = CullIndex(List=flatten(dist), Indices="0", Wrap=True)
item = ListItem(List=flatten(dist), Index="0", Wrap=True)
multiplication = Multiplication(A=cull_i_2, Camber=camber)
multiplication_2 = Multiplication(A=item, B=camber, C=Slider(0.7, range=0..1))
Z = UnitZ(Factor=flatten([multiplication_2, multiplication]))  # -> graft(UnitVector)
move = Move(Geometry=flip, Motion=Z)  # -> Geometry, Transform
arc = Arc3Pt(SheerPt=dispatch.ListA, PointB=move.Geometry, SheerPt_2=dispatch.ListB)  # -> CamberCrv, Plane, Radius
midpt = CurveMiddle(Curve=relay)
merge = Merge(Data1=midpt, Data2=move.Geometry)  # -> flatten(Result)
merge_2 = Merge(Data1=relay, Data2=arc.CamberCrv)
intcrv = Interpolate(Vertices=merge, Degree=3, Periodic=False, KnotStyle=1)  # -> Curve, Length, Domain
merge_3 = Merge(Data1=relay_2, Data2=intcrv.Curve, Data3=relay_3)
netsurf = NetworkSurface(CurvesU=merge_3, CurvesV=flatten(merge_2), Continuity=2)
S = Surface(netsurf)
