# Grasshopper definition category_weight_summary.gh (Grasshopper 1.0.8)
# Copyright: © 2023 SYD all rights reserved

cond = FragmentB()
path = FragmentA()
E = Export()
centre_o = Object()
cat = Name()
object = ModelObject(CentreO=centre_o)  # -> Object, graft(Name)
u_text = UserText(Content=object.Object, Keys="Weight", UserTextMode=1)  # -> Content, Values
u_text_2 = UserText(Content=object.Object, Keys="COG", UserTextMode=1)  # -> Content, Values
concat = Concatenate(FragmentA="H-cond-0", FragmentB=cond)
clean = CleanTree(RemoveNulls=True, RemoveInvalid=True, RemoveEmpty=True, Tree=u_text.Values)
weight_kgs = Number(expr("Round(x,1)", u_text.Values))
pt = Point(u_text_2.Values)
num = Number(clean)
lng = ListLength(List=concat)
ma = MassAddition(Input=flatten(num))  # -> WKgs, PartialResults
wav = WeightedAverage(Input=flatten(pt), Weights=flatten(weight_kgs))
dup = DuplicateData(Data=wav, Number=lng, Order=True)
layers = QueryModelLayers(Name=concat, AutoUpdateState=True)  # -> flatten(Layers)
expression = Expression(x=ma.WKgs, y=lng, Expression="Round(x/y,2)")
name = Text(object.Name)
weight = Text(weight_kgs)
object_2 = ModelObject(Object=dup, Name=cat, Layer=layers)  # -> SummaryO, Geometry
u_text_3 = UserText(Content=object_2.SummaryO, Keys="Weight", Values=simplify(expression), UserTextMode=1)  # -> Content, simplify(Values)
dup_2 = DuplicateData(Data=expression, Number=lng, Order=True)  # -> simplify(graft(Data))

# ---- group: Write to file system
object_3 = ModelObject(Object=u_text_3.Content)  # -> simplify(graft(Object)), graft(Name), Layer
concat_2 = Concatenate(Path=path, File=object_3.Name, _3dm=".3dm")  # -> simplify(graft(Result))
block_definition = ModelBlockDefinition(Objects=object_3.Object, Name=object_3.Name)  # -> simplify(graft(BlockDefinition))
export_definition = ExportModelBlockDefinition(BlockDefinition=block_definition, FilePath=concat_2, Overwrite=True, Export=E)
panel = Panel(object_3.Layer)
block_definition_2 = ModelBlockDefinition(BlockDefinition=block_definition)  # -> BlockDefinition, Objects
panel_2 = Panel(block_definition_2.Objects)
panel_3 = Panel(concat_2)
panel_4 = Panel(export_definition)
u_text_4 = UserText(Content=block_definition_2.Objects, UserTextMode=1)  # -> Content, Values
panel_5 = Panel(u_text_4.Content)
panel_6 = Panel(u_text_4.Values)

# ----
panel_7 = Panel(u_text_3.Values)
concat_3 = Concatenate(FragmentA=cat, FragmentB=dup_2, FragmentC="kgs", JoinSeparator=" ")  # -> flatten(Summary)
concat_4 = Concatenate(FragmentA=name, FragmentB=weight, FragmentC="kgs", JoinSeparator=" ")  # -> flatten(Result)
summary = Result(concat_3)
wt_c = Content(u_text_3.Content)
items = Result(concat_4)
w_kgs = Result(ma.WKgs)
