# Grasshopper definition centre_points_for_weight_categories.gh (Grasshopper 1.0.8)
# Copyright: © 2023 SYD all rights reserved

pchars = Data()
sub_categories = Text()
centre_pln = Plane()
L = List()
bang = ExplodeTree(PChars=pchars)  # -> Branch0, Branch1, Branch2
centre_pln_2 = Plane(centre_pln)
item = ListItem(List=flatten(L), Index=0, Wrap=True)  # -> Item, Item1
pdecon = Deconstruct(Point=centre_pln_2)  # -> XComponent, YComponent, ZComponent
sub_categories_2 = Text(sub_categories)
expression = Expression(x=bang.Branch0, y=pdecon.YComponent, z=bang.Branch2, Expression="{Round(x*0.4*1e3),y,Round(-z*4*1e3)}")
lng = ListLength(List=sub_categories_2)
panel = Panel("{40,-125,0}")
pl_origin = PlaneOrigin(Base=Plane(origin=(0, 0, 0), x=(0, 0, 1), y=(1, 0, 0)), Origin=expression)
series = Series(Start=1, Step=1, Count=expr("x-1", lng))
sqgrid = Square(Plane=pl_origin, Size=1000, ExtentX=1, ExtentY=4)  # -> Cells, simplify(Points)
concat = Concatenate(FragmentA="00", FragmentA_2=series, FragmentC="-", FragmentB=sub_categories_2)
panel_2 = Panel(sqgrid.Points)

# ---- group: New layer
layers = QueryModelLayers(Name="G-anno", AutoUpdateState=True)

# ----
layers_2 = QueryModelLayers(Name="H-cond-00", AutoUpdateState=True)
object = ModelObject(Geometry=flatten(sqgrid.Points), Name=concat, Layer=layers_2)  # -> simplify(OriginPtsO)
object_2 = ModelObject(CntrlPtO=object)  # -> Object, Geometry, Name
as_text = AnnotationTextSettings(TextSettings=item.Item1)  # -> TextSettings, Font, TextHeight
panel_3 = Panel(as_text.Font)
panel_4 = Panel(as_text.TextHeight)
pl_origin_2 = PlaneOrigin(Base=[PlaneXZ(0, 0, 0), PlaneXY(0, 0, 0), PlaneYZ(0, 0, 0)], Origin=graft(object_2.Geometry))
text_entity = TextEntity(Plane=pl_origin_2, Text=graft(object_2.Name), TextSettings=item.Item)
annotation_dot = AnnotationDot(Location=object_2.Geometry, PrimaryText="+", TextHeight=as_text.TextHeight)
object_3 = ModelObject(Geometry=text_entity, Name=graft("0-Mark Txt"), Layer=layers)
object_4 = ModelObject(Geometry=annotation_dot, Name="0-Mark Ad", Layer=layers)
merge = Merge(Data1=simplify(object_3), Data2=simplify(graft(object_4)))
labels = Result(merge)
origin_pts_o = Object(object)
sub_categories_3 = Text(sub_categories_2)
bang_2 = ExplodeTree()  # -> Branch0, Branch1, Branch2
