# Grasshopper definition chine_hull_correct_stem.gh (Grasshopper 1.0.8)
# Copyright: © SYD 2022
# Copyright: © 2023 SYD all rights reserved

fetch_o = Object()
sinkage = Factor()
forefoot_depth = Number()
project_ame = Text()
clipper_bow = Number()
hollow_bow = Number()
forefoot_factor = Number()
deck_curvature = Number()
ts = TextSettings()
transm_srf = Item()
chine_width = Integer()
stem_factor = Number()
chine_angle = Number()
object = ModelObject(FetchO=fetch_o)  # -> ModPtsO, Geometry, Name
Z = UnitZ(Sinkage=expr("-x", sinkage))
chine_angle_2 = Number(chine_angle)
chine_width_mm = Number(expr("x*10", chine_width))
trim = TextTrim(ProjectAme=project_ame, Start=True, End=True)
chine_angle_3 = Number(chine_angle)
abs = Absolute(Value=chine_angle_2)
clipper_bow_2 = Number(clipper_bow)
hollow_bow_2 = Number(hollow_bow)
forefoot_depth_2 = Number(forefoot_depth)
move = Move(Geometry=object.Geometry, Motion=Z)  # -> SunkPoints, Transform
trig = TriangleTrigonometry(Beta=degrees(90), Gamma=degrees(chine_angle_3), ALength=chine_width)  # -> Alpha, Beta, Gamma, ALength, BLength, CLength
trig_2 = TriangleTrigonometry(Beta=degrees(90), Gamma=degrees(abs), ALength=chine_width_mm)  # -> Alpha, Beta, Gamma, ALength, BLength, CLength
larger = LargerThan(FirstNumber=chine_angle_2, SecondNumber=0)  # -> LargerThan, OrEqualTo
object_2 = ModelObject(Geometry=move.SunkPoints, Name=object.Name)  # -> ModPtsO, Name
dispatch = Dispatch(List=trig_2.CLength, DispatchPattern=larger.LargerThan)  # -> ListA, ListB
neg = Negative(Value=dispatch.ListA)
tmatch = MatchText(Text=object_2.Name, Pattern="*bPt", Case=True)
tmatch_2 = MatchText(Text=object_2.Name, Pattern="*ePt", Case=True)
tmatch_3 = MatchText(Text=object_2.Name, Pattern="*Ht", Case=True)
tmatch_4 = MatchText(Text=object_2.Name, Pattern="*aPt", Case=True)
clean = CleanTree(RemoveNulls=True, RemoveInvalid=True, RemoveEmpty=False, Tree=[dispatch.ListB, neg])
dispatch_2 = Dispatch(List=object_2.ModPtsO, DispatchPattern=tmatch)  # -> ListA, ListB
dispatch_3 = Dispatch(List=object_2.ModPtsO, DispatchPattern=tmatch_2)  # -> ListA, ListB
dispatch_4 = Dispatch(List=object_2.ModPtsO, DispatchPattern=tmatch_3)  # -> ListA, ListB
dispatch_5 = Dispatch(List=object_2.ModPtsO, DispatchPattern=tmatch_4)  # -> ListA, ListB
deck_curvature_2 = Number(deck_curvature)
transom_curvature = Number(deck_curvature)
panel = Panel(dispatch_2.ListA)

# ---- group: Seperate Pts
item = ListItem(List=dispatch_2.ListA, Index=0, Wrap=False)  # -> Item, Item1, Item2, Item3, Item4
item_2 = ListItem(List=dispatch_3.ListA, Index=0, Wrap=True)  # -> Item, Item1, Item2, Item3, Item4, Item5

# ----
item_3 = ListItem(List=dispatch_4.ListA, Index=0, Wrap=True)  # -> Item, Item1
vec2pt = Vector2Pt(PointA=item.Item, PointB=dispatch_5.ListA, Unitize=False)  # -> Vector, Length
pt = Point(item.Item)
devec = DeconstructVector(Vector=vec2pt.Vector)  # -> XComponent, YComponent, ZComponent
line = LineSDL(Start=item_3.Item1, Direction=unitize(Vector(1, 0, 0)), Length=100000)
line_2 = LineSDL(Start=item_3.Item, Direction=unitize(Vector(1, 0, 0)), Length=100000)
chine_height = Integer(trig.CLength)
vec = VectorXYZ(XComponent=devec.XComponent, YComponent=expr("x/2", devec.YComponent), ZComponent=devec.ZComponent)  # -> Vector, Length
chine_height_2 = Integer(clean)
X = UnitX(Factor=clipper_bow_2)
Y = UnitY(Factor=hollow_bow_2)
vec2pt_2 = Vector2Pt(FFootBPt=item.Item2, FFootEPt=item_2.Item3, Unitize=False)  # -> Vector, Length
devec_2 = DeconstructVector(Vector=vec.Vector)  # -> XComponent, YComponent, ZComponent
addition = Addition(A=X, B=Y)
multiplication = Multiplication(A=devec_2.ZComponent, B=forefoot_depth_2)
vec_2 = VectorXYZ(XComponent=devec_2.XComponent, YComponent=expr("x/2", devec_2.YComponent), ZComponent=multiplication)  # -> Vector, Length
eval = Evaluate(F="x/10*y", x=vec_2.Vector, y=forefoot_depth_2)
eval_2 = Evaluate(F="-x/20*y", x=vec2pt_2.Vector, y=forefoot_depth_2)
Z_2 = UnitZ(Factor=0.01)
merge = Merge(Data1=item.Item, Data2=item_2.Item, Data3=item_2.Item5, Data4=item.Item4)
nurbs = NurbsCurve(Vertices=merge, Degree=3, Periodic=False)  # -> SheerCrv, Length, Domain

# ---- group: Display / End points
cluster = Cluster_2(pt=dispatch_4.ListA)

# ---- group: Strboard surface
stbd_srf = StbdSrf(B=transm_srf)

# ----
display = DisplayAttributes(IsocurveDensity=-1)
mod_pts_o = Object(object_2.ModPtsO)

# ---- group: Chine
chine_width_2 = Integer(expr("x*10", chine_width))
loft_opt = LoftOptions(Closed=False, Adjust=True, Rebuild=111, Refit=0, Type=3)
dispatch_6 = Dispatch(List=dispatch_4.ListA, DispatchPattern=[True, False])  # -> ListA, ChineHt
xy = XYPlane(Origin=dispatch_6.ChineHt)

# ---- group: Stem updated to sweep 2-rails
forefoot_factor_2 = Number(expr("x*.7", forefoot_factor))
stem_factor_2 = Number(stem_factor)

# ---- group: Vector lines
ln = Line(StartPoint=item.Item, EndPoint=dispatch_5.ListA)
object_3 = ModelObject(Object=dispatch_2.ListA)  # -> Object, Name
rep = ReplaceText(Text=object_3.Name, Find="bPt", Replace="Vect", RecursiveReplace=False)

# ----
llx = LineLine(Line1=ln, Line2=line)  # -> ParamA, ParamB, PointA, PointB
llx_2 = LineLine(Line1=ln, Line2=line_2)  # -> ParamA, ParamB, PointA, PointB
chine_intersect_pt = Point(llx.PointA)
bilge_intersect_pt = Point(llx_2.PointA)
line_3 = LineSDL(Start=bilge_intersect_pt, Direction=unitize(Vector(1, 0, 0)), Length=100000)
llx_3 = LineLine(Line1=ln, Line2=line_3)  # -> ParamA, ParamB, PointA, PointB
move_2 = Move(Geometry=chine_intersect_pt, Motion=addition)  # -> Geometry, Transform
vdis = VectorDisplay(Anchor=llx_3.PointA, Vector=vec_2.Vector)

# ---- group: Always calulated
object_4 = ModelObject(Geometry=move_2.Geometry, Name="1 Chine Intsct iPt Vect")

# ----
bzspan = BezierSpan(StartPoint=llx_3.PointA, StartTangent=eval, EndPoint=item.Item3, EndTangent=eval_2)  # -> BilgeCrv, Length, Domain
eval_3 = EvaluateCurve(Curve=bzspan.BilgeCrv)  # -> Point, Tangent, Angle
merge_2 = Merge(Data1=object_4, Data2=item_2.Item1, Data3=item_2.Item2, Data4=item.Item1)
merge_3 = Merge(
    Data1=bilge_intersect_pt,
    Data2=bzspan.BilgeCrv,
    Data3=item.Item2,
    Data4=item_2.Item3,
    Data5=item_2.Item4,
    Data6=item.Item3)

# ---- group: Start of vectors
entwine = Entwine(
    Branch00=item.Item,
    Branch01=object_4,
    Branch02=item.Item1,
    Branch03=item.Item2,
    Branch04=item.Item3,
    Branch05=item.Item4,
    FlattenInputs=True)  # -> flatten(Result)

# ----
nurbs_2 = NurbsCurve(Vertices=merge_2, Degree=3, Periodic=False)  # -> ChineCrv, Length, Domain
nurbs_3 = NurbsCurve(Vertices=merge_3, Degree=3, Periodic=False)  # -> BilgeCrv, Length, Domain
panel_2 = Panel(entwine)
entwine_2 = Entwine(Branch00=nurbs.SheerCrv, Branch01=nurbs_2.ChineCrv, Branch02=nurbs_3.BilgeCrv, FlattenInputs=True)  # -> flatten(Result)

# ---- group: Display
layers = QueryModelLayers(Name="G-hull-pts", AutoUpdateState=True)
layers_2 = QueryModelLayers(Name="G-hull-ctrl", AutoUpdateState=True)
panel_3 = Panel("""0 Bilge intersect Ht
1 Chine intersect Ht""")
cluster_2 = Cluster_3(cntrl_pt_o=flatten(dispatch_2.ListA), ts=ts)  # -> te, N, ad
cluster_3 = Cluster_3(cntrl_pt_o=[dispatch_3.ListA, object_4], ts=ts)  # -> te, N, ad
cluster_4 = Cluster_3(cntrl_pt_o=dispatch_5.ListA, ts=ts)  # -> te, N, ad
display_2 = DisplayAttributes(DisplayColour=ColourSwatch(SwatchColor=RGB(181, 159, 207)))
display_3 = DisplayAttributes(DisplayColour=ColourSwatch(SwatchColor=RGB(157, 176, 209)))
display_4 = DisplayAttributes(DisplayColour=ColourSwatch(SwatchColor=RGB(192, 145, 204)))
display_5 = DisplayAttributes(DisplayColour=ColourSwatch(SwatchColor=RGB(123, 182, 186)))
display_6 = DisplayAttributes(DisplayColour=ColourSwatch(SwatchColor=RGB(214, 156, 156)))
object_5 = ModelObject(Geometry=cluster, Name=panel_3, Display=display_5)
object_6 = ModelObject(Geometry=ln, Name="Bow Angle V", Layer=layers_2, Display=display_2)
object_7 = ModelObject(Geometry=cluster_2.te, Name=cluster_2.N, Layer=layers, Display=display_3)
object_8 = ModelObject(Geometry=cluster_2.ad, Name=cluster_2.N, Layer=layers, Display=display_3)
object_9 = ModelObject(Geometry=cluster_3.te, Name=cluster_3.N, Layer=layers, Display=display_6)
object_10 = ModelObject(Geometry=cluster_3.ad, Name=cluster_3.N, Layer=layers, Display=display_6)
object_11 = ModelObject(Geometry=cluster_4.te, Name=cluster_4.N, Layer=layers, Display=display_4)
object_12 = ModelObject(Geometry=cluster_4.ad, Name=cluster_4.N, Layer=layers, Display=display_4)

# ---- group: Loft curves
midpt = CurveMiddle(Curve=entwine_2)
pl_origin = PlaneOrigin(Base=[PlaneXZ(0, 0, 0), PlaneXY(0, 0, 0), PlaneYZ(0, 0, 0)], Origin=graft(midpt))
panel_4 = Panel("""Sheer Crv
Chine Crv
Bilge Crv""")
text_entity = TextEntity(Plane=pl_origin, Text=graft(panel_4), TextSettings=ts)
display_7 = DisplayAttributes(DisplayColour=[ColourSwatch(SwatchColor=RGB(153, 201, 166)), ColourSwatch(SwatchColor=RGB(207, 201, 143)), ColourSwatch(SwatchColor=RGB(214, 160, 118))])  # -> Display, DisplayColour, DisplayMode
object_13 = ModelObject(Geometry=text_entity, Name=panel_4, Layer=layers_2, Display=display_7.Display)
object_14 = ModelObject(Geometry=entwine_2, Name=panel_4, Layer=layers_2, Display=display_7.Display)

# ----
object_15 = ModelObject(LoftingO=object_14)
object_16 = ModelObject(Object=object_15)  # -> Object, Name
mirror = Mirror(Geometry=object_15, Plane=Plane(origin=(0, 0, 0), x=(0, 0, 1), y=(1, 0, 0)))  # -> Geometry, Transform
concat = Concatenate(FragmentA=object_16.Name, FragmentB=" p")
object_17 = ModelObject(Object=object_16.Object, Geometry=mirror.Geometry, Name=concat)
item_4 = ListItem(List=flatten(object_15), Index=0, Wrap=True)  # -> Item, Item1, Item2
item_5 = ListItem(List=flatten(object_17), Index=0, Wrap=True)  # -> Item, Item1, Item2
object_18 = ModelObject(item_5.Item)
object_19 = ModelObject(item_5.Item1)
object_20 = ModelObject(item_5.Item2)
object_21 = ModelObject(item_4.Item)
object_22 = ModelObject(item_4.Item1)
object_23 = ModelObject(item_4.Item2)

# ---- group: Chine / Max width
midpt_2 = CurveMiddle(Curve=object_21)
pdecon = Deconstruct(Point=midpt_2)  # -> XComponent, YComponent, ZComponent
pt_2 = ConstructPoint(XCoordinate=pdecon.XComponent, YCoordinate=-5000000, ZCoordinate=0)
crv_cp = CurveClosestPoint(Point=pt_2, Curve=object_21)  # -> Point, Parameter, Distance
pdecon_2 = Deconstruct(Point=crv_cp.Point)  # -> XComponent, expr("ABS(x)*2", YComponent), ZComponent

# ----
end = EndPoints(Curve=object_22)  # -> Start, End

# ---- group: Aft end of sheerline
end_2 = EndPoints(Curve=object_21)  # -> Start, End
pdecon_3 = Deconstruct(Point=[end_2.Start, end_2.End])  # -> XComponent, YComponent, ZComponent
abs_2 = Absolute(Value=pdecon_3.XComponent)
sort = SortList(Keys=abs_2, ValuesA=[end_2.Start, end_2.End])  # -> Keys, ValuesA
dispatch_7 = Dispatch(List=sort.ValuesA, DispatchPattern=[True, False])  # -> ListA, ListB

# ----
pdecon_4 = Deconstruct(Point=end.Start)  # -> XComponent, YComponent, ZComponent
pdecon_5 = Deconstruct(Point=end.End)  # -> XComponent, YComponent, ZComponent
subtraction = Subtraction(A=pdecon_4.ZComponent, B=pdecon_5.ZComponent)
expression = Expression(d=subtraction, Ch=chine_height_2, Expression="(d-Ch)/d")

# ---- group: Chine (continued)
expression_2 = Expression(BOA=pdecon_2.YComponent, Cw=chine_width_2, Expression="(BOA-Cw*2)/BOA")
expression_3 = Expression(BOA=pdecon_2.YComponent, Ch=chine_height, Expression="(BOA-Ch*2)/BOA")  # disabled
hull = Loft(Curves=[object_18, object_19], Options=loft_opt)
scale_nu = ScaleNU(Geometry=object_19, Plane=PlaneXY(0, 0, 0), ScaleX=1, ScaleY=expression_2, ScaleZ=1)  # -> ChineInner, Transform
scale_nu_2 = ScaleNU(Geometry=scale_nu.ChineInner, Plane=xy, ScaleX=1, ScaleY=1, ScaleZ=expression)  # -> ChineInner, Transform
mirror_2 = Mirror(Geometry=scale_nu_2.ChineInner, Plane=PlaneXZ(0, 0, 0))  # -> ChineInner, Transform
entwine_3 = Entwine(Branch00=scale_nu_2.ChineInner, Branch01=object_20, Branch02=object_23, Branch03=mirror_2.ChineInner, FlattenInputs=True)
hull_2 = Loft(
    Curves=flatten(entwine_3),
    Options={Adjust=True, Closed=False, LoftEnds=0, LoftSimp=0, LoftType=1, Rebuild=10, Refit=0.01})
stbd_srf_2 = StbdSrf(B=hull_2)
loft = Loft(
    Curves=flatten([object_19, scale_nu_2.ChineInner]),
    Options={Adjust=False, Closed=False, LoftEnds=0, LoftSimp=0, LoftType=0, Rebuild=10, Refit=0.01})

# ---- group: Transom mid Pt
addition_2 = Addition(A=deck_curvature_2, B=1)
pdecon_6 = Deconstruct(Point=dispatch_7.ListB)  # -> XComponent, YComponent, ZComponent
multiplication_2 = Multiplication(A=transom_curvature, B=pdecon_6.ZComponent)
multiplication_3 = Multiplication(A=addition_2, B=multiplication_2)
addition_3 = Addition(A=pdecon_6.XComponent, B=multiplication_3)
addition_4 = Addition(A=pdecon_6.ZComponent, B=multiplication_2)
mirror_3 = Mirror(TransomPt=dispatch_7.ListB, Plane=PlaneXZ(0, 0, 0))  # -> Geometry, Transform
pt_3 = ConstructPoint(XCoordinate=addition_3, YCoordinate=0, ZCoordinate=addition_4)

# ----
debrep = DeconstructBrep(Brep=hull)  # -> Faces, Edges, Vertices

# ---- group: Aft end of sheerline
midpt_3 = CurveMiddle(Curve=debrep.Edges)
pdecon_7 = Deconstruct(Point=midpt_3)  # -> XComponent, YComponent, ZComponent
abs_3 = Absolute(Value=pdecon_7.XComponent)
sort_2 = SortList(Keys=abs_3, ValuesA=debrep.Edges)  # -> Keys, ValuesA

# ----
sec = BrepPlane(Brep=hull_2, Plane=Plane(origin=(0, 0, 0), x=(0, 0, 1), y=(1, 0, 0)))  # -> Curves, Points
crv = Curve(object_22)
crv_2 = Curve(object_19)

# ---- group: Topside edge @ bow
item_6 = ListItem(List=sort_2.ValuesA, Index=0, Wrap=True)

# ----
end_3 = EndPoints(Curve=sec.Curves)  # -> Start, End
move_3 = Move(Geometry=end_3.Start, Motion=Z_2)  # -> Geometry, Transform
pt_4 = Point(end_3.Start)
stbd_hull_srf = Surface(stbd_srf_2)
contour = Contour(Shape=stbd_hull_srf, Point=move_3.Geometry, Direction=Vector(0, 0, 1), Distance=Slider(48, range=0..100))  # -> simplify(Contours)
end_4 = EndPoints(Curve=contour)  # -> Start, End
pt_5 = Point(end_4.End)

# ---- group: V Crvs
debrep_2 = DeconstructBrep(Brep=stbd_hull_srf)  # -> Faces, Edges, Vertices
midpt_4 = CurveMiddle(Curve=debrep_2.Edges)
pdecon_8 = Deconstruct(Point=midpt_4)  # -> XComponent, YComponent, ZComponent
sort_3 = SortList(Keys=pdecon_8.XComponent, ValuesA=debrep_2.Edges)  # -> Keys, ValuesA
item_7 = ListItem(List=sort_3.ValuesA, Index=0, Wrap=True)
mirror_4 = Mirror(Geometry=item_7, Plane=Plane(origin=(0, 0, 0), x=(0, 0, 1), y=(1, 0, 0)))  # -> Geometry, Transform

# ----
pdecon_9 = Deconstruct(Point=flatten(end_4.Start))  # -> XComponent, YComponent, ZComponent
panel_5 = Panel(pdecon_9.YComponent)
larger_2 = LargerThan(FirstNumber=pdecon_9.YComponent, SecondNumber=0.0001)  # -> LargerThan, OrEqualTo
panel_6 = Panel(larger_2.LargerThan)
dispatch_8 = Dispatch(List=flatten(contour), DispatchPattern=larger_2.LargerThan)  # -> ListA, ListB
panel_7 = Panel(dispatch_8.ListA)
crv_3 = Curve(flatten(dispatch_8.ListB))
crv_4 = Curve(dispatch_8.ListA)

# ---- group: Align with forefoot
cl_hull_crv = Curve(sec.Curves)
item_8 = ListItem(List=crv_4, Index=0, Wrap=True)
end_5 = EndPoints(Curve=item_8)  # -> Start, End
end_6 = EndPoints(Curve=cl_hull_crv)  # -> Start, End
flip = FlipCurve(Curve=cl_hull_crv)  # -> Curve, Flag
mirror_5 = Mirror(Geometry=end_5.Start, Plane=Plane(origin=(0, 0, 0), x=(0, 0, 1), y=(1, 0, 0)))  # -> Geometry, Transform
eval_4 = EvaluateCurve(Curve=reparameterize(item_8), Parameter=0.999)  # -> Point, Tangent, Angle
eval_5 = EvaluateCurve(Curve=reparameterize(cl_hull_crv), Parameter=0.001)  # -> Point, Tangent, Angle
vec2pt_3 = Vector2Pt(PointA=eval_4.Point, PointB=end_5.Start, Unitize=True)  # -> Vector, Length
vec2pt_4 = Vector2Pt(PointA=eval_5.Point, PointB=end_6.Start, Unitize=True)  # -> Vector, Length
mirror_6 = Mirror(Geometry=vec2pt_3.Vector, Plane=Plane(origin=(0, 0, 0), x=(0, 0, 1), y=(1, 0, 0)))  # -> Geometry, Transform
multiplication_4 = Multiplication(A=vec2pt_4.Vector, _01=Slider(0.5, range=0..1))
multiplication_5 = Multiplication(A=vec2pt_3.Vector, _01=0.1)
multiplication_6 = Multiplication(A=mirror_6.Geometry, _01=0.1)
addition_5 = Addition(A=multiplication_5, B=multiplication_4)
addition_6 = Addition(A=multiplication_6, B=multiplication_4)
bzspan_2 = BezierSpan(StartPoint=end_5.Start, StartTangent=addition_5, EndPoint=mirror_5.Geometry, EndTangent=addition_6)  # -> StemRootCrv, Length, Domain

# ----
cull_i = CullIndex(List=crv_4, Indices=0, Wrap=True)

stem_deck_crv = StemDeckCrv(f=stem_factor_2, crv_1=crv)
stem_deck_crv_2 = StemDeckCrv(f=stem_factor_2, crv_1=scale_nu_2.ChineInner)
stem_deck_crv_3 = StemDeckCrv(f=stem_factor_2, crv_1=cull_i)

flip_2 = FlipCurve(Curve=stem_deck_crv_2)  # -> Curve, Flag

# ---- group: Vector lines (continued)
ln_2 = Line(StartPoint=entwine, EndPoint=dispatch_3.ListA)
object_24 = ModelObject(Geometry=ln_2, Name=rep, Layer=layers_2, Display=display_2)

# ----
pt_6 = Point(end_6.Start)
midpt_5 = CurveMiddle(Curve=stem_deck_crv)
vdis_2 = VectorDisplay(Anchor=end_5.Start, Vector=addition_5)
vdis_3 = VectorDisplay(Anchor=mirror_5.Geometry, Vector=addition_6)
vdis_4 = VectorDisplay(Anchor=end_6.Start, Vector=multiplication_4)
crv_5 = Curve(bzspan_2.StemRootCrv)
midpt_6 = CurveMiddle(Curve=[stem_deck_crv_2, stem_deck_crv_3, crv_5])
pdecon_10 = Deconstruct(Point=midpt_6)  # -> XComponent, YComponent, ZComponent
sort_4 = SortList(Keys=flatten(pdecon_10.ZComponent), ValuesA=flatten([stem_deck_crv_2, stem_deck_crv_3, crv_5]))  # -> Keys, ValuesA
netsurf = NetworkSurface(CurvesU=[mirror_4.Geometry, item_7], CurvesV=sort_4.ValuesA, Continuity=3)
stbd_srf_3 = StbdSrf(B=netsurf)
srf = Surface(stbd_srf_3)
cntrl_vector_o = Object([object_24, object_6])
mark_pt_o = Object([object_10, object_8, object_12, object_11, object_9, object_7, object_5])
loft_crv_label_o = Object([object_13, object_14])

# ---- group: Transom to trim
cluster_5 = Cluster(loft_crv=object_15, I=transm_srf)  # -> out, R
dispatch_9 = Dispatch(List=stbd_srf_2, DispatchPattern=cluster_5.R)  # -> ListA, ListB
dispatch_10 = Dispatch(List=hull, DispatchPattern=cluster_5.R)  # -> ListA, ListB
layers_3 = QueryModelLayers(Name="C-hull", AutoUpdateState=True)

# ----
panel_8 = Panel(cluster_5.out)
dispatch_11 = Dispatch(List=sort_2.ValuesA, DispatchPattern=cluster_5.R)  # -> ListA, ListB

# ---- group: Stem updated to sweep 2-rails (continued)
flip_3 = FlipCurve(Curve=object_21, Guide=object_18)  # -> Curve, Flag
stem_deck_crv_4 = StemDeckCrv(f=stem_factor_2, crv_1=object_18)
flip_4 = FlipCurve(Curve=crv)  # -> Curve, Flag
mirror_7 = Mirror(Geometry=item_6, Plane=PlaneXZ(0, 0, 0))  # -> StemEdge, Transform
edgesrf = EdgeSurface(CurveA=stem_deck_crv_4, CurveB=item_6, CurveC=mirror_7.StemEdge, CurveD=stem_deck_crv)
loft_2 = Loft(
    Curves=flatten([flip_2.Curve, stem_deck_crv]),
    Options={Adjust=False, Closed=False, LoftEnds=0, LoftSimp=0, LoftType=0, Rebuild=10, Refit=0.01})
debrep_3 = DeconstructBrep(Brep=stbd_srf_2)  # -> Faces, Edges, Vertices
stbd_srf_4 = StbdSrf(B=loft_2)
midpt_7 = CurveMiddle(Curve=debrep_3.Edges)
pdecon_11 = Deconstruct(Point=midpt_7)  # -> XComponent, YComponent, ZComponent
sort_5 = SortList(Keys=pdecon_11.XComponent, ValuesA=debrep_3.Edges)  # -> Keys, ValuesA
item_9 = ListItem(List=flatten(sort_5.ValuesA), Index=0, Wrap=True)  # -> Item, Item1, Item2, Item3
stbd_srf_5 = StbdSrf(B=edgesrf)

# ---- group: 0-width Srf = problem!!!
larger_3 = LargerThan(FirstNumber=chine_width_2, SecondNumber=0)  # -> LargerThan, OrEqualTo
dispatch_12 = Dispatch(List=stbd_srf_4, DispatchPattern=larger_3.LargerThan)  # -> ListA, ListB
dispatch_13 = Dispatch(List=loft_2, DispatchPattern=larger_3.LargerThan)  # -> ListA, ListB
dispatch_14 = Dispatch(List=stem_deck_crv_2, DispatchPattern=larger_3.LargerThan)  # -> ListA, ListB
dispatch_15 = Dispatch(List=loft, DispatchPattern=larger_3.LargerThan)  # -> ListA, ListB
clean_2 = CleanTree(RemoveNulls=True, RemoveInvalid=True, RemoveEmpty=True, Tree=[srf, stbd_srf_5, dispatch_12.ListA])

# ---- group: Stem updated to sweep 2-rails (continued)
debrep_4 = DeconstructBrep(Brep=dispatch_13.ListA)  # -> Faces, Edges, Vertices

# ----
crv_6 = Curve(item_9.Item3)

# ---- group: Stem updated to sweep 2-rails / Inside of stem chine
len = Length(Curve=debrep_4.Edges)
sort_6 = SortList(Keys=len, ValuesA=debrep_4.Edges)  # -> Keys, ValuesA
item_10 = ListItem(List=reverse(sort_6.ValuesA), Index=0, Wrap=True)  # -> Item, Item1

# ----
midpt_8 = CurveMiddle(Curve=stem_deck_crv_4)
vec2pt_5 = Vector2Pt(PointA=midpt_8, PointB=midpt_5, Unitize=False)  # -> Vector, Length
ln_3 = Line(StartPoint=midpt_8, EndPoint=midpt_5)  # disabled
vdis_5 = VectorDisplay(Anchor=midpt_5, Vector=vec2pt_5.Vector)  # disabled

# ---- group: Transom if not cutting
arc = Arc3Pt(TransomCorner=dispatch_7.ListB, TransomCl=pt_3, TransomCorner_2=mirror_3.Geometry)  # -> DeckAftCrv, Plane, Radius
mirror_8 = Mirror(Geometry=item_9.Item3, Plane=PlaneXZ(0, 0, 0))  # -> Geometry, Transform
eval_6 = EvaluateCurve(Curve=reparameterize([mirror_8.Geometry, item_9.Item3]), Parameter=0)  # -> Point, Tangent, Angle
dispatch_16 = Dispatch(List=eval_6.Point, DispatchPattern=[True, False])  # -> ListA, ListB

# ----
dispatch_17 = Dispatch(List=arc.DeckAftCrv, DispatchPattern=cluster_5.R)  # -> ListA, ListB

item_11 = ListItem(List=dispatch_11.ListA, Index=-1, Wrap=True)
transom_crv = Curve(item_11)
mirror_9 = Mirror(Geometry=transom_crv, Plane=PlaneXZ(0, 0, 0))  # -> Geometry, Transform
eval_7 = EvaluateCurve(Curve=reparameterize([transom_crv, mirror_9.Geometry]), Parameter=0)  # -> Point, Tangent, Angle
eval_8 = EvaluateCurve(Curve=dispatch_17.ListA, Parameter=1)  # -> Point, Tangent, Angle
dispatch_18 = Dispatch(List=eval_7.Point, DispatchPattern=[True, False])  # -> ListA, ListB

# ---- group: Deck/2
edgesrf_2 = EdgeSurface(CurveA=arc.DeckAftCrv, CurveB=object_18, CurveC=stem_deck_crv_4, CurveD=flip_3.Curve)
stbd_srf_6 = StbdSrf(B=edgesrf_2)

# ---- group: Transom if not cutting (continued)
arc_2 = ArcSED(Start=dispatch_16.ListA, End=dispatch_16.ListB, Direction=eval_8.Tangent)  # -> Arc, Plane, Radius
arc_3 = ArcSED(Start=dispatch_18.ListB, End=dispatch_18.ListA, Direction=eval_8.Tangent)  # -> Arc, Plane, Radius
edgesrf_3 = EdgeSurface(CurveA=arc_2.Arc, CurveB=item_9.Item3, CurveC=mirror_8.Geometry)
edgesrf_4 = EdgeSurface(CurveA=dispatch_17.ListA, CurveB=transom_crv, CurveC=mirror_9.Geometry, CurveD=arc_3.Arc)
loft_3 = Loft(
    Curves=flatten([arc_3.Arc, arc_2.Arc]),
    Options={Adjust=False, Closed=False, LoftEnds=0, LoftSimp=0, LoftType=0, Rebuild=10, Refit=0.01})
stbd_srf_7 = StbdSrf(B=edgesrf_4)
stbd_srf_8 = StbdSrf(B=edgesrf_3)
clean_3 = CleanTree(RemoveNulls=True, RemoveInvalid=True, RemoveEmpty=True, Tree=[loft_3, stbd_srf_7, stbd_srf_8])

# ---- group: Transom to trim (continued)
dispatch_19 = Dispatch(List=dispatch_15.ListA, DispatchPattern=cluster_5.R)  # -> ListA, ListB
dispatch_20 = Dispatch(List=stbd_srf_6, DispatchPattern=cluster_5.R)  # -> ListA, ListB
split_larger = SplitLarger(T=[dispatch_20.ListB, dispatch_19.ListB, dispatch_9.ListB, dispatch_10.ListB], cutting_srf=stbd_srf)  # -> larger_srf_2, smaller_srf_2, cutting_crv_2
split_larger_2 = SplitLarger(T=stbd_srf, cutting_crv=split_larger.cutting_crv_2)  # -> larger_srf_2, smaller_srf_2, cutting_crv_2
item_12 = ListItem(List=flatten(split_larger.larger_srf_2), Index=0, Wrap=False)  # -> Item, Item1, Item2, Item3
near_cl = NearCL(srf=[split_larger_2.larger_srf_2, split_larger_2.smaller_srf_2])
transom_srf_stbd = Surface([clean_3, near_cl])
topsides_stbd = Surface([item_12.Item1, dispatch_10.ListA])
canoeb_stbd = Surface([item_12.Item2, dispatch_9.ListA])
chine_stbd = Surface([dispatch_19.ListA, item_12.Item3])
deck_stbd = Surface([item_12.Item, dispatch_20.ListA])
object_25 = ModelObject(Geometry=topsides_stbd, Name="Topside Stbd", Layer=layers_3)  # -> Object, Geometry
object_26 = ModelObject(Geometry=deck_stbd, Name="Deck Stbd", Layer=layers_3)  # -> flatten(Object), Geometry
object_27 = ModelObject(Geometry=chine_stbd, Name="Chine Stbd", Layer=layers_3)  # -> Object, Geometry
object_28 = ModelObject(Geometry=canoeb_stbd, Name="CanoeB Stbd", Layer=layers_3)  # -> Object, Geometry
object_29 = ModelObject(Geometry=transom_srf_stbd, Name="Transom Stbd", Layer=layers_3)  # -> Object, Geometry
object_30 = ModelObject(Geometry=clean_2, Name="Stem Stbd", Layer=layers_3)  # -> flatten(Object)

# ---- group: Solid vessel
clean_4 = CleanTree(
    RemoveNulls=True,
    RemoveInvalid=True,
    RemoveEmpty=True,
    Tree=flatten([object_26.Geometry, object_25.Geometry, object_27.Geometry, object_28.Geometry, object_29.Geometry]))
srf_2 = Surface([clean_4, object_30])
join = BrepJoin(Breps=flatten(srf_2))  # -> Vessel, Closed
mirror_10 = Mirror(Geometry=join.Vessel, Plane=PlaneXZ(0, 0, 0))  # -> Geometry, Transform
join_2 = BrepJoin(Breps=[mirror_10.Geometry, join.Vessel])  # -> Vessel, Closed
capex = CapHolesEx(Brep=join_2.Vessel)  # -> Vessel, Caps, Solid
layers_4 = QueryModelLayers(Name="G-hull", AutoUpdateState=True)
object_31 = ModelObject(Geometry=capex.Vessel, ProjectName=trim, Layer=layers_4, Display=display)

# ----
clean_5 = CleanTree(
    RemoveNulls=True,
    RemoveInvalid=True,
    RemoveEmpty=True,
    Tree=flatten([object_25.Object, object_26.Object, object_27.Object, object_28.Object, object_29.Object]))
half_hull_o = ModelObject([object_30, clean_5])
vessel_o = Object(object_31)
solid = Solid(capex.Solid)
half_hull_o_2 = ModelObject(half_hull_o)

# ==== cluster StemDeckCrv
f = ClusterInput()
crv_1 = ClusterInput()
end = EndPoints(Curve=crv_1)  # -> Start, End
flip = FlipCurve(Curve=crv_1)  # -> Curve, Flag
mirror = Mirror(Geometry=crv_1, Plane=Plane(origin=(0, 0, 0), x=(0, 0, 1), y=(1, 0, 0)))  # -> Geometry, Transform
pdecon = Deconstruct(Point=end.End)  # -> XComponent, YComponent, ZComponent
pdecon_2 = Deconstruct(Point=end.Start)  # -> XComponent, YComponent, ZComponent
eval = EvaluateCurve(Curve=reparameterize(mirror.Geometry), Parameter=0)  # -> Point, Tangent, Angle
eval_2 = EvaluateCurve(Curve=reparameterize(mirror.Geometry), Parameter=0.001)  # -> Point, Tangent, Angle
eval_3 = EvaluateCurve(Curve=reparameterize(crv_1), Parameter=0)  # -> Point, Tangent, Angle
eval_4 = EvaluateCurve(Curve=reparameterize(crv_1), Parameter=0.001)  # -> Point, Tangent, Angle
larger = LargerThan(FirstNumber=pdecon_2.XComponent, SecondNumber=pdecon.XComponent)  # -> LargerThan, OrEqualTo; disabled
dispatch = Dispatch(List=crv_1, DispatchPattern=larger.LargerThan)  # -> ListA, ListB; disabled
vec2pt = Vector2Pt(PointA=eval_4.Point, PointB=eval_3.Point, Unitize=True)  # -> Vector, Length
vec2pt_2 = Vector2Pt(PointA=eval_2.Point, PointB=eval.Point, Unitize=True)  # -> Vector, Length
pt = Point(end.Start)
flip_2 = FlipCurve(Curve=dispatch.ListB)  # -> Curve, Flag; disabled
sift = SiftPattern(List=pdecon_2.YComponent, SiftPattern=larger.LargerThan)  # -> Output0, Output1; disabled
sift_2 = SiftPattern(List=pdecon.YComponent, SiftPattern=larger.LargerThan)  # -> Output0, Output1; disabled
expression = Expression(y=pdecon_2.YComponent, f=f, Expression="ABS(y)*f")
eval_5 = Evaluate(F="if(ABS(x)<ABS(y),ABS(x)*f,ABS(y)*f)", x=pdecon_2.YComponent, y=pdecon.YComponent, f=f)  # disabled
clean = CleanTree(RemoveNulls=True, RemoveInvalid=True, RemoveEmpty=False, Tree=[sift_2.Output1, sift.Output0])  # disabled
expression_2 = Expression(ys=pdecon.YComponent, ye=pdecon_2.YComponent, f=f, Expression="if(ABS(ys)<ABS(ye),ABS(ys)*f,ABS(ye)*f)")
multiplication = Multiplication(A=vec2pt.Vector, Mult=expression)
multiplication_2 = Multiplication(A=vec2pt_2.Vector, Mult=expression)
expression_3 = Expression(x=clean, y=f, Expression="ABS(x)*y")  # disabled
vdis = VectorDisplay(Anchor=eval_3.Point, Vector=vec2pt.Vector)
vdis_2 = VectorDisplay(Anchor=eval.Point, Vector=vec2pt_2.Vector)
bzspan = BezierSpan(StartPoint=end.Start, StartTangent=multiplication, EndPoint=eval.Point, EndTangent=multiplication_2)  # -> StemCrv, Length, Domain
multiplication_3 = Multiplication(A=sift.Output0, B=f)  # disabled
vdis_3 = VectorDisplay(Anchor=eval_3.Point, Vector=multiplication)
vdis_4 = VectorDisplay(Anchor=eval.Point, Vector=multiplication_2)
stem_crv = ClusterOutput(bzspan.StemCrv)
panel = Panel(eval_5)
panel_2 = Panel(pdecon_2.YComponent)
panel_3 = Panel(pdecon.YComponent)
panel_4 = Panel(expression)

# ==== cluster SplitLarger
cutting_crv = ClusterInput()
cutting_srf = ClusterInput()
T = ClusterInput()
flatten = FlattenTree(Tree=T, Path="{0}")  # -> graft(Tree)
bbx = BrepBrep(Surface=flatten, CuttingSrf=cutting_srf)  # -> Curves, Points
srfsplit = SurfaceSplit(Surface=flatten, CuttingCrv=[bbx.Curves, cutting_crv])
area = Area(Geometry=srfsplit)  # -> Area, Centroid
dispatch = Dispatch(List=area.Area, DispatchPattern=[True, False])  # -> ListA, ListB
larger = LargerThan(FirstNumber=dispatch.ListA, SecondNumber=dispatch.ListB)  # -> LargerThan, OrEqualTo
not = GateNot(A=larger.LargerThan)
dispatch_2 = Dispatch(List=srfsplit, DispatchPattern=[larger.LargerThan, not])  # -> ListA, ListB
join = JoinCurves(Curves=flatten(bbx.Curves), Preserve=False)
larger_srf = Surface(dispatch_2.ListA)
smaller_srf = Surface(dispatch_2.ListB)
smaller_srf_2 = ClusterOutput(smaller_srf)
larger_srf_2 = ClusterOutput(larger_srf)
cutting_crv_2 = ClusterOutput(join)

# ==== cluster NearCL
srf = ClusterInput()

# ---- group: Keep inner surface
srf_2 = Surface(srf)
area = Area(Geometry=srf_2)  # -> Area, Centroid
pdecon = Deconstruct(Point=area.Centroid)  # -> XComponent, YComponent, ZComponent
abs = Absolute(Value=pdecon.YComponent)
dispatch = Dispatch(List=abs, DispatchPattern=[True, False])  # -> ListA, ListB
smaller = SmallerThan(FirstNumber=dispatch.ListA, SecondNumber=dispatch.ListB)  # -> SmallerThan, OrEqualTo
not = GateNot(A=smaller.SmallerThan)
dispatch_2 = Dispatch(List=srf_2, DispatchPattern=[smaller.SmallerThan, not])  # -> ListA, ListB

# ----
srf_3 = Surface(dispatch_2.ListA)
A = ClusterOutput(dispatch_2.ListA)

# ==== cluster StbdSrf
B = ClusterInput()
sec = BrepPlane(Brep=B, Plane=Plane(origin=(0, 0, 0), x=(0, 0, 1), y=(1, 0, 0)))  # -> Curves, Points
srfsplit = SurfaceSplit(Surface=B, Curves=sec.Curves)
area = Area(Geometry=srfsplit)  # -> Area, Centroid
pdecon = Deconstruct(Point=area.Centroid)  # -> XComponent, YComponent, ZComponent
sort = SortList(Keys=pdecon.YComponent, ValuesA=srfsplit)  # -> Keys, ValuesA
item = ListItem(List=reverse(sort.ValuesA), Index=0, Wrap=True)
stbd_srf = Surface(item)
stbd_srf_2 = ClusterOutput(stbd_srf)

# ==== cluster Cluster
loft_crv = ClusterInput()
I = ClusterInput()
end = EndPoints(LoftCrv=loft_crv)  # -> Start, End
pdecon = Deconstruct(Point=[end.End, end.Start])  # -> XComponent, YComponent, ZComponent
sort = SortList(Keys=pdecon.XComponent)  # -> reverse(Keys), ValuesA
item = ListItem(List=sort.Keys, Index=0, Wrap=True)

# ---- group: Error check
debrep = DeconstructBrep(TransmSrf=I)  # -> Faces, Edges, Vertices
pdecon_2 = Deconstruct(Point=debrep.Vertices)  # -> XComponent, YComponent, ZComponent
sort_2 = SortList(Keys=pdecon_2.XComponent)  # -> Keys, ValuesA
pdecon_3 = Deconstruct(Point=debrep.Vertices)  # -> XComponent, YComponent, ZComponent
null = NullItem(Item=I)  # -> NullFlags, InvalidFlags, Description
item_2 = ListItem(List=reverse(sort_2.Keys), Index=0, Wrap=True)
sort_3 = SortList(Keys=pdecon_3.XComponent)  # -> reverse(Keys), ValuesA
item_3 = ListItem(List=sort_2.Keys, Index=0, Wrap=True)
item_4 = ListItem(List=sort_3.Keys, Index=0, Wrap=True)
larger = LargerThan(FirstNumber=item_2, SecondNumber=item)  # -> LargerThan, OrEqualTo
larger_2 = LargerThan(FirstNumber=item_3, SecondNumber=item)  # -> LargerThan, OrEqualTo
bool = Boolean(null.NullFlags)
expression = Expression(N=larger_2.LargerThan, S="Transom misses stern", Expression="IF(N,Format(\"{0}\",S),\"\")")
or = GateOr(A=larger.LargerThan, B=larger_2.LargerThan, C=bool)
expression_2 = Expression(N=larger.LargerThan, S="Transom Intersects Stern", Expression="IF(N,Format(\"{0}\",S),\"\")")
input = DataInput(
    Destination="C:\Users\phils\Dropbox\Projects\Software\GH_subcomponents\02 YachtSoft HullZero\01 Displacement\Error Log.ghdata",
    RelativePath="C:\Users\phils\Dropbox\Projects\Software\GH_subcomponents\02 YachtSoft HullZero\01 Displacement\Error Log.ghdata",
    UpdateDelay=9223372036854775807)  # -> flatten(DataOutput); disabled

# ----
entwine = Entwine(Branch00=expression, Branch01=expression_2, Branch02=input, FlattenInputs=True)  # -> flatten(Result); disabled
output = DataOutput(
    DataInput=flatten(entwine),
    Destination="C:\Users\phils\Dropbox\Projects\Software\GH_subcomponents\02 YachtSoft HullZero\01 Displacement\Error Log.ghdata",
    RelativePath="C:\Users\phils\Dropbox\Projects\Software\GH_subcomponents\02 YachtSoft HullZero\01 Displacement\Error Log.ghdata")  # disabled
out = ClusterOutput([expression, expression_2])
R = ClusterOutput(or)

# ==== cluster Cluster_2
pt = ClusterInput()
X = UnitX(Factor=[-1000, 1000])
pt_2 = Point(pt)
move = Move(Geometry=graft(pt_2), Motion=X)  # -> Geometry, Transform
dispatch = Dispatch(List=move.Geometry, DispatchPattern=[True, False])  # -> ListA, ListB
ln = Line(StartPoint=dispatch.ListA, EndPoint=dispatch.ListB)  # -> flatten(Line)
L = ClusterOutput(ln)

# ==== cluster Cluster_3
cntrl_pt_o = ClusterInput()
ts = ClusterInput()
object = ModelObject(CntrlPtO=cntrl_pt_o)  # -> Object, Geometry, Name
pl_origin = PlaneOrigin(Base=[PlaneXZ(0, 0, 0), PlaneXY(0, 0, 0), PlaneYZ(0, 0, 0)], Origin=graft(object.Geometry))
as_text = AnnotationTextSettings(TextSettings=ts)  # -> TextSettings, TextHeight

# ---- group: Upgraded : Text Dot
annotation_dot = AnnotationDot(Location=object.Geometry, PrimaryText="+", TextHeight=expr("x*2", as_text.TextHeight))

# ----
text_entity = TextEntity(Plane=pl_origin, Text=graft(object.Name), TextSettings=as_text.TextSettings)
te = ClusterOutput(text_entity)
N = ClusterOutput(object.Name)
ad = ClusterOutput(annotation_dot)
