# Grasshopper definition coachroof_fairing.gh (Grasshopper 1.0.8)
# Copyright: © 2023 SYD all rights reserved

imported_pt_o = Object()
base_pt_o = Object()
pln = Plane()
pln_2 = Plane(pln)

# ---- group: Base Template layers
panel = Panel("""{0, 0, 0}
{205.285, 0, 810.633}
{981.56, 0, 883.626}
{250.481, 0, 837.145}
{50.383, -958.164, -116.374}
{-18.44, -758.313, -53.664}
{231.538, -1000, -53.664}
{949.067, -975.872, -53.664}
{0, 0, 0}""")
panel_2 = Panel("""0 CrProfile fwd Pt
1 CrProfile fwd ePt
2 CrProfile aft Pt
3 CrProfile aft ePt
4 CrPcamb end Pt
0 CrSide fwd Pt
1 CrSide mid Pt
2 CrSide aft Pt
Base Pt""")

# ----
object = ModelObject(BasePtO=base_pt_o)  # -> Object, Geometry
pt = Point(object.Geometry)
pt_2 = Point(pln_2)
pdecon = Deconstruct(Point=object.Geometry)  # -> XComponent, YComponent, ZComponent
pdecon_2 = Deconstruct(Point=pln_2)  # -> XComponent, YComponent, ZComponent
expression = Expression(Bp=pt, Pl=pt_2, Expression="{Bp.x,Pl.y,Bp.z}")
pt_3 = Point(panel)

# ---- group: Count is right - then use imported points
object_2 = ModelObject(ImportedPtO=imported_pt_o)  # -> Object, Geometry, Name
lng = ListLength(List=object_2.Geometry)
equals = Equality(FirstNumber=lng, SecondNumber=8)  # -> Equality, Inequality
weave = Weave(Pattern=equals.Equality, Stream0=pt_3, Stream1=object_2.Geometry, NullGaps=False)
weave_2 = Weave(Pattern=equals.Equality, Stream0=panel_2, Stream1=object_2.Name, NullGaps=False)

# ----
u_text = UserText(Content=object.Object, UserTextMode=1)  # -> Content, Keys, Values
pt_4 = ConstructPoint(XCoordinate=pdecon.XComponent, YCoordinate=pdecon_2.YComponent, ZCoordinate=pdecon.ZComponent)
item = ListItem(List=u_text.Values, Index=0, Wrap=True)  # -> Item, Item1, Item2
panel_3 = Panel([expression, pt_4])
panel_4 = Panel(u_text.Keys)
loa = Number(item.Item)
D = Number(item.Item2)
boa = Number(item.Item1)
scale_nu = ScaleNU(Geometry=weave, Plane=PlaneXY(0, 0, 0), ScaleX=loa, ScaleY=boa, ScaleZ=D)  # -> ScaledPts, Transform
panel_5 = Panel(object_2.Geometry)
panel_6 = Panel(object_2.Name)
crv = Curve(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)  # disabled

# ---- group: Transom
swatch = ColourSwatch(SwatchColor=RGB(255, 255, 255))  # disabled
panel_7 = Panel("G=input-trans")  # disabled
scale_nu_2 = ScaleNU(Geometry=crv, Plane=PlaneXY(0, 0, 0), ScaleX=1, ScaleY=1, ScaleZ=D)  # -> ScaledTrans, Transform; disabled
layer = ModelLayer(Name=panel_7, DisplayColour=swatch)  # disabled
panel_8 = Panel("Transom Crv")  # disabled
object_3 = ModelObject(Geometry=scale_nu_2.ScaledTrans, Name=panel_8, Layer=layer)  # -> simplify(TransmCrvO); disabled

# ----
move = Move(Geometry=scale_nu.ScaledPts, Motion=pt_4)  # -> Geometry, Transform
pdecon_3 = Deconstruct(Point=scale_nu.ScaledPts)  # -> XComponent, YComponent, ZComponent; disabled
layers = QueryModelLayers(Name="G=input-phse", AutoUpdateState=True)
sort = SortList(Keys=pdecon_3.XComponent)  # -> reverse(MaxX), ValuesA; disabled
object_4 = ModelObject(Geometry=move.Geometry, Name=weave_2, Layer=layers)  # -> simplify(OriginPtsO)
item_2 = ListItem(List=sort.MaxX, Index=0, Wrap=True)  # disabled
max_x = Number(item_2)  # disabled
origin_pts_o = Object(object_4)
