# Grasshopper definition cog_on_mirror_pl.gh (Grasshopper 1.0.8)
# Copyright: © SYD 2022

mirror_pln = Plane()
P = Point()
pdecon = Deconstruct(Point=P)  # -> XComponent, YComponent, ZComponent
mirror_pln_2 = Plane(mirror_pln)
null = NullItem(Item=mirror_pln_2)  # -> NullFlags, InvalidFlags, Description
dispatch = Dispatch(List=pdecon.YComponent, DispatchPattern=null.NullFlags)  # -> ListA, ListB
pdecon_2 = Deconstruct(Point=mirror_pln_2)  # -> XComponent, YComponent, ZComponent
null_2 = NullItem(Item=dispatch.ListA)  # -> NullFlags, InvalidFlags, Description
_0 = Number(0)
dispatch_2 = Dispatch(List=pdecon_2.YComponent, DispatchPattern=null_2.NullFlags)  # -> ListA, ListB
clean = CleanTree(RemoveNulls=True, RemoveInvalid=True, RemoveEmpty=False, Tree=[dispatch.ListA, dispatch_2.ListA])
pt = ConstructPoint(XCoordinate=pdecon.XComponent, YCoordinate=clean, ZCoordinate=pdecon.ZComponent)
pt_2 = Point(pt)
