# Grasshopper definition deck_camber_from_mid-point.gh (Grasshopper 1.0.8)
# Copyright: © SYD 2022

camber = B()
stem_crv = Curve()
C = BaseCurve()
C_2 = BaseCurve()
subcrv = SubCurve(BaseCurve=graft([C, C_2]), Domain=["[0 to 0.5]", "[0.5 to 1.0]"])
end = EndPoints(Curve=flatten(subcrv))  # -> Start, End
item = ListItem(List=end.Start, Index=1, Wrap=True)  # -> flatten(Item), Item1, Item2
flip = FlipCurve(Curve=stem_crv)  # -> Curve, Flag
dispatch = Dispatch(List=item.Item, DispatchPattern=[True, False])  # -> ListA, ListB
pt = Point([item.Item, item.Item2])
dist = Distance(PointA=item.Item, PointB=item.Item2)
ln = Line(StartPoint=item.Item, EndPoint=item.Item2)
midpt = CurveMiddle(Curve=ln)
multiplication = Multiplication(A=dist, Camber=camber)
item_2 = ListItem(List=flatten(subcrv), Index=0, Wrap=True)  # -> Item, Item1, Item2, Item3
Z = UnitZ(Factor=flatten(multiplication))  # -> graft(UnitVector)
dispatch_2 = Dispatch(List=flatten(item_2.Item), DispatchPattern=[True, False])  # -> ListA, ListB
move = Move(Geometry=midpt, Motion=Z)  # -> Geometry, Transform
flip_2 = FlipCurve(Curve=item_2.Item)  # -> Curve, Flag
flip_3 = FlipCurve(Curve=item_2.Item2)  # -> Curve, Flag
arc = Arc3Pt(SheerPt=item.Item, PointB=move.Geometry, SheerPt_2=item.Item2)  # -> CamberCrv, Plane, Radius
crv = Curve(dispatch_2.ListA)
crv_2 = Curve(item_2.Item1)
swp2 = Sweep2(Rail1=flip_2.Curve, Rail2=flip_3.Curve, Sections=arc.CamberCrv, SameHeight=False)
swp2_2 = Sweep2(Rail1=item_2.Item1, Rail2=item_2.Item3, Sections=arc.CamberCrv, SameHeight=False)
debrep = DeconstructBrep(Brep=swp2)  # -> Faces, Edges, Vertices
item_3 = ListItem(List=debrep.Edges, Index=Slider(1, range=0..10), Wrap=True)
crv_3 = Curve(item_3)
loft = Loft(
    Curves=flatten([item_3, flip.Curve]),
    Options={Adjust=False, Closed=False, LoftEnds=0, LoftSimp=0, LoftType=0, Rebuild=10, Refit=0.01})
join = BrepJoin(Breps=flatten([swp2, swp2_2, loft]))  # -> _5050CamberedDeck, Closed
_50_50_cambered_deck = Breps(join._5050CamberedDeck)
rear_s = Brep(swp2_2)
front_s = Brep(swp2)
stem = Loft(loft)
