# Grasshopper definition displacement_hull_fairing.gh (Grasshopper 1.0.8)
# Copyright: © 2023 SYD all rights reserved
# Copyright: © SYD 2022

curve_pts_o = List()
transom_o = Object()
ts = TextSettings()
object = ModelObject(TransomO=transom_o)  # -> Object, Geometry, Name
item = ListItem(List=flatten(object.Object), Index=0, Wrap=True)
object_2 = ModelObject(Object=item)
u_text = UserText(Content=object.Object, UserTextMode=1)  # -> Content, Keys, Values
panel = Panel(object.Name)
bang = ExplodeTree(Data=u_text.Values)  # -> Branch0, Branch1, Branch2, Branch3, Branch4
panel_2 = Panel(u_text.Keys)
panel_3 = Panel(u_text.Values)
item_2 = ListItem(List=bang.Branch0, Index=0, Wrap=False)  # -> Item, Item1, Item2, Item3, Item4, Item5, Item6, Item7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
item_3 = ListItem(List=bang.Branch1, Index=0, Wrap=True)  # -> Item, Item1, Item2, Item3, Item4, Item5, Item6
item_4 = ListItem(List=bang.Branch2, Index=0, Wrap=False)
item_5 = ListItem(List=bang.Branch3, Index=0, Wrap=False)  # -> Item, Item1, Item2
item_6 = ListItem(List=bang.Branch4, Index=0, Wrap=False)  # -> Item, Item1
dsp_chine = Boolean(item_5.Item2)
hard_bilge = Boolean(item_6.Item)
multihull = Boolean(invert(item_4))
planing = Boolean(item_5.Item)
dsp_roundb = Boolean(item_5.Item1)
hourglass = Boolean(item_6.Item1)
multiplication = Multiplication(A=item_3.Item, B=item_3.Item5)
dispatch = Dispatch(CurvePtsO=curve_pts_o, DispatchPattern=simplify(graft([planing, dsp_roundb, dsp_chine])))  # -> ListA, ListB
bang_2 = ExplodeTree(Data=dispatch.ListA)  # -> Branch0, Branch1, Branch2
object_3 = ModelObject(DspRoundBO=bang_2.Branch1)  # -> Object, Name
clean = CleanTree(RemoveNulls=True, RemoveInvalid=True, RemoveEmpty=True, Tree=[bang_2.Branch1, bang_2.Branch2])
object_4 = ModelObject(FetchO=clean)  # -> ModPtsO, Geometry, Name
Z = UnitZ(Sinkage=expr("-x", item_2.Item11))
nullrep = ReplaceNulls(Items=item_2.Item5, Replacements=0)  # -> Items, Count
nullrep_2 = ReplaceNulls(Items=item_2.Item6, Replacements=0)  # -> Items, Count
clipper_bow = Number(nullrep.Items)
forefoot_depth = Number(item_2.Item3)
hollow_bow = Number(nullrep_2.Items)
move = Move(Geometry=object_4.Geometry, Motion=Z)  # -> SunkPoints, Transform
object_5 = ModelObject(Geometry=move.SunkPoints, Name=object_4.Name)  # -> ModPtsO, Name
object_6 = ModelObject(object_3.Object)
tmatch = MatchText(Text=object_5.Name, Pattern="*bPt", Case=True)
tmatch_2 = MatchText(Text=object_5.Name, Pattern="*ePt", Case=True)
tmatch_3 = MatchText(Text=object_5.Name, Pattern="*Ht", Case=True)
tmatch_4 = MatchText(Text=object_5.Name, Pattern="*aPt", Case=True)
panel_4 = Panel(object_3.Name)
dispatch_2 = Dispatch(List=object_5.ModPtsO, DispatchPattern=tmatch)  # -> ListA, ListB
dispatch_3 = Dispatch(List=object_5.ModPtsO, DispatchPattern=tmatch_2)  # -> ListA, ListB
dispatch_4 = Dispatch(List=object_5.ModPtsO, DispatchPattern=tmatch_3)  # -> ListA, ListB
dispatch_5 = Dispatch(List=object_5.ModPtsO, DispatchPattern=tmatch_4)  # -> ListA, ListB
item_7 = ListItem(List=object_6, Index=0, Wrap=True)  # -> Item, Item1, Item2, Item3, Item4, Item5, Item6, Item7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

# ---- group: Seperate Pts
item_8 = ListItem(List=dispatch_2.ListA, Index=0, Wrap=False)  # -> Item, Item1, Item2, Item3, Item4
item_9 = ListItem(List=dispatch_3.ListA, Index=0, Wrap=True)  # -> Item, Item1, Item2, Item3, Item4, Item5

# ----
panel_5 = Panel(dispatch_2.ListA)
item_10 = ListItem(List=dispatch_4.ListA, Index=0, Wrap=True)  # -> Item, Item1
vec2pt = Vector2Pt(PointA=item_8.Item, PointB=dispatch_5.ListA, Unitize=False)  # -> Vector, Length
pt = Point(item_8.Item)
devec = DeconstructVector(Vector=vec2pt.Vector)  # -> XComponent, YComponent, ZComponent
line = LineSDL(Start=item_10.Item1, Direction=unitize(Vector(1, 0, 0)), Length=100000)
line_2 = LineSDL(Start=item_10.Item, Direction=unitize(Vector(1, 0, 0)), Length=100000)
vec = VectorXYZ(XComponent=devec.XComponent, YComponent=expr("x/2", devec.YComponent), ZComponent=devec.ZComponent)  # -> Vector, Length
X = UnitX(Factor=clipper_bow)
Y = UnitY(Factor=hollow_bow)
Z_2 = UnitZ(Sinkage=Z)
addition = Addition(A=X, B=Y)
rbilge = Boolean(dsp_roundb)
move_2 = Move(Geometry=item, Motion=Z_2)  # -> Geometry, Transform
deck_curvature_r = Number(expr("x/100", item_2.Item))
hard_bilge_2 = Boolean(hard_bilge)
merge = Merge(Data1=item_8.Item, Data2=item_9.Item, Data3=item_9.Item5, Data4=item_8.Item4)
nurbs = NurbsCurve(Vertices=merge, Degree=3, Periodic=False)  # -> SheerCrv, Length, Domain

# ---- group: Display / End points
cluster = Cluster(pt=dispatch_4.ListA)

# ----
layers = QueryModelLayers(Name="G-hull", AutoUpdateState=True)
layers_2 = QueryModelLayers(Name="G-hull", AutoUpdateState=True)
panel_6 = Panel("""ClipperB
HollowB
FFdepth
FFdist
DeckC
StemF
ProfileF
ChineW
ChineA
Pname""")  # disabled
multihull_2 = Boolean(multihull)

# ---- group: Transom
stbd_srf = StbdSrf(B=move_2.Geometry)
weave = Weave(Pattern=multihull_2, Stream0=stbd_srf, Stream1=move_2.Geometry, NullGaps=False)

# ----
display = DisplayAttributes(IsocurveDensity=-1)
mod_pts_o = Object(object_5.ModPtsO)

# ---- group: Stem updated to sweep 2-rails
forefoot_factor = Number(item_2.Item4)
stem_factor = Number(item_2.Item1)
profile_factor = Number(item_2.Item7)
flip = FlipCurve()  # -> Curve, Flag; disabled

# ---- group: Vector lines
ln = Line(StartPoint=item_8.Item, EndPoint=dispatch_5.ListA)
object_7 = ModelObject(Object=dispatch_2.ListA)  # -> Object, Name
rep = ReplaceText(Text=object_7.Name, Find="bPt", Replace="Vect", RecursiveReplace=False)

# ----
llx = LineLine(Line1=ln, Line2=line)  # -> ParamA, ParamB, PointA, PointB
llx_2 = LineLine(Line1=ln, Line2=line_2)  # -> ParamA, ParamB, PointA, PointB
bilge_intersect_pt = Point(llx_2.PointA)
chine_intersect_pt = Point(llx.PointA)

# ---- group: Bilge curve
line_3 = LineSDL(Start=bilge_intersect_pt, Direction=unitize(Vector(1, 0, 0)), Length=100000)
vec2pt_2 = Vector2Pt(FFootBPt=item_8.Item2, FFootEPt=item_9.Item3, Unitize=False)  # -> Vector, Length
devec_2 = DeconstructVector(Vector=vec.Vector)  # -> XComponent, YComponent, ZComponent
llx_3 = LineLine(Line1=ln, Line2=line_3)  # -> ParamA, ParamB, PointA, PointB
multiplication_2 = Multiplication(A=devec_2.ZComponent, B=forefoot_depth)
vec_2 = VectorXYZ(XComponent=devec_2.XComponent, YComponent=expr("x/2", devec_2.YComponent), ZComponent=multiplication_2)  # -> Vector, Length
eval = Evaluate(F="x/10*y", x=vec_2.Vector, y=forefoot_depth)
eval_2 = Evaluate(F="-x/20*y", x=vec2pt_2.Vector, y=forefoot_depth)
vdis = VectorDisplay(Anchor=llx_3.PointA, Vector=vec_2.Vector)
bzspan = BezierSpan(StartPoint=llx_3.PointA, StartTangent=eval, EndPoint=item_8.Item3, EndTangent=eval_2)  # -> BilgeCrv, Length, Domain
eval_3 = EvaluateCurve(Curve=reparameterize(bzspan.BilgeCrv), Parameter=forefoot_factor)  # -> Point, Tangent, Angle
merge_2 = Merge(
    Data1=bilge_intersect_pt,
    Data2=eval_3.Point,
    Data3=item_8.Item2,
    Data4=item_9.Item3,
    Data5=item_9.Item4,
    Data6=item_8.Item3)
nurbs_2 = NurbsCurve(Vertices=merge_2, Degree=3, Periodic=False)  # -> BilgeCrv, Length, Domain

# ----
move_3 = Move(Geometry=chine_intersect_pt, Motion=addition)  # -> Geometry, Transform

# ---- group: Always calulated
object_8 = ModelObject(Geometry=move_3.Geometry, Name="1 Chine Intsct iPt Vect")

# ----
merge_3 = Merge(Data1=object_8, Data2=item_9.Item1, Data3=item_9.Item2, Data4=item_8.Item1)

# ---- group: Start of vectors
entwine = Entwine(
    Branch00=item_8.Item,
    Branch01=object_8,
    Branch02=item_8.Item1,
    Branch03=item_8.Item2,
    Branch04=item_8.Item3,
    Branch05=item_8.Item4,
    FlattenInputs=True)  # -> flatten(Result)

# ----
nurbs_3 = NurbsCurve(Vertices=merge_3, Degree=3, Periodic=False)  # -> ChineCrv, Length, Domain
panel_7 = Panel(entwine)
entwine_2 = Entwine(Branch00=nurbs.SheerCrv, Branch01=nurbs_3.ChineCrv, Branch02=nurbs_2.BilgeCrv, FlattenInputs=True)
cluster_2 = Cluster_4(C=entwine_2)  # -> flatten(curve_direction_ve_2)
item_11 = ListItem(List=cluster_2, Index=0, Wrap=True)  # -> Item, Item1, Item2

# ---- group: Display
layers_3 = QueryModelLayers(Name="G-hull-pts", AutoUpdateState=True)
layers_4 = QueryModelLayers(Name="G-hull-ctrl", AutoUpdateState=True)
cluster_3 = Cluster_2(cntrl_pt_o=flatten(dispatch_2.ListA), ts=ts)  # -> te, N, ad
panel_8 = Panel("""0 Bilge intersect Ht
1 Chine intersect Ht""")
cluster_4 = Cluster_2(cntrl_pt_o=[dispatch_3.ListA, object_8], ts=ts)  # -> te, N, ad
cluster_5 = Cluster_2(cntrl_pt_o=dispatch_5.ListA, ts=ts)  # -> te, N, ad
display_2 = DisplayAttributes(DisplayColour=ColourSwatch(SwatchColor=RGB(181, 159, 207)))
display_3 = DisplayAttributes(DisplayColour=ColourSwatch(SwatchColor=RGB(157, 176, 209)))
display_4 = DisplayAttributes(DisplayColour=ColourSwatch(SwatchColor=RGB(192, 145, 204)))
display_5 = DisplayAttributes(DisplayColour=ColourSwatch(SwatchColor=RGB(123, 182, 186)))
display_6 = DisplayAttributes(DisplayColour=ColourSwatch(SwatchColor=RGB(214, 156, 156)))
object_9 = ModelObject(Geometry=cluster, Name=panel_8, Display=display_5)
object_10 = ModelObject(Geometry=ln, Name="Bow Angle V", Layer=layers_4, Display=display_2)
object_11 = ModelObject(Geometry=cluster_3.te, Name=cluster_3.N, Layer=layers_3, Display=display_3)
object_12 = ModelObject(Geometry=cluster_3.ad, Name=cluster_3.N, Layer=layers_3, Display=display_3)
object_13 = ModelObject(Geometry=cluster_4.te, Name=cluster_4.N, Layer=layers_3, Display=display_6)
object_14 = ModelObject(Geometry=cluster_4.ad, Name=cluster_4.N, Layer=layers_3, Display=display_6)
object_15 = ModelObject(Geometry=cluster_5.te, Name=cluster_5.N, Layer=layers_3, Display=display_4)
object_16 = ModelObject(Geometry=cluster_5.ad, Name=cluster_5.N, Layer=layers_3, Display=display_4)

# ---- group: Loft curves
midpt = CurveMiddle(Curve=entwine_2)
panel_9 = Panel("""Sheer Crv
Chine outer Crv
Bilge Crv""")
pl_origin = PlaneOrigin(Base=[PlaneXZ(0, 0, 0), PlaneXY(0, 0, 0), PlaneYZ(0, 0, 0)], Origin=graft(midpt))
text_entity = TextEntity(Plane=pl_origin, Text=graft(panel_9), TextSettings=ts)
display_7 = DisplayAttributes(DisplayColour=[ColourSwatch(SwatchColor=RGB(153, 201, 166)), ColourSwatch(SwatchColor=RGB(207, 201, 143)), ColourSwatch(SwatchColor=RGB(214, 160, 118))])  # -> Display, DisplayColour, DisplayMode
object_17 = ModelObject(Geometry=text_entity, Name=panel_9, Layer=layers_4, Display=display_7.Display)
object_18 = ModelObject(Geometry=cluster_2, Name=panel_9, Layer=layers_4, Display=display_7.Display)

# ----
object_19 = ModelObject(LoftingO=object_18)

# ---- group: Asymmetry in Multihulls
assymmetry_f = Number(item_3.Item3)
multihull_3 = Boolean(multihull)
weave_2 = Weave(Pattern=multihull_3, Stream0="1", Stream1=assymmetry_f, NullGaps=False)
mirror = Mirror(Geometry=object_19, Plane=Plane(origin=(0, 0, 0), x=(0, 0, 1), y=(1, 0, 0)))  # -> Geometry, Transform
scale_nu = ScaleNU(Geometry=mirror.Geometry, Plane=PlaneXY(0, 0, 0), ScaleX=1, ScaleY=weave_2, ScaleZ=1)  # -> Geometry, Transform

# ----
object_20 = ModelObject(Object=object_19)  # -> Object, Name
concat = Concatenate(FragmentA=object_20.Name, FragmentB=" p")
dispatch_6 = Dispatch(List=object_19, DispatchPattern=rbilge)  # -> ListA, ListB
object_21 = ModelObject(Object=object_20.Object, Geometry=scale_nu.Geometry, Name=concat)
item_12 = ListItem(List=flatten(object_19), Index=0, Wrap=True)  # -> Item, Item1, Item2
item_13 = ListItem(List=flatten(dispatch_6.ListB), Index=0, Wrap=True)  # -> Item, Item1, Item2
item_14 = ListItem(List=flatten(dispatch_6.ListA), Index=0, Wrap=True)  # -> Item, Item1, Item2
item_15 = ListItem(List=flatten(object_21), Index=0, Wrap=True)  # -> Item, Item1, Item2
outboard_chine = ModelObject(item_13.Item1)
inboard_bilge = ModelObject(item_15.Item2)
outboard_chine_2 = ModelObject(item_14.Item1)
inboard_sheer = ModelObject(item_15.Item)
inboard_chine = ModelObject(item_15.Item1)
outboard_sheer = ModelObject(item_13.Item)
outboard_bilge = ModelObject(item_13.Item2)
outboard_sheer_2 = ModelObject(item_14.Item)
outboard_bilge_2 = ModelObject(item_14.Item2)
tweencrv = TweenCurve(CurveA=outboard_bilge, CurveB=inboard_bilge, Factor=0.5, BlendType=0)

# ---- group: Chine / Max width
midpt_2 = CurveMiddle(Curve=outboard_sheer_2)
pdecon = Deconstruct(Point=midpt_2)  # -> XComponent, YComponent, ZComponent
pt_2 = ConstructPoint(XCoordinate=pdecon.XComponent, YCoordinate=-5000000, ZCoordinate=0)
crv_cp = CurveClosestPoint(Point=pt_2, Curve=outboard_sheer_2)  # -> Point, Parameter, Distance
pdecon_2 = Deconstruct(Point=crv_cp.Point)  # -> XComponent, expr("ABS(x)*2", YComponent), ZComponent

# ---- group: Flared inner sheer line
topside_flare_f = Number(item_3.Item1)
topside_ht_f = Number(item_3.Item2)
multihull_4 = Boolean(multihull)
end = EndPoints(Curve=inboard_sheer)  # -> Start, End
weave_3 = Weave(Pattern=multihull_4, Stream0="1", Stream1=topside_ht_f, NullGaps=False)
scale_nu_2 = ScaleNU(Geometry=inboard_sheer, Plane=end.Start, ScaleX=1, ScaleY=1, ScaleZ=weave_3)  # -> Geometry, Transform
weave_4 = Weave(Pattern=multihull_4, Stream0="1", Stream1=topside_flare_f, NullGaps=False)
scale_nu_3 = ScaleNU(Geometry=scale_nu_2.Geometry, Plane=PlaneXY(0, 0, 0), ScaleX=1, ScaleY=weave_4, ScaleZ=1)  # -> Geometry, Transform
object_22 = ModelObject(Geometry=scale_nu_3.Geometry, Name="Sheerline inner adj")

# ----
dispatch_7 = Dispatch(List=tweencrv, DispatchPattern=hard_bilge_2)  # -> ListA, ListB
clean_2 = CleanTree(RemoveNulls=True, RemoveInvalid=True, RemoveEmpty=False, Tree=dispatch_7.ListA)
crv = Curve(item_11.Item)
crv_2 = Curve(item_11.Item1)
crv_3 = Curve(item_11.Item2)

# ---- group: Vector lines (continued)
ln_2 = Line(StartPoint=entwine, EndPoint=dispatch_3.ListA)
object_23 = ModelObject(Geometry=ln_2, Name=rep, Layer=layers_4, Display=display_2)

# ----
crv_4 = Curve(inboard_chine)
sheer1 = ModelObject(outboard_sheer)
sheer2 = ModelObject(inboard_sheer)
loft_crv_label_o = Object([object_17, object_18])
cntrl_vector_o = Object([object_23, object_10])
mark_pt_o = Object([object_14, object_12, object_16, object_15, object_13, object_11, object_9])

# ---- group: Chine
chine_width_mm = Number(item_2.Item8)
chine_angle = Number(item_2.Item9)
abs = Absolute(Value=chine_angle)
trig = TriangleTrigonometry(Beta=degrees(90), Gamma=degrees(abs), ALength=chine_width_mm)  # -> Alpha, Beta, Gamma, ALength, BLength, CLength
nullrep_3 = ReplaceNulls(Items=trig.CLength, Replacements=0)  # -> Items, Count
larger = LargerThan(FirstNumber=chine_angle, SecondNumber=0)  # -> LargerThan, OrEqualTo
dispatch_8 = Dispatch(List=nullrep_3.Items, DispatchPattern=larger.LargerThan)  # -> ListA, ListB
neg = Negative(Value=dispatch_8.ListA)
clean_3 = CleanTree(RemoveNulls=True, RemoveInvalid=True, RemoveEmpty=False, Tree=[dispatch_8.ListB, neg])
end_2 = EndPoints(Curve=outboard_chine_2)  # -> Start, End
pdecon_3 = Deconstruct(Point=end_2.Start)  # -> XComponent, YComponent, ZComponent
pdecon_4 = Deconstruct(Point=end_2.End)  # -> XComponent, YComponent, ZComponent
subtraction = Subtraction(A=pdecon_3.ZComponent, B=pdecon_4.ZComponent)
chine_height = Integer(clean_3)
expression = Expression(BOA=pdecon_2.YComponent, Cw=chine_width_mm, Expression="(BOA-Cw*2)/BOA")
expression_2 = Expression(d=subtraction, Ch=chine_height, Expression="(d-Ch)/d")
dispatch_9 = Dispatch(List=dispatch_4.ListA, DispatchPattern=[True, False])  # -> ListA, ChineHt
loft_opt = LoftOptions(Closed=False, Adjust=True, Rebuild=111, Refit=0, Type=3)
scale_nu_4 = ScaleNU(Geometry=inboard_chine, Plane=PlaneXY(0, 0, 0), ScaleX=1, ScaleY=expression, ScaleZ=1)  # -> ChineInnerNarrow, Transform
xy = XYPlane(Origin=dispatch_9.ChineHt)
hull = Loft(Curves=flatten([inboard_chine, object_22]), Options=loft_opt)
scale_nu_5 = ScaleNU(Geometry=scale_nu_4.ChineInnerNarrow, Plane=xy, ScaleX=1, ScaleY=1, ScaleZ=expression_2)  # -> ChineInnerAngled, Transform

# ----
hull_2 = Loft(Curves=flatten([outboard_sheer_2, outboard_chine_2]), Options=loft_opt)

# ---- group: Asymmetry in Multihulls
chine_assymmetry_f = Number(item_3.Item4)
multihull_5 = Boolean(multihull)
weave_5 = Weave(Pattern=multihull_5, Stream0="1", Stream1=chine_assymmetry_f, NullGaps=False)
scale_nu_6 = ScaleNU(Geometry=scale_nu_5.ChineInnerAngled, Plane=PlaneXY(0, 0, 0), ScaleX=1, ScaleY=weave_5, ScaleZ=1)  # -> ChineInnerWidened, Transform

# ---- group: Aft end of sheerline
debrep = DeconstructBrep(Brep=[hull, hull_2])  # -> Faces, Edges, Vertices
midpt_3 = CurveMiddle(Curve=debrep.Edges)
pdecon_5 = Deconstruct(Point=midpt_3)  # -> XComponent, YComponent, ZComponent
abs_2 = Absolute(Value=pdecon_5.XComponent)
sort = SortList(Keys=abs_2, ValuesA=debrep.Edges)  # -> Keys, ValuesA

# ----
mirror_2 = Mirror(Geometry=scale_nu_5.ChineInnerAngled, Plane=Plane(origin=(0, 0, 0), x=(0, 0, 1), y=(1, 0, 0)))  # -> Geometry, Transform

# ---- group: Canoe Body
entwine_3 = Entwine(
    Branch00=scale_nu_6.ChineInnerWidened,
    Branch01=inboard_bilge,
    Branch02=clean_2,
    Branch03=outboard_bilge_2,
    Branch04=mirror_2.Geometry,
    FlattenInputs=True)
hull_3 = Loft(
    Curves=flatten(entwine_3),
    Options={Adjust=True, Closed=False, LoftEnds=0, LoftSimp=0, LoftType=1, Rebuild=10, Refit=0.01})
dom²num = ConstructDomain²(UMin=0, UMax="0.5", VMin=0, VMax=1)
dom²num_2 = ConstructDomain²(UMin="0.5", UMax=1, VMin=0, VMax=1)
subsrf = Isotrim(Surface=reparameterize(hull_3), Domain=dom²num)
subsrf_2 = Isotrim(Surface=reparameterize(hull_3), Domain=dom²num_2)

# ---- group: Topside edge @ bow
item_16 = ListItem(List=sort.ValuesA, Index=0, Wrap=True)

# ---- group: Chine (continued)
loft = Loft(
    Curves=flatten([outboard_chine_2, mirror_2.Geometry]),
    Options={Adjust=False, Closed=False, LoftEnds=0, LoftSimp=0, LoftType=0, Rebuild=10, Refit=0.01})
loft_2 = Loft(
    Curves=flatten([scale_nu_6.ChineInnerWidened, inboard_chine]),
    Options={Adjust=False, Closed=False, LoftEnds=0, LoftSimp=0, LoftType=0, Rebuild=10, Refit=0.01})

# ----
entwine_4 = Entwine(
    Branch00=clipper_bow,
    Branch01=hollow_bow,
    Branch02=forefoot_depth,
    Branch03=forefoot_factor,
    Branch04=item_2.Item,
    Branch05=stem_factor,
    Branch06=profile_factor,
    Branch07=chine_width_mm,
    Branch08=chine_angle,
    Branch09=panel,
    FlattenInputs=True)  # -> flatten(Result); disabled
u_text_2 = UserText(Keys=flatten(panel_6), Values=entwine_4, UserTextMode=1)  # -> LoftCrv, Keys, Values; disabled
loft_crv = Content(u_text_2.LoftCrv)  # disabled

# ---- group: Stem updated to sweep 2-rails (continued)
clean_4 = CleanTree(RemoveNulls=True, RemoveInvalid=True, RemoveEmpty=False, Tree=[outboard_sheer, outboard_sheer_2])
flip_2 = FlipCurve(Curve=object_22)  # -> Curve, Flag
stem_deck_crv = StemDeckCrv(f=stem_factor, crv_1=clean_4, crv_2=flip_2.Curve)
flip_3 = FlipCurve(Curve=outboard_chine_2)  # -> Curve, Flag
stem_deck_crv_2 = StemDeckCrv(f=stem_factor, crv_1=inboard_chine, crv_2=flip_3.Curve)
dispatch_10 = Dispatch(List=flatten(item_16), DispatchPattern=[True, False])  # -> ListA, ListB
edgesrf = EdgeSurface(CurveA=stem_deck_crv, CurveB=dispatch_10.ListA, CurveC=dispatch_10.ListB, CurveD=stem_deck_crv_2)
stem_srf = StemSrf(
    B=hull_3,
    stem_f=stem_factor,
    f=profile_factor,
    d1=Slider(0.57, range=0..1),
    d2=Slider(0.9, range=0..1),
    N=Slider(3, range=0..10))  # -> C, stem_side_crv, stem_base, stem_crv, profile_crv
loft_3 = Loft(
    Curves=flatten([stem_srf.C, stem_deck_crv_2]),
    Options={Adjust=False, Closed=False, LoftEnds=0, LoftSimp=0, LoftType=0, Rebuild=10, Refit=0.01})
srf = Surface(stem_srf.stem_base)
crv_5 = Curve(stem_srf.stem_crv)
crv_6 = Curve(stem_srf.profile_crv)
stbd_srf_2 = StbdSrf(B=loft_3)
stbd_srf_3 = StbdSrf(B=edgesrf)
stbd_srf_4 = StbdSrf(B=graft(stem_srf.stem_base))

# ---- group: Deck/2
flip_4 = FlipCurve(Curve=stem_deck_crv)  # -> Curve, Flag
deck_camber_from_mid_point = DeckCamberFromMidPoint(C=item_12.Item, C_2=object_22, camber=deck_curvature_r, stem_crv=flip_4.Curve)  # -> _50_50_cambered_deck, front_s, rear_s, stem
stbd_srf_5 = StbdSrf(B=flatten(deck_camber_from_mid_point.rear_s))
stbd_srf_6 = StbdSrf(B=flatten([deck_camber_from_mid_point.front_s, deck_camber_from_mid_point.stem]))
join = BrepJoin(Breps=flatten(stbd_srf_5))  # -> RearSrf, Closed
multihull_6 = Boolean(multihull)
layers_5 = QueryModelLayers(Name="G-hull", AutoUpdateState=True)
weave_6 = Weave(Pattern=multihull_6, Stream0=stbd_srf_5, Stream1=deck_camber_from_mid_point.rear_s, NullGaps=False)
object_24 = ModelObject(Geometry=weave_6, Name="Deck", Layer=layers_5)  # -> flatten(DeckAftO)

# ---- group: Does not Close
cambered_deck_from_sheer_lines = CamberedDeckSrf(relay_2=sheer1, relay_3=sheer2, relay=flip_4.Curve, camber=deck_curvature_r)

# ----
weave_7 = Weave(
    Pattern=multihull_6,
    Stream0=stbd_srf_6,
    Stream1=[deck_camber_from_mid_point.stem, deck_camber_from_mid_point.front_s],
    NullGaps=False)

# ---- group: 0-width Srf = problem!!!
larger_2 = LargerThan(FirstNumber=chine_width_mm, SecondNumber=0)  # -> LargerThan, OrEqualTo
dispatch_11 = Dispatch(List=loft_2, DispatchPattern=larger_2.LargerThan)  # -> ListA, ListB
dispatch_12 = Dispatch(List=stbd_srf_2, DispatchPattern=larger_2.LargerThan)  # -> ListA, ListB

# ----
dispatch_13 = Dispatch(List=loft, DispatchPattern=larger_2.LargerThan)  # -> ListA, ListB

# ---- group: Outer surfaces
object_25 = ModelObject(Geometry=hull, Name="Topsides", Layer=layers_2)  # -> Object, Geometry
object_26 = ModelObject(Geometry=subsrf, Name="CanoeBody", Layer=layers_2)  # -> Object, Geometry
object_27 = ModelObject(Geometry=dispatch_11.ListA, Name="Chine", Layer=layers_2)  # -> Object, Geometry
merge_4 = Merge(Data1=object_25.Object, Data2=object_26.Object, Data3=object_27.Object)  # -> flatten(Result)

# ----
object_28 = ModelObject(Geometry=hull_2, Name="Topsides", Layer=layers_2)  # -> Object, Geometry
object_29 = ModelObject(Geometry=hull_3, Name="CanoeBody", Layer=layers_2)  # -> Object, Geometry
object_30 = ModelObject(Geometry=dispatch_13.ListA, Name="Chine", Layer=layers_2)  # -> Object, Geometry
merge_5 = Merge(Data1=object_28.Object, Data2=object_29.Object, Data3=object_30.Object)  # -> flatten(Result)

weave_8 = Weave(Pattern=multihull_2, Stream0=merge_4, Stream1=merge_5, NullGaps=False)

# ---- group: Round Bilge
sheer = ModelObject(outboard_sheer)
chine = ModelObject(outboard_chine)
bilge = ModelObject(outboard_bilge)

# ---- group: Round Bilge / Tucked-in waist
Z_3 = UnitZ(Factor=1)
move_4 = Move(Geometry=inboard_chine, Motion=Z_3)  # -> Geometry, Transform
move_5 = Move(Geometry=chine, Motion=Z_3)  # -> Geometry, Transform
entwine_5 = Entwine(
    Branch00=sheer,
    Branch01=chine,
    Branch02=move_5.Geometry,
    Branch03=bilge,
    Branch04=clean_2,
    Branch05=inboard_bilge,
    Branch06=move_4.Geometry,
    Branch07=inboard_chine,
    Branch08=object_22,
    FlattenInputs=True)  # -> flatten(Result)
dispatch_14 = Dispatch(List=entwine_5, DispatchPattern=[True, False])  # -> ListA, ListB

# ---- group: Round Bilge
entwine_6 = Entwine(
    Branch00=sheer,
    Branch01=chine,
    Branch02=bilge,
    Branch03=clean_2,
    Branch04=inboard_bilge,
    Branch05=inboard_chine,
    Branch06=object_22,
    FlattenInputs=True)  # -> flatten(Result)
dispatch_15 = Dispatch(List=entwine_6, DispatchPattern=[True, False])  # -> ListA, ListB

filter = StreamFilter(Gate=hourglass, Stream0=entwine_6, Stream1=entwine_5)
hull_4 = Loft(Curves=flatten(filter), Options={Adjust=True, Closed=False, LoftEnds=0, LoftSimp=0, LoftType=1, Rebuild=10, Refit=0.01})

# ----
stbd_srf_7 = StbdSrf(B=flatten(hull_4))
weave_9 = Weave(Pattern=multihull, Stream0=stbd_srf_7, Stream1=hull_4, NullGaps=False)
object_31 = ModelObject(Geometry=weave_9, Name="Topsides", Layer=layers)  # -> TopsidesSrfO, Geometry

# ---- group: Stem updated to sweep 2-rails (continued)
stem_srf_2 = StemSrf(
    B=hull_4,
    stem_f=stem_factor,
    f=profile_factor,
    d1=Slider(0.57, range=0..1),
    d2=Slider(0.9, range=0..1),
    N=Slider(3, range=0..10))  # -> C, stem_side_crv, stem_base, stem_crv, profile_crv
stbd_srf_8 = StbdSrf(B=stem_srf_2.stem_base)
clean_5 = CleanTree(RemoveNulls=True, RemoveInvalid=True, RemoveEmpty=True, Tree=[stbd_srf_3, dispatch_12.ListA, stbd_srf_4])
weave_10 = Weave(Pattern=multihull_2, Stream0=flatten(stem_srf_2.stem_base), Stream1=flatten(stbd_srf_8), NullGaps=False)
weave_11 = Weave(Pattern=multihull_2, Stream0=flatten([edgesrf, stem_srf.stem_base, loft_3]), Stream1=flatten(clean_5), NullGaps=False)
weave_12 = Weave(Pattern=rbilge, Stream0=weave_10, Stream1=weave_11, NullGaps=False)

# ----
weave_13 = Weave(Pattern=rbilge, Stream0=object_31.TopsidesSrfO, Stream1=weave_8, NullGaps=False)

# ---- group: Transom to trim
split_larger = SplitLarger(O=flatten([object_24, weave_13]), cutting_srf=weave)  # -> lrge_srf_o, small_srf_o, cutting_crv_2
split_larger_2 = SplitLarger(O=weave, cutting_crv=split_larger.cutting_crv_2)  # -> lrge_srf_o, small_srf_o, cutting_crv_2
split = SplitList(List=split_larger.lrge_srf_o, Index=1)  # -> ListA, ListB
near_cl = NearCL(srf=[split_larger_2.small_srf_o, split_larger_2.lrge_srf_o])
layers_6 = QueryModelLayers(Name="G-hull", AutoUpdateState=True)
transom_srf_stbd = Surface(near_cl)
weave_14 = Weave(Pattern=multihull_2, Stream0=transom_srf_stbd, Stream1=near_cl, NullGaps=False)
object_32 = ModelObject(Geometry=flatten(weave_12), Name="Stem", Layer=layers_6)  # -> flatten(Object)
object_33 = ModelObject(Geometry=weave_14, Name="Transom", Layer=layers_6)

# ----
join_2 = BrepJoin(Breps=flatten([weave_7, split.ListA]))  # -> Breps, Closed
object_34 = ModelObject(Geometry=join_2.Breps, Name="Deck", Layer=layers_5)  # -> flatten(DeckSrfO)
clean_6 = CleanTree(RemoveNulls=True, RemoveInvalid=True, RemoveEmpty=True, Tree=flatten([split.ListB, object_33]))

# ---- group: Solid vessel
half_hull = ModelObject([clean_6, object_32, object_34])
join_3 = BrepJoin(Breps=flatten(half_hull))  # -> Vessel, Closed
mirror_3 = Mirror(Geometry=join_3.Vessel, Plane=PlaneXZ(0, 0, 0))  # -> Geometry, Transform
dispatch_16 = Dispatch(List=mirror_3.Geometry, DispatchPattern=multihull_2)  # -> ListA, ListB
join_4 = BrepJoin(Breps=flatten([join_3.Vessel, dispatch_16.ListB]))  # -> Vessel, Closed
capex = CapHolesEx(Brep=join_4.Vessel)  # -> Vessel, Caps, Solid
layers_7 = QueryModelLayers(Name="G-hull", AutoUpdateState=True)
object_35 = ModelObject(Geometry=capex.Vessel, ProjectName=panel, Layer=layers_7, Display=display)

# ----
half_hull_2 = ModelObject(half_hull)
vessel_o = Object(object_35)
solid = Solid(capex.Solid)

# ==== cluster SplitLarger
cutting_crv = ClusterInput()
cutting_srf = ClusterInput()
O = ClusterInput()
object = ModelObject(Object=flatten(O))  # -> Object, Geometry, Name
flatten = FlattenTree(Tree=object.Geometry, Path="{0}")  # -> graft(Tree)
bbx = BrepBrep(Surface=flatten, CuttingSrf=cutting_srf)  # -> Curves, Points
srfsplit = SurfaceSplit(Surface=simplify(flatten), CuttingCrv=simplify([bbx.Curves, cutting_crv]))
area = Area(Geometry=srfsplit)  # -> Area, Centroid
dispatch = Dispatch(List=area.Area, DispatchPattern=[True, False])  # -> ListA, ListB
concat = Concatenate(FragmentA=object.Name, FragmentB="Small", JoinSeparator="-")
larger = LargerThan(FirstNumber=dispatch.ListA, SecondNumber=dispatch.ListB)  # -> LargerThan, OrEqualTo
not = GateNot(A=larger.LargerThan)
dispatch_2 = Dispatch(List=srfsplit, DispatchPattern=[larger.LargerThan, not])  # -> ListA, ListB
join = JoinCurves(Curves=flatten(bbx.Curves), Preserve=False)
larger_srf = Surface(dispatch_2.ListA)
smaller_srf = Surface(dispatch_2.ListB)
object_2 = ModelObject(Object=object.Object, Geometry=flatten(larger_srf))
object_3 = ModelObject(Object=object.Object, Geometry=flatten(smaller_srf), Name=concat)
cutting_crv_2 = ClusterOutput(join)
lrge_srf_o = ClusterOutput(object_2)
small_srf_o = ClusterOutput(object_3)

# ==== cluster NearCL
srf = ClusterInput()

# ---- group: Keep inner surface
srf_2 = Surface(srf)
area = Area(Geometry=srf_2)  # -> Area, Centroid
pdecon = Deconstruct(Point=area.Centroid)  # -> XComponent, YComponent, ZComponent
abs = Absolute(Value=pdecon.YComponent)
dispatch = Dispatch(List=abs, DispatchPattern=[True, False])  # -> ListA, ListB
smaller = SmallerThan(FirstNumber=dispatch.ListA, SecondNumber=dispatch.ListB)  # -> SmallerThan, OrEqualTo
not = GateNot(A=smaller.SmallerThan)
dispatch_2 = Dispatch(List=srf_2, DispatchPattern=[smaller.SmallerThan, not])  # -> ListA, ListB

# ----
srf_3 = Surface(dispatch_2.ListA)
A = ClusterOutput(dispatch_2.ListA)

# ==== cluster StbdSrf
B = ClusterInput()
sec = BrepPlane(Brep=B, Plane=Plane(origin=(0, 0, 0), x=(0, 0, 1), y=(1, 0, 0)))  # -> Curves, Points
srfsplit = SurfaceSplit(Surface=graft(B), Curves=sec.Curves)
area = Area(Geometry=srfsplit)  # -> Area, Centroid
pdecon = Deconstruct(Point=area.Centroid)  # -> XComponent, YComponent, ZComponent
sort = SortList(Keys=pdecon.YComponent, ValuesA=srfsplit)  # -> Keys, ValuesA
item = ListItem(List=reverse(sort.ValuesA), Index=0, Wrap=True)
stbd_srf = Surface(item)
stbd_srf_2 = ClusterOutput(stbd_srf)

# ==== cluster Cluster
pt = ClusterInput()
X = UnitX(Factor=[-1000, 1000])
pt_2 = Point(pt)
move = Move(Geometry=graft(pt_2), Motion=X)  # -> Geometry, Transform
dispatch = Dispatch(List=move.Geometry, DispatchPattern=[True, False])  # -> ListA, ListB
ln = Line(StartPoint=dispatch.ListA, EndPoint=dispatch.ListB)  # -> flatten(Line)
L = ClusterOutput(ln)

# ==== cluster Cluster_2
cntrl_pt_o = ClusterInput()
ts = ClusterInput()
object = ModelObject(CntrlPtO=cntrl_pt_o)  # -> Object, Geometry, Name
pl_origin = PlaneOrigin(Base=[PlaneXZ(0, 0, 0), PlaneXY(0, 0, 0), PlaneYZ(0, 0, 0)], Origin=graft(object.Geometry))
as_text = AnnotationTextSettings(TextSettings=ts)  # -> TextSettings, TextHeight

# ---- group: Upgraded : Text Dot
annotation_dot = AnnotationDot(Location=object.Geometry, PrimaryText="+", TextHeight=expr("x*2", as_text.TextHeight))

# ----
text_entity = TextEntity(Plane=pl_origin, Text=graft(object.Name), TextSettings=as_text.TextSettings)
te = ClusterOutput(text_entity)
N = ClusterOutput(object.Name)
ad = ClusterOutput(annotation_dot)

# ==== cluster StemSrf

# ---- group: Stem
stem_f = ClusterInput()

# ----
f = ClusterInput()
B = ClusterInput()
N = ClusterInput()
d1 = ClusterInput()
d2 = ClusterInput()
dom = ConstructDomain(DomainStart="0", DomainEnd="1")
dom_2 = ConstructDomain(DomainStart="0.5", DomainEnd="1")
dom_3 = ConstructDomain(DomainStart="0", DomainEnd="0.5")
sec = BrepPlane(Brep=B, Plane=Plane(origin=(0, 0, 0), x=(0, 0, 1), y=(1, 0, 0)))  # -> Curves, Points; disabled
dom² = ConstructDomain²(DomainU=dom_2, DomainV=dom)
dom²_2 = ConstructDomain²(DomainU=dom_3, DomainV=dom)
srfsplit = SurfaceSplit(Surface=B, Curves=sec.Curves)  # disabled
subsrf = Isotrim(Surface=reparameterize(B), Domain=dom²_2)
subsrf_2 = Isotrim(Surface=reparameterize(B), Domain=dom²)
number_slider = Slider(0.31, range=0..1)
number_slider_2 = Slider(0.97, range=0..1)
debrep = DeconstructBrep(Brep=B)  # -> Faces, Edges, Vertices
srf = Surface([subsrf, subsrf_2])
len = Length(Curve=debrep.Edges)
debrep_2 = DeconstructBrep(Brep=srf)  # -> Faces, Edges, Vertices
sort = SortList(Keys=len, ValuesA=debrep.Edges)  # -> Keys, reverse(ValuesA)
midpt = CurveMiddle(Curve=debrep_2.Edges)
merge = Merge(Data1=d1, Data2=d2)
pdecon = Deconstruct(Point=midpt)  # -> XComponent, YComponent, ZComponent
item = ListItem(List=sort.ValuesA, Index=0, Wrap=True)  # -> Item, Item1
sort_2 = SortList(Keys=pdecon.XComponent, ValuesA=debrep_2.Edges)  # -> Keys, ValuesA
item_2 = ListItem(List=sort_2.ValuesA, Index=0, Wrap=True)  # -> Item, Item1
dispatch = Dispatch(List=flatten(item_2.Item), DispatchPattern=[True, False])  # -> ListA, ListB
debrep_3 = DeconstructBrep(Brep=subsrf)  # -> Faces, Edges, Vertices
flip = FlipCurve(Curve=dispatch.ListA)  # -> Curve, Flag
sort_pt = SortPoints(Points=debrep_3.Vertices)  # -> Points, Indices
aligned_front_of_hull_crv = Curve([flip.Curve, dispatch.ListB])
split = SplitList(List=sort_pt.Points, Index=2)  # -> ListA, ListB
shatter = Shatter(Curve=reparameterize(aligned_front_of_hull_crv), Parameters=merge)
pdecon_2 = Deconstruct(Point=split.ListA)  # -> XComponent, YComponent, ZComponent
sort_3 = SortList(Keys=pdecon_2.ZComponent, ValuesA=split.ListA)  # -> Keys, ValuesA
dispatch_2 = Dispatch(List=shatter, DispatchPattern=[True, False])  # -> ListA, ListB
item_3 = ListItem(List=sort_3.ValuesA, Index=Slider(0, range=0..10), Wrap=True)
multiplication = Multiplication(StemF=stem_f, B=f)
crv = Curve(dispatch_2.ListA)
crv_2 = Curve(dispatch_2.ListB)
bow_pt = Point(item_3)
pframes = PerpFrames(Curve=crv_2, Count=N, Align=simplify(True))  # -> Frames, Parameters
outer_chine = Curve(item.Item1)
inner_chine = Curve(item.Item)
sec_2 = BrepPlane(Brep=graft(srf), Plane=pframes.Frames)  # -> simplify(Curves), Points

# ---- group: Stem top
cluster = Cluster_3(f=multiplication, inner_chine=inner_chine, outer_chine=outer_chine)

# ----
panel = Panel(pframes.Parameters)
trim = TrimTree(Tree=sec_2.Curves, Depth=1)
bang = ExplodeTree(Data=trim)  # -> Branch0, Branch1
flip_2 = FlipCurve(Curve=cluster)  # -> Curve, Flag
bang_2 = ExplodeTree(Data=pframes.Frames)  # -> Branch0, Branch1

# ---- group: Stem mid
cluster_2 = Cluster_3(f=multiplication, inner_chine=bang.Branch0, outer_chine=bang.Branch1)

# ----
pt = Point(bang_2.Branch0)

# ---- group: Stem sides
reb = RebuildCurve(Curve=aligned_front_of_hull_crv, Degree=2, Count=1000, Tangents=True)  # -> flatten(StemSideCrv)

# ----
pdecon_3 = Deconstruct(Point=bang_2.Branch0)  # -> XComponent, YComponent, ZComponent
crv_3 = Curve(flatten([flip_2.Curve, cluster_2]))
midpt_2 = CurveMiddle(Curve=crv_3)
pdecon_4 = Deconstruct(Point=midpt_2)  # -> XComponent, YComponent, ZComponent
sort_4 = SortList(Keys=pdecon_4.ZComponent, ValuesStemCrv=crv_3)  # -> Keys, ValuesStemCrv
midpt_3 = CurveMiddle(Curve=sort_4.ValuesStemCrv)
entwine = Entwine(Branch00=bow_pt, Branch01=midpt_3, FlattenInputs=True)  # -> flatten(Result)
points = PointList(Points=entwine, Size=20)
intcrv = Interpolate(Vertices=entwine, Degree=3, Periodic=False, KnotStyle=1)  # -> ProfileCrv, Length, Domain
pcx = CurvePlane(Curve=intcrv.ProfileCrv, Plane=bang_2.Branch0)  # -> Points, ParamsC, ParamsP
pdecon_5 = Deconstruct(Point=flatten(pcx.Points))  # -> XComponent, YComponent, ZComponent
subtraction = Subtraction(A=pdecon_3.XComponent, B=pdecon_5.XComponent)
netsurf = NetworkSurface(CurvesU=reb, CurvesV=sort_4.ValuesStemCrv, Continuity=1)  # -> flatten(StemBase)
panel_2 = Panel("""0
0.001
0.999
1""")
inner_chine_2 = Curve(bang.Branch0)
outer_chine_2 = Curve(bang.Branch1)
eval = EvaluateCurve(Curve=reparameterize(graft(inner_chine_2)), Parameter=panel_2)  # -> Point, Tangent, Angle
eval_2 = EvaluateCurve(Curve=reparameterize(graft(outer_chine_2)), Parameter=panel_2)  # -> Point, Tangent, Angle
x_tremez = Extremes(Curve=inner_chine_2, Plane=PlaneYZ(0, 0, 0))  # -> Highest, Lowest
x_tremez_2 = Extremes(Curve=outer_chine_2, Plane=PlaneYZ(0, 0, 0))  # -> Highest, Lowest
pdecon_6 = Deconstruct(Point=eval.Point)  # -> XComponent, YComponent, ZComponent
pdecon_7 = Deconstruct(Point=eval_2.Point)  # -> XComponent, YComponent, ZComponent
pdecon_8 = Deconstruct(Point=x_tremez.Lowest)  # -> XComponent, YComponent, ZComponent
pdecon_9 = Deconstruct(Point=x_tremez_2.Lowest)  # -> XComponent, YComponent, ZComponent
sort_5 = SortList(Keys=pdecon_7.XComponent, ValuesA=eval_2.Point)  # -> Keys, ValuesA
sort_6 = SortList(Keys=pdecon_6.XComponent, ValuesA=eval.Point)  # -> Keys, ValuesA
expression = Expression(y=pdecon_8.YComponent, f=multiplication, Expression="ABS(y)*f")
item_4 = ListItem(List=sort_5.ValuesA, Index=0, Wrap=True)  # -> Item, Item1
expression_2 = Expression(y=pdecon_9.YComponent, f=multiplication, Expression="ABS(y)*f")
item_5 = ListItem(List=sort_6.ValuesA, Index=0, Wrap=True)  # -> Item, Item1
vec2pt = Vector2Pt(PointA=item_5.Item1, PointB=item_5.Item, Unitize=True)  # -> Vector, Length
vec2pt_2 = Vector2Pt(PointA=item_4.Item1, PointB=item_4.Item, Unitize=True)  # -> Vector, Length
panel_3 = Panel(expression)
vdis = VectorDisplay(Anchor=item_5.Item, Vector=vec2pt.Vector)
vdis_2 = VectorDisplay(Anchor=item_4.Item, Vector=vec2pt_2.Vector)
panel_4 = Panel(expression_2)
multiplication_2 = Multiplication(A=flatten(vec2pt.Vector), Mult=expression)
multiplication_3 = Multiplication(A=flatten(vec2pt_2.Vector), Mult=expression_2)
multiplication_4 = Multiplication(A=flatten(vec2pt.Vector), Mult=subtraction, C=multiplication)
multiplication_5 = Multiplication(A=flatten(vec2pt_2.Vector), Mult=subtraction, C=multiplication)
panel_5 = Panel(subtraction)
bzspan = BezierSpan(StartPoint=x_tremez.Lowest, StartTangent=multiplication_2, EndPoint=x_tremez_2.Lowest, EndTangent=multiplication_3)  # -> StemCrv, Length, Domain
bzspan_2 = BezierSpan(StartPoint=x_tremez.Lowest, StartTangent=multiplication_4, EndPoint=x_tremez_2.Lowest, EndTangent=multiplication_5)  # -> StemCrv, Length, Domain
crv_4 = Curve(reb)
crv_5 = Curve(flatten([flip_2.Curve, bzspan_2.StemCrv]))
C = ClusterOutput(flip_2.Curve)
stem_side_crv = ClusterOutput(reb)
stem_base = ClusterOutput(netsurf)
stem_crv = ClusterOutput(sort_4.ValuesStemCrv)
profile_crv = ClusterOutput(intcrv.ProfileCrv)
netsurf_2 = NetworkSurface(CurvesU=crv_4, CurvesV=crv_5, Continuity=1)  # -> flatten(StemBase)

# ==== cluster Cluster_4
C = ClusterInput()
end = EndPoints(Curve=C)  # -> Start, End
pdecon = Deconstruct(Point=end.Start)  # -> XComponent, YComponent, ZComponent
pdecon_2 = Deconstruct(Point=end.End)  # -> XComponent, YComponent, ZComponent
larger = LargerThan(FirstNumber=pdecon.XComponent, SecondNumber=pdecon_2.XComponent)  # -> LargerThan, OrEqualTo
dispatch = Dispatch(List=C, DispatchPattern=larger.LargerThan)  # -> ListA, ListB
flip = FlipCurve(Curve=dispatch.ListA)  # -> Curve, Flag
curve_direction_ve = Curve(reverse([dispatch.ListB, flip.Curve]))
curve_direction_ve_2 = ClusterOutput(curve_direction_ve)

# ==== cluster CamberedDeckSrf: Cambered Deck fromdividing Sheer lines & adding CL offset to make arc
relay = ClusterInput()
relay_2 = ClusterInput()
relay_3 = ClusterInput()
camber = ClusterInput()
number_slider = Slider(35, range=0..100)
ext = ExtendCurve(Curve=relay_2, Type=2, Start=expr("-x", number_slider), End=0)
ext_2 = ExtendCurve(Curve=relay_3, Type=2, Start=expr("-x", number_slider), End=0)
number_slider_2 = Slider(113, range=0..1000)
tweencrv = TweenCurve(CurveA=relay_2, CurveB=relay_3, Factor=0.5, BlendType=0)
divdist = DivideDistance(Curve=tweencrv, Distance=number_slider_2)  # -> Points, Tangents, Parameters
divdist_2 = DivideDistance(Curve=[ext_2, ext], Distance=number_slider_2)  # -> Points, Tangents, Parameters
cull_i = CullIndex(List=divdist_2.Points, Indices="-1", Wrap=True)
flip = FlipMatrix(Data=divdist.Points)
flip_2 = FlipMatrix(Data=cull_i)
dispatch = Dispatch(List=flip_2, DispatchPattern=[True, False])  # -> ListA, ListB
dist = Distance(PointA=dispatch.ListA, PointB=dispatch.ListB)
cull_i_2 = CullIndex(List=flatten(dist), Indices="0", Wrap=True)
item = ListItem(List=flatten(dist), Index="0", Wrap=True)
multiplication = Multiplication(A=cull_i_2, Camber=camber)
multiplication_2 = Multiplication(A=item, B=camber, C=Slider(0.7, range=0..1))
Z = UnitZ(Factor=flatten([multiplication_2, multiplication]))  # -> graft(UnitVector)
move = Move(Geometry=flip, Motion=Z)  # -> Geometry, Transform
arc = Arc3Pt(SheerPt=dispatch.ListA, PointB=move.Geometry, SheerPt_2=dispatch.ListB)  # -> CamberCrv, Plane, Radius
midpt = CurveMiddle(Curve=relay)
merge = Merge(Data1=midpt, Data2=move.Geometry)  # -> flatten(Result)
merge_2 = Merge(Data1=relay, Data2=arc.CamberCrv)
intcrv = Interpolate(Vertices=merge, Degree=3, Periodic=False, KnotStyle=1)  # -> Curve, Length, Domain
merge_3 = Merge(Data1=relay_2, Data2=intcrv.Curve, Data3=relay_3)
netsurf = NetworkSurface(CurvesU=merge_3, CurvesV=flatten(merge_2), Continuity=2)
S = ClusterOutput(netsurf)

# ==== cluster DeckCamberFromMidPoint: Deck Camber from mid-point
camber = ClusterInput()
stem_crv = ClusterInput()
C = ClusterInput()
C_2 = ClusterInput()
subcrv = SubCurve(BaseCurve=graft([C, C_2]), Domain=["[0 to 0.5]", "[0.5 to 1.0]"])
end = EndPoints(Curve=flatten(subcrv))  # -> Start, End
item = ListItem(List=end.Start, Index=1, Wrap=True)  # -> flatten(Item), Item1, Item2
flip = FlipCurve(Curve=stem_crv)  # -> Curve, Flag
dispatch = Dispatch(List=item.Item, DispatchPattern=[True, False])  # -> ListA, ListB
pt = Point([item.Item, item.Item2])
dist = Distance(PointA=item.Item, PointB=item.Item2)
ln = Line(StartPoint=item.Item, EndPoint=item.Item2)
midpt = CurveMiddle(Curve=ln)
multiplication = Multiplication(A=dist, Camber=camber)
item_2 = ListItem(List=flatten(subcrv), Index=0, Wrap=True)  # -> Item, Item1, Item2, Item3
Z = UnitZ(Factor=flatten(multiplication))  # -> graft(UnitVector)
dispatch_2 = Dispatch(List=flatten(item_2.Item), DispatchPattern=[True, False])  # -> ListA, ListB
move = Move(Geometry=midpt, Motion=Z)  # -> Geometry, Transform
flip_2 = FlipCurve(Curve=item_2.Item)  # -> Curve, Flag
flip_3 = FlipCurve(Curve=item_2.Item2)  # -> Curve, Flag
arc = Arc3Pt(SheerPt=item.Item, PointB=move.Geometry, SheerPt_2=item.Item2)  # -> CamberCrv, Plane, Radius
crv = Curve(dispatch_2.ListA)
crv_2 = Curve(item_2.Item1)
swp2 = Sweep2(Rail1=flip_2.Curve, Rail2=flip_3.Curve, Sections=arc.CamberCrv, SameHeight=False)
swp2_2 = Sweep2(Rail1=item_2.Item1, Rail2=item_2.Item3, Sections=arc.CamberCrv, SameHeight=False)
debrep = DeconstructBrep(Brep=swp2)  # -> Faces, Edges, Vertices
item_3 = ListItem(List=debrep.Edges, Index=Slider(1, range=0..10), Wrap=True)
crv_3 = Curve(item_3)
loft = Loft(
    Curves=flatten([item_3, flip.Curve]),
    Options={Adjust=False, Closed=False, LoftEnds=0, LoftSimp=0, LoftType=0, Rebuild=10, Refit=0.01})
join = BrepJoin(Breps=flatten([swp2, swp2_2, loft]))  # -> _5050CamberedDeck, Closed
_50_50_cambered_deck = ClusterOutput(join._5050CamberedDeck)
rear_s = ClusterOutput(swp2_2)
front_s = ClusterOutput(swp2)
stem = ClusterOutput(loft)

# ==== cluster StemDeckCrv
f = ClusterInput()
crv_1 = ClusterInput()
crv_2 = ClusterInput()
end = EndPoints(Curve=crv_1)  # -> Start, End
end_2 = EndPoints(Curve=crv_2)  # -> Start, End
flip = FlipCurve(Curve=crv_2)  # -> Curve, Flag
eval = EvaluateCurve(Curve=reparameterize(crv_1), Parameter=0.001)  # -> Point, Tangent, Angle
eval_2 = EvaluateCurve(Curve=reparameterize(flip.Curve), Parameter=0.001)  # -> Point, Tangent, Angle
pdecon = Deconstruct(Point=end.Start)  # -> XComponent, YComponent, ZComponent
pdecon_2 = Deconstruct(Point=end.End)  # -> XComponent, YComponent, ZComponent
vec2pt = Vector2Pt(PointA=eval.Point, PointB=end.Start, Unitize=True)  # -> Vector, Length
vec2pt_2 = Vector2Pt(PointA=eval_2.Point, PointB=end_2.End, Unitize=True)  # -> Vector, Length
eval_3 = Evaluate(F="if(ABS(x)<ABS(y),ABS(x)*f,ABS(y)*f)", x=pdecon.YComponent, y=pdecon_2.YComponent, f=f)
multiplication = Multiplication(A=vec2pt.Vector, Mult=eval_3)
multiplication_2 = Multiplication(A=vec2pt_2.Vector, Mult=eval_3)
bzspan = BezierSpan(StartPoint=end.Start, StartTangent=multiplication, EndPoint=end_2.End, EndTangent=multiplication_2)  # -> StemCrv, Length, Domain
stem_crv = ClusterOutput(bzspan.StemCrv)

# ==== cluster Cluster_3
inner_chine = ClusterInput()
outer_chine = ClusterInput()
f = ClusterInput()
panel = Panel("""0
0.001
0.999
1""")
inner_chine_2 = Curve(inner_chine)
outer_chine_2 = Curve(outer_chine)
eval = EvaluateCurve(Curve=reparameterize(graft(inner_chine_2)), Parameter=panel)  # -> Point, Tangent, Angle
eval_2 = EvaluateCurve(Curve=reparameterize(graft(outer_chine_2)), Parameter=panel)  # -> Point, Tangent, Angle
x_tremez = Extremes(Curve=inner_chine_2, Plane=PlaneYZ(0, 0, 0))  # -> Highest, Lowest
x_tremez_2 = Extremes(Curve=outer_chine_2, Plane=PlaneYZ(0, 0, 0))  # -> Highest, Lowest
pdecon = Deconstruct(Point=eval.Point)  # -> XComponent, YComponent, ZComponent
pdecon_2 = Deconstruct(Point=eval_2.Point)  # -> XComponent, YComponent, ZComponent
pdecon_3 = Deconstruct(Point=x_tremez.Lowest)  # -> XComponent, YComponent, ZComponent
pdecon_4 = Deconstruct(Point=x_tremez_2.Lowest)  # -> XComponent, YComponent, ZComponent
sort = SortList(Keys=pdecon_2.XComponent, ValuesA=eval_2.Point)  # -> Keys, ValuesA
sort_2 = SortList(Keys=pdecon.XComponent, ValuesA=eval.Point)  # -> Keys, ValuesA
expression = Expression(y=pdecon_3.YComponent, f=f, Expression="ABS(y)*f")
item = ListItem(List=sort_2.ValuesA, Index=0, Wrap=True)  # -> Item, Item1
item_2 = ListItem(List=sort.ValuesA, Index=0, Wrap=True)  # -> Item, Item1
expression_2 = Expression(y=pdecon_4.YComponent, f=f, Expression="ABS(y)*f")
vec2pt = Vector2Pt(PointA=item.Item1, PointB=item.Item, Unitize=True)  # -> Vector, Length
vec2pt_2 = Vector2Pt(PointA=item_2.Item1, PointB=item_2.Item, Unitize=True)  # -> Vector, Length
panel_2 = Panel(expression)
vdis = VectorDisplay(Anchor=item.Item, Vector=vec2pt.Vector)
vdis_2 = VectorDisplay(Anchor=item_2.Item, Vector=vec2pt_2.Vector)
panel_3 = Panel(expression_2)
multiplication = Multiplication(A=flatten(vec2pt.Vector), Mult=expression)
multiplication_2 = Multiplication(A=flatten(vec2pt_2.Vector), Mult=expression_2)
bzspan = BezierSpan(StartPoint=x_tremez.Lowest, StartTangent=multiplication, EndPoint=x_tremez_2.Lowest, EndTangent=multiplication_2)  # -> StemCrv, Length, Domain
stem_crv = ClusterOutput(bzspan.StemCrv)
