# Grasshopper definition displacement_hull_pts.gh (Grasshopper 1.0.8)
# Copyright: © 2023 SYD all rights reserved

chine_points = Panel("""{5.39, -64.417, 821.426}
{5.28, -81.76, 788.569}
{1000.0, -523.449, 150.234}
{979.592, -664.378, 144.225}
{59.694, -16.381, -178.574}
{58.475, -20.791, -171.431}
{1000.0, -334.411, 44.078}
{979.592, -424.445, 42.315}
{1000.0, -587.397, 654.699}
{979.592, -745.543, 628.511}
{303.338, -787.879, 738.293}
{297.148, -1000, 708.761}
{300.803, -634.117, 150.234}
{294.664, -804.841, 144.225}
{0, 0, 0}""")
round_bilge_pts = Panel("""{-59.334, -43.785, 632.55}
{893.596, -404.189, 48.687}
{53.342, -18.563, -237.34}
{893.596, -189.97, -43.657}
{893.596, -476.655, 487.516}
{271.062, -892.829, 560.234}
{268.796, -756.376, 48.687}
{626.208, -864.368, 48.687}
{265.619, -437.581, -333.498}
{641.587, -718.209, -367.45}
{594.609, -1000, 487.781}
{-106.404, 0, -128.53}
{-104.433, 0, 232.617}
{-8.47, -20.602, -335.734}
{0, 0, -82}""")
chine_pts = Panel("""{4.816, -72.997, 714.55}
{893.596, -593.176, 130.687}
{53.342, -18.563, -155.34}
{893.596, -378.957, 38.343}
{893.596, -665.642, 569.516}
{271.062, -892.829, 642.234}
{268.796, -718.586, 130.687}
{626.208, -864.368, 130.687}
{265.619, -437.581, -251.498}
{641.587, -762.87, -285.45}
{594.609, -1000, 569.781}
{-106.404, 0, -46.53}
{-104.433, 0, 314.617}
{-8.47, -53.465, -253.734}
{0, 0, 0}""")
imported_pt_o = Object()
D = Number()
loa = Number()
boa = Number()
G = Gate()

# ---- group: Base Template layers
panel = Panel("""{-143.462, 101.363, 731.735}
{824.614, 713.142, 48.982}
{824.614, 4.467, -150.94}
{824.614, 777.793, 515.729}
{46.683, 1000.0, 729.821}
{104.465, 636.514, 317.934}
{824.614, 713.142, 48.982}
{135.304, 3.619, -268.265}
{355.672, 805.891, 580.549}
{-175.386, 0, 355.238}
{-42.157, 35.749, 69.077}
{0, 0, 0}""")
pt = Point(panel)
panel_2 = Panel("""0 Stem-sheer bPt
2 Chine stern bPt
4 Bilge stern bPt
5 Transom bPt
0 Stem-sheer ePt
1 Chine ePt
2 Chine stern ePt
4 Bilge stern ePt
5 Transom ePt
1 Chine intersect Ht
Bow angle aPt
Base Pt""")

# ---- group: Count is right - then use imported layers
lng = ListLength(List=imported_pt_o)
object = ModelObject(ImportedPtO=imported_pt_o)  # -> Object, Geometry, Name
equals = Equality(FirstNumber=lng, SecondNumber=15)  # -> Equality, Inequality
weave = Weave(Pattern=equals.Equality, Stream0=pt, Stream1=object.Geometry, NullGaps=False)
weave_2 = Weave(Pattern=equals.Equality, Stream0=panel_2, Stream1=object.Name, NullGaps=False)

# ----
filter = StreamFilter(Gate=G, Stream1=chine_pts, Stream2=round_bilge_pts)
pt_2 = ConstructPoint(XCoordinate=0, YCoordinate=0, ZCoordinate=0)
layers = QueryModelLayers(Name="G=input-hull", AutoUpdateState=True)

# ---- group: Embedded Crv
crv = Curve(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)

# ----
layer = ModelLayer(Name="G=input-trans", DisplayColour=ColourSwatch(SwatchColor=RGB(255, 255, 255)))
pt_3 = Point([filter, weave])
loa_2 = Number(loa)
D_2 = Number(D)
boa_2 = Number(boa)
scale_nu = ScaleNU(Geometry=pt_3, Plane=pt_2, ScaleX=loa_2, ScaleY=boa_2, ScaleZ=D_2)  # -> ScaledPts, Transform
panel_3 = Panel(object.Name)
pdecon = Deconstruct(Point=scale_nu.ScaledPts)  # -> XComponent, YComponent, ZComponent
sort = SortList(Keys=pdecon.XComponent)  # -> reverse(MaxX), ValuesA
object_2 = ModelObject(Geometry=scale_nu.ScaledPts, Name=weave_2, Layer=layers)  # -> simplify(OriginPtsO), Geometry
panel_4 = Panel(object_2.OriginPtsO)
item = ListItem(List=sort.MaxX, Index=0, Wrap=True)
max_x = Number(item)
origin_pts_o = Object(object_2.OriginPtsO)
max_x_2 = Number(max_x)
panel_5 = Panel(object_2.Geometry)

# ---- group: Transom
pt_4 = ConstructPoint(XCoordinate=0, YCoordinate=0, ZCoordinate=0)

# ---- group: Transom / Scale trans vertically
scale_nu_2 = ScaleNU(Geometry=crv, Plane=pt_4, ScaleX=1, ScaleY=1, ScaleZ=D_2)  # -> ScaledTrans, Transform

# ---- group: Transom (continued)
object_3 = ModelObject(Geometry=scale_nu_2.ScaledTrans, Name="Transom Crv", Layer=layer)  # -> simplify(TransmCrvO), Geometry

# ----
transm_crv_o = Object(object_3.TransmCrvO)
