# Grasshopper definition extraa_bhds.gh (Grasshopper 1.0.8)
# Copyright: © SYD 2022

curves_to_be_removed_from_bhds = CurvesToBeRemovedFromBHDs()
direction = Direction()
vessel_o = Object()
A = FragmentA()
C = Curve()
object = ModelObject(VesselO=vessel_o)  # -> Object, Geometry, Layer
explode = Explode(Curve=C, Recursive=True)  # -> Segments, Vertices
project = Project(BHEnclosedCrv=explode.Segments, Vessel=object.Object, Direction=direction)  # disabled
Z = UnitZ(Factor=-4000)
amp = Amplitude(Vector=direction, Amplitude=expr("-x", "20000"))
move = Move(BHCrossingCrv=explode.Segments, Motion=amp)  # -> Geometry, Transform
Z_2 = UnitZ(Factor=8000)
amp_2 = Amplitude(Vector=direction, Amplitude=expr("2*x", "20000"))
extr = Extrude(Base=move.Geometry, Direction=amp_2)
bbox = BoundingBox(Content=object.Object, Plane=PlaneXY(0, 0, 0))  # -> flatten(Box), Box_2
split = SplitBrep(Brep=extr, Cutter=object.Object)  # -> simplify(Result)
shapein = ShapeInBrep(Brep=bbox.Box, Shape=flatten(split))
sift = SiftPattern(List=flatten(split), SiftPattern=shapein)  # -> Output0, Output1
clean = CleanTree(RemoveNulls=True, RemoveInvalid=True, RemoveEmpty=False, Tree=sift.Output0)
debrep = DeconstructBrep(Brep=clean)  # -> Faces, Edges, Vertices
planar = IsPlanar(Surface=flatten(debrep.Faces), Interior=True)  # -> Planar, Plane
dispatch = Dispatch(List=flatten(debrep.Faces), DispatchPattern=planar.Planar)  # -> ListA, NonPBHDS
wires = BrepWireframe(Brep=dispatch.ListA, Density=-1)
partial_bulkheads = BoundarySurfaces(EdgeCrvs=flatten([wires, curves_to_be_removed_from_bhds]))
concat = Concatenate(FragmentA=A, FragmentB="flat", JoinSeparator=" ")
concat_2 = Concatenate(FragmentA=A, FragmentB="NonP", JoinSeparator=" ")
layers = QueryModelLayers(Name="G-hull-bhd", AutoUpdateState=True)
clean_2 = CleanTree(RemoveNulls=True, RemoveInvalid=True, RemoveEmpty=False, Tree=[dispatch.ListA, partial_bulkheads])
clean_3 = CleanTree(RemoveNulls=True, RemoveInvalid=True, RemoveEmpty=False, Tree=dispatch.NonPBHDS)
object_2 = ModelObject(Geometry=clean_3, Name=concat_2, Layer=layers)
object_3 = ModelObject(Geometry=clean_2, Name=concat, Layer=layers)
u_text = UserText(Content=object_3, Keys="Category", Values=concat, UserTextMode=1)
u_text_2 = UserText(Content=object_2, Keys="Category", Values=concat_2, UserTextMode=1)
clean_4 = CleanTree(RemoveNulls=True, RemoveInvalid=True, RemoveEmpty=False, Tree=u_text)
clean_5 = CleanTree(RemoveNulls=True, RemoveInvalid=True, RemoveEmpty=False, Tree=u_text_2)
T = Tree(clean_4)
T_2 = Tree(clean_5)
