# Grasshopper definition extrude_straight.gh (Grasshopper 1.0.8)
# Copyright: © SYD 2022
# plug-ins: Pufferfish
# HullZero module that generates a planing hull from topside & canoeBody surfaces. Additional Grasshopper components remove sold volumes from the base geometry

G = Geometry()
dist = Factor()
crv = Curve()
crv_2 = Curve(crv)
planar = Planar(Curve=G)  # -> Planar, Plane, Deviation
X = UnitX(Factor=5000)
project = Project(Geometry=G, Plane=planar.Plane)  # -> Geometry, Transform
extr = Extrude(Base=crv_2, Direction=X)
Y = UnitY(Factor=dist)
clscrv = CloseCurve(Curve=project.Geometry, CloseType=0, Bulge=0.5, Tolerance=0)  # -> Closed, R
mirror = Mirror(Geometry=extr, Plane=planar.Plane)  # -> Geometry, Transform
extr_2 = Extrude(Base=clscrv.Closed, Direction=Y)
move = Move(Geometry=extr_2, Motion=expr("-x/2", Y))  # -> Geometry, Transform
split = SplitBrep(Brep=move.Geometry, Cutter=[mirror.Geometry, extr])
trim = TrimSolid(Shape=move.Geometry, Cutters=extr)
cap = CapHoles(Brep=extr_2)
B = Brep(cap)
