# Grasshopper definition fetch_pts.gh (Grasshopper 1.0.8)
# Copyright: © 2023 SYD all rights reserved

D = Directory()
get = Import()
i = Index()
loa = Number()
boa = Number()
D_2 = Number()
loa_2 = Number(loa)
boa_2 = Number(boa)
D_3 = Number(D_2)
directory = QueryDirectory(Directory=D, MaxDepth=2, Name=".3dm")
tsort = SortText(Keys=directory, Culture=127)  # -> Keys, Values

# ---- group: Display only filename
split = TextSplit(Text=tsort.Keys, Separators="\")
item = ListItem(List=split, Index=-1, Wrap=True)  # -> flatten(Item)
len = TextLength(Text=item)
fragment = TextFragment(Text=item, Start=0, Count=expr("x-4", len))
item_2 = ListItem(List=fragment, Index=i, Wrap=True)

# ----
item_3 = ListItem(List=tsort.Keys, Index=i, Wrap=True)
import_definition = ImportModelBlockDefinition(FilePath=item_3, UpdateType=0, Import=get)
name = Text(item_2)
block_definition = ModelBlockDefinition(BlockDefinition=import_definition)  # -> BlockDefinition, reverse(UnitPtsO), Name
object = ModelObject(Object=block_definition.UnitPtsO)  # -> Object, Name
tmatch = MatchText(Text=object.Name, Pattern="*Base*", Case=True)
dispatch = Dispatch(List=object.Object, DispatchPattern=tmatch)  # -> ListA, ListB
pt = ConstructPoint(XCoordinate=0, YCoordinate=0, ZCoordinate=0)
null = NullItem(Item=dispatch.ListA)  # -> NullFlags, InvalidFlags, Description
dispatch_2 = Dispatch(List=dispatch.ListA, DispatchPattern=null.NullFlags)  # -> ListA, ListB
combine = CombineData(Input0=dispatch_2.ListB, Input1=pt)  # -> Result, Index
scale_nu = ScaleNU(Geometry=block_definition.UnitPtsO, Plane=combine.Result, ScaleX=loa_2, ScaleY=boa_2, ScaleZ=D_3)  # -> ScaledPts, Transform
object_2 = ModelObject(Geometry=scale_nu.ScaledPts, Name=object.Name)  # -> simplify(ScaledPtsO)
u_text = UserText(Content=object_2, UserTextMode=1)  # -> ScaledPtsO, Keys, Values
name_2 = Text(name)
scaled_pts_o = Object(object_2)
