# Grasshopper definition frame.gh (Grasshopper 1.0.8)
# Copyright: © 2023 SYD all rights reserved
# plug-ins: Pufferfish, ClipperComponents

cutting_crv = Geometry()
D = Distance()
object = ModelObject()
cl_pl = Plane()
object_2 = ModelObject(object)

join = JoinCurves(Curves=object_2, Preserve=False)
planar = Planar(Curve=object_2)  # -> Planar, Plane, Deviation
Z = UnitZ(Factor=-5000)
polyoffset = PolylineOffset(
    Polylines=simplify(graft(join)),
    Distance=D,
    Plane=simplify(graft(planar.Plane)),
    Tolerance=0.1,
    ClosedFillet=1,
    OpenFillet=1,
    Miter=2)  # -> Contour, flatten(Holes)
move = Move(CuttingCrv=cutting_crv, Motion=Z)  # -> Geometry, Transform
end = EndPoints(Curve=polyoffset.Holes)  # -> Start, End
extr = Extrude(Base=move.Geometry, Direction=expr("-x*2", Z))
end_2 = EndPoints(Curve=object_2)  # -> Start, End
pdecon = Deconstruct(Point=end.Start)  # -> XComponent, YComponent, ZComponent
pdecon_2 = Deconstruct(Point=end_2.Start)  # -> XComponent, YComponent, ZComponent
sort = SortList(Keys=pdecon.XComponent, ValuesA=polyoffset.Holes)  # -> Keys, graft(ValuesA)
sort_2 = SortList(Keys=pdecon_2.XComponent, ValuesA=object_2)  # -> Keys, ValuesA

Y = UnitY(Factor=5000)
extr_2 = Extrude(Base=extr, Direction=Y)
mirror = Mirror(Geometry=extr_2, Plane=cl_pl)  # -> Geometry, Transform
trim = TrimWithBreps(Curve=sort.ValuesA, Brep=extr_2)  # -> Inside, Outside
clscrv = CloseCurve(Curve=trim.Outside, CloseType=0, Bulge=0.5, Tolerance=0)  # -> flatten(Closed), R
trim_2 = TrimWithBreps(Curve=clscrv.Closed, Brep=mirror.Geometry)  # -> Inside, flatten(Outside)
clscrv_2 = CloseCurve(Curve=trim_2.Outside, CloseType=0, Bulge=0.5, Tolerance=0)  # -> simplify(graft(Closed)), R
entwine = Entwine(Branch00=sort_2.ValuesA, Branch01=clscrv_2.Closed, FlattenInputs=True)
flip = FlipMatrix(Data=entwine)
boundary = BoundarySurfaces(Edges=[clscrv_2.Closed, sort_2.ValuesA])
object_3 = ModelObject(Object=object_2, Geometry=boundary)
u_text = UserText(Content=object_3, Keys="Category", Values="Frame", UserTextMode=1)  # -> Content, Keys, Values
frame_o = Content(u_text.Content)
