# Grasshopper definition frp.gh (Grasshopper 1.0.8)
# Copyright: © 2023 SYD all rights reserved

material = ValueList({"Aluminium": "Aluminium,2700,207,310", "Steel HR": "Steel,8000,345,450", "Stainless 316": "Stainless steel 316,8100,517,600", "Bronze": "Bronze,7800.00,300,400, "Carbon Epoxy": "Carbon Epoxy,1700.00,600,900", "Kevlar Epoxy": "Kevlar Epoxy,1400.00,380,410"}, selected="Kevlar Epoxy")  # disabled
type = Type({"Concrete": 0, "Steel": 1, "Timber": 2, "Aluminium": 3, "Masonry": 4, "FRP": 5, "Glass": 6, "Fabric": 7, "Rebar": 8, "Tendon": 9, "ColdFormed": 10, "Other": 11}, selected="FRP")  # disabled
eglassepoxy = Panel("EglassEpoxy")  # disabled
panel = Panel("3")  # disabled
panel_2 = Panel("0.39")  # disabled
panel_3 = Panel("1300")  # disabled
split = TextSplit(Text=material, Separators=",")  # disabled
item = ListItem(List=split, Index=0, Wrap=True)  # -> Item, Item1, Item2, Item3; disabled
panel_4 = Panel(item.Item2)  # disabled
panel_5 = Panel(item.Item3)  # disabled
panel_6 = Panel(item.Item)  # disabled
panel_7 = Panel(item.Item1)  # disabled
merge = Merge(Data1=eglassepoxy, Data2=panel_3, Data3=type)  # disabled
type_2 = Type({"Concrete": 0, "Steel": 1, "Timber": 2, "Aluminium": 3, "Masonry": 4, "FRP": 5, "Glass": 6, "Fabric": 7, "Rebar": 8, "Tendon": 9, "ColdFormed": 10, "Other": 11, "StructuralCore": 12}, selected="StructuralCore")
type_3 = Type({"Concrete": 0, "Steel": 1, "Timber": 2, "Aluminium": 3, "Masonry": 4, "FRP": 5, "Glass": 6, "Fabric": 7, "Rebar": 8, "Tendon": 9, "ColdFormed": 10, "Other": 11}, selected="FRP")
type_4 = Type({"Concrete": 0, "Steel": 1, "Timber": 2, "Aluminium": 3, "Masonry": 4, "FRP": 5, "Glass": 6, "Fabric": 7, "Rebar": 8, "Tendon": 9, "ColdFormed": 10, "Other": 11}, selected="FRP")
type_5 = Type({"Concrete": 0, "Steel": 1, "Timber": 2, "Aluminium": 3, "Masonry": 4, "FRP": 5, "Glass": 6, "Fabric": 7, "Rebar": 8, "Tendon": 9, "ColdFormed": 10, "Other": 11}, selected="FRP")
entwine = Entwine(Branch00=type_2, Branch01="200", Branch02=0, FlattenInputs=True)
entwine_2 = Entwine(Branch00=type_2, Branch01="130", Branch02=0, FlattenInputs=True)
entwine_3 = Entwine(Branch00=type_2, Branch01="80", Branch02=0, FlattenInputs=True)
entwine_4 = Entwine(Branch00=type_2, Branch01="100", Branch02=0, FlattenInputs=True)
entwine_5 = Entwine(Branch00=type_3, Branch01="1300", Branch02="1300", Branch03="1300", FlattenInputs=True)
entwine_6 = Entwine(Branch00=type_4, Branch01="1400", Branch02="380", Branch03="410", FlattenInputs=True)
object = ModelObject(Object="CrossLinked PVC 200", Name="CrossLinked PVC 200")
entwine_7 = Entwine(Branch00=type_5, Branch01="1700", Branch02="600", Branch03="900", FlattenInputs=True)
object_2 = ModelObject(Object="CrossLinked PVC 130", Name="CrossLinked PVC 130")
object_3 = ModelObject(Object="CrossLinked PVC 80", Name="CrossLinked PVC 80")
object_4 = ModelObject(Object="CrossLinked PVC 100", Name="CrossLinked PVC 100")
object_5 = ModelObject(Object="Kevlar/Epoxy", Name="Kevlar/Epoxy")
object_6 = ModelObject(Object="Carbon/Epoxy", Name="Carbon/Epoxy")
object_7 = ModelObject(Object="EglassEpoxy", Name="EglassEpoxy")
u_text = UserText(Content=object_4, Values=flatten(entwine_4), UserTextMode=1)  # -> CCrossLinkedPVC100, Keys, Values
u_text_2 = UserText(Content=object_2, Values=flatten(entwine_2), UserTextMode=1)  # -> CCrossLinkedPVC130, Keys, Values
u_text_3 = UserText(Content=object, Values=flatten(entwine), UserTextMode=1)  # -> CCrossLinkedPVC200, Keys, Values
u_text_4 = UserText(Content=object_3, Values=flatten(entwine_3), UserTextMode=1)  # -> CCrossLinkedPVC80, Keys, Values
u_text_5 = UserText(Content=object_6, Values=flatten(entwine_7), UserTextMode=1)  # -> CarbonEpoxy, Keys, Values
u_text_6 = UserText(Content=object_5, Values=flatten(entwine_6), UserTextMode=1)  # -> KevlarEpoxy, Keys, Values
u_text_7 = UserText(Content=object_7, Values=flatten(entwine_5), UserTextMode=1)  # -> EglassEpoxy, Keys, Values
kevlar_epoxy = Content(u_text_6.KevlarEpoxy)
carbon_epoxy = Content(u_text_5.CarbonEpoxy)
eglass_epoxy = Content(u_text_7.EglassEpoxy)
ccrosslinked_pvc_80 = Content(u_text_4.CCrossLinkedPVC80)
ccrosslinked_pvc_100 = Content(u_text.CCrossLinkedPVC100)
ccrosslinked_pvc_130 = Content(u_text_2.CCrossLinkedPVC130)
ccrosslinked_pvc_200 = Content(u_text_3.CCrossLinkedPVC200)
