# Grasshopper definition generate_text_dot.gh (Grasshopper 1.0.8)
# Copyright: © 2023 SYD all rights reserved

cntrl_pt_o = Object()
ts = TextSettings()
object = ModelObject(CntrlPtO=cntrl_pt_o)  # -> Object, Geometry, Name
as_text = AnnotationTextSettings(TextSettings=ts, ViewOriented=True)  # -> TextSettings, Font, TextHeight
pl_origin = PlaneOrigin(
    Base=graft([PlaneXY(0, 0, 0), PlaneYZ(0, 0, 0), Plane(origin=(0, 0, 0), x=(0, 0, 1), y=(1, 0, 0))]),
    Origin=object.Geometry)

# ---- group: Upgraded : Text Dot
annotation_dot = AnnotationDot(Location=object.Geometry, PrimaryText="+", TextHeight=as_text.TextHeight, Font=as_text.Font)

# ----
text_entity = TextEntity(Plane=pl_origin, Text=object.Name, TextSettings=as_text.TextSettings)
ad = AnnotationDot(annotation_dot)
te = TextEntity(text_entity)
N = Name(object.Name)
