# Grasshopper definition glazing.gh (Grasshopper 1.0.8)
# Copyright: © 2023 SYD all rights reserved
# plug-ins: Pufferfish

bd = BlockDefinition()
A = DomainStart()
B = DomainEnd()
block_definition = ModelBlockDefinition(BlockDefinition=bd)  # -> BlockDefinition, Objects, Name
join = BrepJoin(Breps=block_definition.Objects)  # -> Breps, Closed
edges = BrepEdges(Brep=join.Breps)  # -> Naked, Interior, NonManifold
dom = ConstructDomain(DomainStart=expr("-x/2", A), DomainEnd=expr("x/2", B))
offset = OffsetSurface(Surface=graft(block_definition.Objects), Distance=10, Retrim=True)  # disabled
pframes = PerpFrames(Curve=[edges.Naked, edges.Interior], Count=1, Align=True)  # -> simplify(Frames), Parameters
offsrf = OffsetSurface(Surface=join.Breps, Distance=10, BothSides=0, CreateSolid=True)
cap = CapHoles(Brep=offset)  # disabled
rectangle = Rectangle(Plane=pframes.Frames, XSize=dom, YSize=dom, Radius=5)  # -> Rectangle, Length
item = ListItem(List=edges.Naked, Index=0, Wrap=True)
srf = Surface(rectangle.Rectangle)
loft = Loft(
    Curves=rectangle.Rectangle,
    Options={Adjust=False, Closed=False, LoftEnds=0, LoftSimp=0, LoftType=0, Rebuild=10, Refit=0.01})  # disabled
item_2 = ListItem(List=srf, Index=0, Wrap=True)
cap_2 = CapHoles(Brep=flatten(loft))  # disabled
extrcrv = ExtrudeAlong(Base=[edges.Naked, edges.Interior], Curve=flatten(item_2))
display = DisplayAttributes(IsocurveDensity=-1)  # -> Display, DisplayColour, DisplayMode, IsocurveDensity
display_2 = DisplayAttributes()  # -> Display, DisplayColour, DisplayMode, IsocurveDensity
layers = QueryModelLayers(Name="C-glss", AutoUpdateState=True)
layers_2 = QueryModelLayers(Name="C-glss-frame", AutoUpdateState=True)
object = ModelObject(Geometry=offsrf, Name="Coachroof Window glass", Layer=layers, Display=display.Display)
object_2 = ModelObject(Geometry=extrcrv, Name="Coachroof Window frame", Layer=layers_2, Display=display_2.Display)
frame_o = Object(object_2)
extrude = Extrusion(extrcrv)
glass_o = Object(object)
