# Grasshopper definition graph.gh (Grasshopper 1.0.8)
# Copyright: © 2023 SYD all rights reserved

aspect_r = Number()
scale_x = Number()
values = Number()
P = Point()
T = Text()
ts = TextSettings()
values_2 = Number(values)
aspect_r_2 = Number(aspect_r)
scale_x_2 = Number(scale_x)
lng = ListLength(List=values_2)
pdecon = Deconstruct(Point=P)  # -> XComponent, YComponent, ZComponent
expression = Expression(x=scale_x_2, y=aspect_r_2, Expression="x*y/10000")
sort = SortList(Keys=values_2)  # -> Keys, ValuesA
series = Series(Start=pdecon.XComponent, Step=scale_x_2, Count=lng)
item = ListItem(List=reverse(sort.Keys), Index=0, Wrap=True)
expression_2 = Expression(x=item, y=lng, m=expression, Expression="Ceiling(x*m/y/100)*100")
expression_3 = Expression(Zo=pdecon.ZComponent, Z=values_2, m=expression, Expression="Z*m+Zo")
multiplication = Multiplication(MaxVal=item, ScaleZ=expression)
multiplication_2 = Multiplication(Count=lng, ScaleX=scale_x_2)
X = UnitX(Factor=1)
Z = UnitZ(Factor=1)
line = LineSDL(Origin=P, Direction=Z, Length=expr("x*1.1", multiplication))
line_2 = LineSDL(Origin=P, Direction=X, Length=multiplication_2)
pt = ConstructPoint(XCoordinate=series, YCoordinate=pdecon.YComponent, ZCoordinate=expr("x-50", pdecon.ZComponent))
division = Division(A=multiplication, B=expression_2)
pt_2 = ConstructPoint(XCoordinate=series, YCoordinate=pdecon.YComponent, ZCoordinate=expression_3)
as_text = AnnotationTextSettings(TextSettings=ts)  # -> TextSettings, TextHeight
multiplication_3 = Multiplication(A=as_text.TextHeight, _50=50)
multiplication_4 = Multiplication(A=as_text.TextHeight, _10=100)
as_text_2 = AnnotationTextSettings(TextSettings=ts, TextHeight=multiplication_3)
as_text_3 = AnnotationTextSettings(TextSettings=ts, TextHeight=multiplication_4)
intcrv = Interpolate(Vertices=pt_2, Degree=2, Periodic=False, KnotStyle=1)  # -> Curve, Length, Domain
linetype = ModelLinetype(Name="Graph", Width=3, WidthUnits=0)  # -> ModelLinetype, Name, Segments, CapStyle, JoinStyle, Width, WidthUnits
concat = Concatenate(FragmentA=T, FragmentB=" report")
concat_2 = Concatenate(FragmentA=T, FragmentB=" graph")
concat_3 = Concatenate(FragmentA=T, FragmentB="pts")
layers = QueryModelLayers(Name="G-anno", AutoUpdateState=True)
layers_2 = QueryModelLayers(Name="G-anno-text", AutoUpdateState=True)
drafting = DraftingAttributes(Linetype=linetype.ModelLinetype, LinetypeScale=100)  # -> Drafting, Linetype, LinetypeScale, PrintColour, PrintWidth, DrawOrder
object = ModelObject(Geometry=intcrv.Curve, Name=concat_2, Layer=layers, Drafting=drafting.Drafting)
object_2 = ModelObject(Geometry=pt_2, Name=concat_3, Layer=layers, Drafting=drafting.Drafting)
graph_o = Object(object)
maximum = Item(item)
pts_o = Object(object_2)
layers_3 = QueryModelLayers(Name="G-anno", AutoUpdateState=True)
object_3 = ModelObject(Name="Report", Layer=layers_3)

# ---- group: Offset Tics
panel = Panel("100")
expression_4 = Expression(P=P, d=panel, Expression="{p.x-d/2,p.y,p.z}")
line_3 = LineSDL(Start=expression_4, Direction=Vector(1, 0, 0), Length=panel)
line_4 = LineSDL(Start=Point(0, 0, 0), Direction=Vector(0, 0, 1), Length=panel)
transform = Transform(Geometry=line_4, Transform=pt)

# ---- group: Offset text
pl_origin = PlaneOrigin(Base=Plane(origin=(0, 0, 0), x=(0, 0, 1), y=(1, 0, 0)), Origin=P)
series_2 = Series(Start=0, Step=expression_2, Count=expr("x+1", division))
Z_2 = UnitZ(Factor=series_2)
prot = RotatePlane(Plane=pl_origin, Angle=degrees(90))
X_2 = UnitX(Factor=expr("-x*2", panel))
addition = Addition(A=X_2, B=Z_2)
transform_2 = Transform(Geometry=prot, Transform=addition)

# ---- group: Offset Tics (continued)
transform_3 = Transform(Geometry=line_3, Transform=Z_2)

# ---- group: title
X_3 = UnitX(Factor=expr("-x*6", panel))
midpt = CurveMiddle(Curve=line)
move = Move(Geometry=midpt, Motion=X_3)  # -> Geometry, Transform
pl_origin_2 = PlaneOrigin(Base=Plane(origin=(0, 0, 0), x=(0, 0, 1), y=(1, 0, 0)), Origin=move.Geometry)

# ----
text_entity = TextEntity(Plane=transform_2, Text=series_2, TextSettings=as_text.TextSettings)
text_entity_2 = TextEntity(Plane=pl_origin_2, Text=T, TextSettings=as_text.TextSettings)
object_4 = ModelObject(Geometry=flatten([line_2, transform, line, text_entity, transform_3]), Name=concat, Layer=layers)
object_5 = ModelObject(Geometry=text_entity_2, Name=concat, Layer=layers_2)
block_definition = ModelBlockDefinition(Objects=flatten([object, object_4, object_5]), Name=concat)
title_o = Object(object_5)
axes_o = Object(object_4)
bd = BlockDefinition(block_definition)
