# Grasshopper definition import_blocks.gh (Grasshopper 1.0.8)
# Copyright: © 2023 SYD all rights reserved

subdirectory = FragmentB()
directory = FragmentA()
import = Boolean()
concat = Concatenate(FragmentA=directory, Subdirectory=subdirectory)
c_script = CSharpScript(Folder=concat, Pattern="*.3dm")  # -> out, Files; inputs Folder: String, Pattern: String
# ---------- c_script: C# ----------
    // Ensure valid search pattern.
    if (string.IsNullOrEmpty(Pattern))
      Pattern = "*";

    // Perform file search.
    Files = System.IO.Directory.GetFiles(Folder, Pattern);
# ---------- end c_script ----------
import_2 = Boolean(import)
split = TextSplit(Text=c_script.Files, Separators="\")  # -> simplify(Result)
lng = ListLength(List=c_script.Files)  # -> flatten(Length)
trim = TrimTree(Tree=split, Depth=1)
series = Series(Start=-1, Step=Slider(11, range=0..12), Count=lng)
item = ListItem(List=trim, Index=series, Wrap=True)
import_definition = ImportModelBlockDefinition(FilePath=c_script.Files, UpdateType=0, Name=item, Import=import_2)
block_names = Text(simplify(item))
pt = ConstructPoint(XCoordinate=0, YCoordinate=0, ZCoordinate=0)
panel = Panel(import_definition)
block_instance = ModelBlockInstance(Transform=pt, BlockDefinition=import_definition)  # -> BlockInstance, Transform, BlockDefinition
clean = CleanTree(RemoveNulls=True, RemoveInvalid=True, RemoveEmpty=True, Tree=simplify(block_instance.BlockInstance))
block_names_2 = Text(block_names)
imported_blocks = Tree(clean)
