# Grasshopper definition insert_scale_pts.gh (Grasshopper 1.0.8)
# Copyright: © 2023 SYD all rights reserved

O = Object()
size = Integer()
object = ModelObject(Object=O)  # -> Object, Geometry, Name
size_2 = Integer(size)
split = SplitList(List=object.Object, Index=size_2)  # -> ListA, ListB
item = ListItem(List=split.ListA, Index=0, Wrap=True)  # -> Item, Item1, Item2, Item3, Item4, Item5, Item6, Item7
panel = Panel(object.Name)
crprofile_fwd_ept = ModelObject(item.Item1)
crprofile_aft_ept = ModelObject(item.Item3)
crprofile_fwd_pt = ModelObject(item.Item)
crprofile_aft_pt = ModelObject(item.Item2)
crside_fwd_pt = ModelObject(item.Item5)
crside_mid_pt = ModelObject(item.Item6)
crpcamb_ept = ModelObject(item.Item4)
crside_aft_pt = ModelObject(item.Item7)
crprofile_fwd_pt_2 = ModelObject(crprofile_fwd_pt)
crprofile_fwd_ept_2 = ModelObject(crprofile_fwd_ept)
crprofile_aft_pt_2 = ModelObject(crprofile_aft_pt)
crprofile_aft_ept_2 = ModelObject(crprofile_aft_ept)
crpcamb_ept_2 = ModelObject(crpcamb_ept)
crside_fwd_pt_2 = ModelObject(crside_fwd_pt)
crside_mid_pt_2 = ModelObject(crside_mid_pt)
crside_aft_pt_2 = ModelObject(crside_aft_pt)
