# Grasshopper definition label_cog.gh (Grasshopper 1.0.8)
# Copyright: © 2023 SYD all rights reserved

centre_o = Object()
object = ModelObject(CentreO=flatten(centre_o))  # -> Object, Geometry, Name, Layer
u_text = UserText(Content=centre_o, Keys="Weight", UserTextMode=1)  # -> Content, Keys, Values
ff = FontFamily()
th = TextHeight()
num = Number(expr("Round(x)", u_text.Values))
pl_origin = PlaneOrigin(Base=[PlaneXY(0, 0, 0), PlaneYZ(0, 0, 0)], Origin=object.Geometry)
pl_origin_2 = PlaneOrigin(Base=Plane(origin=(0, 0, 0), x=(0, 0, 1), y=(1, 0, 0)), Origin=object.Geometry)
concat = Concatenate(gravity_mark="<", Category=object.Name, Wt=flatten(num), Kgs="kgs", JoinSeparator=" ")
fonts = QueryInstalledFonts(FontFamily=ff, FontWeight=4, FontStyle=1, FontStretch=5, Symbol=False)
as_text = AnnotationTextSettings(Font=fonts, TextHeight=th, ViewOriented=invert(False))
cir = Circle(Plane=pl_origin_2, Radius=80)
clean = CleanTree(RemoveNulls=True, RemoveInvalid=True, RemoveEmpty=False, Tree=object.Layer)
text_entity = TextEntity(Plane=pl_origin_2, Text=flatten(concat), TextSettings=as_text)  # -> simplify(TextEntity)
item = ListItem(List=clean, Index=0, Wrap=True)
object_2 = ModelObject(Geometry=simplify([text_entity, cir]), Name=object.Name, Layer=item)  # -> flatten(LabelO)
rotate = Rotate(Geometry=object_2, Angle=3.141592654, Plane=PlaneXY(0, 0, 0))  # -> Geometry, Transform
block_definition = ModelBlockDefinition(Objects=object_2, Name=graft(object.Name))  # -> BlockDefinition, Objects, Name, Notes, URL, URLDescription; disabled
object_3 = ModelObject(Geometry=rotate.Geometry, Name=object.Name, Layer=item)
block_instance = ModelBlockInstance(BlockDefinition=block_definition.BlockDefinition)  # disabled
label_o = Object([object_3, object_2])
