# Grasshopper definition layer_colours.gh (Grasshopper 1.0.8)
# Copyright: © 2023 SYD all rights reserved

layer = ListLayer()
C = Colour()
argb = SplitARGB(Colour=C)  # -> Alpha, Red, Green, Blue
series = Series(Start=argb.Blue, Step=0.05, Count=15)
frgb = ColourRGBF(Alpha=argb.Alpha, Red=argb.Red, Green=argb.Green, Blue=series)
short = ShortestList(ListLayer=layer, ListColour=frgb, TrimMode=2)  # -> ListLayer, ListColour
colour = ListColour(short.ListColour)
layer_2 = ListLayer(short.ListLayer)
