# Grasshopper definition layer_management.gh (Grasshopper 1.0.8)
# Copyright: © 2023 SYD all rights reserved
# plug-ins: LunchBox

# Retrieve layers from Rhino file
# Architecture
panel = Panel("A-*")
# Grasshopper
panel_2 = Panel("G-*")
# Construction
panel_3 = Panel("C-*")
# Hydrostatics
panel_4 = Panel("H-*")
# Model specific
panel_5 = Panel("M-*")
# eQuipment
panel_6 = Panel("Q-*")
# Rig
panel_7 = Panel("R-*")
# Systems
panel_8 = Panel("S-*")
layers = QueryModelLayers(Name=panel, AutoUpdateState=True)
layers_2 = QueryModelLayers(Name=panel_3, AutoUpdateState=True)
layers_3 = QueryModelLayers(Name=panel_2, AutoUpdateState=True)
layers_4 = QueryModelLayers(Name=panel_4, AutoUpdateState=True)
layers_5 = QueryModelLayers(Name=panel_5, AutoUpdateState=True)
layers_6 = QueryModelLayers(Name=panel_6, AutoUpdateState=True)
layers_7 = QueryModelLayers(Name=panel_7, AutoUpdateState=True)
layers_8 = QueryModelLayers(Name=panel_8, AutoUpdateState=True)
layer = ModelLayer(Layer=layers)  # -> Layer, Name, DisplayColour
layer_2 = ModelLayer(Layer=layers_2)  # -> Layer, Name, DisplayColour
layer_3 = ModelLayer(Layer=layers_3)  # -> Layer, Name, DisplayColour
layer_4 = ModelLayer(Layer=layers_4)  # -> Layer, Name, DisplayColour
layer_5 = ModelLayer(Layer=layers_5)  # -> Layer, Name, DisplayColour
layer_6 = ModelLayer(Layer=layers_6)  # -> Layer, Name, DisplayColour
layer_7 = ModelLayer(Layer=layers_7)  # -> Layer, Name, DisplayColour
layer_8 = ModelLayer(Layer=layers_8)  # -> Layer, Name, DisplayColour
panel_9 = Panel(layer_5.Name)
panel_10 = Panel(layer.Name)
panel_11 = Panel(layer_6.Name)
panel_12 = Panel(layer_2.Name)
panel_13 = Panel(layer_3.Name)
panel_14 = Panel(layer_7.Name)
panel_15 = Panel(layer_4.Name)
panel_16 = Panel(layer_8.Name)
rig = Panel("""R-boom
R-mast
R-sail
R-sail-battn
R-shrd
R-spar
R-sprd
R-sprd-diag
R-sprd-vert
R-stay""")
arch = Panel("""A-balst
A-deck
A-glss
A-hull
A-join
A-keel
A-rig
A-rudr
A-sole""")
cons = Panel("""C-deck
C-deck-phse
C-deck-strngr
C-FRP-cored
C-FRP-Solid
C-glss
C-hull
C-hull-belw
C-hull-BHDs
C-hull-chine
C-hull-frames
C-hull-strngr
C-hull-tops
C-keel
C-keel-BHDs
C-longt
C-tank""")
model = Panel("""M-anno
M-cons
M-cutp
M-lins
M-lins-WLs
M-lins-buts
M-lins-stns""")
grasshopper = Panel("""G=inpt-anno
G=inpt-deck
G=inpt-foil
G=inpt-hull
G=inpt-longt
G=inpt-phse
G=inpt-rig
G=inpt-sys
G=inpt-trans
G-anno
G-anno-dims
G-cut-layouts
G-cutout
G-deck
G-foil
G-FST
G-HDTc
G-HDTs
G-hull
G-hull-core
G-hull-bhd
G-hull-frame
G-hull-wtb
G-longt
G-lont-keelsn
G-mold
G-nest
G-phse
G-rig
G-rig-shrd
G-rig-spar
G-rig-stay
G-temp
G-temp-cutsheet
G-XV-BHD
G-XV-BHwt
G-XV-frame
G-XV-frames
G-XV-keel
G-hull-solid""")
hydrostatics = Panel("""H-cond-01
H-cond-02
H-cond-03""")
equipment = Panel("""Q-deck
Q-mold
Q-outfit""")
systems = Panel("""S-elec
S-elec-gen
S-engn
S-engn-instr
S-engn-yanmar
S-engn-props
S-safe
S-steer
S-tank""")
sort_val = SortDuplicateValues(ValueList=flatten([model, layer_5.Name]))  # -> UniqueValues, Indices
sort_val_2 = SortDuplicateValues(ValueList=flatten([layer.Name, arch]))  # -> UniqueValues, Indices
sort_val_3 = SortDuplicateValues(ValueList=flatten([cons, layer_2.Name]))  # -> UniqueValues, Indices
sort_val_4 = SortDuplicateValues(ValueList=flatten([grasshopper, layer_3.Name]))  # -> UniqueValues, Indices
sort_val_5 = SortDuplicateValues(ValueList=flatten([hydrostatics, layer_4.Name]))  # -> UniqueValues, Indices
sort_val_6 = SortDuplicateValues(ValueList=flatten([layer_6.Name, equipment]))  # -> UniqueValues, Indices
sort_val_7 = SortDuplicateValues(ValueList=flatten([rig, layer_7.Name]))  # -> UniqueValues, Indices
sort_val_8 = SortDuplicateValues(ValueList=flatten([systems, layer_8.Name]))  # -> UniqueValues, Indices
layer_colours = LayerColours(layer=arch, C=ColourSwatch(SwatchColor=RGB(85, 166, 144)))  # -> layer_2, colour
layer_colours_2 = LayerColours(layer=cons, C=ColourSwatch(SwatchColor=RGB(186, 69, 11)))  # -> layer_2, colour
layer_colours_3 = LayerColours(layer=grasshopper, C=ColourSwatch(SwatchColor=RGBA(62, 222, 78, 132)))  # -> layer_2, colour
layer_colours_4 = LayerColours(layer=model, C=ColourSwatch(SwatchColor=RGB(156, 154, 154)))  # -> layer_2, colour
layer_colours_5 = LayerColours(layer=hydrostatics, C=ColourSwatch(SwatchColor=RGB(227, 95, 203)))  # -> layer_2, colour
layer_colours_6 = LayerColours(layer=equipment, C=ColourSwatch(SwatchColor=RGB(197, 127, 240)))  # -> layer_2, colour
layer_colours_7 = LayerColours(layer=rig, C=ColourSwatch(SwatchColor=RGB(53, 155, 184)))  # -> layer_2, colour
layer_colours_8 = LayerColours(layer=systems, C=ColourSwatch(SwatchColor=RGB(0, 115, 255)))  # -> layer_2, colour
panel_17 = Panel(layer_colours_2.colour)
layer_9 = ModelLayer(
    Layer=[layer_colours.layer_2, layer_colours_2.layer_2, layer_colours_3.layer_2, layer_colours_4.layer_2, layer_colours_5.layer_2, layer_colours_7.layer_2, layer_colours_6.layer_2],
    DisplayColour=[layer_colours.colour, layer_colours_2.colour, layer_colours_3.colour, layer_colours_4.colour, layer_colours_5.colour, layer_colours_7.colour])
layer_10 = ModelLayer(GLayers=sort_val_4.UniqueValues, DisplayColour=layer_3.DisplayColour)
layer_11 = ModelLayer(
    Layer=[sort_val_2.UniqueValues, sort_val_3.UniqueValues, sort_val_4.UniqueValues, sort_val_5.UniqueValues, sort_val.UniqueValues, sort_val_6.UniqueValues, sort_val_7.UniqueValues, sort_val_8.UniqueValues],
    DisplayColour=[layer.DisplayColour, layer_2.DisplayColour, layer_3.DisplayColour, layer_4.DisplayColour, layer_5.DisplayColour, layer_6.DisplayColour, layer_7.DisplayColour, layer_8.DisplayColour])
g_layers_only = Layer(layer_10)
gh_layers = Layer(layer_11)
std_layers = Layer(layer_9)

# ==== cluster LayerColours
layer = ClusterInput()
C = ClusterInput()
argb = SplitARGB(Colour=C)  # -> Alpha, Red, Green, Blue
series = Series(Start=argb.Blue, Step=0.05, Count=15)
frgb = ColourRGBF(Alpha=argb.Alpha, Red=argb.Red, Green=argb.Green, Blue=series)
short = ShortestList(ListLayer=layer, ListColour=frgb, TrimMode=2)  # -> ListLayer, ListColour
colour = ClusterOutput(short.ListColour)
layer_2 = ClusterOutput(short.ListLayer)
