# Grasshopper definition layer_management_gh.gh (Grasshopper 1.0.8)
# Copyright: © 2023 SYD all rights reserved

# Retrieve layers from Rhino file
# Architecture
panel = Panel("A-*")
# Grasshopper
panel_2 = Panel("""G-*
G=*""")
# Construction
panel_3 = Panel("C-*")
# Hydrostatics
panel_4 = Panel("H-*")
# Model specific
panel_5 = Panel("M-*")
# eQuipment
panel_6 = Panel("Q-*")
# Rig
panel_7 = Panel("R-*")
# Systems
panel_8 = Panel("S-*")
layers = QueryModelLayers(Name=panel, AutoUpdateState=True)
layers_2 = QueryModelLayers(Name=panel_3, AutoUpdateState=True)
layers_3 = QueryModelLayers(Name=panel_2, AutoUpdateState=True)
layers_4 = QueryModelLayers(Name=panel_4, AutoUpdateState=True)
layers_5 = QueryModelLayers(Name=panel_5, AutoUpdateState=True)
layers_6 = QueryModelLayers(Name=panel_6, AutoUpdateState=True)
layers_7 = QueryModelLayers(Name=panel_7, AutoUpdateState=True)
layers_8 = QueryModelLayers(Name=panel_8, AutoUpdateState=True)
layer = ModelLayer(Layer=layers)  # -> Layer, Name, DisplayColour
layer_2 = ModelLayer(Layer=layers_2)  # -> Layer, Name, DisplayColour
layer_3 = ModelLayer(Layer=layers_3)  # -> Layer, Name, DisplayColour
layer_4 = ModelLayer(Layer=layers_4)  # -> Layer, Name, DisplayColour
layer_5 = ModelLayer(Layer=layers_5)  # -> Layer, Name, DisplayColour
layer_6 = ModelLayer(Layer=layers_6)  # -> Layer, Name, DisplayColour
layer_7 = ModelLayer(Layer=layers_7)  # -> Layer, Name, DisplayColour
layer_8 = ModelLayer(Layer=layers_8)  # -> Layer, Name, DisplayColour
panel_9 = Panel(layer_5.Name)
panel_10 = Panel(layer.Name)
panel_11 = Panel(layer_6.Name)
panel_12 = Panel(layer_2.Name)
panel_13 = Panel(layer_3.Name)
panel_14 = Panel(layer_7.Name)
panel_15 = Panel(layer_8.Name)
panel_16 = Panel(layer_4.Name)
rig = Panel("""R-spar
R-mast
R-boom
R-stay
R-shrd
R-sprd""")
arch = Panel("""A-balst
A-deck
A-hull
A-keel
A-rudr
A-sole""")
cons = Panel("""C-deck
C-deck-phse
C-deck-strngr
C-FRP-cored
C-FRP-Solid
C-hull
C-hull-belw
C-hull-BHDs
C-hull-chine
C-hull-frames
C-hull-strngr
C-hull-tops
C-keel
C-keel-BHDs
C-longt
C-tank""")
model = Panel("""M-anno
M-cons
M-cutp
M-lins
M-lins-WLs
M-lins-buts
M-lins-stns""")
grasshopper = Panel("""G-anno
G-anno-text
G-anno-wt
G-cutout
G-deck
G-foil
G-foil-pts
G-phse
G-HDTc
G-hull
G-hull-pts
G-hull-ctrl
G-syst-pts
G-FST
G-mold
G-XV-BHD
G-XV-BHwt
G-XV-frame
G-XV-keel
G=input-flyb
G=input-foil
G=input-hull
G=input-inte
G=input-phse
G=input-rig
G=input-sys""")
hydrostatics = Panel("""H-cond-00
H-cond-01
H-cond-02
H-cond-03""")
equipment = Panel("""Q-deck
Q-mold
Q-outfit""")
systems = Panel("""S-elec
S-elec-gen
S-engn
S-engn-instr
S-engn-yanmar
S-engn-props
S-safe
S-steer
S-tank""")
combine = CombineData(Input0=flatten(layer.Name), Input1=flatten(arch))  # -> Result, Index
combine_2 = CombineData(Input0=flatten(layer_2.Name), Input1=flatten(panel_12))  # -> Result, Index
combine_3 = CombineData(Input0=flatten(layer_3.Name), Input1=flatten(panel_13))  # -> Result, Index
combine_4 = CombineData(Input0=flatten(layer_4.Name), Input1=flatten(hydrostatics))  # -> Result, Index
combine_5 = CombineData(Input0=flatten(layer_5.Name), Input1=flatten(model))  # -> Result, Index
combine_6 = CombineData(Input0=flatten(layer_6.Name), Input1=flatten(equipment))  # -> Result, Index
combine_7 = CombineData(Input0=flatten(layer_7.Name), Input1=flatten(rig))  # -> Result, Index
combine_8 = CombineData(Input0=flatten(layer_8.Name), Input1=flatten(systems))  # -> Result, Index
cluster = Cluster(layer=arch, C=ColourSwatch(SwatchColor=RGB(85, 166, 144)))  # -> layer_2, colour
cluster_2 = Cluster(layer=cons, C=ColourSwatch(SwatchColor=RGB(186, 69, 11)))  # -> layer_2, colour
cluster_3 = Cluster(layer=grasshopper, C=ColourSwatch(SwatchColor=RGBA(62, 222, 78, 132)))  # -> layer_2, colour
cluster_4 = Cluster(layer=model, C=ColourSwatch(SwatchColor=RGB(156, 154, 154)))  # -> layer_2, colour
cluster_5 = Cluster(layer=hydrostatics, C=ColourSwatch(SwatchColor=RGB(227, 95, 203)))  # -> layer_2, colour
cluster_6 = Cluster(layer=equipment, C=ColourSwatch(SwatchColor=RGB(197, 127, 240)))  # -> layer_2, colour
cluster_7 = Cluster(layer=rig, C=ColourSwatch(SwatchColor=RGB(53, 155, 184)))  # -> layer_2, colour
cluster_8 = Cluster(layer=systems, C=ColourSwatch(SwatchColor=RGB(0, 115, 255)))  # -> layer_2, colour
layer_9 = ModelLayer(
    Layer=[cluster.layer_2, cluster_2.layer_2, cluster_3.layer_2, cluster_4.layer_2, cluster_5.layer_2, cluster_7.layer_2, cluster_6.layer_2, combine_8.Result],
    DisplayColour=[cluster.colour, cluster_2.colour, cluster_3.colour, cluster_4.colour, cluster_5.colour, cluster_7.colour, cluster_8.layer_2])
layer_10 = ModelLayer(
    Layer=[cluster_3.layer_2, cluster_5.layer_2, cluster_4.layer_2],
    DisplayColour=[cluster_3.colour, cluster_5.colour, cluster_4.colour])
panel_17 = Panel(cluster_2.colour)
layer_11 = ModelLayer(
    Layer=[combine.Result, combine_2.Result, combine_3.Result, combine_4.Result, combine_5.Result, combine_6.Result, combine_7.Result],
    DisplayColour=[layer.DisplayColour, layer_2.DisplayColour, layer_3.DisplayColour, layer_4.DisplayColour, layer_5.DisplayColour, layer_6.DisplayColour, layer_7.DisplayColour, layer_8.DisplayColour])
gh_layers = Layer(layer_11)
std_layers = Layer(layer_9)
basic_layers = Layer(layer_10)
panel_18 = Panel(layer_10)

# ==== cluster Cluster
layer = ClusterInput()
C = ClusterInput()
argb = SplitARGB(Colour=C)  # -> Alpha, Red, Green, Blue
lng = ListLength(List=layer)
expression = Expression(x=argb.Blue, y=lng, Expression="(1-x)/y")
series = Series(Start=argb.Blue, Step=expression, Count=lng)
frgb = ColourRGBF(Alpha=argb.Alpha, Red=argb.Red, Green=argb.Green, Blue=series)
short = ShortestList(ListLayer=layer, ListColour=frgb, TrimMode=2)  # -> ListLayer, ListColour
colour = ClusterOutput(short.ListColour)
layer_2 = ClusterOutput(short.ListLayer)
