# Grasshopper definition metals.gh (Grasshopper 1.0.8)
# Copyright: © 2023 SYD all rights reserved
# Copyright: © SYD 2022

material = ValueList({"Aluminium": "Aluminium,2700,207,310", "Steel HR": "Steel,8000,345,450", "Stainless 316": "Stainless steel 316,8100,517,600", "Bronze": "Bronze,7800.00,300,400, "Carbon Epoxy": "Carbon Epoxy,1700.00,600,900", "Kevlar Epoxy": "Kevlar Epoxy,1400.00,380,410"}, selected="Kevlar Epoxy")  # disabled
type = Type({"Concrete": 0, "Steel": 1, "Timber": 2, "Aluminium": 3, "Masonry": 4, "FRP": 5, "Glass": 6, "Fabric": 7, "Rebar": 8, "Tendon": 9, "ColdFormed": 10, "Other": 11}, selected="FRP")  # disabled
eglassepoxy = Panel("EglassEpoxy")  # disabled
panel = Panel("3")  # disabled
panel_2 = Panel("0.39")  # disabled
panel_3 = Panel("1300")  # disabled
split = TextSplit(Text=material, Separators=",")  # disabled
item = ListItem(List=split, Index=0, Wrap=True)  # -> Item, Item1, Item2, Item3; disabled
panel_4 = Panel(item.Item2)  # disabled
panel_5 = Panel(item.Item3)  # disabled
panel_6 = Panel(item.Item)  # disabled
panel_7 = Panel(item.Item1)  # disabled
merge = Merge(Data1=eglassepoxy, Data2=panel_3, Data3=type)  # disabled
panel_8 = Panel("""Type
Density
Sheer Str
Tensile Str""")
# Aluminium     = "Aluminium,2700,207,310"
# Steel HR      = "Steel,8000,345,450"
# Stainless 316 = "Stainless steel 316,8100,517,600"
# Bronze        = "Bronze,7800.00,300,400
# Carbon Epoxy  = "Carbon Epoxy,1700.00,600,900"
# Kevlar Epoxy  = "Kevlar Epoxy,1400.00,380,410"
number_slider = Slider(11, range=0..20)
type_2 = Type({"Concrete": 0, "Steel": 1, "Timber": 2, "Aluminium": 3, "Masonry": 4, "FRP": 5, "Glass": 6, "Fabric": 7, "Rebar": 8, "Tendon": 9, "ColdFormed": 10, "Other": 11, "StructuralCore": 12}, selected="StructuralCore")  # disabled
cluster = Cluster(N="Alum", relay=Slider(2, range=0..20))  # -> render_mtl, i
cluster_2 = Cluster(N="Steel", relay=Slider(10, range=0..20))  # -> render_mtl, i
cluster_3 = Cluster(N="Steel", relay=number_slider)  # -> render_mtl, i
panel_9 = Panel(cluster.i)
panel_10 = Panel(cluster_3.i)
panel_11 = Panel(cluster_2.i)
type_3 = Type({"Concrete": 0, "Steel": 1, "Timber": 2, "Aluminium": 3, "Masonry": 4, "FRP": 5, "Glass": 6, "Fabric": 7, "Rebar": 8, "Tendon": 9, "ColdFormed": 10, "Other": 11}, selected="FRP")  # disabled
type_4 = Type({"Concrete": 0, "Steel": 1, "Timber": 2, "Aluminium": 3, "Masonry": 4, "FRP": 5, "Glass": 6, "Fabric": 7, "Rebar": 8, "Tendon": 9, "ColdFormed": 10, "Other": 11}, selected="FRP")  # disabled
type_5 = Type({"Concrete": 0, "Steel": 1, "Timber": 2, "Aluminium": 3, "Masonry": 4, "FRP": 5, "Glass": 6, "Fabric": 7, "Rebar": 8, "Tendon": 9, "ColdFormed": 10, "Other": 11}, selected="FRP")  # disabled
panel_12 = Panel("1300")  # disabled
panel_13 = Panel("1400")  # disabled
type_6 = Type({"Concrete": 0, "Steel": 1, "Timber": 2, "Aluminium": 3, "Masonry": 4, "FRP": 5, "Glass": 6, "Fabric": 7, "Rebar": 8, "Tendon": 9, "ColdFormed": 10, "Other": 11, "StructuralCore": 12}, selected="Other")
type_7 = Type({"Concrete": 0, "Steel": 1, "Timber": 2, "Aluminium": 3, "Masonry": 4, "FRP": 5, "Glass": 6, "Fabric": 7, "Rebar": 8, "Tendon": 9, "ColdFormed": 10, "Other": 11, "StructuralCore": 12}, selected="Other")
panel_14 = Panel("1700")  # disabled
type_8 = Type({"Concrete": 0, "Steel": 1, "Timber": 2, "Aluminium": 3, "Masonry": 4, "FRP": 5, "Glass": 6, "Fabric": 7, "Rebar": 8, "Tendon": 9, "ColdFormed": 10, "Other": 11, "StructuralCore": 12}, selected="Timber")  # disabled
type_9 = Type({"Concrete": 0, "Steel": 1, "Timber": 2, "Aluminium": 3, "Masonry": 4, "FRP": 5, "Glass": 6, "Fabric": 7, "Rebar": 8, "Tendon": 9, "ColdFormed": 10, "Other": 11, "StructuralCore": 12}, selected="Timber")  # disabled
type_10 = Type({"Concrete": 0, "Steel": 1, "Timber": 2, "Aluminium": 3, "Masonry": 4, "FRP": 5, "Glass": 6, "Fabric": 7, "Rebar": 8, "Tendon": 9, "ColdFormed": 10, "Other": 11, "StructuralCore": 12}, selected="Timber")  # disabled
type_11 = Type({"Concrete": 0, "Steel": 1, "Timber": 2, "Aluminium": 3, "Masonry": 4, "FRP": 5, "Glass": 6, "Fabric": 7, "Rebar": 8, "Tendon": 9, "ColdFormed": 10, "Other": 11, "StructuralCore": 12}, selected="Aluminium")
type_12 = Type({"Concrete": 0, "Steel": 1, "Timber": 2, "Aluminium": 3, "Masonry": 4, "FRP": 5, "Glass": 6, "Fabric": 7, "Rebar": 8, "Tendon": 9, "ColdFormed": 10, "Other": 11, "StructuralCore": 12}, selected="Steel")
type_13 = Type({"Concrete": 0, "Steel": 1, "Timber": 2, "Aluminium": 3, "Masonry": 4, "FRP": 5, "Glass": 6, "Fabric": 7, "Rebar": 8, "Tendon": 9, "ColdFormed": 10, "Other": 11, "StructuralCore": 12}, selected="Steel")
panel_15 = Panel("Kevlar/Epoxy")  # disabled
panel_16 = Panel("1300")  # disabled
panel_17 = Panel("380")  # disabled
panel_18 = Panel("Carbon/Epoxy")  # disabled
panel_19 = Panel("600")  # disabled
panel_20 = Panel("CrossLinked PVC 130")  # disabled
panel_21 = Panel("EglassEpoxy")  # disabled
panel_22 = Panel("CrossLinked PVC 80")  # disabled
panel_23 = Panel("CrossLinked PVC 100")  # disabled
panel_24 = Panel("CrossLinked PVC 200")  # disabled
panel_25 = Panel("Marine Plywood")  # disabled
panel_26 = Panel("Pine Plywood")  # disabled
panel_27 = Panel("MDF")  # disabled
panel_28 = Panel("410")  # disabled
panel_29 = Panel("1300")  # disabled
panel_30 = Panel("900")  # disabled
panel_31 = Panel("200")  # disabled
panel_32 = Panel("130")  # disabled
panel_33 = Panel("80")  # disabled
panel_34 = Panel("780")  # disabled
panel_35 = Panel("600")  # disabled
panel_36 = Panel("900")  # disabled
panel_37 = Panel("100")  # disabled
entwine = Entwine(Branch00=type_7, Branch01="11000", Branch02=0, FlattenInputs=True)
entwine_2 = Entwine(Branch00=type_6, Branch01="8000", Branch02=0, FlattenInputs=True)
entwine_3 = Entwine(Branch00=type_12, Branch01="7870", Branch02="517", Branch03="600", FlattenInputs=True)
object = ModelObject(Object="Bronze", Name="Bronze")
entwine_4 = Entwine(Branch00=type_13, Branch01="8000", Branch02="345", Branch03="450", FlattenInputs=True)
entwine_5 = Entwine(Branch00=type_10, Branch01=panel_36, Branch02=0, FlattenInputs=True)  # disabled
entwine_6 = Entwine(Branch00=type_11, Branch01="2700", Branch02="207", Branch03="310", FlattenInputs=True)
entwine_7 = Entwine(Branch00=type_9, Branch01=panel_35, Branch02=0, FlattenInputs=True)  # disabled
object_2 = ModelObject(Object="Lead", Name="Lead")
entwine_8 = Entwine(Branch00=type_2, Branch01=panel_31, Branch02=0, FlattenInputs=True)  # disabled
entwine_9 = Entwine(Branch00=type_8, Branch01=panel_34, Branch02=0, FlattenInputs=True)  # disabled
entwine_10 = Entwine(Branch00=type_2, Branch01=panel_32, Branch02=0, FlattenInputs=True)  # disabled
object_3 = ModelObject(Object="Stainless steel 316", Name="Stainless steel 316", Render=cluster_3.render_mtl)
object_4 = ModelObject(Object=panel_27, Name=panel_27)  # disabled
object_5 = ModelObject(Object="Alloy D54/5083", Name="Alloy D54/5083", Render=cluster.render_mtl)
object_6 = ModelObject(Object="Steel", Name="Steel", Render=cluster_2.render_mtl)
object_7 = ModelObject(Object=panel_26, Name=panel_26)  # disabled
entwine_11 = Entwine(Branch00=type_2, Branch01=panel_33, Branch02=0, FlattenInputs=True)  # disabled
entwine_12 = Entwine(Branch00=type_2, Branch01=panel_37, Branch02=0, FlattenInputs=True)  # disabled
entwine_13 = Entwine(Branch00=type_3, Branch01=panel_12, Branch02=panel_16, Branch03=panel_29, FlattenInputs=True)  # disabled
entwine_14 = Entwine(Branch00=type_4, Branch01=panel_13, Branch02=panel_17, Branch03=panel_28, FlattenInputs=True)  # disabled
object_8 = ModelObject(Object=panel_24, Name=panel_24)  # disabled
object_9 = ModelObject(Object=panel_25, Name=panel_25)  # disabled
entwine_15 = Entwine(Branch00=type_5, Branch01=panel_14, Branch02=panel_19, Branch03=panel_30, FlattenInputs=True)  # disabled
object_10 = ModelObject(Object=panel_20, Name=panel_20)  # disabled
object_11 = ModelObject(Object=panel_22, Name=panel_22)  # disabled
object_12 = ModelObject(Object=panel_23, Name=panel_23)  # disabled
object_13 = ModelObject(Object=panel_15, Name=panel_15)  # disabled
object_14 = ModelObject(Object=panel_18, Name=panel_18)  # disabled
object_15 = ModelObject(Object=panel_21, Name=panel_21)  # disabled
u_text = UserText(Content=object, Keys=panel_8, Values=flatten(entwine_2), UserTextMode=1)  # -> Content, Keys, Values
u_text_2 = UserText(Content=object_2, Keys=panel_8, Values=flatten(entwine), UserTextMode=1)  # -> Content, Keys, Values
u_text_3 = UserText(Content=object_3, Keys=panel_8, Values=flatten(entwine_3), UserTextMode=1)  # -> StainlessSteel316, Keys, Values
u_text_4 = UserText(Content=object_6, Keys=panel_8, Values=flatten(entwine_4), UserTextMode=1)  # -> Content, Keys, Values
u_text_5 = UserText(Content=object_4, Keys=panel_8, Values=flatten(entwine_5), UserTextMode=1)  # -> Content, Keys, Values; disabled
u_text_6 = UserText(Content=object_5, Keys=panel_8, Values=flatten(entwine_6), UserTextMode=1)  # -> AlloyD545083, Keys, Values
u_text_7 = UserText(Content=object_7, Keys=panel_8, Values=flatten(entwine_7), UserTextMode=1)  # -> PinePlywood, Keys, Values; disabled
u_text_8 = UserText(Content=object_8, Keys=panel_8, Values=flatten(entwine_8), UserTextMode=1)  # -> CCrossLinkedPVC200, Keys, Values; disabled
u_text_9 = UserText(Content=object_9, Keys=panel_8, Values=flatten(entwine_9), UserTextMode=1)  # -> MarinePlywood, Keys, Values; disabled
u_text_10 = UserText(Content=object_10, Keys=panel_8, Values=flatten(entwine_10), UserTextMode=1)  # -> CCrossLinkedPVC130, Keys, Values; disabled
u_text_11 = UserText(Content=object_11, Keys=panel_8, Values=flatten(entwine_11), UserTextMode=1)  # -> CCrossLinkedPVC80, Keys, Values; disabled
u_text_12 = UserText(Content=object_12, Keys=panel_8, Values=flatten(entwine_12), UserTextMode=1)  # -> CCrossLinkedPVC100, Keys, Values; disabled
u_text_13 = UserText(Content=object_15, Keys=panel_8, Values=flatten(entwine_13), UserTextMode=1)  # -> EglassEpoxy, Keys, Values; disabled
u_text_14 = UserText(Content=object_13, Keys=panel_8, Values=flatten(entwine_14), UserTextMode=1)  # -> KevlarEpoxy, Keys, Values; disabled
u_text_15 = UserText(Content=object_14, Keys=panel_8, Values=flatten(entwine_15), UserTextMode=1)  # -> CarbonEpoxy, Keys, Values; disabled
lead = Content(u_text_2.Content)
bronze = Content(u_text.Content)
alloy_d54_5083 = Content(u_text_6.AlloyD545083)
steel = Content(u_text_4.Content)
stainless_steel_316 = Content(u_text_3.StainlessSteel316)

# ==== cluster Cluster
N = ClusterInput()
relay = ClusterInput()
materials = QueryModelMaterials(Name=N, AutoUpdateState=True)
material = ModelMaterial(Material=materials, Name=N)  # -> Material, Name, Shader
object_material = RenderMaterial(Material=material.Material)  # -> ObjectMaterial, Source, Material
material_2 = ModelMaterial(Material=materials)  # -> Material, Name, Shader
render = RenderAttributes(ObjectMaterial=object_material.ObjectMaterial)  # -> Render, ObjectMaterial, CastsShadows, ReceivesShadows
item = ListItem(List=render.Render, Index=relay, Wrap=True)
item_2 = ListItem(List=material_2.Name, Index=relay, Wrap=True)
render_mtl = ClusterOutput(item)
i = ClusterOutput(item_2)
