# Grasshopper definition mirror_hulls__join.gh (Grasshopper 1.0.8)
# Copyright: © 2023 SYD all rights reserved

vessel_o = Object()
centre_pln = Plane()
bridgedeck = Breps()
centre_pln_2 = Plane(centre_pln)
object = ModelObject(VesselO=vessel_o)  # -> Object, Geometry, Name
bbox = BoundingBox(Content=object.Geometry, Plane=PlaneXY(0, 0, 0))  # -> Box, Box_2
box_corners = BoxCorners(Box=bbox.Box)  # -> CornerA, CornerB, CornerC, CornerD, CornerE, CornerF, CornerG, CornerH
pdecon = Deconstruct(Point=box_corners.CornerA)  # -> XComponent, YComponent, ZComponent
pdecon_2 = Deconstruct(Point=centre_pln_2)  # -> XComponent, YComponent, ZComponent
pt = Point(box_corners.CornerA)
mirror = Mirror(Geometry=object.Geometry, Plane=centre_pln_2)  # -> StbdHull, Transform
txt = Text(flatten(object.Name))
panel = Panel("""LcB
VcB
LWL
WPA
LcF
WSA
Amax""")
entwine = Entwine(FlattenInputs=True)
brep = Brep(bridgedeck)
panel_2 = Panel(txt)
eval = Evaluate(F="Round((BCL+ABS(B2))*2/1e3,3)", B2=pdecon.YComponent, BCL=pdecon_2.YComponent)  # -> simplify(BOA_m)
panel_3 = Panel("""/Vol
/LcB%
/LwL
/EntryA
/Displ
/Deadrise
/DeariseT""")
sunion = SolidUnion(Bridgedeck=[object.Geometry, mirror.StbdHull, bridgedeck])  # -> flatten(Result)
entwine_2 = Entwine(FlattenInputs=True)
concat = Concatenate(FragmentA="/", FragmentB=panel)
concat_2 = Concatenate(FragmentA=txt, FragmentB="stbd", JoinSeparator=" ")
txt_2 = Text(entwine_2)
txt_3 = Text(entwine)
txt_4 = Text(eval)
object_2 = ModelObject(Object=object.Object, Geometry=mirror.StbdHull, Name=concat_2)  # -> StbdHullO, Layer
merge = Merge(Data1=flatten("/BOAm"), Data2=flatten(txt_4))
merge_2 = Merge(Data1=graft(panel_3), Data2=txt_2)
merge_3 = Merge(Data1=graft(concat), Data2=txt_3)
concat_3 = Concatenate(FragmentA=txt, FragmentB="BD", JoinSeparator=" ")
panel_4 = Panel(object_2.Layer)
entwine_3 = Entwine(Branch0X=merge, FlattenInputs=False)
object_3 = ModelObject(Object=object.Object, Geometry=sunion, Name=concat_3)  # -> HullDeckO, Layer
panel_5 = Panel(entwine_3)
stbd_hull_o = Object(object_2.StbdHullO)
hull_deck_o = Object(object_3.HullDeckO)
osc = Result(entwine_3)
boa_m = Result(eval)
