# Grasshopper definition multihull_bridgedeck.gh (Grasshopper 1.0.8)
# Copyright: © 2023 SYD all rights reserved
# Copyright: © SYD 2022
# plug-ins: Sasquatch

db_pts_o = Object()
centre_pln = Plane()
ts = TextSettings()
R = Radii()
A = Angle()
G = Geometry()
dx = Number()
dz = Number()
object = ModelObject(DBPtsO=db_pts_o)  # -> Object, Geometry, Name
pt = Point(centre_pln)
panel = Panel(object.Name)
expression = Expression(C=pt, P=object.Geometry, Expression="{P.x,C.y,P.z}")

# ---- group: Max heigt x 2
pdecon = Deconstruct(Point=object.Object)  # -> XComponent, YComponent, ZComponent
panel_2 = Panel("""0
-1""")
sort = SortList(Keys=pdecon.ZComponent, ValuesA=object.Object)  # -> Keys, ValuesA
item = ListItem(List=sort.Keys, Index=panel_2, Wrap=True)
dispatch = Dispatch(List=item, DispatchPattern=[True, False])  # -> ListA, ListB
expression_2 = Expression(x=dispatch.ListA, y=dispatch.ListB, Expression="ABS(x-y)*2")

# ----
object_2 = ModelObject(Object=object.Object, Geometry=expression)  # -> Object, Geometry, Name
points = PointList(Points=expression, Size=200)
cl_points = ListItem(List=expression, Index=0, Wrap=True)  # -> Item, Item1, Item2, Item3, Item4, Item5
y_points = ListItem(List=object.Geometry, Index=0, Wrap=True)  # -> Item, Item1, Item2, Item3, Item4, Item5
tmatch = MatchText(Text=object_2.Name, Pattern="*bPt", Case=True)
dispatch_2 = Dispatch(List=object_2.Object, DispatchPattern=tmatch)  # -> ListA, ListB
bdeck_crv_pts = ModelObject([cl_points.Item, cl_points.Item3, cl_points.Item4, cl_points.Item5])
deck_crv_pts = ModelObject([cl_points.Item, cl_points.Item1, cl_points.Item2])
panel_3 = Panel(dispatch_2.ListB)
panel_4 = Panel(dispatch_2.ListA)
item_2 = ListItem(List=dispatch_2.ListA, Index=0, Wrap=True)  # -> Item, Item1, Item2
item_3 = ListItem(List=dispatch_2.ListB, Index=0, Wrap=True)  # -> Item, Item1, Item2
points_2 = PointList(Points=deck_crv_pts, Size=200)
points_3 = PointList(Points=bdeck_crv_pts, Size=200)
vec2pt = Vector2Pt(PointA=cl_points.Item, PointB=cl_points.Item3, Unitize=False)  # -> Vector, Length

# ---- group: Horizontal w Length
vec2pt_2 = Vector2Pt(PointA=cl_points.Item5, PointB=cl_points.Item4, Unitize=False)  # -> Vector, Length
X = UnitX(Factor=expr("-x", vec2pt_2.Length))

# ----
Z = UnitZ(Factor=expression_2)
X_2 = UnitX(Factor=1)
dx_2 = Number(dx)
dz_2 = Number(dz)
vrot = Rotate(Vector=expr("-x", Z), Axis=X_2, Angle=expr("-x", degrees(A)))
vdis = VectorDisplay(Anchor=cl_points.Item, Vector=vec2pt.Vector)
vdis_2 = VectorDisplay(Anchor=cl_points.Item5, Vector=vec2pt_2.Vector)
X_3 = UnitX(Factor=dx_2)
Z_2 = UnitZ(Factor=dz_2)
addition = Addition(A=X_3, B=Z_2)
bzspan = BezierSpan(StartPoint=cl_points.Item, StartTangent=vec2pt.Vector, EndPoint=cl_points.Item5, EndTangent=X)  # -> BDeckCrv, Length, Domain
nurbs = NurbsCurve(Vertices=deck_crv_pts, Degree=2, Periodic=False)  # -> DeckClCrv, Length, Domain
pt_2 = Point([y_points.Item, y_points.Item1, y_points.Item2])
transform = Transform(Geometry=y_points.Item, Transform=addition)
Y = UnitY(Factor=1)
nurbs_2 = NurbsCurve(Vertices=pt_2, Degree=2, Periodic=False)  # -> DeckSideCrv, Length, Domain
arc = ArcSED(Start=cl_points.Item, End=transform, Direction=expr("-x", Y))  # -> ApexCrv, Plane, Radius
centre_pln_2 = Plane(centre_pln)
extr = Extrude(Base=nurbs_2.DeckSideCrv, Direction=vrot)
scale_nu = ScaleNU(Geometry=arc.ApexCrv, Plane=centre_pln_2, ScaleX=1, ScaleY=1, ScaleZ=Slider(1.4, range=1..2))  # -> Geometry, Transform
extrcrv = ExtrudeAlong(Base=scale_nu.Geometry, Curve=[bzspan.BDeckCrv, nurbs.DeckClCrv])  # -> graft(Extrusion)
bbx = BrepBrep(BrepA=extrcrv, BrepB=extr)  # -> Curves, Points
join = JoinCurves(Curves=flatten(bbx.Curves), Preserve=False)
end = EndPoints(Curve=join)  # -> Start, End
ln = Line(StartPoint=end.Start, EndPoint=end.End)
dispatch_3 = Dispatch(List=flatten(bbx.Curves), DispatchPattern=[True, False])  # -> ListA, ListB
edgesrf = EdgeSurface(CurveA=dispatch_3.ListA, CurveB=dispatch_3.ListB, CurveC=ln)
end_2 = EndPoints(Curve=nurbs_2.DeckSideCrv)  # -> Start, End
pl_origin = PlaneOrigin(Base=PlaneYZ(0, 0, 0), Origin=end_2.End)
pt_3 = ConstructPoint(XCoordinate=0, YCoordinate=0, ZCoordinate=0)
sec = BrepPlane(Brep=extrcrv, Plane=pl_origin)  # -> Curves, Points
vec2pt_3 = Vector2Pt(PointA=pt_3, PointB=centre_pln, Unitize=False)  # -> Vector, Length
srfsplit = SurfaceSplit(Surface=extrcrv, Curves=sec.Curves)
transform_2 = Transform(Geometry=G, Transform=vec2pt_3.Vector)
brep = Brep(transform_2)
cull_i = CullIndex(List=srfsplit, Indices=0, Wrap=True)
layers = QueryModelLayers(Name="G-bdek-cntr", AutoUpdateState=True)
sec_2 = BrepPlane(Brep=brep, Plane=centre_pln)  # -> Curves, Points
srf = Surface(flatten(cull_i))
debrep = DeconstructBrep(Brep=brep)  # -> Faces, Edges, Vertices
null = NullItem(Item=layers)  # -> NullFlags, InvalidFlags, Description
layer = ModelLayer(Name="G-bdek-cntr", DisplayColour=ColourSwatch(SwatchColor=RGB(75, 189, 147)))
dispatch_4 = Dispatch(List=srf, DispatchPattern=[True, False])  # -> ListA, ListB
srfsplit_2 = SurfaceSplit(Surface=debrep.Faces, Curves=sec_2.Curves)
dispatch_5 = Dispatch(List=layer, DispatchPattern=null.NullFlags)  # -> ListA, ListB

# ---- group: Display
merge = Merge(Data1=bzspan.BDeckCrv, Data2=arc.ApexCrv, Data3=nurbs_2.DeckSideCrv, Data4=bzspan.BDeckCrv)
panel_5 = Panel("""BDeck Crv
Apex Crv
Deck Side Crv
Deck Cl Crv""")
layers_2 = QueryModelLayers(Name="G-bdek-pts", AutoUpdateState=True)
midpt = CurveMiddle(Curve=merge)
ln_2 = Line(StartPoint=[item_2.Item, item_2.Item2], EndPoint=[item_3.Item1, item_3.Item2])
object_3 = ModelObject(Object=[item_2.Item, item_2.Item2])  # -> Object, Name
null_2 = NullItem(Item=layers_2)  # -> NullFlags, InvalidFlags, Description
layer_2 = ModelLayer(Name="G-bdek-pts", DisplayColour=ColourSwatch(SwatchColor=RGB(75, 189, 147)))
pl_origin_2 = PlaneOrigin(Base=[PlaneXZ(0, 0, 0), PlaneXY(0, 0, 0), PlaneYZ(0, 0, 0)], Origin=graft(midpt))
cluster = Cluster(cntrl_pt_o=flatten(dispatch_2.ListA), ts=ts)  # -> te, N, ad
cluster_2 = Cluster(cntrl_pt_o=dispatch_2.ListB, ts=ts)  # -> te, N, ad
dispatch_6 = Dispatch(List=layer_2, DispatchPattern=null_2.NullFlags)  # -> ListA, ListB
cluster_3 = Cluster(cntrl_pt_o=dispatch_2.ListA, ts=ts)  # -> te, N, ad
text_entity = TextEntity(Plane=pl_origin_2, Text=graft(panel_5), TextSettings=ts)
display = DisplayAttributes(DisplayColour=ColourSwatch(SwatchColor=RGB(181, 159, 207)))
display_2 = DisplayAttributes(DisplayColour=ColourSwatch(SwatchColor=RGB(157, 176, 209)))
display_3 = DisplayAttributes(DisplayColour=ColourSwatch(SwatchColor=RGB(192, 145, 204)))
display_4 = DisplayAttributes(DisplayColour=ColourSwatch(SwatchColor=RGB(214, 156, 156)))
display_5 = DisplayAttributes(DisplayColour=[ColourSwatch(SwatchColor=RGB(153, 201, 166)), ColourSwatch(SwatchColor=RGB(207, 201, 143)), ColourSwatch(SwatchColor=RGB(214, 160, 118))])  # -> Display, DisplayColour, DisplayMode
rep = ReplaceText(Text=object_3.Name, Find="bPt", Replace="Vect", RecursiveReplace=False)
object_4 = ModelObject(Geometry=text_entity, Name=panel_5, Layer=dispatch_5.ListA, Display=display_5.Display)
object_5 = ModelObject(Geometry=merge, Name=panel_5, Layer=dispatch_5.ListA, Display=display_5.Display)
object_6 = ModelObject(Geometry=ln_2, Name=rep, Display=display)
object_7 = ModelObject(Geometry=cluster.te, Name=cluster.N, Layer=dispatch_6.ListA, Display=display_2)
object_8 = ModelObject(Geometry=cluster.ad, Name=cluster.N, Layer=dispatch_6.ListA, Display=display_2)
object_9 = ModelObject(Geometry=cluster_2.te, Name=cluster_2.N, Layer=dispatch_6.ListA, Display=display_4)
object_10 = ModelObject(Geometry=cluster_2.ad, Name=cluster_2.N, Layer=dispatch_6.ListA, Display=display_4)
object_11 = ModelObject(Geometry=cluster_3.te, Name=cluster_3.N, Layer=dispatch_6.ListA, Display=display_3)
object_12 = ModelObject(Geometry=cluster_3.ad, Name=cluster_3.N, Layer=dispatch_6.ListA, Display=display_3)

# ----
bbx_2 = BrepBrep(BrepA=edgesrf, BrepB=dispatch_4.ListA)  # -> Curves, Points
bbx_3 = BrepBrep(BrepA=edgesrf, BrepB=dispatch_4.ListB)  # -> Curves, Points
dispatch_7 = Dispatch(List=srfsplit_2, DispatchPattern=[True, False])  # -> ListA, ListB
srfsplit_3 = SurfaceSplit(Surface=dispatch_4.ListA, Curves=bbx_2.Curves)
srfsplit_4 = SurfaceSplit(Surface=dispatch_4.ListB, Curves=bbx_3.Curves)
srf_2 = Surface(dispatch_7.ListB)
transom_srf = Surface(flatten(srf_2))
area = Area(Geometry=[srfsplit_3, srfsplit_4])  # -> Area, Centroid
pdecon_2 = Deconstruct(Point=area.Centroid)  # -> XComponent, YComponent, ZComponent
sort_2 = SortList(Keys=pdecon_2.YComponent, ValuesA=[srfsplit_3, srfsplit_4])  # -> Keys, reverse(ValuesA)
item_4 = ListItem(List=sort_2.ValuesA, Index=0, Wrap=True)  # -> Item, Item1
brep_2 = Brep([edgesrf, item_4.Item, item_4.Item1])
mirror = Mirror(Geometry=brep_2, Plane=centre_pln_2)  # -> Geometry, Transform
join_2 = BrepJoin(Breps=flatten([mirror.Geometry, brep_2]))  # -> Breps, Closed
capex = CapHolesEx(Brep=join_2.Breps)  # -> Bridgedeck, Caps, Solid
split_larger = SplitLarger(T=brep_2, cutting_srf=brep)  # -> flatten(larger_srf_2), smaller_srf_2, cutting_crv_2
join_3 = JoinCurves(Curves=split_larger.cutting_crv_2, Preserve=False)
split_larger_2 = SplitLarger(T=transom_srf, cutting_crv=join_3)  # -> larger_srf_2, smaller_srf_2, cutting_crv_2
item_5 = ListItem(List=split_larger.larger_srf_2, Index=0, Wrap=False)  # -> Item, Item1, Item2
crv = Curve(split_larger.cutting_crv_2)
O = Object(object_2.Object)
cntrl_vector_o = Object(object_6)
mark_pt_o = Object([object_10, object_8, object_12, object_11, object_9, object_7])
loft_crv_o = Object([object_5, object_4])
area_2 = Area(Geometry=[split_larger_2.larger_srf_2, split_larger_2.smaller_srf_2])  # -> Area, Centroid
near_cl = NearCL(srf=[split_larger_2.larger_srf_2, split_larger_2.smaller_srf_2])
sort_3 = SortList(Keys=area_2.Centroid, ValuesA=[split_larger_2.larger_srf_2, split_larger_2.smaller_srf_2])  # -> Keys, reverse(ValuesA)
item_6 = ListItem(List=sort_3.ValuesA, Index=0, Wrap=True)
join_4 = BrepJoin(Breps=flatten([split_larger.larger_srf_2, item_6]))  # -> Breps, Closed
mirror_2 = Mirror(Geometry=join_4.Breps, Plane=centre_pln_2)  # -> Geometry, Transform
join_5 = BrepJoin(Breps=flatten([join_4.Breps, mirror_2.Geometry]))  # -> Breps, Closed
midpt_2 = CurveMiddle(Curve=arc.ApexCrv)  # disabled
brep_3 = Brep(join_5.Breps)
mirror_3 = Mirror(Geometry=midpt_2, Plane=centre_pln_2)  # -> Geometry, Transform; disabled
edgescvx = ConvexEdges(Brep=brep_3)  # -> Convex, Concave, Mixed
edgespt = EdgesFromPoints(Brep=brep_3, Points=[mirror_3.Geometry, midpt_2], Valence=3, Tolerance=1)  # -> Edges, Indices, Map; disabled
panel_6 = Panel("""6
11""")  # disabled
filedge = FilletEdge(Shape=brep_3, Blend=0, Metric=0, Edges=edgescvx.Convex, Radii=R)
panel_7 = Panel(edgespt.Indices)  # disabled
layers_3 = QueryModelLayers(Name="G-deck", AutoUpdateState=True)
display_6 = DisplayAttributes(IsocurveDensity=-1)
layers_4 = QueryModelLayers(Name="G-deck", AutoUpdateState=True)
layers_5 = QueryModelLayers(Name="G-deck", AutoUpdateState=True)
display_7 = DisplayAttributes(IsocurveDensity=-1)
display_8 = DisplayAttributes(IsocurveDensity=-1)
issolid = BrepIsSolid(Brep=filedge)
object_13 = ModelObject(Geometry=capex.Bridgedeck, Name="BridgeDeck", Layer=layers_3, Display=display_6)
object_14 = ModelObject(Geometry=filedge, Name="BridgeDeck", Layer=layers_4, Display=display_7)
object_15 = ModelObject(Geometry=join_5.Breps, Name="BridgeDeck trimmed", Layer=layers_5, Display=display_8)
bd_straight_o = Object(object_13)
solid = Solid(capex.Solid)
bd_trimmed_o = Object(object_15)
solid_2 = Closed(join_5.Closed)
bdt_radius_o = Object(object_14)
S = IsSolid(issolid)

# ==== cluster Cluster
cntrl_pt_o = ClusterInput()
ts = ClusterInput()
object = ModelObject(CntrlPtO=cntrl_pt_o)  # -> Object, Geometry, Name
as_text = AnnotationTextSettings(TextSettings=ts)  # -> TextSettings, TextHeight
pl_origin = PlaneOrigin(Base=[PlaneXZ(0, 0, 0), PlaneXY(0, 0, 0), PlaneYZ(0, 0, 0)], Origin=graft(object.Geometry))

# ---- group: Upgraded : Text Dot
annotation_dot = AnnotationDot(Location=object.Geometry, PrimaryText="+", TextHeight=expr("x*2", as_text.TextHeight))

# ----
text_entity = TextEntity(Plane=pl_origin, Text=graft(object.Name), TextSettings=as_text.TextSettings)
te = ClusterOutput(text_entity)
N = ClusterOutput(object.Name)
ad = ClusterOutput(annotation_dot)

# ==== cluster SplitLarger
cutting_crv = ClusterInput()
cutting_srf = ClusterInput()
T = ClusterInput()
flatten = FlattenTree(Tree=T, Path="{0}")  # -> graft(Tree)
bbx = BrepBrep(Surface=flatten, CuttingSrf=cutting_srf)  # -> Curves, Points
srfsplit = SurfaceSplit(Surface=flatten, CuttingCrv=[bbx.Curves, cutting_crv])
area = Area(Geometry=srfsplit)  # -> Area, Centroid
dispatch = Dispatch(List=area.Area, DispatchPattern=[True, False])  # -> ListA, ListB
larger = LargerThan(FirstNumber=dispatch.ListA, SecondNumber=dispatch.ListB)  # -> LargerThan, OrEqualTo
not = GateNot(A=larger.LargerThan)
dispatch_2 = Dispatch(List=srfsplit, DispatchPattern=[larger.LargerThan, not])  # -> ListA, ListB
join = JoinCurves(Curves=flatten(bbx.Curves), Preserve=False)
larger_srf = Surface(dispatch_2.ListA)
smaller_srf = Surface(dispatch_2.ListB)
smaller_srf_2 = ClusterOutput(smaller_srf)
larger_srf_2 = ClusterOutput(larger_srf)
cutting_crv_2 = ClusterOutput(join)

# ==== cluster NearCL
srf = ClusterInput()

# ---- group: How many edges?
dispatch = Dispatch(List=srf, DispatchPattern=[True, False])  # -> ListA, ListB
wires = BrepWireframe(Brep=dispatch.ListB, Density=-1)
wires_2 = BrepWireframe(Brep=dispatch.ListA, Density=-1)
join = JoinCurves(Curves=wires_2, Preserve=False)
join_2 = JoinCurves(Curves=wires, Preserve=False)
lng = ListLength(List=join_2)
lng_2 = ListLength(List=join)

# ---- group: Keep inner surface
srf_2 = Surface(srf)
area = Area(Geometry=srf_2)  # -> Area, Centroid
pdecon = Deconstruct(Point=area.Centroid)  # -> XComponent, YComponent, ZComponent
abs = Absolute(Value=pdecon.YComponent)
dispatch_2 = Dispatch(List=abs, DispatchPattern=[True, False])  # -> ListA, ListB
smaller = SmallerThan(FirstNumber=dispatch_2.ListA, SecondNumber=dispatch_2.ListB)  # -> SmallerThan, OrEqualTo
not = GateNot(A=smaller.SmallerThan)
dispatch_3 = Dispatch(List=srf_2, DispatchPattern=[smaller.SmallerThan, not])  # -> ListA, ListB

# ----
larger = LargerThan(FirstNumber=lng_2, SecondNumber=lng)  # -> LargerThan, OrEqualTo
dispatch_4 = Dispatch(List=dispatch.ListA, DispatchPattern=larger.LargerThan)  # -> ListA, ListB
dispatch_5 = Dispatch(List=dispatch.ListB, DispatchPattern=larger.LargerThan)  # -> ListA, ListB
transom_srf = Surface([dispatch_4.ListB, dispatch_5.ListA])
transom_srf_2 = ClusterOutput(transom_srf)
