# Grasshopper definition multihull_fairing.gh (Grasshopper 1.0.8)
# Copyright: © 2023 SYD all rights reserved
# Copyright: © SYD 2022
# plug-ins: Pufferfish

T = Tree()
sheerline_inboard_f = Number()
sheerline_inboard_ht = Number()
asymmetry_f = Number()
hard_bilge = Boolean()
hourglass_figure = Boolean()
transom_cutting_srf = Surface()
increase_inner_chine = Number()
sheerline_inboard_ht_2 = Number(sheerline_inboard_ht)
hourglass_figure_2 = Boolean(hourglass_figure)
clean = CleanTree(RemoveNulls=True, RemoveInvalid=True, RemoveEmpty=False, Tree=T)
sheerline_inboard_f_2 = Number(sheerline_inboard_f)
asymmetry_f_2 = Number(asymmetry_f)
hard_bilge_2 = Boolean(hard_bilge)
increase_inner_chine_2 = Number(increase_inner_chine)
panel = Panel("""DeckC
StemF
ProfileF
ChineW
ChineA
Pname""")
panel_2 = Panel("""ClipperB
HollowB
FFdepth
FFdist
DeckC
StemF
Profile F
ChineW
ChineA
Pname""")
object = ModelObject(LoftingO=clean)  # -> Object, Geometry, Name
item = ListItem(List=flatten(clean), Index=0, Wrap=True)
u_text = UserText(Content=item, Keys=panel, UserTextMode=1)  # -> Content, Keys, Values
panel_3 = Panel(u_text.Keys)

# ---- group: Inner Crvs flattened
mirror = Mirror(Geometry=object.Geometry, Plane=Plane(origin=(0, 0, 0), x=(0, 0, 1), y=(1, 0, 0)))  # -> Geometry, Transform
scale_nu = ScaleNU(Geometry=mirror.Geometry, Plane=PlaneXY(0, 0, 0), ScaleX=1, ScaleY=asymmetry_f_2, ScaleZ=1)  # -> Geometry, Transform
concat = Concatenate(FragmentA=object.Name, FragmentB=" in")
object_2 = ModelObject(Object=object.Object, Geometry=scale_nu.Geometry, Name=concat)
item_2 = ListItem(List=flatten(object_2), Index=0, Wrap=True)  # -> Item, Item1, Item2
sheer = ModelObject(item_2.Item)
chine = ModelObject(item_2.Item1)
bilge = ModelObject(item_2.Item2)

# ----
item_3 = ListItem(List=flatten(object.Object), Index=0, Wrap=True)  # -> Item, Item1, Item2
item_4 = ListItem(List=u_text.Values, Index=0, Wrap=True)  # -> Item, Item1, Item2, Item3, Item4, Item5
profile_factor = Number(item_4.Item2)
mirror_2 = Mirror(Geometry=item_3.Item2, Plane=Plane(origin=(0, 0, 0), x=(0, 0, 1), y=(1, 0, 0)))  # -> Geometry, Transform
sheer_2 = ModelObject(item_3.Item)
chine_2 = ModelObject(item_3.Item1)
bilge_2 = ModelObject(item_3.Item2)
tweencrv = TweenCurve(CurveA=item_3.Item2, CurveB=mirror_2.Geometry, Factor=0.5, BlendType=0)  # disabled

# ---- group: Asym sheer
cp = ControlPoints(Curve=item_2.Item)  # -> Points, Weights, Knots; disabled
pdecon = Deconstruct(Point=cp.Points)  # -> XComponent, YComponent, ZComponent; disabled
item_5 = ListItem(List=pdecon.XComponent, Index=0, Wrap=True)  # disabled
expression = Expression(x=pdecon.XComponent, xs=item_5, hf=sheerline_inboard_ht_2, z=pdecon.ZComponent, Expression="(((x-xs)*hf-(x-xs))/10)+1*z")  # disabled
expression_2 = Expression(y=pdecon.YComponent, f=sheerline_inboard_f_2, Expression="y*f")  # disabled
pt = ConstructPoint(XCoordinate=pdecon.XComponent, YCoordinate=expression_2, ZCoordinate=expression)  # disabled
nurbs = NurbsCurve(Vertices=pt, Degree=3, Periodic=False)  # -> Curve, Length, Domain; disabled

# ---- group: Hard bilge asymmetrical
dispatch = Dispatch(List=tweencrv, DispatchPattern=hard_bilge_2)  # -> ListA, ListB; disabled

# ----
relay = Relay()  # disabled
scale_nu_2 = ScaleNU(Geometry=chine, Plane=PlaneXY(0, 0, 0), ScaleX=1, ScaleY=expr("1+x/100", increase_inner_chine_2), ScaleZ=1)  # -> Geometry, Transform; disabled

# ---- group: Sheer line flaired
end = EndPoints(Curve=nurbs.Curve)  # -> Start, End; disabled
scale_nu_3 = ScaleNU(Geometry=sheer, Plane=PlaneXY(0, 0, 0), ScaleX=1, ScaleY=sheerline_inboard_f_2, ScaleZ=1)  # -> Geometry, Transform; disabled

# ---- group: Topsides
loft_opt = LoftOptions(Closed=False, Adjust=True, Rebuild=111, Refit=0, Type=3)  # disabled
loft_opt_2 = LoftOptions(Closed=False, Adjust=True, Rebuild=111, Refit=0, Type=3)  # disabled
hull = Loft(Curves=flatten([nurbs.Curve, scale_nu_2.Geometry]), Options=loft_opt_2)  # disabled
hull_2 = Loft(Curves=[sheer_2, chine_2], Options=loft_opt)  # disabled

# ---- group: Tucked-in waist
Z = UnitZ(Factor=1)  # disabled
move = Move(Geometry=chine_2, Motion=Z)  # -> Geometry, Transform; disabled
move_2 = Move(Geometry=chine, Motion=Z)  # -> Geometry, Transform; disabled
entwine = Entwine(
    Branch00=sheer_2,
    Branch01=chine_2,
    Branch02=move.Geometry,
    Branch03=bilge_2,
    Branch04=dispatch.ListA,
    Branch05=bilge,
    Branch06=move_2.Geometry,
    Branch07=chine,
    Branch08=scale_nu_3.Geometry,
    FlattenInputs=True)  # -> flatten(Result); disabled

# ----
debrep = DeconstructBrep(Brep=[hull_2, hull])  # -> Faces, Edges, Vertices; disabled

# ---- group: Wide chine Crvs
len = Length(Curve=debrep.Edges)  # disabled
ma = MassAddition(Input=len)  # -> Result, PartialResults; disabled
edgeslen = EdgesFromLength(Brep=debrep.Faces, Minimum=expr("x/4", ma.Result), Maximum=ma.Result)  # -> Edges, Indices; disabled
midpt = CurveMiddle(Curve=edgeslen.Edges)  # disabled
pdecon_2 = Deconstruct(Point=midpt)  # -> XComponent, YComponent, ZComponent; disabled
sort = SortList(Keys=pdecon_2.ZComponent, ValuesA=edgeslen.Edges)  # -> Keys, ValuesA; disabled
item_6 = ListItem(List=sort.ValuesA, Index=0, Wrap=True)  # disabled
dispatch_2 = Dispatch(List=flatten(item_6), DispatchPattern=[True, False])  # -> ListA, ListB; disabled

# ----
midpt_2 = CurveMiddle(Curve=debrep.Edges)  # disabled

# ---- group: Aft edge of sheerline
pdecon_3 = Deconstruct(Point=midpt_2)  # -> XComponent, YComponent, ZComponent; disabled
abs = Absolute(Value=pdecon_3.XComponent)  # disabled
sort_2 = SortList(Keys=abs, ValuesA=debrep.Edges)  # -> Keys, ValuesA; disabled

# ----
panel_4 = Panel("G-hull")  # disabled
layers = QueryModelLayers(Name=panel_4, AutoUpdateState=True)  # disabled
panel_5 = Panel("CanoeBody")  # disabled
flip = FlipCurve(Curve=dispatch_2.ListB)  # -> Curve, Flag; disabled
crv = Curve(dispatch_2.ListB)  # disabled

# ---- group: Topside edge @ bow
item_7 = ListItem(List=sort_2.ValuesA, Index=0, Wrap=True)  # disabled
dispatch_3 = Dispatch(List=flatten(item_7), DispatchPattern=[True, False])  # -> ListA, ListB; disabled

# ----
panel_6 = Panel("Topsides")  # disabled
panel_7 = Panel("""Topside Inner
Topside Outer""")  # disabled
object_3 = ModelObject(Geometry=[hull_2, hull], Name=panel_7, Layer=layers)  # -> Object, Geometry; disabled
transom_cutting_srf_2 = Surface(transom_cutting_srf)  # disabled
panel_8 = Panel("""Chine Flat Outer
Chine Flat Inner""")  # disabled
panel_9 = Panel("C-deck")  # disabled
panel_10 = Panel("Deck")  # disabled
layers_2 = QueryModelLayers(Name=panel_9, AutoUpdateState=True)  # disabled
display = DisplayAttributes(IsocurveDensity=-11)  # disabled
panel_11 = Panel("""LOA <m>
BOAh <m>
Dh <m>""")  # disabled

# ---- group: Stem
deck_camber = Number(expr("x/100", item_4.Item))
chine_angle = Integer(item_4.Item4)
stem_factor = Number(item_4.Item1)
chine_width = Integer(item_4.Item3)
flip_2 = FlipCurve(Curve=nurbs.Curve, Guide=sheer_2)  # -> Curve, Flag; disabled
stem_deck_crv = StemDeckCrv(f=stem_factor, crv_1=sheer_2, crv_2=flip_2.Curve)  # disabled
stem_deck_crv_2 = StemDeckCrv(f=stem_factor, crv_1=chine_2, crv_2=flip.Curve)  # disabled
edgesrf = EdgeSurface(CurveA=stem_deck_crv, CurveB=dispatch_3.ListB, CurveC=dispatch_3.ListA, CurveD=stem_deck_crv_2)  # disabled

# ----
multiplication = Multiplication(A=stem_factor, B=profile_factor)  # disabled

# ---- group: Cambered Deck
cambered_deck_from_sheer_lines = CamberedDeckSrf(C=sheer_2, C_2=nurbs.Curve, dist=1400, stem_crv=stem_deck_crv, camber=deck_camber)  # disabled

# ----
flip_3 = FlipCurve(Curve=stem_deck_crv)  # -> Curve, Flag; disabled
cluster = Cluster_2(C=sheer_2, C_2=nurbs.Curve, camber=deck_camber, stem_crv=flip_3.Curve)  # -> _50_50_cambered_deck, front_s, rear_s, stem; disabled

# ---- group: If it's called outer chine it is hard chine
object_4 = ModelObject(Object=item_3.Item1)  # -> Object, Name
panel_12 = Panel(object_4.Name)
tmatch = MatchText(Text=object_4.Name, Pattern="*outer*", Case=True)
dispatch_4 = Dispatch(List=entwine, DispatchPattern=tmatch)  # -> ListA, ListB; disabled
dispatch_5 = Dispatch(List=cluster._50_50_cambered_deck, DispatchPattern=tmatch)  # -> ListA, ListB; disabled

# ---- group: Scale inner chine line
object_5 = ModelObject(Object=item_3.Item1)  # -> Object, Geometry, Name; disabled
object_6 = ModelObject(Object=item_2.Item1)  # -> Object, Geometry, Name; disabled
object_7 = ModelObject(item_2.Item2)  # disabled
panel_13 = Panel(object_6.Name)  # disabled
x_tremez = Extremes(Curve=object_5.Geometry, Plane=Plane(origin=(0, 0, 0), x=(0, 0, 1), y=(1, 0, 0)))  # -> Highest, Lowest; disabled
panel_14 = Panel(object_5.Name)  # disabled
x_tremez_2 = Extremes(Curve=object_6.Geometry, Plane=Plane(origin=(0, 0, 0), x=(0, 0, 1), y=(1, 0, 0)))  # -> Highest, Lowest; disabled
x_tremez_3 = Extremes(Curve=object_7, Plane=PlaneXY(0, 0, 0))  # -> Highest, Lowest; disabled
pdecon_4 = Deconstruct(Point=x_tremez.Lowest)  # -> XComponent, expr("ABS(x)*2", YComponent), ZComponent; disabled
chine_width_2 = Integer(chine_width)  # disabled
chine_height = Integer(chine_angle)  # disabled
pdecon_5 = Deconstruct(Point=x_tremez_2.Highest)  # -> XComponent, expr("ABS(x)*2", YComponent), ZComponent; disabled
pdecon_6 = Deconstruct(Point=x_tremez_3.Lowest)  # -> XComponent, YComponent, ZComponent; disabled
expression_3 = Expression(BOA=pdecon_4.YComponent, Cw=chine_width_2, Expression="(BOA-Cw)/BOA")  # disabled
expression_4 = Expression(BOA=pdecon_5.YComponent, Cw=chine_width_2, CF=increase_inner_chine_2, Expression="(BOA-Cw)/BOA*(1+CF/100)")  # disabled
expression_5 = Expression(d=pdecon_6.YComponent, Ch=chine_height, Expression="(d-Ch)/d")  # disabled
end_2 = EndPoints(Curve=object_5.Geometry)  # -> Start, End; disabled
pt_2 = Point(end_2.Start)  # disabled
expression_6 = Expression(p=pt_2, Expression="{p.x,0,p.z}")  # disabled
scale_nu_4 = ScaleNU(Geometry=object_5.Geometry, Plane=PlaneXY(0, 0, 0), ScaleX=1, ScaleY=expression_3, ScaleZ=1)  # -> ChineOutInside, Transform; disabled
scale_nu_5 = ScaleNU(Geometry=object_6.Geometry, Plane=PlaneXY(0, 0, 0), ScaleX=1, ScaleY=expression_4, ScaleZ=1)  # -> ChineInnInside, Transform; disabled
xy = XYPlane(Origin=expression_6)  # disabled
scale_nu_6 = ScaleNU(Geometry=scale_nu_4.ChineOutInside, Plane=xy, ScaleX=1, ScaleY=1, ScaleZ=expression_5)  # -> ChineOutInside, Transform; disabled
scale_nu_7 = ScaleNU(Geometry=scale_nu_5.ChineInnInside, Plane=xy, ScaleX=1, ScaleY=1, ScaleZ=expression_5)  # -> ChineInnInside, Transform; disabled
panel_15 = Panel("Chine outside inner Crv")  # disabled
panel_16 = Panel("Chine inside inner Crv")  # disabled
object_8 = ModelObject(Object=object_5.Object, Geometry=scale_nu_6.ChineOutInside, Name=panel_15)  # disabled
object_9 = ModelObject(Object=object_6.Object, Geometry=scale_nu_7.ChineInnInside, Name=panel_16)  # disabled

# ---- group: If not hard-bilge deepen the line
object_10 = ModelObject(Object=[bilge_2, bilge])  # -> Object, Geometry; disabled
dispatch_6 = Dispatch(List=object_10.Geometry, DispatchPattern=[True, False])  # -> ListA, ListB; disabled
end_3 = EndPoints(Curve=dispatch_6.ListA)  # -> Start, End; disabled
pdecon_7 = Deconstruct(Point=[end_3.End, end_3.Start])  # -> XComponent, YComponent, ZComponent; disabled
dispatch_7 = Dispatch(List=object_10.Geometry, DispatchPattern=hard_bilge_2)  # -> ListA, ListB; disabled
sort_3 = SortList(Keys=pdecon_7.ZComponent, ValuesA=[end_3.Start, end_3.End])  # -> Keys, ValuesA; disabled
number_slider = Slider(1.4, range=1..2)  # disabled

# ----
item_8 = ListItem(List=sort_3.ValuesA, Index=0, Wrap=True)  # disabled

# ---- group: If not hard-bilge deepen the line (continued)
pl_origin = PlaneOrigin(Base=PlaneXY(0, 0, 0), Origin=item_8)  # disabled
scale_nu_8 = ScaleNU(Geometry=dispatch_7.ListB, Plane=pl_origin, ScaleX=1, ScaleY=1, ScaleZ=number_slider)  # -> Geometry, Transform; disabled
clean_2 = CleanTree(RemoveNulls=True, RemoveInvalid=True, RemoveEmpty=False, Tree=[scale_nu_8.Geometry, dispatch_7.ListA])  # disabled
object_11 = ModelObject(Object=object_10.Object, Geometry=clean_2)  # disabled
dispatch_8 = Dispatch(List=object_11, DispatchPattern=[True, False])  # -> ListA, ListB; disabled

# ---- group: Scale inner chine line (continued)
entwine_2 = Entwine(
    Branch00=object_8,
    Branch01=dispatch_8.ListA,
    Branch02=dispatch.ListA,
    Branch03=dispatch_8.ListB,
    Branch04=object_9,
    FlattenInputs=True)  # -> flatten(Result); disabled

# ---- group: Round bilge (one topside)
entwine_3 = Entwine(
    Branch00=sheer_2,
    Branch01=chine_2,
    Branch02=bilge_2,
    Branch03=dispatch.ListA,
    Branch04=bilge,
    Branch05=chine,
    Branch06=scale_nu_3.Geometry,
    FlattenInputs=True)  # -> flatten(Result); disabled
panel_17 = Panel("Topsides")  # disabled

# ---- group: If it's called outer chine it is hard chine (continued)
dispatch_9 = Dispatch(List=entwine_3, DispatchPattern=tmatch)  # -> ListA, ListB; disabled
dispatch_10 = Dispatch(List=entwine_2, DispatchPattern=tmatch)  # -> ListA, ListB; disabled

# ---- group: Round bilge (one topside) (continued)
filter = StreamFilter(Gate=hourglass_figure_2, Stream0=dispatch_9.ListB, Stream1=dispatch_4.ListB)  # disabled
hull_3 = Loft(Curves=flatten(filter), Options={Adjust=True, Closed=False, LoftEnds=0, LoftSimp=0, LoftType=1, Rebuild=10, Refit=0.01})  # disabled

# ---- group: Round bilge (one topside) / Stem for Asymmetrical hull
stem_srf = StemSrf(B=hull_3, stem_f=stem_factor, f=profile_factor, d1=0.9, d2=0.1)  # -> C, stem_side_crv, stem_base, stem_crv, profile_crv; disabled
srf = Surface(stem_srf.stem_base)  # disabled
crv_2 = Curve(stem_srf.profile_crv)  # disabled
flip_4 = FlipCurve(Curve=stem_srf.C)  # -> Curve, Flag; disabled
crv_3 = Curve(stem_srf.stem_crv)  # disabled

# ----
object_12 = ModelObject(Geometry=hull_3, Name=panel_6, Layer=layers)  # -> Object, Geometry; disabled
entwine_4 = Entwine(Branch00=cluster.front_s, Branch01=object_12.Object, Branch02=dispatch_5.ListB, FlattenInputs=True)  # disabled

hull_4 = Loft(
    Curves=flatten(dispatch_10.ListA),
    Options={Adjust=True, Closed=False, LoftEnds=0, LoftSimp=0, LoftType=1, Rebuild=10, Refit=0.01})  # disabled
outer_chine_wide = Curve(dispatch_2.ListA)  # disabled
inner_chine_wide = Curve(dispatch_2.ListB)  # disabled
panel_18 = Panel("Stem lower")  # disabled
panel_19 = Panel("Stem Chine")  # disabled

object_13 = ModelObject(Geometry=hull_4, Name=panel_5, Layer=layers)  # -> Object, Geometry; disabled

# ---- group: Stem for Asymmetrical hull
stem_srf_2 = StemSrf(B=hull_4, stem_f=multiplication, f=profile_factor, d1=0.9, d2=0.1)  # -> C, stem_side_crv, stem_base, stem_crv, profile_crv; disabled
crv_4 = Curve(stem_srf_2.C)  # disabled
flip_5 = FlipCurve(Curve=stem_srf_2.C)  # -> Curve, Flag; disabled
srf_2 = Surface(stem_srf_2.stem_base)  # disabled
crv_5 = Curve(stem_srf_2.stem_crv)  # disabled

# ---- group: Stem (continued)
debrep_2 = DeconstructBrep(Brep=hull_4)  # -> Faces, Edges, Vertices; disabled
len_2 = Length(Curve=debrep_2.Edges)  # disabled
ma_2 = MassAddition(Input=len_2)  # -> Result, PartialResults; disabled
edgeslen_2 = EdgesFromLength(Brep=hull_4, Minimum=expr("x/4", ma_2.Result), Maximum=ma_2.Result)  # -> Edges, Indices; disabled
dispatch_11 = Dispatch(List=edgeslen_2.Edges, DispatchPattern=[True, False])  # -> ListA, ListB; disabled
stem_deck_crv_3 = StemDeckCrv(f=multiplication, crv_1=dispatch_11.ListA, crv_2=dispatch_11.ListB)  # disabled

# ---- group: Blend between stem shapes
twn2crvs = TweenTwoCurves(CurveA=stem_srf_2.C, CurveB=stem_deck_crv_3, Factor=0.5, Refit=0, PointSample=0)  # disabled
end_4 = EndPoints(Curve=stem_deck_crv_3)  # -> Start, End; disabled
end_5 = EndPoints(Curve=twn2crvs)  # -> Start, End; disabled
planar = Planar(Curve=stem_deck_crv_3)  # -> Planar, Plane, Deviation; disabled
yz = YZPlane(Origin=Point(0, 0, 0))  # disabled
dist = Distance(PointA=end_4.Start, PointB=end_4.End)  # disabled
dist_2 = Distance(PointA=end_5.Start, PointB=end_5.End)  # disabled
vec2pt = Vector2Pt(PointA=end_5.End, PointB=end_4.End, Unitize=False)  # -> Vector, Length; disabled
align = AlignPlanes(Planes=planar.Plane, Master=yz)  # disabled
transform = Transform(Geometry=twn2crvs, Transform=vec2pt.Vector)  # disabled
division = Division(A=dist, B=dist_2)  # disabled
pl_origin_2 = PlaneOrigin(Base=align, Origin=end_5.End)  # disabled
scale_nu_9 = ScaleNU(Geometry=transform, Plane=pl_origin_2, ScaleX=division, ScaleY=1, ScaleZ=1)  # -> Geometry, Transform; disabled

# ---- group: Round bilge (one topside) (continued)
cull_i = CullIndex(List=reverse(crv_3), Indices=-1, Wrap=True)  # disabled
netsurf = NetworkSurface(CurvesU=stem_srf.stem_side_crv, CurvesV=flatten(cull_i), Continuity=1)  # -> flatten(StemBase); disabled
split_larger = SplitLarger(O=entwine_4, cutting_srf=transom_cutting_srf_2)  # -> lrge_srf_o, small_srf_o, cutting_crv_2; disabled
split_larger_2 = SplitLarger(O=transom_cutting_srf_2, cutting_srf=transom_cutting_srf_2, cutting_crv=split_larger.cutting_crv_2)  # -> lrge_srf_o, small_srf_o, cutting_crv_2; disabled
near_cl = NearCL(srf=[split_larger_2.lrge_srf_o, split_larger_2.small_srf_o])  # disabled
topsides = Surface(split_larger.lrge_srf_o)  # disabled

# ----
cull_i_2 = CullIndex(List=crv_5, Indices=-1, Wrap=True)  # disabled
outer_chine_narrow = Curve(dispatch_11.ListB)  # disabled
inner_chine_narrow = Curve(dispatch_11.ListA)  # disabled
flip_6 = FlipCurve(Curve=scale_nu_9.Geometry)  # -> Curve, Flag; disabled
flip_7 = FlipCurve(Curve=outer_chine_narrow, Guide=outer_chine_wide)  # -> Curve, Flag; disabled
flip_8 = FlipCurve(Curve=inner_chine_narrow)  # -> Curve, Flag; disabled
loft = Loft(
    Curves=flatten([outer_chine_wide, flip_7.Curve]),
    Options={Adjust=False, Closed=False, LoftEnds=0, LoftSimp=0, LoftType=0, Rebuild=10, Refit=0.01})  # disabled
loft_2 = Loft(
    Curves=flatten([inner_chine_narrow, inner_chine_wide]),
    Options={Adjust=False, Closed=False, LoftEnds=0, LoftSimp=0, LoftType=0, Rebuild=10, Refit=0.01})  # disabled

# ---- group: Stem (continued)
loft_3 = Loft(
    Curves=flatten([flip_6.Curve, stem_deck_crv_2]),
    Options={Adjust=False, Closed=False, LoftEnds=0, LoftSimp=0, LoftType=0, Rebuild=10, Refit=0.01})  # disabled
netsurf_2 = NetworkSurface(CurvesU=stem_srf_2.stem_side_crv, CurvesV=flatten([scale_nu_9.Geometry, cull_i_2]), Continuity=1)  # -> flatten(StemBase); disabled

# ----
object_14 = ModelObject(Geometry=[loft, loft_2], Name=panel_8, Layer=layers)  # -> Object, Geometry; disabled
entwine_5 = Entwine(
    Branch00=cluster.rear_s,
    Branch01=object_14.Object,
    Branch02=object_3.Object,
    Branch03=object_13.Object,
    FlattenInputs=True)  # disabled
panel_20 = Panel(entwine_5)  # disabled

split_larger_3 = SplitLarger(O=entwine_5, cutting_srf=transom_cutting_srf_2)  # -> lrge_srf_o, small_srf_o, cutting_crv_2; disabled
split_larger_4 = SplitLarger(O=transom_cutting_srf_2, cutting_srf=transom_cutting_srf_2, cutting_crv=split_larger_3.cutting_crv_2)  # -> lrge_srf_o, small_srf_o, cutting_crv_2; disabled
near_cl_2 = NearCL(srf=flatten([split_larger_4.lrge_srf_o, split_larger_4.small_srf_o]))  # disabled

split = SplitList(List=split_larger_3.lrge_srf_o, Index=1)  # -> ListA, ListB; disabled
srf_3 = Surface(split.ListA)  # disabled
join = BrepJoin(Breps=flatten([split.ListA, cluster.front_s, cluster.stem]))  # -> Breps, Closed; disabled
object_15 = ModelObject(Geometry=join.Breps, Name=panel_10, Layer=layers_2)  # -> flatten(Object), Geometry; disabled

# ---- group: Transom to trim
panel_21 = Panel("C-hull")  # disabled
layers_3 = QueryModelLayers(Name=panel_21, AutoUpdateState=True)  # disabled
panel_22 = Panel("Transom")  # disabled
panel_23 = Panel("Stem upper")  # disabled
transom_srf = Surface([near_cl, near_cl_2])  # disabled
object_16 = ModelObject(Geometry=transom_srf, Name=panel_22, Layer=layers_3)  # -> Object, Geometry; disabled
object_17 = ModelObject(Geometry=[edgesrf, netsurf], Name=panel_23, Layer=layers_3)  # -> flatten(Object), Geometry; disabled

# ---- group: Round bilge (one topside) (continued)
object_18 = ModelObject(Geometry=topsides, Name=panel_17, Layer=layers_3)  # -> Object, Geometry; disabled

# ----
object_19 = ModelObject(Geometry=netsurf_2, Name=panel_18, Layer=layers_3)  # -> flatten(Object), Geometry; disabled
object_20 = ModelObject(Geometry=loft_3, Name=panel_19, Layer=layers_3)  # -> flatten(Object), Geometry; disabled

# ---- group: Solid vessel
clean_3 = CleanTree(
    RemoveNulls=True,
    RemoveInvalid=True,
    RemoveEmpty=True,
    Tree=flatten([split.ListB, split_larger.lrge_srf_o, object_16.Object, object_15.Object, object_17.Object, object_19.Object, object_20.Object]))  # disabled
join_2 = BrepJoin(Breps=flatten(clean_3))  # -> Vessel, Closed; disabled
capex = CapHolesEx(Brep=join_2.Vessel)  # -> Vessel, Caps, Solid; disabled
panel_24 = Panel("G-hull")  # disabled
layers_4 = QueryModelLayers(Name=panel_24, AutoUpdateState=True)  # disabled
object_21 = ModelObject(Geometry=capex.Vessel, Name=item_4.Item5, Layer=layers_4, Display=display)  # disabled

# ----
bbox = BoundingBox(Content=clean_3, Plane=PlaneXY(0, 0, 0), UnionBox=True)  # -> Box, Box_2; disabled
debox = DeconstructBox(Box=bbox.Box)  # -> Plane, X, Y, Z; disabled
dedomain = DeconstructDomain(Domain=debox.Y)  # -> Start, End; disabled
dedomain_2 = DeconstructDomain(Domain=debox.Z)  # -> Start, End; disabled
dedomain_3 = DeconstructDomain(Domain=debox.X)  # -> Start, End; disabled
expression_7 = Expression(x=dedomain.Start, y=dedomain.End, Expression="Round((y-x)/1e3,3)")  # disabled
expression_8 = Expression(x=dedomain_2.Start, y=dedomain_2.End, Expression="Round((y-x)/1e3,3)")  # disabled
expression_9 = Expression(x=dedomain_3.Start, y=dedomain_3.End, Expression="Round((y-x)/1e3,3)")  # disabled
entwine_6 = Entwine(Branch00=expression_9, Branch01=expression_7, Branch02=expression_8, FlattenInputs=True)  # disabled
concat_2 = Concatenate(FragmentA=graft(panel_11), FragmentB=entwine_6, JoinSeparator=" : ")  # disabled
panel_25 = Panel(concat_2)  # disabled
vessel_o = Object(object_21)  # disabled
solid = Solid(capex.Solid)  # disabled

# ==== cluster StemDeckCrv
f = ClusterInput()
crv_1 = ClusterInput()
crv_2 = ClusterInput()
end = EndPoints(Curve=crv_1)  # -> Start, End
end_2 = EndPoints(Curve=crv_2)  # -> Start, End
flip = FlipCurve(Curve=crv_2)  # -> Curve, Flag
eval = EvaluateCurve(Curve=reparameterize(crv_1), Parameter=0.001)  # -> Point, Tangent, Angle
eval_2 = EvaluateCurve(Curve=reparameterize(flip.Curve), Parameter=0.001)  # -> Point, Tangent, Angle
pdecon = Deconstruct(Point=end.Start)  # -> XComponent, YComponent, ZComponent
pdecon_2 = Deconstruct(Point=end.End)  # -> XComponent, YComponent, ZComponent
vec2pt = Vector2Pt(PointA=eval.Point, PointB=end.Start, Unitize=True)  # -> Vector, Length
vec2pt_2 = Vector2Pt(PointA=eval_2.Point, PointB=end_2.End, Unitize=True)  # -> Vector, Length
eval_3 = Evaluate(F="if(ABS(x)<ABS(y),ABS(x)*f,ABS(y)*f)", x=pdecon.YComponent, y=pdecon_2.YComponent, f=f)
multiplication = Multiplication(A=vec2pt.Vector, Mult=eval_3)
multiplication_2 = Multiplication(A=vec2pt_2.Vector, Mult=eval_3)
bzspan = BezierSpan(StartPoint=end.Start, StartTangent=multiplication, EndPoint=end_2.End, EndTangent=multiplication_2)  # -> StemCrv, Length, Domain
stem_crv = ClusterOutput(bzspan.StemCrv)

# ==== cluster NearCL
srf = ClusterInput()

# ---- group: How many edges?
dispatch = Dispatch(List=srf, DispatchPattern=[True, False])  # -> ListA, ListB
wires = BrepWireframe(Brep=dispatch.ListB, Density=-1)
wires_2 = BrepWireframe(Brep=dispatch.ListA, Density=-1)
join = JoinCurves(Curves=wires_2, Preserve=False)
join_2 = JoinCurves(Curves=wires, Preserve=False)
lng = ListLength(List=join_2)
lng_2 = ListLength(List=join)

# ---- group: Keep inner surface
srf_2 = Surface(srf)  # disabled
area = Area(Geometry=srf_2)  # -> Area, Centroid; disabled
pdecon = Deconstruct(Point=area.Centroid)  # -> XComponent, YComponent, ZComponent; disabled
abs = Absolute(Value=pdecon.YComponent)  # disabled
dispatch_2 = Dispatch(List=abs, DispatchPattern=[True, False])  # -> ListA, ListB; disabled
smaller = SmallerThan(FirstNumber=dispatch_2.ListA, SecondNumber=dispatch_2.ListB)  # -> SmallerThan, OrEqualTo; disabled
not = GateNot(A=smaller.SmallerThan)  # disabled
dispatch_3 = Dispatch(List=srf_2, DispatchPattern=[smaller.SmallerThan, not])  # -> ListA, ListB; disabled

# ----
debox = DeconstructBox()  # -> Plane, X, Y, Z
box = EvaluateBox(UParameter=0.5, VParameter=0.5, WParameter=0.5)  # -> Plane, Point, Include
larger = LargerThan(FirstNumber=lng_2, SecondNumber=lng)  # -> LargerThan, OrEqualTo
dispatch_4 = Dispatch(List=dispatch.ListA, DispatchPattern=larger.LargerThan)  # -> ListA, ListB
dispatch_5 = Dispatch(List=dispatch.ListB, DispatchPattern=larger.LargerThan)  # -> ListA, ListB
transom_srf = Surface([dispatch_4.ListB, dispatch_5.ListA])
transom_srf_2 = ClusterOutput(transom_srf)

# ==== cluster StemSrf

# ---- group: Stem
stem_f = ClusterInput()

# ----
f = ClusterInput()
B = ClusterInput()
d1 = ClusterInput()
d2 = ClusterInput()
merge = Merge(Data1=d1, Data2=d2)
dom = ConstructDomain(DomainStart="0", DomainEnd="1")
dom_2 = ConstructDomain(DomainStart="0.5", DomainEnd="1")
dom_3 = ConstructDomain(DomainStart="0", DomainEnd="0.5")
sec = BrepPlane(Brep=B, Plane=Plane(origin=(0, 0, 0), x=(0, 0, 1), y=(1, 0, 0)))  # -> Curves, Points; disabled
dom² = ConstructDomain²(DomainU=dom_2, DomainV=dom)
dom²_2 = ConstructDomain²(DomainU=dom_3, DomainV=dom)
srfsplit = SurfaceSplit(Surface=B, Curves=sec.Curves)  # disabled
subsrf = Isotrim(Surface=reparameterize(B), Domain=dom²_2)
subsrf_2 = Isotrim(Surface=reparameterize(B), Domain=dom²)
debrep = DeconstructBrep(Brep=B)  # -> Faces, Edges, Vertices
srf = Surface([subsrf, subsrf_2])
len = Length(Curve=debrep.Edges)
debrep_2 = DeconstructBrep(Brep=srf)  # -> Faces, Edges, Vertices
sort = SortList(Keys=len, ValuesA=debrep.Edges)  # -> Keys, reverse(ValuesA)
midpt = CurveMiddle(Curve=debrep_2.Edges)
pdecon = Deconstruct(Point=midpt)  # -> XComponent, YComponent, ZComponent
item = ListItem(List=sort.ValuesA, Index=0, Wrap=True)  # -> Item, Item1
sort_2 = SortList(Keys=pdecon.XComponent, ValuesA=debrep_2.Edges)  # -> Keys, ValuesA
item_2 = ListItem(List=sort_2.ValuesA, Index=0, Wrap=True)  # -> Item, Item1
dispatch = Dispatch(List=flatten(item_2.Item), DispatchPattern=[True, False])  # -> ListA, ListB
debrep_3 = DeconstructBrep(Brep=subsrf)  # -> Faces, Edges, Vertices
flip = FlipCurve(Curve=dispatch.ListA)  # -> Curve, Flag
sort_pt = SortPoints(Points=debrep_3.Vertices)  # -> Points, Indices
aligned_front_of_hull_crv = Curve([flip.Curve, dispatch.ListB])
split = SplitList(List=sort_pt.Points, Index=2)  # -> ListA, ListB
shatter = Shatter(Curve=reparameterize(aligned_front_of_hull_crv), Parameters=merge)
pdecon_2 = Deconstruct(Point=split.ListA)  # -> XComponent, YComponent, ZComponent
sort_3 = SortList(Keys=pdecon_2.ZComponent, ValuesA=split.ListA)  # -> Keys, ValuesA
dispatch_2 = Dispatch(List=shatter, DispatchPattern=[True, False])  # -> ListA, ListB
item_3 = ListItem(List=sort_3.ValuesA, Index=Slider(0, range=0..10), Wrap=True)
multiplication = Multiplication(StemF=stem_f, B=f)
crv = Curve(dispatch_2.ListB)
bow_pt = Point(item_3)
pframes = PerpFrames(Curve=crv, Count=6, Align=simplify(True))  # -> Frames, Parameters
outer_chine = Curve(item.Item1)
inner_chine = Curve(item.Item)
sec_2 = BrepPlane(Brep=graft(srf), Plane=pframes.Frames)  # -> simplify(Curves), Points

# ---- group: Stem top
cluster = Cluster(f=multiplication, inner_chine=inner_chine, outer_chine=outer_chine)

# ----
panel = Panel(pframes.Parameters)
trim = TrimTree(Tree=sec_2.Curves, Depth=1)
bang = ExplodeTree(Data=trim)  # -> Branch0, Branch1
flip_2 = FlipCurve(Curve=cluster)  # -> Curve, Flag

# ---- group: Stem mid
cluster_2 = Cluster(f=multiplication, inner_chine=bang.Branch0, outer_chine=bang.Branch1)

# ----
crv_2 = Curve(flatten([flip_2.Curve, cluster_2]))

# ---- group: Stem sides
reb = RebuildCurve(Curve=aligned_front_of_hull_crv, Degree=2, Count=1000, Tangents=True)  # -> flatten(StemSideCrv)

# ----
midpt_2 = CurveMiddle(Curve=crv_2)
pdecon_3 = Deconstruct(Point=midpt_2)  # -> XComponent, YComponent, ZComponent
sort_4 = SortList(Keys=pdecon_3.ZComponent, ValuesStemCrv=crv_2)  # -> Keys, ValuesStemCrv
netsurf = NetworkSurface(CurvesU=reb, CurvesV=sort_4.ValuesStemCrv, Continuity=1)  # -> flatten(StemBase)
midpt_3 = CurveMiddle(Curve=sort_4.ValuesStemCrv)
entwine = Entwine(Branch00=bow_pt, Branch01=midpt_3, FlattenInputs=True)  # -> flatten(Result)
points = PointList(Points=entwine, Size=20)
intcrv = Interpolate(Vertices=entwine, Degree=3, Periodic=False, KnotStyle=1)  # -> ProfileCrv, Length, Domain
C = ClusterOutput(flip_2.Curve)
stem_side_crv = ClusterOutput(reb)
stem_base = ClusterOutput(netsurf)
stem_crv = ClusterOutput(sort_4.ValuesStemCrv)
profile_crv = ClusterOutput(intcrv.ProfileCrv)

# ==== cluster CamberedDeckSrf: Cambered Deck fromdividing Sheer lines & adding CL offset to make arc
number_slider = Slider(1552, range=10..10000)
C = ClusterInput()
C_2 = ClusterInput()
dist = ClusterInput()
stem_crv = ClusterInput()
camber = ClusterInput()
panel = Panel("1")
ext = ExtendCurve(Curve=C_2, Type=2, Start=expr("-x", "0.001"), End=dist)
ext_2 = ExtendCurve(Curve=C, Type=2, Start=expr("-x", "0.001"), End=dist)
tweencrv = TweenCurve(CurveA=ext_2, CurveB=ext, Factor=0.5, BlendType=0)
number_slider_2 = Slider(0, range=0..100)
divdist = DivideDistance(Curve=flatten([ext, ext_2]), Distance=dist)  # -> Points, Tangents, Parameters
divdist_2 = DivideDistance(Curve=tweencrv, Distance=dist)  # -> Points, Tangents, Parameters
panel_2 = Panel("-1")
cull_i = CullIndex(List=divdist_2.Points, Indices=number_slider_2, Wrap=True)
cull_i_2 = CullIndex(List=divdist.Points, Indices=number_slider_2, Wrap=True)
flip = FlipMatrix(Data=cull_i)
flip_2 = FlipMatrix(Data=cull_i_2)
dispatch = Dispatch(List=flip_2, DispatchPattern=[True, False])  # -> ListA, ListB
dist_2 = Distance(PointA=dispatch.ListA, PointB=dispatch.ListB)
multiplication = Multiplication(A=dist_2, Camber=camber)
merge = Merge()
Z = UnitZ(Factor=flatten(multiplication))  # -> graft(UnitVector)
midpt = CurveMiddle(Curve=stem_crv)
move = Move(Geometry=flip, Motion=Z)  # -> Geometry, Transform
merge_2 = Merge(Data1=midpt, Data2=move.Geometry)
arc = Arc3Pt(SheerPt=dispatch.ListA, PointB=move.Geometry, SheerPt_2=dispatch.ListB)  # -> CamberCrv, Plane, Radius
intcrv = Interpolate(Vertices=flatten(merge_2), Degree=3, Periodic=False, KnotStyle=1)  # -> Curve, Length, Domain
merge_3 = Merge(Data1=ext_2, Data2=intcrv.Curve, Data3=ext)
merge_4 = Merge(Data1=stem_crv, Data2=arc.CamberCrv)
netsurf = NetworkSurface(CurvesU=flatten(merge_3), CurvesV=flatten(merge_4), Continuity=3)
deck_srf = ClusterOutput(netsurf)

# ==== cluster Cluster_2
camber = ClusterInput()
stem_crv = ClusterInput()
C = ClusterInput()
C_2 = ClusterInput()
subcrv = SubCurve(BaseCurve=graft([C, C_2]), Domain=["[0 to 0.5]", "[0.5 to 1.0]"])
end = EndPoints(Curve=flatten(subcrv))  # -> Start, End
item = ListItem(List=end.Start, Index=1, Wrap=True)  # -> flatten(Item), Item1, Item2
flip = FlipCurve(Curve=stem_crv)  # -> Curve, Flag
dispatch = Dispatch(List=item.Item, DispatchPattern=[True, False])  # -> ListA, ListB
pt = Point([item.Item, item.Item2])
dist = Distance(PointA=item.Item, PointB=item.Item2)
ln = Line(StartPoint=item.Item, EndPoint=item.Item2)
midpt = CurveMiddle(Curve=ln)
multiplication = Multiplication(A=dist, Camber=camber)
item_2 = ListItem(List=flatten(subcrv), Index=0, Wrap=True)  # -> Item, Item1, Item2, Item3
Z = UnitZ(Factor=flatten(multiplication))  # -> graft(UnitVector)
dispatch_2 = Dispatch(List=flatten(item_2.Item), DispatchPattern=[True, False])  # -> ListA, ListB
move = Move(Geometry=midpt, Motion=Z)  # -> Geometry, Transform
flip_2 = FlipCurve(Curve=item_2.Item)  # -> Curve, Flag
flip_3 = FlipCurve(Curve=item_2.Item2)  # -> Curve, Flag
arc = Arc3Pt(SheerPt=item.Item, PointB=move.Geometry, SheerPt_2=item.Item2)  # -> CamberCrv, Plane, Radius
crv = Curve(dispatch_2.ListA)
crv_2 = Curve(item_2.Item1)
swp2 = Sweep2(Rail1=flip_2.Curve, Rail2=flip_3.Curve, Sections=arc.CamberCrv, SameHeight=False)
swp2_2 = Sweep2(Rail1=item_2.Item1, Rail2=item_2.Item3, Sections=arc.CamberCrv, SameHeight=False)
debrep = DeconstructBrep(Brep=swp2)  # -> Faces, Edges, Vertices
item_3 = ListItem(List=debrep.Edges, Index=Slider(1, range=0..10), Wrap=True)
crv_3 = Curve(item_3)
loft = Loft(
    Curves=flatten([item_3, flip.Curve]),
    Options={Adjust=False, Closed=False, LoftEnds=0, LoftSimp=0, LoftType=0, Rebuild=10, Refit=0.01})
join = BrepJoin(Breps=flatten([swp2, swp2_2, loft]))  # -> _5050CamberedDeck, Closed
_50_50_cambered_deck = ClusterOutput(join._5050CamberedDeck)
rear_s = ClusterOutput(swp2_2)
front_s = ClusterOutput(swp2)
stem = ClusterOutput(loft)

# ==== cluster SplitLarger
cutting_crv = ClusterInput()
cutting_srf = ClusterInput()
O = ClusterInput()
object = ModelObject(Object=flatten(O))  # -> Object, Geometry, Name
flatten = FlattenTree(Tree=object.Geometry, Path="{0}")  # -> graft(Tree)
bbx = BrepBrep(Surface=flatten, CuttingSrf=cutting_srf)  # -> Curves, Points
srfsplit = SurfaceSplit(Surface=simplify(flatten), CuttingCrv=simplify([bbx.Curves, cutting_crv]))
area = Area(Geometry=srfsplit)  # -> Area, Centroid
dispatch = Dispatch(List=area.Area, DispatchPattern=[True, False])  # -> ListA, ListB
concat = Concatenate(FragmentA=object.Name, FragmentB="Small", JoinSeparator="-")
larger = LargerThan(FirstNumber=dispatch.ListA, SecondNumber=dispatch.ListB)  # -> LargerThan, OrEqualTo
not = GateNot(A=larger.LargerThan)
dispatch_2 = Dispatch(List=srfsplit, DispatchPattern=[larger.LargerThan, not])  # -> ListA, ListB
join = JoinCurves(Curves=flatten(bbx.Curves), Preserve=False)
larger_srf = Surface(dispatch_2.ListA)
smaller_srf = Surface(dispatch_2.ListB)
object_2 = ModelObject(Object=object.Object, Geometry=flatten(larger_srf))
object_3 = ModelObject(Object=object.Object, Geometry=flatten(smaller_srf), Name=concat)
cutting_crv_2 = ClusterOutput(join)
lrge_srf_o = ClusterOutput(object_2)
small_srf_o = ClusterOutput(object_3)

# ==== cluster Cluster
inner_chine = ClusterInput()
outer_chine = ClusterInput()
f = ClusterInput()
panel = Panel("""0
0.001
0.999
1""")
inner_chine_2 = Curve(inner_chine)
outer_chine_2 = Curve(outer_chine)
eval = EvaluateCurve(Curve=reparameterize(graft(inner_chine_2)), Parameter=panel)  # -> Point, Tangent, Angle
eval_2 = EvaluateCurve(Curve=reparameterize(graft(outer_chine_2)), Parameter=panel)  # -> Point, Tangent, Angle
x_tremez = Extremes(Curve=inner_chine_2, Plane=PlaneYZ(0, 0, 0))  # -> Highest, Lowest
x_tremez_2 = Extremes(Curve=outer_chine_2, Plane=PlaneYZ(0, 0, 0))  # -> Highest, Lowest
pdecon = Deconstruct(Point=eval.Point)  # -> XComponent, YComponent, ZComponent
pdecon_2 = Deconstruct(Point=eval_2.Point)  # -> XComponent, YComponent, ZComponent
pdecon_3 = Deconstruct(Point=x_tremez.Lowest)  # -> XComponent, YComponent, ZComponent
pdecon_4 = Deconstruct(Point=x_tremez_2.Lowest)  # -> XComponent, YComponent, ZComponent
sort = SortList(Keys=pdecon_2.XComponent, ValuesA=eval_2.Point)  # -> Keys, ValuesA
sort_2 = SortList(Keys=pdecon.XComponent, ValuesA=eval.Point)  # -> Keys, ValuesA
item = ListItem(List=sort_2.ValuesA, Index=0, Wrap=True)  # -> Item, Item1
item_2 = ListItem(List=sort.ValuesA, Index=0, Wrap=True)  # -> Item, Item1
expression = Expression(y=pdecon_3.YComponent, f=f, Expression="ABS(y)*f")
expression_2 = Expression(y=pdecon_4.YComponent, f=f, Expression="ABS(y)*f")
vec2pt = Vector2Pt(PointA=item.Item1, PointB=item.Item, Unitize=True)  # -> Vector, Length
vec2pt_2 = Vector2Pt(PointA=item_2.Item1, PointB=item_2.Item, Unitize=True)  # -> Vector, Length
vdis = VectorDisplay(Anchor=item.Item, Vector=vec2pt.Vector)
vdis_2 = VectorDisplay(Anchor=item_2.Item, Vector=vec2pt_2.Vector)
multiplication = Multiplication(A=flatten(vec2pt.Vector), Mult=expression)
multiplication_2 = Multiplication(A=flatten(vec2pt_2.Vector), Mult=expression_2)
bzspan = BezierSpan(StartPoint=x_tremez.Lowest, StartTangent=multiplication, EndPoint=x_tremez_2.Lowest, EndTangent=multiplication_2)  # -> StemCrv, Length, Domain
stem_crv = ClusterOutput(bzspan.StemCrv)
