# Grasshopper definition panel__cutout.gh (Grasshopper 1.0.8)
# Copyright: © 2023 SYD all rights reserved

cutout_offset = Number()
height = Number()
gap = Number()
centre = Relay()
length = Number()
width = Number()
length_2 = Number(length)
width_2 = Number(width)
height_2 = Number(height)
cutout_offset_2 = Number(cutout_offset)
gap_2 = Number(gap)
subtraction = Subtraction(A=length_2, B=cutout_offset_2)
subtraction_2 = Subtraction(A=width_2, B=cutout_offset_2)
dom = ConstructDomain(DomainStart=expr("-x/2", length_2), DomainEnd=expr("x/2", length_2))
dom_2 = ConstructDomain(DomainStart=expr("-x/2", width_2), DomainEnd=expr("x/2", width_2))
dom_3 = ConstructDomain(DomainStart=expr("-x/2", subtraction), DomainEnd=expr("x/2", subtraction))
dom_4 = ConstructDomain(DomainStart=expr("-x/2", subtraction_2), DomainEnd=expr("x/2", subtraction_2))
rectangle = Rectangle(Plane=centre, XSize=dom_3, YSize=dom_4, Radius=expr("x/2", cutout_offset_2))  # -> Rectangle, Length
rectangle_2 = Rectangle(Plane=centre, XSize=dom, YSize=dom_2, Radius=0)  # -> Rectangle, Length
Z = UnitZ(Factor=height_2)
srf = Surface(rectangle_2.Rectangle)
extr = Extrude(Base=srf, Direction=Z)
concat = Concatenate(L=length_2, W=width_2, H=height_2, JoinSeparator="x")
Z_2 = UnitZ(Factor=gap_2)
layers = QueryModelLayers(Name="Q-deck-tech", AutoUpdateState=True)
move = Move(Geometry=extr, Motion=Z_2)  # -> Geometry, Transform
concat_2 = Concatenate(FragmentA="Solar panel", FragmentB=concat, JoinSeparator=" ")
object = ModelObject(Geometry=move.Geometry, Name=concat_2, Layer=layers)
panel = Panel("""Length
Width""")
u_text = UserText(Content=object, Keys=panel, Values=[length_2, width_2], UserTextMode=1)  # -> Content, Keys, Values
rect = Rectangle(rectangle_2.Rectangle)
cutout = Rectangle(rectangle.Rectangle)
solar_o = Content(u_text.Content)
