# Grasshopper definition planing_hull_fairing.gh (Grasshopper 1.0.8)
# Copyright: © SYD 2022
# Copyright: © 2023 SYD all rights reserved

stem_factor = Number()
project = Text()
fetch_o = Object()
chine_width_mm = Number()
straight_f = B()
ts = TextSettings()
chine_angle = Number()
transom_o = Object()
sinkage = Factor()
camber = Number()
object = ModelObject(TransomO=transom_o)  # -> Object, Geometry, Name, Layer, Visibility, Display, Drafting, Render
item = ListItem(List=flatten(object.Object), Index=0, Wrap=True)
object_2 = ModelObject(Object=item)
u_text = UserText(Content=object.Object, UserTextMode=1)  # -> Content, Keys, Values
panel = Panel(object.Name)
bang = ExplodeTree(Data=u_text.Values)  # -> Branch0, Branch1, Branch2, Branch3, Branch4
panel_2 = Panel(u_text.Keys)
panel_3 = Panel(u_text.Values)
item_2 = ListItem(List=bang.Branch0, Index=0, Wrap=False)  # -> Item, Item1, Item2, Item3, Item4, Item5, Item6, Item7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
item_3 = ListItem(List=bang.Branch1, Index=0, Wrap=True)  # -> Item, Item1, Item2, Item3, Item4, Item5, Item6
item_4 = ListItem(List=bang.Branch2, Index=0, Wrap=False)
item_5 = ListItem(List=bang.Branch3, Index=0, Wrap=False)  # -> Item, Item1, Item2
item_6 = ListItem(List=bang.Branch4, Index=0, Wrap=False)  # -> Item, Item1
dsp_chine = Boolean(item_5.Item2)
hard_bilge = Boolean(item_6.Item)
multihull = Boolean(invert(item_4))
planing = Boolean(item_5.Item)
dsp_roundb = Boolean(item_5.Item1)
hourglass = Boolean(item_6.Item1)
multiplication = Multiplication(A=item_3.Item, B=item_3.Item5)
dispatch = Dispatch(CurvePtsO=fetch_o, DispatchPattern=simplify(graft([planing, dsp_roundb, dsp_chine])))  # -> ListA, ListB
bang_2 = ExplodeTree(Data=dispatch.ListA)  # -> Branch0, Branch1, Branch2
object_3 = ModelObject(DspRoundBO=bang_2.Branch1)  # -> Object, Name
chine_angle_2 = Number(chine_angle)
Z = UnitZ(Sinkage=expr("-x", sinkage))
object_4 = ModelObject(FetchO=fetch_o)  # -> ModPtsO, Geometry, Name
chine_width_mm_2 = Number(chine_width_mm)
abs = Absolute(Value=chine_angle_2)
move = Move(Geometry=object_2, Motion=Z)  # -> Geometry, Transform
camber_2 = Number(expr("x/100", camber))
move_2 = Move(Geometry=object_4.Geometry, Motion=Z)  # -> SunkPoints, Transform
stem_factor_2 = Number(stem_factor)
trig = TriangleTrigonometry(Beta=degrees(90), Gamma=degrees(abs), ALength=chine_width_mm_2)  # -> Alpha, Beta, Gamma, ALength, BLength, CLength
larger = LargerThan(FirstNumber=chine_angle_2, SecondNumber=0)  # -> LargerThan, OrEqualTo

# ---- group: Transom to trim
null = NullItem(Item=object_2)  # -> NullFlags, InvalidFlags, Description
bool = Boolean(null.NullFlags)

# ----
trim = TextTrim(Project=project, Start=True, End=True)
object_5 = ModelObject(Geometry=move_2.SunkPoints, Name=object_4.Name)  # -> Object, Name
dispatch_2 = Dispatch(List=trig.CLength, DispatchPattern=larger.LargerThan)  # -> ListA, ListB
neg = Negative(Value=dispatch_2.ListA)
tmatch = MatchText(Text=object_5.Name, Pattern="*bPt", Case=True)
tmatch_2 = MatchText(Text=object_5.Name, Pattern="*ePt", Case=True)
tmatch_3 = MatchText(Text=object_5.Name, Pattern="*Ht", Case=True)
tmatch_4 = MatchText(Text=object_5.Name, Pattern="*aPt", Case=True)
clean = CleanTree(RemoveNulls=True, RemoveInvalid=True, RemoveEmpty=False, Tree=[dispatch_2.ListB, neg])
dispatch_3 = Dispatch(List=object_5.Object, DispatchPattern=tmatch)  # -> ListA, ListB
dispatch_4 = Dispatch(List=object_5.Object, DispatchPattern=tmatch_2)  # -> ListA, ListB
dispatch_5 = Dispatch(List=object_5.Object, DispatchPattern=tmatch_3)  # -> ListA, ListB
dispatch_6 = Dispatch(List=object_5.Object, DispatchPattern=tmatch_4)  # -> ListA, ListB

# ---- group: Seperate Pts
item_7 = ListItem(List=dispatch_3.ListA, Index=0, Wrap=False)  # -> Item, Item1, Item2, Item3
item_8 = ListItem(List=dispatch_4.ListA, Index=0, Wrap=True)  # -> Item, Item1, Item2, Item3, Item4

# ----
pdecon = Deconstruct(Point=item_7.Item1)  # -> XComponent, YComponent, ZComponent
pdecon_2 = Deconstruct(Point=item_7.Item2)  # -> XComponent, YComponent, ZComponent

# ---- group: Aligh all stern points for flat transom
pdecon_3 = Deconstruct(Point=[item_7.Item1, item_7.Item2, item_7.Item3])  # -> XComponent, YComponent, ZComponent
sort = SortList(Keys=pdecon_3.XComponent)  # -> Keys, ValuesA
item_9 = ListItem(List=sort.Keys, Index=0, Wrap=True)
pt = ConstructPoint(XCoordinate=item_9, YCoordinate=pdecon_3.YComponent, ZCoordinate=pdecon_3.ZComponent)
object_6 = ModelObject(Object=[item_7.Item1, item_7.Item2, item_7.Item3])  # -> Object, Name
# Control Curves
pt_2 = Point(item_7.Item1)
object_7 = ModelObject(Geometry=pt, Name=object_6.Name)
item_10 = ListItem(List=object_7, Index=0, Wrap=True)  # -> Item, Item1, Item2

# ----
subtraction = Subtraction(A=pdecon.ZComponent, B=pdecon_2.ZComponent)
ln = Line(StartPoint=item_7.Item, EndPoint=dispatch_6.ListA)
X = UnitX(Factor=1)
line = LineSDL(Start=dispatch_5.ListA, Direction=unitize(X), Length=100000)
llx = LineLine(Line1=ln, Line2=line)  # -> ParamA, ParamB, PointA, PointB
object_8 = ModelObject(item_8.Item4)
chine_transm_bpt = ModelObject(item_10.Item)
chine_stem_bpt = ModelObject(llx.PointA)
stem_sheer_bpt = ModelObject(item_7.Item)
sort_2 = SortList(Keys=pdecon_3.YComponent)  # -> reverse(Keys), ValuesA
vec2pt = Vector2Pt(PointA=chine_stem_bpt, PointB=item_8.Item1, Unitize=False)  # -> Vector, Length
vec2pt_2 = Vector2Pt(PointA=item_7.Item2, PointB=item_8.Item3, Unitize=False)  # -> Vector, Length
vec2pt_3 = Vector2Pt(PointA=item_7.Item, PointB=dispatch_6.ListA, Unitize=False)  # -> Vector, Length
vec2pt_4 = Vector2Pt(PointA=item_7.Item3, PointB=item_8.Item4, Unitize=False)  # -> Vector, Length
vec2pt_5 = Vector2Pt(PointA=stem_sheer_bpt, PointB=item_8.Item, Unitize=False)  # -> Vector, Length
chine_height = Integer(clean)
chine_width = Integer(chine_width_mm_2)
item_11 = ListItem(List=sort_2.Keys, Index=0, Wrap=True)
multiplication_2 = Multiplication(A=vec2pt_4.Length, StraightF=straight_f)
expression = Expression(BOA=item_11, Cw=chine_width, Expression="(BOA-Cw)/BOA")
Y = UnitY(Factor=expr("-x*10", chine_width_mm_2))
expression_2 = Expression(v=vec2pt_4.Vector, Expression="{v.x,v.y,0}")
expression_3 = Expression(d=subtraction, Ch=chine_height, Expression="(d-Ch)/d")
amp = Amplitude(Vector=expression_2, Amplitude=multiplication_2)
bzspan = BezierSpan(StartPoint=chine_stem_bpt, StartTangent=vec2pt.Vector, EndPoint=chine_transm_bpt, EndTangent=amp)  # -> ChineOuter, Length, Domain

# ---- group: Scale inner chine line
pt_3 = Point(dispatch_5.ListA)
expression_4 = Expression(p=pt_3, Expression="{p.x,0,p.z}")
scale_nu = ScaleNU(Geometry=bzspan.ChineOuter, Plane=PlaneXY(0, 0, 0), ScaleX=1, ScaleY=expression, ScaleZ=1)  # -> ChineInner, Transform
xy = XYPlane(Origin=expression_4)
scale_nu_2 = ScaleNU(Geometry=scale_nu.ChineInner, Plane=xy, ScaleX=1, ScaleY=1, ScaleZ=expression_3)  # -> ChineInner, Transform

# ----
move_3 = Move(Geometry=chine_transm_bpt, Motion=Y)  # -> InnerChineTrnsmEPt, Transform
bzspan_2 = BezierSpan(StartPoint=stem_sheer_bpt, StartTangent=vec2pt_5.Vector, EndPoint=item_7.Item3, EndTangent=vec2pt_4.Vector)  # -> SheerLine, Length, Domain

vdis = VectorDisplay(BowAngle=chine_stem_bpt, Vector=vec2pt_3.Vector)
vdis_2 = VectorDisplay(KeelAngle=item_7.Item2, Vector=vec2pt_2.Vector)
vdis_3 = VectorDisplay(ChineBowA=chine_stem_bpt, Vector=vec2pt.Vector)
vdis_4 = VectorDisplay(TransomSheerA=item_7.Item3, Vector=vec2pt_4.Vector)
vdis_5 = VectorDisplay(ChineA=chine_transm_bpt, Vector=amp)
vdis_6 = VectorDisplay(InnerChineA=move_3.InnerChineTrnsmEPt, Vector=amp)

end = EndPoints(Curve=scale_nu_2.ChineInner)  # -> Start, End
vec2pt_6 = Vector2Pt(Unitize=False)  # -> Vector, Length
bzspan_3 = BezierSpan(StartPoint=end.Start, StartTangent=vec2pt_3.Vector, EndPoint=item_7.Item2, EndTangent=vec2pt_2.Vector)  # -> KeelLine, Length, Domain
pt_4 = Point(end.Start)
as_text = AnnotationTextSettings(TextSettings=ts)  # -> TextSettings, TextHeight
panel_4 = Panel("""0-Sheer
1-Ch-Out
2-Ch-Inn
3-Bilge""")

# ---- group: Display / End points
cluster = Cluster(pt=dispatch_5.ListA)

# ----
debrep = DeconstructBrep(Transom=move.Geometry)  # -> Faces, Edges, Vertices
stbd_srf = StbdSrf(B=debrep.Faces)
O = Object(object_5.Object)

# ---- group: Display
entwine = Entwine(
    Branch00=bzspan_2.SheerLine,
    Branch01=bzspan.ChineOuter,
    Branch02=scale_nu_2.ChineInner,
    Branch03=bzspan_3.KeelLine,
    FlattenInputs=True)
object_9 = ModelObject(Geometry=chine_stem_bpt, Name="Chine Stem bPt")
end_pts = ModelObject([item_8.Item, item_8.Item1, item_8.Item2, item_8.Item4, item_8.Item3])
base_pts = ModelObject([item_7.Item, item_10.Item, item_10.Item1, item_10.Item2, object_9])
layers = QueryModelLayers(Name="G-anno-text", AutoUpdateState=True)
panel_5 = Panel("G-anno")
panel_6 = Panel("""0 Bilge intersect Ht
1 Chine intersect Ht""")
cluster_2 = Cluster_2(cntrl_pt_o=flatten(base_pts), ts=ts)  # -> te, N, ad
cluster_3 = Cluster_2(cntrl_pt_o=end_pts, ts=ts)  # -> te, N, ad
cluster_4 = Cluster_2(cntrl_pt_o=dispatch_6.ListA, ts=ts)  # -> te, N, ad
display = DisplayAttributes(DisplayColour=ColourSwatch(SwatchColor=RGB(123, 182, 186)))
display_2 = DisplayAttributes(DisplayColour=ColourSwatch(SwatchColor=RGB(149, 96, 209)))
display_3 = DisplayAttributes(DisplayColour=ColourSwatch(SwatchColor=RGB(157, 176, 209)))
display_4 = DisplayAttributes(DisplayColour=ColourSwatch(SwatchColor=RGB(192, 145, 204)))
display_5 = DisplayAttributes(DisplayColour=ColourSwatch(SwatchColor=RGB(214, 156, 156)))
layers_2 = QueryModelLayers(Name="G-hull-ctrl", AutoUpdateState=True)
object_10 = ModelObject(Geometry=cluster_2.te, Name=cluster_2.N, Layer=layers)
object_11 = ModelObject(Geometry=cluster_3.te, Name=cluster_3.N, Layer=layers)
object_12 = ModelObject(Geometry=cluster_4.te, Name=cluster_4.N, Layer=layers)

# ----
cluster_5 = Cluster_4(crv=entwine)

# ---- group: Display / Loft curves
midpt = CurveMiddle(Curve=entwine)
panel_7 = Panel("""Sheer Crv
Chine Inner Crv
Chine Outer Crv
Bilge Crv""")
pl_origin = PlaneOrigin(Base=[PlaneXZ(0, 0, 0), PlaneXY(0, 0, 0), PlaneYZ(0, 0, 0)], Origin=graft(midpt))
text_entity = TextEntity(Plane=pl_origin, Text=graft(panel_7), TextSettings=ts)
object_13 = ModelObject(Geometry=flatten(cluster_5), Name=panel_4, Layer=layers_2)
object_14 = ModelObject(Geometry=text_entity, Name=panel_7, Layer=layers)

# ----
object_15 = ModelObject(Object=object_13)  # -> Object, Name
panel_8 = Panel(object_15.Name)
tsort = SortText(Keys=object_15.Name, Values=object_15.Object, Culture=127)  # -> Keys, Values
item_12 = ListItem(List=flatten(tsort.Values), Index=0, Wrap=True)  # -> Item, Item1, Item2, Item3
sheer = ModelObject(item_12.Item)
ch_inn = ModelObject(item_12.Item2)
ch_out = ModelObject(item_12.Item1)
bilge = ModelObject(item_12.Item3)
loft = Loft(
    Curves=flatten([bilge, ch_inn]),
    Options={Adjust=False, Closed=False, LoftEnds=0, LoftSimp=0, LoftType=0, Rebuild=10, Refit=0.01})

# ---- group: Does V cross the CL?
sec = BrepPlane(Brep=loft, Plane=Plane(origin=(0, 0, 0), x=(0, 0, 1), y=(1, 0, 0)))  # -> Curves, Points
null_2 = NullItem(Item=sec.Curves)  # -> NullFlags, InvalidFlags, Description
dispatch_7 = Dispatch(List=loft, DispatchPattern=null_2.NullFlags)  # -> ListA, ListB
srfsplit = SurfaceSplit(Surface=dispatch_7.ListB, Curves=sec.Curves)
area = Area(Geometry=srfsplit)  # -> Area, Centroid
# Surfaces
sort_3 = SortList(Keys=area.Area, ValuesA=srfsplit)  # -> Keys, ValuesA
item_13 = ListItem(List=reverse(sort_3.ValuesA), Index=0, Wrap=True)
clean_2 = CleanTree(RemoveNulls=True, RemoveInvalid=True, RemoveEmpty=True, Tree=[dispatch_7.ListA, item_13])

# ---- group: Stem / Chine flat
mirror = Mirror(Geometry=ch_inn, Plane=PlaneXZ(0, 0, 0))  # -> Geometry, Transform
mirror_2 = Mirror(Geometry=ch_out, Plane=PlaneXZ(0, 0, 0))  # -> Geometry, Transform

# ---- group: Stem
edges = BrepEdges(Brep=clean_2)  # -> Naked, Interior, NonManifold
mirror_3 = Mirror(Geometry=sheer, Plane=PlaneXZ(0, 0, 0))  # -> Geometry, Transform
item_14 = ListItem(List=edges.Naked, Index=Slider(2, range=0..4), Wrap=True)
mirror_4 = Mirror(Geometry=item_14, Plane=PlaneXZ(0, 0, 0))  # -> Geometry, Transform
flip = FlipCurve(Curve=item_14)  # -> Curve, Flag
flip_2 = FlipCurve(Curve=sheer)  # -> Curve, Flag
flip_3 = FlipCurve(Curve=ch_out)  # -> Curve, Flag
flip_4 = FlipCurve(Curve=ch_inn)  # -> Curve, Flag
cluster_6 = Cluster_3(f=stem_factor_2, crv_1=mirror_4.Geometry, crv_2=flip.Curve)
cluster_7 = Cluster_3(f=stem_factor_2, crv_1=mirror.Geometry, crv_2=flip_4.Curve)
cluster_8 = Cluster_3(f=stem_factor_2, crv_1=mirror_2.Geometry, crv_2=flip_3.Curve)
cluster_9 = Cluster_3(f=stem_factor_2, crv_1=mirror_3.Geometry, crv_2=flip_2.Curve)
mirror_5 = Mirror(Geometry=bilge, Plane=PlaneXZ(0, 0, 0))  # -> Geometry, Transform
edgesrf = EdgeSurface(CurveA=bilge, CurveB=mirror_5.Geometry, CurveC=cluster_7, CurveD=cluster_6)
loft_2 = Loft(
    Curves=[cluster_9, cluster_8],
    Options={Adjust=False, Closed=False, LoftEnds=0, LoftSimp=0, LoftType=0, Rebuild=10, Refit=0.01})
loft_3 = Loft(
    Curves=[cluster_7, cluster_8],
    Options={Adjust=False, Closed=False, LoftEnds=0, LoftSimp=0, LoftType=0, Rebuild=10, Refit=0.01})

# ----
layers_3 = QueryModelLayers(Name=panel_5, AutoUpdateState=True)

# ---- group: Vector lines
move_4 = Move(Geometry=chine_transm_bpt, Motion=amp)  # -> Geometry, Transform
object_16 = ModelObject(Object=dispatch_3.ListA)  # -> Object, Name
merge = Merge(Data1=item_7.Item, Data2=item_7.Item1, Data3=item_7.Item2, Data4=item_7.Item3, Data5=chine_stem_bpt)
merge_2 = Merge(Data1=item_8.Item, Data2=move_4.Geometry, Data3=item_8.Item3, Data4=item_8.Item4, Data5=item_8.Item1)
rep = ReplaceText(Text=object_16.Name, Find="bPt", Replace="Vect", RecursiveReplace=False)
as_arrows = AnnotationArrowSettings(Arrow1=0, Arrow2=8, ArrowSize=as_text.TextHeight, FitArrow=1, LeaderArrow=0, LeaderArrowSize=0)  # -> ArrowSettings, Arrow1, Arrow2, ArrowSize, FitArrow, DimensionInline, LeaderArrow, LeaderArrowSize
aligned_dimension = AlignedDimension(PointA=merge, PointB=merge_2, TextOverride=" ", ArrowSettings=as_arrows.ArrowSettings)  # -> AlignedDimension, PointA, PointB, Offset
aligned_dimension_2 = AlignedDimension(PointA=item_7.Item, PointB=dispatch_6.ListA, TextOverride=" ", ArrowSettings=as_arrows.ArrowSettings)  # -> AlignedDimension, PointA, PointB, Offset
object_17 = ModelObject(Geometry=aligned_dimension.AlignedDimension, Name=rep, Layer=layers_3, Display=display_2)  # -> CntrlVectorO, Geometry, Name, Layer, Visibility, Display, Drafting, Render

# ----
loft_4 = Loft(
    Curves=[mirror_3.Geometry, sheer],
    Options={Adjust=False, Closed=False, LoftEnds=0, LoftSimp=0, LoftType=0, Rebuild=10, Refit=0.01})  # disabled
panel_9 = Panel(merge)
midpt_2 = CurveMiddle(Curve=flatten(cluster_5))
debrep_2 = DeconstructBrep(Brep=loft_4)  # -> Faces, Edges, Vertices; disabled
points = PointList(Points=midpt_2, Size=40)
mirror_6 = Mirror(Geometry=sheer, Plane=Plane(origin=(0, 0, 0), x=(0, 0, 1), y=(1, 0, 0)))  # -> Geometry, Transform
item_15 = ListItem(List=debrep_2.Edges, Index=0, Wrap=True)  # disabled
cambered_deck_from_sheer_lines = CamberedDeckSrf(C=sheer, C_2=mirror_6.Geometry, dist=1400, stem_crv=cluster_9, camber=camber_2)
loft_5 = Loft(
    Curves=flatten([cluster_9, item_15]),
    Options={Adjust=False, Closed=False, LoftEnds=0, LoftSimp=0, LoftType=0, Rebuild=10, Refit=0.01})  # disabled
panel_10 = Panel(merge_2)

# ---- group: Display (continued)
object_18 = ModelObject(Geometry=cluster, Name=panel_6, Layer=layers_3)
object_19 = ModelObject(Geometry=aligned_dimension_2.AlignedDimension, Name="Bow Angle V", Layer=layers_3, Display=display_2)
object_20 = ModelObject(Geometry=cluster_2.ad, Name=cluster_2.N, Layer=layers_3)
object_21 = ModelObject(Geometry=cluster_3.ad, Name=cluster_3.N, Layer=layers_3)
object_22 = ModelObject(Geometry=cluster_4.ad, Name=cluster_4.N, Layer=layers_3)

# ----
stbd_srf_2 = StbdSrf(B=loft_4)  # disabled
stbd_srf_3 = StbdSrf(B=loft_5)  # disabled
chine = Loft(
    Curves=flatten([ch_out, ch_inn]),
    Options={Adjust=False, Closed=False, LoftEnds=0, LoftSimp=0, LoftType=2, Rebuild=10, Refit=0.01})
loft_6 = Loft(Curves=[ch_out, sheer], Options={Adjust=False, Closed=False, LoftEnds=0, LoftSimp=0, LoftType=0, Rebuild=10, Refit=0.01})
stbd_srf_4 = StbdSrf_2(B=cambered_deck_from_sheer_lines)
stbd_srf_5 = StbdSrf(B=edgesrf)

# ---- group: Not cut by transom
stbd_srf_6 = StbdSrf(B=loft_2)
stbd_srf_7 = StbdSrf(B=loft_3)
object_23 = ModelObject(Geometry=stbd_srf_6, Name="Stem-Top")
object_24 = ModelObject(Geometry=stbd_srf_7, Name="Stem-Ch-flat")

# ----
v_hull_srf = Surface(clean_2)
object_25 = ModelObject(Geometry=loft_6, Name="Hull-Top")
object_26 = ModelObject(Geometry=chine, Name="Ch-flat")
object_27 = ModelObject(Geometry=stbd_srf_5, Name="Stem-V")
object_28 = ModelObject(Geometry=stbd_srf_4, Name="Deck-C")
object_29 = ModelObject(Geometry=v_hull_srf, Name="Hull-V")

# ---- group: Fill the minute gap between deck and stem
debrep_3 = DeconstructBrep(DeckSrf=cambered_deck_from_sheer_lines)  # -> Faces, Edges, Vertices
item_16 = ListItem(List=debrep_3.Edges, Index=Slider(3, range=0..10), Wrap=True)
loft_7 = Loft(
    Curves=flatten([item_16, cluster_9]),
    Options={Adjust=False, Closed=False, LoftEnds=0, LoftSimp=0, LoftType=0, Rebuild=10, Refit=0.01})

# ----
debrep_4 = DeconstructBrep(TopsSrf=loft_6)  # -> Faces, Edges, Vertices; disabled
item_17 = ListItem(List=debrep_4.Edges, Index=Slider(0, range=0..10), Wrap=True)  # disabled
split_larger = SplitLarger(srf_o=flatten([object_27, object_28, object_29, object_25, object_26]), brep=stbd_srf)  # -> trim_srf_o, larger_srf_2, smaller_srf_2, C
mirror_7 = Mirror(Geometry=item_17, Plane=Plane(origin=(0, 0, 0), x=(0, 0, 1), y=(1, 0, 0)))  # -> Geometry, Transform; disabled
edgesrf_2 = EdgeSurface(CurveA=item_16, CurveB=item_17, CurveC=mirror_7.Geometry, CurveD=cluster_8)  # disabled
split_larger_2 = SplitLarger(srf_o=stbd_srf, T=split_larger.C)  # -> trim_srf_o, larger_srf_2, smaller_srf_2, C
stbd_srf_8 = StbdSrf(B=edgesrf_2)  # disabled
near_cl = NearCL(srf=[split_larger_2.larger_srf_2, split_larger_2.smaller_srf_2])
object_30 = ModelObject(Geometry=near_cl, Name="Transm")
join = BrepJoin(Breps=flatten([split_larger.trim_srf_o, object_30]))  # -> Breps, Closed
mirror_8 = Mirror(Geometry=join.Breps, Plane=Plane(origin=(0, 0, 0), x=(0, 0, 1), y=(1, 0, 0)))  # -> Geometry, Transform
join_2 = BrepJoin(Breps=[join.Breps, mirror_8.Geometry, loft_2, loft_3, loft_7])  # -> Vessel, Closed

capex = CapHolesEx(Brep=flatten(join_2.Vessel))  # -> Brep, Caps, Solid
layers_4 = QueryModelLayers(Name="G-hull", AutoUpdateState=True)
object_31 = ModelObject(Geometry=capex.Brep, ProjectName=trim, Layer=layers_4)
object_32 = ModelObject(Object=flatten([object_24, split_larger.trim_srf_o, object_30, object_23]), Layer=layers_4)

cntrl_vector_o = Object([object_17.CntrlVectorO, object_19])
mark_pt_o = Object([object_21, object_20, object_22, object_18, object_12, object_11, object_10])
loft_crv_o = Object([object_13, object_14])
half_hull_o = Object(object_32)
vessel_o = Object(object_31)
S = Solid(capex.Solid)

# ==== cluster Cluster
pt = ClusterInput()
X = UnitX(Factor=[-1000, 1000])
pt_2 = Point(pt)
move = Move(Geometry=graft(pt_2), Motion=X)  # -> Geometry, Transform
dispatch = Dispatch(List=move.Geometry, DispatchPattern=[True, False])  # -> ListA, ListB
ln = Line(StartPoint=dispatch.ListA, EndPoint=dispatch.ListB)  # -> flatten(Line)
L = ClusterOutput(ln)

# ==== cluster Cluster_2
cntrl_pt_o = ClusterInput()
ts = ClusterInput()
object = ModelObject(CntrlPtO=cntrl_pt_o)  # -> Object, Geometry, Name
pl_origin = PlaneOrigin(Base=[PlaneXZ(0, 0, 0), PlaneXY(0, 0, 0), PlaneYZ(0, 0, 0)], Origin=graft(object.Geometry))
as_text = AnnotationTextSettings(TextSettings=ts)  # -> TextSettings, TextHeight

# ---- group: Upgraded : Text Dot
annotation_dot = AnnotationDot(Location=object.Geometry, PrimaryText="+", TextHeight=expr("x/4", as_text.TextHeight))

# ----
text_entity = TextEntity(Plane=pl_origin, Text=graft(object.Name), TextSettings=as_text.TextSettings)
te = ClusterOutput(text_entity)
N = ClusterOutput(object.Name)
ad = ClusterOutput(annotation_dot)

# ==== cluster Cluster_3
f = ClusterInput()
crv_2 = ClusterInput()
crv_1 = ClusterInput()
end = EndPoints(Curve=crv_1)  # -> Start, End
end_2 = EndPoints(Curve=crv_2)  # -> Start, End
flip = FlipCurve(Curve=crv_2)  # -> Curve, Flag
eval = EvaluateCurve(Curve=crv_1, Parameter=0.0001)  # -> Point, Tangent, Angle
eval_2 = EvaluateCurve(Curve=flip.Curve, Parameter=0.0001)  # -> Point, Tangent, Angle
pdecon = Deconstruct(Point=end.End)  # -> XComponent, YComponent, ZComponent
pdecon_2 = Deconstruct(Point=end.Start)  # -> XComponent, YComponent, ZComponent
vec2pt = Vector2Pt(PointA=eval.Point, PointB=end.Start, Unitize=True)  # -> Vector, Length
vec2pt_2 = Vector2Pt(PointA=eval_2.Point, PointB=end_2.End, Unitize=True)  # -> Vector, Length
eval_3 = Evaluate(F="if(ABS(x)<ABS(y),ABS(x)*f,ABS(y)*f)", x=pdecon_2.YComponent, y=pdecon.YComponent, f=f)
multiplication = Multiplication(A=vec2pt.Vector, Mult=eval_3)
multiplication_2 = Multiplication(A=vec2pt_2.Vector, Mult=eval_3)
bzspan = BezierSpan(StartPoint=end.Start, StartTangent=multiplication, EndPoint=end_2.End, EndTangent=multiplication_2)  # -> Curve, Length, Domain
C = ClusterOutput(bzspan.Curve)

# ==== cluster StbdSrf
B = ClusterInput()
sec = BrepPlane(Brep=flatten(B), Plane=Plane(origin=(0, 0, 0), x=(0, 0, 1), y=(1, 0, 0)))  # -> simplify(Curves), Points
flatten = FlattenTree(Tree=B, Path="{0}")  # -> graft(Tree)
srfsplit = SurfaceSplit(Surface=flatten, Curves=sec.Curves)  # -> flatten(Fragments)
area = Area(Geometry=flatten(srfsplit))  # -> Area, Centroid
pdecon = Deconstruct(Point=area.Centroid)  # -> XComponent, YComponent, ZComponent
larger = LargerThan(FirstNumber=pdecon.YComponent, SecondNumber=0)  # -> LargerThan, OrEqualTo
dispatch = Dispatch(List=srfsplit, DispatchPattern=larger.LargerThan)  # -> ListA, ListB
stbd_srf = Surface(dispatch.ListA)
stbd_srf_2 = ClusterOutput(stbd_srf)

# ==== cluster SplitLarger
brep = ClusterInput()
T = ClusterInput()
srf_o = ClusterInput()
join = BrepJoin(Breps=brep)  # -> Breps, Closed
object = ModelObject(Object=flatten(srf_o))  # -> Object, Geometry
bbx = BrepBrep(Surface=flatten(object.Geometry), CuttingSrf=join.Breps)  # -> Curves, Points
flatten = FlattenTree(Tree=object.Geometry, Path="{0}")
clean = CleanTree(RemoveNulls=True, RemoveInvalid=True, RemoveEmpty=True, Tree=[bbx.Curves, T])
srfsplit = SurfaceSplit(Surface=graft(flatten), CuttingCrv=clean)  # -> simplify(Fragments)
join_2 = JoinCurves(Curves=flatten(clean), Preserve=False)
area = Area(Geometry=srfsplit)  # -> Area, Centroid
sort = SortList(Keys=area.Area, ValuesA=srfsplit)  # -> Keys, ValuesA
dispatch = Dispatch(List=sort.ValuesA, DispatchPattern=[True, False])  # -> ListA, ListB
larger_srf = Surface(dispatch.ListB)
smaller_srf = Surface(dispatch.ListA)
object_2 = ModelObject(Object=object.Object, Geometry=flatten(larger_srf))
trim_srf_o = ClusterOutput(object_2)
larger_srf_2 = ClusterOutput(larger_srf)
smaller_srf_2 = ClusterOutput(smaller_srf)
C = ClusterOutput(join_2)

# ==== cluster NearCL
srf = ClusterInput()
srf_2 = Surface(srf)
area = Area(Geometry=srf_2)  # -> Area, Centroid
pdecon = Deconstruct(Point=area.Centroid)  # -> XComponent, YComponent, ZComponent
abs = Absolute(Value=pdecon.YComponent)
dispatch = Dispatch(List=abs, DispatchPattern=[True, False])  # -> ListA, ListB
smaller = SmallerThan(FirstNumber=dispatch.ListA, SecondNumber=dispatch.ListB)  # -> SmallerThan, OrEqualTo
not = GateNot(A=smaller.SmallerThan)
dispatch_2 = Dispatch(List=srf_2, DispatchPattern=[smaller.SmallerThan, not])  # -> ListA, ListB
A = ClusterOutput(dispatch_2.ListA)

# ==== cluster Cluster_4
crv = ClusterInput()
end = EndPoints(Curve=crv)  # -> Start, End
pdecon = Deconstruct(Point=end.Start)  # -> XComponent, YComponent, ZComponent
pdecon_2 = Deconstruct(Point=end.End)  # -> XComponent, YComponent, ZComponent
larger = LargerThan(FirstNumber=pdecon.XComponent, SecondNumber=pdecon_2.XComponent)  # -> LargerThan, OrEqualTo
dispatch = Dispatch(List=crv, DispatchPattern=larger.LargerThan)  # -> ListA, ListB
flip = FlipCurve(Curve=dispatch.ListA)  # -> Curve, Flag
curve_direction_ve = Curve(reverse([dispatch.ListB, flip.Curve]))
curve_direction_ve_2 = ClusterOutput(curve_direction_ve)

# ==== cluster StbdSrf_2
B = ClusterInput()
sec = BrepPlane(Brep=B, Plane=Plane(origin=(0, 0, 0), x=(0, 0, 1), y=(1, 0, 0)))  # -> Curves, Points
srfsplit = SurfaceSplit(Surface=B, Curves=sec.Curves)
area = Area(Geometry=srfsplit)  # -> Area, Centroid
pdecon = Deconstruct(Point=area.Centroid)  # -> XComponent, YComponent, ZComponent
sort = SortList(Keys=pdecon.YComponent, ValuesA=srfsplit)  # -> Keys, ValuesA
item = ListItem(List=reverse(sort.ValuesA), Index=0, Wrap=True)
stbd_srf = Surface(item)
stbd_srf_2 = ClusterOutput(stbd_srf)

# ==== cluster CamberedDeckSrf: Cambered Deck fromdividing Sheer lines & adding CL offset to make arc
number_slider = Slider(1552, range=10..10000)
C = ClusterInput()
C_2 = ClusterInput()
dist = ClusterInput()
stem_crv = ClusterInput()
camber = ClusterInput()
panel = Panel("1")
ext = ExtendCurve(Curve=C_2, Type=2, Start=expr("-x", "0.001"), End=dist)
ext_2 = ExtendCurve(Curve=C, Type=2, Start=expr("-x", "0.001"), End=dist)
ext_3 = ExtendCurve(Curve=C, Type=2, Start=-100, End=dist)
ext_4 = ExtendCurve(Curve=C_2, Type=2, Start=-100, End=dist)
tweencrv = TweenCurve(CurveA=ext_2, CurveB=ext, Factor=0.5, BlendType=0)
number_slider_2 = Slider(0, range=0..100)
divdist = DivideDistance(Curve=tweencrv, Distance=dist)  # -> Points, Tangents, Parameters
divdist_2 = DivideDistance(Curve=[ext, ext_2], Distance=dist)  # -> Points, Tangents, Parameters
panel_2 = Panel("-1")
cull_i = CullIndex(List=divdist.Points, Indices=number_slider_2, Wrap=True)
cull_i_2 = CullIndex(List=divdist_2.Points, Indices=number_slider_2, Wrap=True)
flip = FlipMatrix(Data=cull_i)
flip_2 = FlipMatrix(Data=cull_i_2)
dispatch = Dispatch(List=flip_2, DispatchPattern=[True, False])  # -> ListA, ListB
dist_2 = Distance(PointA=dispatch.ListA, PointB=dispatch.ListB)
multiplication = Multiplication(A=dist_2, Camber=camber)
Z = UnitZ(Factor=flatten(multiplication))  # -> graft(UnitVector)
merge = Merge()
midpt = CurveMiddle(Curve=stem_crv)
move = Move(Geometry=flip, Motion=Z)  # -> Geometry, Transform
merge_2 = Merge(Data1=midpt, Data2=move.Geometry)
arc = Arc3Pt(SheerPt=dispatch.ListA, PointB=move.Geometry, SheerPt_2=dispatch.ListB)  # -> CamberCrv, Plane, Radius
intcrv = Interpolate(Vertices=flatten(merge_2), Degree=3, Periodic=False, KnotStyle=1)  # -> Curve, Length, Domain
merge_3 = Merge(Data1=ext_2, Data2=intcrv.Curve, Data3=ext)
merge_4 = Merge(Data1=stem_crv, Data2=arc.CamberCrv)
netsurf = NetworkSurface(CurvesU=merge_3, CurvesV=flatten(merge_4), Continuity=3)
deck_srf = ClusterOutput(netsurf)
