# Grasshopper definition planing_hull_fairing_w_merge_v.gh (Grasshopper 1.0.8)
# Copyright: © SYD 2022
# Copyright: © 2023 SYD all rights reserved
# plug-ins: RhinoCodePluginGH

T = Tree()
C = Content()
L = List()
u_text = UserText(Content=C, UserTextMode=1)  # -> Content, Keys, Values
bang = ExplodeTree(Data=u_text.Values)  # -> Branch0, Branch1, Branch2, Branch3, Branch4, Branch5
panel = Panel(u_text.Keys)

# ---- group: Multihull
item = ListItem(List=bang.Branch4, Index=0, Wrap=True)  # -> Item, Item1
item_2 = ListItem(List=bang.Branch5, Index="3", Wrap=True)

# ----
panel_2 = Panel(u_text.Values)

# ---- group: If no data replace with Asymm = 1
nullrep = ReplaceNulls(Items=item_2, Replacements="1.0")  # -> Items, Count

# ----
item_3 = ListItem(List=bang.Branch0, Index=0, Wrap=False)  # -> Item, Item1, Item2, Item3, Item4, Item5, Item6, Item7, Item8, Item9
item_4 = ListItem(List=bang.Branch1, Index=0, Wrap=True)  # -> Item, Item1
item_5 = ListItem(List=bang.Branch2, Index=0, Wrap=False)  # disabled
item_6 = ListItem(List=bang.Branch2, Index=0, Wrap=False)  # -> Item, Item1, Item2, Item3; disabled
multihull = Boolean(invert(item_5))  # disabled

# ---- group: Transom (single)
item_7 = ListItem(List=flatten(C), Index=0, Wrap=True)
object = ModelObject(Object=item_7)  # -> Object, Name
panel_3 = Panel(object.Name)

# ----
planing = Boolean(item_6.Item)  # disabled
stepped = Boolean(item_6.Item1)  # disabled
dsp_roundb = Boolean(item_6.Item2)  # disabled
dsp_chine = Boolean(item_6.Item3)  # disabled
expression = Expression(L=item_4.Item, R=item_4.Item1, Expression="Round(L*R,3)")
camber = Number(expr("x/100", item_3.Item))
chine_width_mm = Number(item_3.Item6)
chine_angle = Number(item_3.Item7)
abs = Absolute(Value=chine_angle)
trig = TriangleTrigonometry(Beta=degrees(90), Gamma=degrees(abs), ALength=chine_width_mm)  # -> Alpha, Beta, Gamma, ALength, BLength, CLength
clean = CleanTree(RemoveNulls=True, RemoveInvalid=True, RemoveEmpty=True, Tree=T)
larger = LargerThan(FirstNumber=chine_angle, SecondNumber=0)  # -> LargerThan, OrEqualTo
object_2 = ModelObject(CntrlPtsO=clean)  # -> Object, Name
dispatch = Dispatch(List=trig.CLength, DispatchPattern=larger.LargerThan)  # -> ListA, ListB
neg = Negative(Value=dispatch.ListA)
tmatch = MatchText(Text=object_2.Name, Pattern="*bPt", Case=True)
tmatch_2 = MatchText(Text=object_2.Name, Pattern="*ePt", Case=True)
tmatch_3 = MatchText(Text=object_2.Name, Pattern="*aPt", Case=True)
tmatch_4 = MatchText(Text=object_2.Name, Pattern="*Ht", Case=True)
tmatch_5 = MatchText(Text=object_2.Name, Pattern="*Base*", Case=True)
clean_2 = CleanTree(RemoveNulls=True, RemoveInvalid=True, RemoveEmpty=False, Tree=[dispatch.ListB, neg])
dispatch_2 = Dispatch(List=object_2.Object, DispatchPattern=tmatch)  # -> ListA, ListB
dispatch_3 = Dispatch(List=object_2.Object, DispatchPattern=tmatch_2)  # -> ListA, ListB
dispatch_4 = Dispatch(List=object_2.Object, DispatchPattern=tmatch_3)  # -> ListA, ListB
dispatch_5 = Dispatch(List=object_2.Object, DispatchPattern=tmatch_4)  # -> ListA, ListB
dispatch_6 = Dispatch(List=object_2.Object, DispatchPattern=tmatch_5)  # -> ListA, ListB

# ---- group: Seperate Pts
item_8 = ListItem(List=dispatch_2.ListA, Index=0, Wrap=False)  # -> Item, Item1, Item2, Item3
item_9 = ListItem(List=dispatch_3.ListA, Index=0, Wrap=False)  # -> Item, Item1, Item2, Item3, Item4

# ----
pdecon = Deconstruct(Point=item_8.Item1)  # -> XComponent, YComponent, ZComponent
pdecon_2 = Deconstruct(Point=item_8.Item2)  # -> XComponent, YComponent, ZComponent
pt = Point(item_9.Item3)

# ---- group: Aligh all stern points for flat transom
pdecon_3 = Deconstruct(Point=[item_8.Item1, item_8.Item2, item_8.Item3])  # -> XComponent, YComponent, ZComponent
sort = SortList(Keys=pdecon_3.XComponent)  # -> Keys, ValuesA
item_10 = ListItem(List=sort.Keys, Index=0, Wrap=True)
pt_2 = ConstructPoint(XCoordinate=item_10, YCoordinate=pdecon_3.YComponent, ZCoordinate=pdecon_3.ZComponent)
object_3 = ModelObject(Object=[item_8.Item1, item_8.Item2, item_8.Item3])  # -> Object, Name
# Control Curves
pt_3 = Point(item_8.Item1)
object_4 = ModelObject(Geometry=pt_2, Name=object_3.Name)
item_11 = ListItem(List=object_4, Index=0, Wrap=True)  # -> Item, Item1, Item2

# ----
subtraction = Subtraction(A=pdecon.ZComponent, B=pdecon_2.ZComponent)
X = UnitX(Factor=1)
ln = Line(StartPoint=item_8.Item, EndPoint=dispatch_4.ListA)
line = LineSDL(Start=dispatch_5.ListA, Direction=unitize(X), Length=100000)
pdecon_4 = Deconstruct(Point=T)  # -> XComponent, YComponent, ZComponent
llx = LineLine(Line1=ln, Line2=line)  # -> ParamA, ParamB, PointA, PointB
sort_2 = SortList(Keys=pdecon_4.YComponent)  # -> Keys, ValuesA
stem_sheer_bpt = ModelObject(item_8.Item)
item_12 = ListItem(List=sort_2.Keys, Index=0, Wrap=True)
object_5 = ModelObject(Geometry=llx.PointA, Name="Chine stem bPt")
sort_3 = SortList(Keys=pdecon_3.YComponent)  # -> reverse(Keys), ValuesA
abs_2 = Absolute(Value=item_12)
vec2pt = Vector2Pt(PointA=object_5, PointB=item_9.Item1, Unitize=False)  # -> Vector, Length
vec2pt_2 = Vector2Pt(PointA=item_8.Item, PointB=dispatch_4.ListA, Unitize=False)  # -> Vector, Length
vec2pt_3 = Vector2Pt(PointA=item_8.Item2, PointB=item_9.Item2, Unitize=False)  # -> Vector, Length
vec2pt_4 = Vector2Pt(PointA=item_8.Item3, PointB=item_9.Item3, Unitize=False)  # -> Vector, Length
vec2pt_5 = Vector2Pt(PointA=stem_sheer_bpt, PointB=item_9.Item, Unitize=False)  # -> Vector, Length
chine_transm_bpt = ModelObject(item_11.Item)
item_13 = ListItem(List=sort_3.Keys, Index=0, Wrap=True)
chine_width = Integer(chine_width_mm)
chine_height = Integer(clean_2)
chine_stem_bpt = ModelObject(object_5)
expression_2 = Expression(v=vec2pt_4.Vector, Expression="{v.x,v.y,0}")
expression_3 = Expression(BOA=abs_2, Cw=chine_width, Expression="(BOA-Cw)/BOA")
multiplication = Multiplication(A=vec2pt_4.Length, StraightF=item_3.Item8)
Y = UnitY(Factor=chine_width_mm)
expression_4 = Expression(d=subtraction, Ch=chine_height, Expression="(d-Ch)/d")
move = Move(Geometry=chine_transm_bpt, Motion=Y)  # -> InnerChineTrnsmEPt, Transform
amp = Amplitude(Vector=expression_2, Amplitude=multiplication)
bzspan = BezierSpan(StartPoint=chine_stem_bpt, StartTangent=vec2pt.Vector, EndPoint=chine_transm_bpt, EndTangent=amp)  # -> ChineOuter, Length, Domain

# ---- group: Scale inner chine line
pt_4 = Point(dispatch_6.ListA)
expression_5 = Expression(p=pt_4, Expression="{p.x,0,p.z}")
scale_nu = ScaleNU(Geometry=bzspan.ChineOuter, Plane=PlaneXY(0, 0, 0), ScaleX=1, ScaleY=expression_3, ScaleZ=1)  # -> ChineInner, Transform
xy = XYPlane(Origin=object_5)
scale_nu_2 = ScaleNU(Geometry=scale_nu.ChineInner, Plane=xy, ScaleX=1, ScaleY=1, ScaleZ=expression_4)  # -> ChineInner, Transform

# ----
bzspan_2 = BezierSpan(StartPoint=stem_sheer_bpt, StartTangent=vec2pt_5.Vector, EndPoint=item_8.Item3, EndTangent=vec2pt_4.Vector)  # -> SheerLine, Length, Domain

vdis = VectorDisplay(BowAngle=chine_stem_bpt, Vector=vec2pt_2.Vector)
vdis_2 = VectorDisplay(KeelAngle=item_8.Item2, Vector=vec2pt_3.Vector)
vdis_3 = VectorDisplay(ChineBowA=chine_stem_bpt, Vector=vec2pt.Vector)
vdis_4 = VectorDisplay(TransomSheerA=item_8.Item3, Vector=vec2pt_4.Vector)
vdis_5 = VectorDisplay(ChineA=chine_transm_bpt, Vector=amp)
vdis_6 = VectorDisplay(InnerChineA=move.InnerChineTrnsmEPt, Vector=amp)

item_14 = ListItem(List=flatten(L), Index=0, Wrap=True)  # -> Item, Item1, Item2
item_15 = ListItem(List=bang.Branch3, Index=0, Wrap=True)  # -> Item, Item1
end = EndPoints(Curve=scale_nu_2.ChineInner)  # -> Start, End
stem_corr_factor = Number(item_15.Item1)
stem_factor = Number(item_15.Item)
pt_5 = Point(end.Start)
bzspan_3 = BezierSpan(StartPoint=end.Start, StartTangent=vec2pt_2.Vector, EndPoint=item_8.Item2, EndTangent=vec2pt_3.Vector)  # -> KeelLine, Length, Domain
as_text = AnnotationTextSettings(TextSettings=item_14.Item)  # -> TextSettings, TextHeight

# ---- group: Display / End points
cluster = Cluster(pt=dispatch_5.ListA)

# ----
panel_4 = Panel("""2-Hull-V
2-Hull-Tops
2-Ch-flat""")
panel_5 = Panel("""0-Deck-fwd
0-Deck-stem""")
rep = ReplaceText(Text=panel_4, Find="2-", Replace="3-", RecursiveReplace=False)
transom_srf = TransomSurface(B=expr("x*1000*1.2", expression), curve_amount=item_3.Item1, tr_profile=object.Object)
branch = TreeBranch(Tree=u_text.Keys, Path="{0;0;0}", MaintainPaths=True)
branch_2 = TreeBranch(Tree=u_text.Values, Path="{0;0;0}", MaintainPaths=True)
debrep = DeconstructBrep(Brep=transom_srf)  # -> Faces, Edges, Vertices
display = DisplayAttributes(IsocurveDensity=-1)

# ---- group: Does V cross the CL?
# Surfaces
py3 = Python3Script()  # -> out, a; disabled
# ---------- py3: Python ----------
import Grasshopper as gh

e_str = "Test error"
ghenv.Component.AddRuntimeMessage(
 gh.Kernel.GH_RuntimeMessageLevel.Error, e_str
 )
# ---------- end py3 ----------

# ---- group: Display
entwine = Entwine(
    Branch00=bzspan_2.SheerLine,
    Branch01=bzspan.ChineOuter,
    Branch02=scale_nu_2.ChineInner,
    Branch03=bzspan_3.KeelLine,
    FlattenInputs=True)
layers = QueryModelLayers(Name="G-anno-text", AutoUpdateState=True)
panel_6 = Panel("G-anno")
end_pts = ModelObject([item_9.Item, item_9.Item1, item_9.Item2, item_9.Item4, item_9.Item3])
display_2 = DisplayAttributes(DisplayColour=ColourSwatch(SwatchColor=RGB(123, 182, 186)))
display_3 = DisplayAttributes(DisplayColour=ColourSwatch(SwatchColor=RGB(149, 96, 209)))
display_4 = DisplayAttributes(DisplayColour=ColourSwatch(SwatchColor=RGB(157, 176, 209)))
display_5 = DisplayAttributes(DisplayColour=ColourSwatch(SwatchColor=RGB(214, 156, 156)))
panel_7 = Panel("""0 Bilge intersect Ht
1 Chine intersect Ht""")
layers_2 = QueryModelLayers(Name="G-hull-ctrl", AutoUpdateState=True)

# ----
cluster_2 = Cluster_4(crv=entwine)
midpt = CurveMiddle(Curve=flatten(cluster_2))
points = PointList(Points=midpt, Size=40)
scale_nu_3 = ScaleNU(Geometry=cluster_2, Plane=PlaneXY(0, 0, 0), ScaleX=1, ScaleY=nullrep.Items, ScaleZ=1)  # -> Geometry, Transform
mirror = Mirror(Geometry=scale_nu_3.Geometry, Plane=Plane(origin=(0, 0, 0), x=(0, 0, 1), y=(1, 0, 0)))  # -> Geometry, Transform

# ---- group: Display / Loft curves
midpt_2 = CurveMiddle(Curve=entwine)
panel_8 = Panel("""Sheer Crv
Chine Inner Crv
Chine Outer Crv
Bilge Crv""")
pl_origin = PlaneOrigin(Base=[PlaneXZ(0, 0, 0), PlaneXY(0, 0, 0), PlaneYZ(0, 0, 0)], Origin=graft(midpt_2))
text_entity = TextEntity(Plane=pl_origin, Text=graft(panel_8), TextSettings=item_14.Item)
panel_9 = Panel("""0-Sheer-i
1-Ch-Out-i
2-Ch-Inn-i
3-Bilge-i""")
panel_10 = Panel("""0-Sheer
1-Ch-Out
2-Ch-Inn
3-Bilge""")
object_6 = ModelObject(Geometry=text_entity, Name=panel_8, Layer=layers)
object_7 = ModelObject(Geometry=flatten(mirror.Geometry), Name=panel_9, Layer=layers_2)
object_8 = ModelObject(Geometry=flatten(cluster_2), Name=panel_10, Layer=layers_2)

# ----
item_16 = ListItem(List=flatten(object_7), Index=0, Wrap=True)  # -> Item, Item1, Item2, Item3
item_17 = ListItem(List=flatten(object_8), Index=0, Wrap=True)  # -> Item, Item1, Item2, Item3
sheer = ModelObject(item_16.Item)
ch_out = ModelObject(item_16.Item1)
ch_inn = ModelObject(item_16.Item2)
bilge = ModelObject(item_16.Item3)
sheer_2 = ModelObject(item_17.Item)
ch_out_2 = ModelObject(item_17.Item1)
ch_inn_2 = ModelObject(item_17.Item2)
bilge_2 = ModelObject(item_17.Item3)
loft = Loft(
    Curves=flatten([ch_inn_2, bilge_2]),
    Options={Adjust=False, Closed=False, LoftEnds=0, LoftSimp=0, LoftType=0, Rebuild=10, Refit=0.01})
loft_2 = Loft(
    Curves=flatten([bilge, ch_inn]),
    Options={Adjust=False, Closed=False, LoftEnds=0, LoftSimp=0, LoftType=0, Rebuild=10, Refit=0.01})

# ---- group: Does V cross the CL? (continued)
sec = BrepPlane(Brep=loft_2, Plane=Plane(origin=(0, 0, 0), x=(0, 0, 1), y=(1, 0, 0)))  # -> Curves, Points; disabled

# ----
edges = BrepEdges(Brep=loft)  # -> Naked, Interior, NonManifold
item_18 = ListItem(List=edges.Naked, Index=1, Wrap=True)
flip = FlipCurve(Curve=item_18)  # -> Curve, Flag

# ---- group: Stem
edges_2 = BrepEdges(Brep=loft_2)  # -> Naked, Interior, NonManifold
item_19 = ListItem(List=edges_2.Naked, Index=1, Wrap=True)
flip_2 = FlipCurve(Curve=item_19)  # -> Curve, Flag
flip_3 = FlipCurve(Curve=sheer)  # -> Curve, Flag
flip_4 = FlipCurve(Curve=ch_out)  # -> Curve, Flag
flip_5 = FlipCurve(Curve=ch_inn)  # -> Curve, Flag
cluster_3 = Cluster_3(f=stem_factor, crv_1=ch_inn_2, crv_2=flip_5.Curve)
cluster_4 = Cluster_3(f="1", crv_1=flip_2.Curve, crv_2=flip.Curve)
cluster_5 = Cluster_3(f=stem_factor, crv_1=sheer_2, crv_2=flip_3.Curve)
cluster_6 = Cluster_3(f=stem_factor, crv_1=ch_out_2, crv_2=flip_4.Curve)
flip_6 = FlipCurve(Curve=cluster_3)  # -> Curve, Flag
cluster_7 = Cluster_6(
    side_srf=[loft_2, loft],
    stem_f=stem_factor,
    profile_corr_f=stem_corr_factor,
    top_crv=flip_6.Curve,
    transm_crv=cluster_4,
    d1=Slider(0.05, range=0..1),
    d2=Slider(0.95, range=0..1),
    N=Slider(45, range=0..100))  # -> stem_crv_2, stem_base
loft_3 = Loft(
    Curves=[cluster_5, cluster_6],
    Options={Adjust=False, Closed=False, LoftEnds=0, LoftSimp=0, LoftType=0, Rebuild=10, Refit=0.01})
loft_4 = Loft(
    Curves=[cluster_3, cluster_6],
    Options={Adjust=False, Closed=False, LoftEnds=0, LoftSimp=0, LoftType=0, Rebuild=10, Refit=0.01})

# ----
layers_3 = QueryModelLayers(Name=panel_6, AutoUpdateState=True)
deck_camber_from_mid_point = DeckCamberFromMidPoint(C=sheer, C_2=sheer_2, camber=camber, stem_crv=cluster_5)  # -> _50_50_cambered_deck, front_s, rear_s, stem
chine = Loft(
    Curves=flatten([ch_out, ch_inn]),
    Options={Adjust=False, Closed=False, LoftEnds=0, LoftSimp=0, LoftType=2, Rebuild=10, Refit=0.01})
chine_2 = Loft(
    Curves=flatten([ch_out_2, ch_inn_2]),
    Options={Adjust=False, Closed=False, LoftEnds=0, LoftSimp=0, LoftType=2, Rebuild=10, Refit=0.01})
loft_5 = Loft(Curves=[ch_out, sheer], Options={Adjust=False, Closed=False, LoftEnds=0, LoftSimp=0, LoftType=0, Rebuild=10, Refit=0.01})
loft_6 = Loft(
    Curves=[sheer_2, ch_out_2],
    Options={Adjust=False, Closed=False, LoftEnds=0, LoftSimp=0, LoftType=0, Rebuild=10, Refit=0.01})
v_hull_srf = Surface(loft_2)
srf = Surface([deck_camber_from_mid_point.front_s, deck_camber_from_mid_point.stem])
srf_2 = Surface(deck_camber_from_mid_point.rear_s)
srf_3 = Surface(loft_5)
srf_4 = Surface(chine)
v_hull_srf_2 = Surface(loft)
entwine_2 = Entwine(Branch00=v_hull_srf, Branch01=srf_3, Branch02=srf_4, FlattenInputs=True)
entwine_3 = Entwine(Branch00=v_hull_srf_2, Branch01=loft_6, Branch02=chine_2, FlattenInputs=True)
srf_5 = Surface(cluster_7.stem_base)
object_9 = ModelObject(Geometry=flatten(srf_5), Name="1-Stem-V")
object_10 = ModelObject(Geometry=flatten(srf), Name=panel_5)
object_11 = ModelObject(Geometry=flatten(srf_2), Name="0-Deck-aft")
object_12 = ModelObject(Geometry=flatten(entwine_2), Name=panel_4)
object_13 = ModelObject(Geometry=flatten(entwine_3), Name=rep)
u_text_2 = UserText(Content=object_7, Keys=branch, Values=branch_2, UserTextMode=1)  # -> LoftCrvC, Keys, Values

# ---- group: Trim with transom
split_larger = SplitLarger(srf_o=[object_12, object_11, object_13, object_9], cutting_srf=debrep.Faces)  # -> trim_srf_o, C
srfsplit = SurfaceSplit(Surface=graft(debrep.Faces), CuttingCrv=split_larger.C)  # -> simplify(Fragments)
tmatch_6 = MatchText(Text=flatten(split_larger.trim_srf_o), Pattern="*0-Deck-aft*", Case=True)
dispatch_7 = Dispatch(List=flatten(split_larger.trim_srf_o), DispatchPattern=tmatch_6)  # -> ListA, ListB
small_perimeter = SmallPerimeter(B=srfsplit)
transom_srf_stbd = Surface(small_perimeter)
object_14 = ModelObject(Geometry=small_perimeter, Name="3-Transm")

# ----
crv = Curve(split_larger.C)
panel_11 = Panel(split_larger.trim_srf_o)
srf_6 = Surface(dispatch_7.ListA)
join = BrepJoin(Breps=flatten([deck_camber_from_mid_point.front_s, deck_camber_from_mid_point.stem, dispatch_7.ListA]))  # -> DeckSrf, Closed
stbd_srf = StbdSrf(B=[deck_camber_from_mid_point.front_s, deck_camber_from_mid_point.stem, srf_6])
tmatch_7 = MatchText(Text=flatten(split_larger.trim_srf_o), Pattern="*2-*", Case=True)
merge = Merge(Data1=loft_3, Data2=loft_4, Data3=object_10, Data4=dispatch_7.ListA, Data5=dispatch_7.ListB, Data6=object_14)  # -> flatten(Result)
dispatch_8 = Dispatch(List=flatten(split_larger.trim_srf_o), DispatchPattern=tmatch_7)  # -> ListA, ListB
object_15 = ModelObject(Geometry=stbd_srf, Name="0-Deck")
item_20 = ListItem(List=merge, Index=Slider(9, range=0..14), Wrap=False)
join_2 = BrepJoin(Breps=flatten(merge))  # -> Vessel, Closed
capex = CapHolesEx(Brep=flatten(join_2.Vessel))  # -> Brep, Caps, Solid
S = Solid(capex.Solid)
loft_crv_c = Content([u_text_2.LoftCrvC, object_8])

# ---- group: Vector lines
move_2 = Move(Geometry=chine_transm_bpt, Motion=amp)  # -> Geometry, Transform
object_16 = ModelObject(Object=dispatch_2.ListA)  # -> Object, Name
rep_2 = ReplaceText(Text=object_16.Name, Find="bPt", Replace="Vect", RecursiveReplace=False)
as_arrows = AnnotationArrowSettings(Arrow1=0, Arrow2=8, ArrowSize=as_text.TextHeight, FitArrow=1, LeaderArrow=0, LeaderArrowSize=0)
entwine_4 = Entwine(
    Branch00=item_8.Item,
    Branch01=chine_transm_bpt,
    Branch02=item_11.Item1,
    Branch03=item_11.Item2,
    Branch04=chine_stem_bpt,
    FlattenInputs=True)
aligned_dimension = AlignedDimension(PointA=dispatch_4.ListA, PointB=item_8.Item, TextOverride=" ", ArrowSettings=as_arrows)  # -> AlignedDimension, PointA, PointB, Offset

# ----
object_17 = ModelObject(Geometry=move_2.Geometry, Name="Chine stern ePt")

# ---- group: Vector lines (continued)
entwine_5 = Entwine(
    Branch00=item_9.Item,
    Branch01=object_17,
    Branch02=item_9.Item2,
    Branch03=item_9.Item3,
    Branch04=item_9.Item1,
    FlattenInputs=True)
aligned_dimension_2 = AlignedDimension(PointA=entwine_4, PointB=entwine_5, TextOverride=" ", ArrowSettings=as_arrows)  # -> AlignedDimension, PointA, PointB, Offset
object_18 = ModelObject(Geometry=aligned_dimension_2.AlignedDimension, Name=rep_2, Layer=layers_3, Display=display_3)  # -> CntrlVectorO, Geometry, Name, Layer, Visibility, Display, Drafting, Render

# ---- group: Display (continued)
cluster_8 = Cluster_2(cntrl_pt_o=flatten([entwine_4, dispatch_5.ListA, dispatch_4.ListA]), ts_txt=item_14.Item, ts_ad=item_14.Item2)  # -> te, N, ad
cluster_9 = Cluster_2(cntrl_pt_o=entwine_5, ts_txt=item_14.Item, ts_ad=item_14.Item2)  # -> te, N, ad
object_19 = ModelObject(Geometry=aligned_dimension.AlignedDimension, Name="Bow Angle V", Layer=layers_3, Display=display_3)
object_20 = ModelObject(Geometry=cluster_8.te, Name=cluster_8.N, Layer=layers)
object_21 = ModelObject(Geometry=cluster_8.ad, Name=cluster_8.N, Layer=layers_3)
object_22 = ModelObject(Geometry=cluster_9.te, Name=cluster_9.N, Layer=layers)
object_23 = ModelObject(Geometry=cluster_9.ad, Name=cluster_9.N, Layer=layers_3)
object_24 = ModelObject(Geometry=cluster, Name=panel_7, Layer=layers_3)

# ----
panel_12 = Panel(entwine_4)
panel_13 = Panel(entwine_5)
mark_pt_o = Object([object_23, object_21, object_24, object_22, object_20, object_7, object_6, object_18.CntrlVectorO, object_19])

# ---- group: Not cut by transom
stbd_srf_2 = StbdSrf(B=object_9)
stbd_srf_3 = StbdSrf(B=loft_3)
stbd_srf_4 = StbdSrf(B=loft_4)
panel_14 = Panel("""1-Stem-V
1-Stem-Top
1-Stem-Ch""")

# ----
merge_2 = Merge(Data1=stbd_srf_2, Data2=stbd_srf_3, Data3=stbd_srf_4)

# ---- group: Not cut by transom (continued)
object_25 = ModelObject(Geometry=merge_2, Name=panel_14)

# ----
clean_3 = CleanTree(RemoveNulls=True, RemoveInvalid=True, RemoveEmpty=False, Tree=[object_25, object_15, dispatch_8.ListA])

layers_4 = QueryModelLayers(Name="G-hull", AutoUpdateState=True)
object_26 = ModelObject(Geometry=capex.Brep, ProjectName=panel_3, Layer=layers_4, Display=display)
object_27 = ModelObject(Object=flatten(clean_3), Layer=layers_4, Display=display)

half_hull_o = Object(object_27)
vessel_o = Object(object_26)

# ==== cluster Cluster
pt = ClusterInput()
X = UnitX(Factor=[-1000, 1000])
pt_2 = Point(pt)
move = Move(Geometry=graft(pt_2), Motion=X)  # -> Geometry, Transform
dispatch = Dispatch(List=move.Geometry, DispatchPattern=[True, False])  # -> ListA, ListB
ln = Line(StartPoint=dispatch.ListA, EndPoint=dispatch.ListB)  # -> flatten(Line)
L = ClusterOutput(ln)

# ==== cluster Cluster_2
cntrl_pt_o = ClusterInput()
ts_ad = ClusterInput()
ts_txt = ClusterInput()
object = ModelObject(CntrlPtO=cntrl_pt_o)  # -> Object, Geometry, Name
as_text = AnnotationTextSettings(TextSettings=ts_ad)  # -> TextSettings, TextHeight
pl_origin = PlaneOrigin(Base=[PlaneXZ(0, 0, 0), PlaneXY(0, 0, 0), PlaneYZ(0, 0, 0)], Origin=graft(object.Geometry))
text_entity = TextEntity(Plane=pl_origin, Text=graft(object.Name), TextSettings=ts_txt)

# ---- group: Upgraded : Text Dot
annotation_dot = AnnotationDot(Location=object.Geometry, PrimaryText="+", TextHeight=expr("x/4", as_text.TextHeight))

# ----
te = ClusterOutput(text_entity)
N = ClusterOutput(object.Name)
ad = ClusterOutput(annotation_dot)

# ==== cluster Cluster_3
f = ClusterInput()
crv_2 = ClusterInput()
crv_1 = ClusterInput()
end = EndPoints(Curve=crv_1)  # -> Start, End
end_2 = EndPoints(Curve=crv_2)  # -> Start, End
flip = FlipCurve(Curve=crv_2)  # -> Curve, Flag
eval = EvaluateCurve(Curve=crv_1, Parameter=0.0001)  # -> Point, Tangent, Angle
eval_2 = EvaluateCurve(Curve=flip.Curve, Parameter=0.0001)  # -> Point, Tangent, Angle
pdecon = Deconstruct(Point=end.End)  # -> XComponent, YComponent, ZComponent
pdecon_2 = Deconstruct(Point=end.Start)  # -> XComponent, YComponent, ZComponent
vec2pt = Vector2Pt(PointA=eval.Point, PointB=end.Start, Unitize=True)  # -> Vector, Length
vec2pt_2 = Vector2Pt(PointA=eval_2.Point, PointB=end_2.End, Unitize=True)  # -> Vector, Length
eval_3 = Evaluate(F="if(ABS(x)<ABS(y),ABS(x)*f,ABS(y)*f)", x=pdecon_2.YComponent, y=pdecon.YComponent, f=f)
multiplication = Multiplication(A=vec2pt.Vector, Mult=eval_3)
multiplication_2 = Multiplication(A=vec2pt_2.Vector, Mult=eval_3)
bzspan = BezierSpan(StartPoint=end.Start, StartTangent=multiplication, EndPoint=end_2.End, EndTangent=multiplication_2)  # -> Curve, Length, Domain
C = ClusterOutput(bzspan.Curve)

# ==== cluster StbdSrf
B = ClusterInput()
sec = BrepPlane(Brep=flatten(B), Plane=Plane(origin=(0, 0, 0), x=(0, 0, 1), y=(1, 0, 0)))  # -> simplify(Curves), Points
flatten = FlattenTree(Tree=B, Path="{0}")  # -> graft(Tree)
srfsplit = SurfaceSplit(Surface=flatten, Curves=sec.Curves)  # -> flatten(Fragments)
area = Area(Geometry=flatten(srfsplit))  # -> Area, Centroid
pdecon = Deconstruct(Point=area.Centroid)  # -> XComponent, YComponent, ZComponent
larger = LargerThan(FirstNumber=pdecon.YComponent, SecondNumber=0)  # -> LargerThan, OrEqualTo
dispatch = Dispatch(List=srfsplit, DispatchPattern=larger.LargerThan)  # -> ListA, ListB
stbd_srf = Surface(dispatch.ListA)
stbd_srf_2 = ClusterOutput(stbd_srf)

# ==== cluster Cluster_4
crv = ClusterInput()
end = EndPoints(Curve=crv)  # -> Start, End
pdecon = Deconstruct(Point=end.Start)  # -> XComponent, YComponent, ZComponent
pdecon_2 = Deconstruct(Point=end.End)  # -> XComponent, YComponent, ZComponent
larger = LargerThan(FirstNumber=pdecon.XComponent, SecondNumber=pdecon_2.XComponent)  # -> LargerThan, OrEqualTo
dispatch = Dispatch(List=crv, DispatchPattern=larger.LargerThan)  # -> ListA, ListB
flip = FlipCurve(Curve=dispatch.ListA)  # -> Curve, Flag
curve_direction_ve = Curve(reverse([dispatch.ListB, flip.Curve]))
curve_direction_ve_2 = ClusterOutput(curve_direction_ve)

# ==== cluster DeckCamberFromMidPoint: Deck Camber from mid-point
camber = ClusterInput()
stem_crv = ClusterInput()
C = ClusterInput()
C_2 = ClusterInput()
subcrv = SubCurve(BaseCurve=graft([C, C_2]), Domain=["[0 to 0.5]", "[0.5 to 1.0]"])
end = EndPoints(Curve=flatten(subcrv))  # -> Start, End
item = ListItem(List=end.Start, Index=1, Wrap=True)  # -> flatten(Item), Item1, Item2
flip = FlipCurve(Curve=stem_crv)  # -> Curve, Flag
dispatch = Dispatch(List=item.Item, DispatchPattern=[True, False])  # -> ListA, ListB
pt = Point([item.Item, item.Item2])
dist = Distance(PointA=item.Item, PointB=item.Item2)
ln = Line(StartPoint=item.Item, EndPoint=item.Item2)
midpt = CurveMiddle(Curve=ln)
multiplication = Multiplication(A=dist, Camber=camber)
item_2 = ListItem(List=flatten(subcrv), Index=0, Wrap=True)  # -> Item, Item1, Item2, Item3
Z = UnitZ(Factor=flatten(multiplication))  # -> graft(UnitVector)
dispatch_2 = Dispatch(List=flatten(item_2.Item), DispatchPattern=[True, False])  # -> ListA, ListB
move = Move(Geometry=midpt, Motion=Z)  # -> Geometry, Transform
flip_2 = FlipCurve(Curve=item_2.Item)  # -> Curve, Flag
flip_3 = FlipCurve(Curve=item_2.Item2)  # -> Curve, Flag
arc = Arc3Pt(SheerPt=item.Item, PointB=move.Geometry, SheerPt_2=item.Item2)  # -> CamberCrv, Plane, Radius
crv = Curve(dispatch_2.ListA)
crv_2 = Curve(item_2.Item1)
swp2 = Sweep2(Rail1=flip_2.Curve, Rail2=flip_3.Curve, Sections=arc.CamberCrv, SameHeight=False)
swp2_2 = Sweep2(Rail1=item_2.Item1, Rail2=item_2.Item3, Sections=arc.CamberCrv, SameHeight=False)
debrep = DeconstructBrep(Brep=swp2)  # -> Faces, Edges, Vertices
item_3 = ListItem(List=debrep.Edges, Index=Slider(1, range=0..10), Wrap=True)
crv_3 = Curve(item_3)
loft = Loft(
    Curves=flatten([item_3, flip.Curve]),
    Options={Adjust=False, Closed=False, LoftEnds=0, LoftSimp=0, LoftType=0, Rebuild=10, Refit=0.01})
join = BrepJoin(Breps=flatten([swp2, swp2_2, loft]))  # -> _5050CamberedDeck, Closed
_50_50_cambered_deck = ClusterOutput(join._5050CamberedDeck)
rear_s = ClusterOutput(swp2_2)
front_s = ClusterOutput(swp2)
stem = ClusterOutput(loft)

# ==== cluster TransomSurface: Creates a surface with which to truncate the vessel stern
curve_amount = ClusterInput()
tr_profile = ClusterInput()
B = ClusterInput()

# ---- group: Top point on Cl
x_tremez = Extremes(Curve=tr_profile, Plane=PlaneXY(0, 0, 0))  # -> Highest, Lowest
pdecon = Deconstruct(Point=[x_tremez.Highest, x_tremez.Lowest])  # -> XComponent, YComponent, ZComponent
pt = ConstructPoint(XCoordinate=pdecon.XComponent, YCoordinate=0, ZCoordinate=pdecon.ZComponent)

# ----
curve_amount_2 = Integer(curve_amount)

# ---- group: Plan view Crv
subtraction = Subtraction(A=pdecon.XComponent, CrvAmt=curve_amount_2)
pt_2 = ConstructPoint(XCoordinate=subtraction, YCoordinate=B, ZCoordinate=pdecon.ZComponent)  # -> graft(Point)
mirror = Mirror(Geometry=pt_2, Plane=Plane(origin=(0, 0, 0), x=(0, 0, 1), y=(1, 0, 0)))  # -> Geometry, Transform
entwine = Entwine(Branch00=pt_2, Branch01=graft(pt), Branch02=mirror.Geometry, FlattenInputs=True)
flip = FlipMatrix(Data=entwine)
nurbs = NurbsCurve(Vertices=flip, Degree=2, Periodic=False)  # -> Curve, Length, Domain

# ----
extrcrv = ExtrudeAlong(TopCrv=nurbs.Curve, TrProfile=tr_profile)
area = Area(Geometry=extrcrv)  # -> Area, Centroid
crv = Curve(nurbs.Curve)
pdecon_2 = Deconstruct(Point=area.Centroid)  # -> XComponent, YComponent, ZComponent
sort = SortList(Keys=flatten(pdecon_2.ZComponent), ValuesA=flatten(extrcrv))  # -> Keys, ValuesA
item = ListItem(List=sort.ValuesA, Index=0, Wrap=True)
trans_brep = Brep(item)
srf = Surface(item)
trans_brep_2 = ClusterOutput(trans_brep)

# ==== cluster SplitLarger
cutting_srf = ClusterInput()
srf_o = ClusterInput()
object = ModelObject(Object=srf_o)  # -> Object, Geometry
number_slider = Slider(7, range=0..7)  # disabled
join = BrepJoin(Breps=cutting_srf)  # -> Breps, Closed
X = UnitX(Factor=1000)
srf = Surface(cutting_srf)
bbx = BrepBrep(Surface=object.Object, CuttingSrf=graft(cutting_srf))  # -> Curves, Points
extr = Extrude(Base=join.Breps, Direction=X)
item = ListItem(List=object.Object, Index=number_slider, Wrap=True)  # disabled
srfsplit = SurfaceSplit(Surface=graft(object.Geometry), CuttingCrv=bbx.Curves)  # disabled
split = SplitBrep(Brep=object.Geometry, Cutter=extr)
join_2 = JoinCurves(Curves=flatten(bbx.Curves), Preserve=False)
item_2 = ListItem(List=split, Index=0, Wrap=True)
area = Area(Geometry=srfsplit)  # -> Area, Centroid; disabled
srf_2 = Surface(item_2)
sort = SortList(Keys=area.Area, ValuesA=srfsplit)  # -> Keys, ValuesA; disabled
dispatch = Dispatch(List=sort.ValuesA, DispatchPattern=invert([True, False]))  # -> ListA, ListB; disabled
fwd_srf = Surface(dispatch.ListA)  # disabled
aft_srf = Surface(dispatch.ListB)  # disabled
object_2 = ModelObject(Object=graft(object.Object), Geometry=srf_2)
trim_srf_o = ClusterOutput(object_2)
C = ClusterOutput(join_2)

# ==== cluster SmallPerimeter
B = ClusterInput()
debrep = DeconstructBrep(Brep=B)  # -> Faces, Edges, Vertices; disabled
wires = BrepWireframe(Brep=B, Density=-1)
area = Area(Geometry=B)  # -> Area, Centroid; disabled
join = JoinCurves(Curves=wires, Preserve=False)
sort = SortList(Keys=area.Area, ValuesA=B)  # -> Keys, ValuesA; disabled
len = Length(Curve=join)
crv = Curve(join)
rint = RegionIntersection()  # disabled
srf = Surface(sort.ValuesA)  # disabled
ma = MassAddition(Input=len)  # -> Result, PartialResults
incurve = PointInCurve(Point=area.Centroid, Curve=graft(join))  # -> Relationship, Point; disabled
trim = TrimTree(Tree=crv, Depth=1)
trim_2 = TrimTree(Tree=ma.Result, Depth=2)
sort_2 = SortList(Keys=trim_2, ValuesA=B)  # -> Keys, ValuesA
equals = Equality(FirstNumber=incurve.Relationship, SecondNumber=2)  # -> Equality, Inequality; disabled
panel = Panel(equals.Equality)  # disabled
item = ListItem(List=trim_2, Index=0, Wrap=True)  # -> Item, Item1, Item2; disabled
item_2 = ListItem(List=sort_2.ValuesA, Index=0, Wrap=True)
dispatch = Dispatch(List=B, DispatchPattern=equals.Equality)  # -> ListA, ListB; disabled
gate = StreamGate(Stream=flatten(B), Gate=flatten(incurve.Relationship))  # -> Target0, Target1, Target2; disabled
crv_2 = Curve(item.Item)  # disabled
crv_3 = Curve(item.Item1)  # disabled
crv_4 = Curve(item.Item2)  # disabled
clean = CleanTree(RemoveNulls=True, RemoveInvalid=True, RemoveEmpty=False, Tree=item_2)
panel_2 = Panel(trim_2)  # disabled
panel_3 = Panel(dispatch.ListA)  # disabled
T = ClusterOutput(clean)

# ==== cluster Cluster_6
side_srf = ClusterInput()
N = ClusterInput()
d1 = ClusterInput()
d2 = ClusterInput()
transm_crv = ClusterInput()
profile_corr_f = ClusterInput()
top_crv = ClusterInput()

# ---- group: Stem
stem_f = ClusterInput()

# ----
dispatch = Dispatch(SideSrf=side_srf, DispatchPattern=[True, False])  # -> ListA, ListB
top_crv_2 = Curve(top_crv)
transm_crv_2 = Curve(transm_crv)
merge = Merge(Data1=d1, Data2=d2)
dom = ConstructDomain(DomainStart="0", DomainEnd="1")
dom_2 = ConstructDomain(DomainStart="0.5", DomainEnd="1")
dom_3 = ConstructDomain(DomainStart="0", DomainEnd="0.5")
debrep = DeconstructBrep()  # -> Faces, Edges, Vertices
dom² = ConstructDomain²(DomainU=dom_3, DomainV=dom)
dom²_2 = ConstructDomain²(DomainU=dom_2, DomainV=dom)
len = Length(Curve=debrep.Edges)
subsrf = Isotrim(Surface=reparameterize(dispatch.ListA), Domain=dom²)
subsrf_2 = Isotrim(Surface=reparameterize(dispatch.ListB), Domain=dom²_2)
sort = SortList(Keys=len, ValuesA=debrep.Edges)  # -> Keys, reverse(ValuesA)
item = ListItem(List=sort.ValuesA, Index=0, Wrap=True)  # -> Item, Item1
srf = Surface([subsrf, subsrf_2])
debrep_2 = DeconstructBrep(Brep=subsrf)  # -> Faces, Edges, Vertices
debrep_3 = DeconstructBrep(Brep=srf)  # -> Faces, Edges, Vertices
crv = Curve(item.Item)
crv_2 = Curve(item.Item1)
midpt = CurveMiddle(Curve=debrep_3.Edges)
sort_pt = SortPoints(Points=debrep_2.Vertices)  # -> Points, Indices
multiplication = Multiplication(StemF=stem_f, ProfileCorrF=profile_corr_f)
pdecon = Deconstruct(Point=midpt)  # -> XComponent, YComponent, ZComponent
split = SplitList(List=sort_pt.Points, Index=2)  # -> ListA, ListB
sort_2 = SortList(Keys=pdecon.XComponent, ValuesA=debrep_3.Edges)  # -> Keys, ValuesA
item_2 = ListItem(List=sort_2.ValuesA, Index=0, Wrap=True)  # -> Item, Item1
pdecon_2 = Deconstruct(Point=split.ListA)  # -> XComponent, YComponent, ZComponent
dispatch_2 = Dispatch(List=flatten(item_2.Item), DispatchPattern=[True, False])  # -> ListA, ListB
sort_3 = SortList(Keys=pdecon_2.ZComponent, ValuesA=split.ListA)  # -> Keys, ValuesA
end = EndPoints(Curve=dispatch_2.ListA)  # -> Start, End
end_2 = EndPoints(Curve=dispatch_2.ListB)  # -> Start, End
pt = Point([end_2.End, end.End])
larger = LargerThan(FirstNumber=end.Start, SecondNumber=end.End)  # -> LargerThan, OrEqualTo
larger_2 = LargerThan(FirstNumber=end_2.Start, SecondNumber=end_2.End)  # -> LargerThan, OrEqualTo
dispatch_3 = Dispatch(List=flatten(dispatch_2.ListA), DispatchPattern=larger.LargerThan)  # -> ListA, ListB
panel = Panel(larger.LargerThan)
dispatch_4 = Dispatch(List=flatten(dispatch_2.ListB), DispatchPattern=larger_2.LargerThan)  # -> ListA, ListB
panel_2 = Panel(larger_2.LargerThan)
flip = FlipCurve(Curve=dispatch_3.ListA)  # -> Curve, Flag
flip_2 = FlipCurve(Curve=dispatch_4.ListA)  # -> Curve, Flag
aligned_front_of_hull_crv = Curve([flip_2.Curve, dispatch_4.ListB, flip.Curve, dispatch_3.ListB])
number_slider = Slider(0, range=0..10)  # disabled
shatter = Shatter(Curve=reparameterize(aligned_front_of_hull_crv), Parameters=merge)
dispatch_5 = Dispatch(List=flatten(shatter), DispatchPattern=[True, False])  # -> ListA, ListB; disabled
item_3 = ListItem(List=shatter, Index=0, Wrap=True)  # -> Item, Item1
item_4 = ListItem(List=sort_3.ValuesA, Index=number_slider, Wrap=True)  # disabled
outer_chine = Curve(item.Item1)  # disabled
crv_3 = Curve(dispatch_5.ListB)  # disabled
crv_4 = Curve(item_3.Item1)
bow_pt = Point(item_4)  # disabled
inner_chine = Curve(item.Item)  # disabled
pframes = PerpFrames(Curve=crv_4, Count=N, Align=simplify(True))  # -> Frames, Parameters
dispatch_6 = Dispatch(List=flatten(outer_chine), DispatchPattern=[True, False])  # -> ListA, ListB; disabled

# ---- group: Stem sides
reb = RebuildCurve(Curve=aligned_front_of_hull_crv, Degree=2, Count=1000, Tangents=True)  # -> flatten(StemSideCrv); disabled

# ----
crv_5 = Curve(aligned_front_of_hull_crv)
sec = BrepPlane(Brep=graft(srf), Plane=pframes.Frames)  # -> simplify(Curves), Points

# ---- group: Stem top
cluster = Cluster_5(f=multiplication, inner_chine=dispatch_6.ListA, outer_chine=dispatch_6.ListB)  # disabled

# ----
trim = TrimTree(Tree=sec.Curves, Depth=1)
bang = ExplodeTree(Data=trim)  # -> Branch0, Branch1
flip_3 = FlipCurve(Curve=cluster)  # -> Curve, Flag; disabled
outer_chine_2 = Curve(bang.Branch1)
inner_chine_2 = Curve(bang.Branch0)
end_3 = EndPoints(Curve=graft(inner_chine_2))  # -> Start, End; disabled
bang_2 = ExplodeTree(Data=pframes.Frames)  # -> Branch0, Branch1; disabled

# ---- group: Stem mid
cluster_2 = Cluster_5(f=multiplication, inner_chine=bang.Branch0, outer_chine=bang.Branch1)  # disabled

# ----
panel_3 = Panel("""0
0.001
0.999
1""")
pdecon_3 = Deconstruct(Point=[end_3.Start, end_3.End])  # -> XComponent, YComponent, ZComponent; disabled
abs = Absolute(Value=pdecon_3.YComponent)  # disabled
x_tremez = Extremes(Curve=inner_chine_2, Plane=PlaneXY(0, 0, 0))  # -> Highest, Lowest
x_tremez_2 = Extremes(Curve=outer_chine_2, Plane=PlaneXY(0, 0, 0))  # -> Highest, Lowest
eval = EvaluateCurve(Curve=reparameterize(graft(inner_chine_2)), Parameter=panel_3)  # -> Point, Tangent, Angle
eval_2 = EvaluateCurve(Curve=reparameterize(graft(outer_chine_2)), Parameter=panel_3)  # -> Point, Tangent, Angle
pdecon_4 = Deconstruct(Point=bang_2.Branch0)  # -> XComponent, YComponent, ZComponent; disabled
dispatch_7 = Dispatch(List=abs, DispatchPattern=[True, False])  # -> ListA, ListB; disabled

# ---- group: Check Towards CL
pt_2 = Point(x_tremez.Lowest)  # disabled
pt_3 = Point(x_tremez_2.Lowest)  # disabled

# ----
pt_4 = Point(bang_2.Branch0)  # disabled
crv_6 = Curve(flatten([flip_3.Curve, cluster_2]))  # disabled
smaller = SmallerThan(FirstNumber=dispatch_7.ListA, SecondNumber=dispatch_7.ListB)  # -> SmallerThan, OrEqualTo; disabled
pdecon_5 = Deconstruct(Point=eval.Point)  # -> XComponent, YComponent, ZComponent
pdecon_6 = Deconstruct(Point=eval_2.Point)  # -> XComponent, YComponent, ZComponent
pdecon_7 = Deconstruct(Point=x_tremez.Lowest)  # -> XComponent, YComponent, ZComponent
pdecon_8 = Deconstruct(Point=x_tremez_2.Lowest)  # -> XComponent, YComponent, ZComponent
sort_4 = SortList(Keys=pdecon_6.XComponent, ValuesA=eval_2.Point)  # -> Keys, ValuesA
sort_5 = SortList(Keys=pdecon_5.XComponent, ValuesA=eval.Point)  # -> Keys, ValuesA
dispatch_8 = Dispatch(List=[end_3.Start, end_3.End], DispatchPattern=smaller.SmallerThan)  # -> ListA, ListB; disabled
panel_4 = Panel(pframes.Parameters)
midpt_2 = CurveMiddle(Curve=crv_6)  # disabled
expression = Expression(y=pdecon_7.YComponent, f=multiplication, Expression="ABS(y)*f")
item_5 = ListItem(List=sort_4.ValuesA, Index=0, Wrap=True)  # -> Item, Item1
expression_2 = Expression(y=pdecon_8.YComponent, f=multiplication, Expression="ABS(y)*f")
item_6 = ListItem(List=sort_5.ValuesA, Index=0, Wrap=True)  # -> Item, Item1
pt_5 = Point(dispatch_8.ListA)  # disabled
pdecon_9 = Deconstruct(Point=midpt_2)  # -> XComponent, YComponent, ZComponent; disabled
sort_6 = SortList(Keys=pdecon_9.ZComponent, ValuesStemCrv1=crv_6)  # -> Keys, ValuesStemCrv1; disabled
vec2pt = Vector2Pt(PointA=item_6.Item1, PointB=item_6.Item, Unitize=True)  # -> Vector, Length
vec2pt_2 = Vector2Pt(PointA=item_5.Item1, PointB=item_5.Item, Unitize=True)  # -> Vector, Length
midpt_3 = CurveMiddle(Curve=sort_6.ValuesStemCrv1)  # disabled
multiplication_2 = Multiplication(A=flatten(vec2pt.Vector), Mult=expression)
multiplication_3 = Multiplication(A=flatten(vec2pt_2.Vector), Mult=expression_2)
vdis = VectorDisplay(Anchor=item_6.Item, Vector=vec2pt.Vector)
entwine = Entwine(Branch00=bow_pt, Branch01=midpt_3, FlattenInputs=True)  # -> flatten(Result); disabled
points = PointList(Points=entwine, Size=20)  # disabled
intcrv = Interpolate(Vertices=entwine, Degree=4, Periodic=False, KnotStyle=1)  # -> ProfileCrv, Length, Domain; disabled
bzspan = BezierSpan(StartPoint=x_tremez.Lowest, StartTangent=multiplication_2, EndPoint=x_tremez_2.Lowest, EndTangent=multiplication_3)  # -> StemCrv2, Length, Domain
pcx = CurvePlane(Curve=intcrv.ProfileCrv, Plane=bang_2.Branch0)  # -> Points, ParamsC, ParamsP; disabled
netsurf = NetworkSurface(CurvesU=crv_5, CurvesV=sort_6.ValuesStemCrv1, Continuity=1)  # -> flatten(StemBase); disabled
pdecon_10 = Deconstruct(Point=flatten(pcx.Points))  # -> XComponent, YComponent, ZComponent; disabled
entwine_2 = Entwine(Branch00=top_crv_2, Branch01=bzspan.StemCrv2, Branch02=transm_crv_2, FlattenInputs=True)  # -> flatten(Result)
crv_7 = Curve(crv_5)
subtraction = Subtraction(A=pdecon_4.XComponent, B=pdecon_10.XComponent)  # disabled
netsurf_2 = NetworkSurface(CurvesU=crv_7, CurvesV=entwine_2, Continuity=1)  # -> flatten(StemBase)
midpt_4 = CurveMiddle(Curve=entwine_2)
points_2 = PointList(Points=midpt_4, Size=50)
vdis_2 = VectorDisplay(Anchor=item_5.Item, Vector=vec2pt_2.Vector)  # disabled
panel_5 = Panel(expression)  # disabled
multiplication_4 = Multiplication(A=flatten(vec2pt.Vector), Mult=subtraction, C=multiplication)  # disabled
multiplication_5 = Multiplication(A=flatten(vec2pt_2.Vector), Mult=subtraction, C=multiplication)  # disabled
panel_6 = Panel(expression_2)  # disabled
stem_crv_2 = ClusterOutput(bzspan.StemCrv2)
stem_base = ClusterOutput(netsurf_2)
panel_7 = Panel(subtraction)  # disabled
bzspan_2 = BezierSpan(StartPoint=x_tremez.Lowest, StartTangent=multiplication_4, EndPoint=x_tremez_2.Lowest, EndTangent=multiplication_5)  # -> StemCrv, Length, Domain; disabled
crv_8 = Curve(flatten([flip_3.Curve, bzspan_2.StemCrv]))  # disabled

# ==== cluster Cluster_5
inner_chine = ClusterInput()
outer_chine = ClusterInput()
f = ClusterInput()
panel = Panel("""0
0.001
0.999
1""")
inner_chine_2 = Curve(inner_chine)
outer_chine_2 = Curve(outer_chine)
eval = EvaluateCurve(Curve=reparameterize(graft(inner_chine_2)), Parameter=panel)  # -> Point, Tangent, Angle
eval_2 = EvaluateCurve(Curve=reparameterize(graft(outer_chine_2)), Parameter=panel)  # -> Point, Tangent, Angle
x_tremez = Extremes(Curve=inner_chine_2, Plane=PlaneYZ(0, 0, 0))  # -> Highest, Lowest
x_tremez_2 = Extremes(Curve=outer_chine_2, Plane=PlaneYZ(0, 0, 0))  # -> Highest, Lowest
pdecon = Deconstruct(Point=eval.Point)  # -> XComponent, YComponent, ZComponent
pdecon_2 = Deconstruct(Point=eval_2.Point)  # -> XComponent, YComponent, ZComponent
pdecon_3 = Deconstruct(Point=x_tremez.Lowest)  # -> XComponent, YComponent, ZComponent
pdecon_4 = Deconstruct(Point=x_tremez_2.Lowest)  # -> XComponent, YComponent, ZComponent
sort = SortList(Keys=pdecon_2.XComponent, ValuesA=eval_2.Point)  # -> Keys, ValuesA
sort_2 = SortList(Keys=pdecon.XComponent, ValuesA=eval.Point)  # -> Keys, ValuesA
expression = Expression(y=pdecon_3.YComponent, f=f, Expression="ABS(y)*f")
item = ListItem(List=sort_2.ValuesA, Index=0, Wrap=True)  # -> Item, Item1
item_2 = ListItem(List=sort.ValuesA, Index=0, Wrap=True)  # -> Item, Item1
expression_2 = Expression(y=pdecon_4.YComponent, f=f, Expression="ABS(y)*f")
vec2pt = Vector2Pt(PointA=item.Item1, PointB=item.Item, Unitize=True)  # -> Vector, Length
vec2pt_2 = Vector2Pt(PointA=item_2.Item1, PointB=item_2.Item, Unitize=True)  # -> Vector, Length
panel_2 = Panel(expression)
vdis = VectorDisplay(Anchor=item.Item, Vector=vec2pt.Vector)
vdis_2 = VectorDisplay(Anchor=item_2.Item, Vector=vec2pt_2.Vector)
panel_3 = Panel(expression_2)
multiplication = Multiplication(A=flatten(vec2pt.Vector), Mult=expression)
multiplication_2 = Multiplication(A=flatten(vec2pt_2.Vector), Mult=expression_2)
bzspan = BezierSpan(StartPoint=x_tremez.Lowest, StartTangent=multiplication, EndPoint=x_tremez_2.Lowest, EndTangent=multiplication_2)  # -> StemCrv, Length, Domain
stem_crv = ClusterOutput(bzspan.StemCrv)
