# Grasshopper definition planing_hull_pts.gh (Grasshopper 1.0.8)
# Copyright: © 2023 SYD all rights reserved

imported_pt_o = Object()
D = Number()
loa = Number()
boa = Number()

# ---- group: Base Template layers
panel = Panel("""{-143.462, 101.363, 731.735}
{824.614, 713.142, 48.982}
{824.614, 4.467, -150.94}
{824.614, 777.793, 515.729}
{46.683, 1000.0, 729.821}
{104.465, 636.514, 317.934}
{824.614, 713.142, 48.982}
{135.304, 3.619, -268.265}
{355.672, 805.891, 580.549}
{-175.386, 0, 355.238}
{-42.157, 35.749, 69.077}
{0, 0, 0}""")
pt = Point(panel)
panel_2 = Panel("""0 Stem-sheer bPt
2 Chine stern bPt
4 Bilge stern bPt
5 Transom bPt
0 Stem-sheer ePt
1 Chine ePt
2 Chine stern ePt
4 Bilge stern ePt
5 Transom ePt
1 Chine intersect Ht
Bow angle aPt
Base Pt""")

# ---- group: Count is right - then use imported layers
lng = ListLength(List=imported_pt_o)
object = ModelObject(ImportedPtO=imported_pt_o)  # -> Object, Geometry, Name
equals = Equality(FirstNumber=lng, SecondNumber=12)  # -> Equality, Inequality
weave = Weave(Pattern=equals.Equality, Stream0=pt, Stream1=object.Geometry, NullGaps=False)
weave_2 = Weave(Pattern=equals.Equality, Stream0=panel_2, Stream1=object.Name, NullGaps=False)

# ----
pt_2 = ConstructPoint(XCoordinate=0, YCoordinate=0, ZCoordinate=0)
loa_2 = Number(loa)
D_2 = Number(D)
swatch = ColourSwatch(SwatchColor=RGB(60, 255, 0))  # disabled
boa_2 = Number(boa)
D_3 = Number(D)
scale_nu = ScaleNU(Geometry=weave, Plane=pt_2, ScaleX=loa_2, ScaleY=boa_2, ScaleZ=D_2)  # -> ScaledPts, Transform
layer = ModelLayer(Name="G=input-hull", DisplayColour=swatch)  # disabled
display_colour = DisplayColour(Source=0, Colour=swatch)  # -> DisplayColour, Source, Colour; disabled
panel_3 = Panel(object.Name)
layers = QueryModelLayers(Name="G=input-hull", AutoUpdateState=True)
crv = Curve(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)

# ---- group: Transom
scale_nu_2 = ScaleNU(Geometry=crv, Plane=PlaneXY(0, 0, 0), ScaleX=1, ScaleY=1, ScaleZ=D_2)  # -> ScaledTrans, Transform
layer_2 = ModelLayer(Name="G=input-trans", DisplayColour=ColourSwatch(SwatchColor=RGB(255, 255, 255)))
object_2 = ModelObject(Geometry=scale_nu_2.ScaledTrans, Name="Transom Crv", Layer=layer_2)  # -> simplify(TransmCrvO)
transm_crv_o = Object(object_2)

# ----
object_3 = ModelObject(Geometry=scale_nu.ScaledPts, Name=weave_2, Layer=layers)  # -> simplify(OriginPtsO)
pdecon = Deconstruct(Point=scale_nu.ScaledPts)  # -> XComponent, YComponent, ZComponent
sort = SortList(Keys=pdecon.XComponent)  # -> reverse(MaxX), ValuesA
item = ListItem(List=sort.MaxX, Index=0, Wrap=True)
max_x = Number(item)
origin_pts_o = Object(object_3)
max_x_2 = Number(max_x)
