# Grasshopper definition roundb_hull_correct_stem.gh (Grasshopper 1.0.8)
# Copyright: © SYD 2022
# Copyright: © 2023 SYD all rights reserved

project_ame = Text()
mod_pts_o = Object()
sinkage = Factor()
clipper_bow = Number()
hollow_bow = Number()
forefoot_depth = Number()
position = Position()
deck_curvature = Number()
transom_curvature = Number()
stem_factor = Number()
forefoot_factor = Number()
whole_srf = Surface()
ts = TextSettings()
object = ModelObject(FetchO=mod_pts_o)  # -> ModPtsO, Geometry, Name
Z = UnitZ(Sinkage=expr("-x", sinkage))
deck_curvature_2 = Number(deck_curvature)
transom_curvature_2 = Number(transom_curvature)
stem_factor_2 = Number(stem_factor)
forefoot_factor_2 = Number(forefoot_factor)
trim = TextTrim(ProjectAme=project_ame, Start=True, End=True)
object_2 = ModelObject(ModPtsO=mod_pts_o)  # -> ModPtsO, Name
clipper_bow_2 = Number(clipper_bow)
hollow_bow_2 = Number(hollow_bow)
forefoot_depth_2 = Number(forefoot_depth)
move = Move(Geometry=object.Geometry, Motion=Z)  # -> SunkPoints, Transform
object_3 = ModelObject(Geometry=move.SunkPoints, Name=object.Name)  # -> ModPtsO, Name
tmatch = MatchText(Text=object_3.Name, Pattern="*bPt", Case=True)
tmatch_2 = MatchText(Text=object_3.Name, Pattern="*ePt", Case=True)
tmatch_3 = MatchText(Text=object_3.Name, Pattern="*Ht", Case=True)
tmatch_4 = MatchText(Text=object_3.Name, Pattern="*aPt", Case=True)
dispatch = Dispatch(List=object_3.ModPtsO, DispatchPattern=tmatch)  # -> ListA, ListB
dispatch_2 = Dispatch(List=object_3.ModPtsO, DispatchPattern=tmatch_2)  # -> ListA, ListB
dispatch_3 = Dispatch(List=object_3.ModPtsO, DispatchPattern=tmatch_3)  # -> ListA, ListB
dispatch_4 = Dispatch(List=object_3.ModPtsO, DispatchPattern=tmatch_4)  # -> ListA, ListB
panel = Panel(dispatch.ListA)

# ---- group: Seperate Pts
item = ListItem(List=dispatch.ListA, Index=0, Wrap=False)  # -> Item, Item1, Item2, Item3, Item4
item_2 = ListItem(List=dispatch_2.ListA, Index=0, Wrap=True)  # -> Item, Item1, Item2, Item3, Item4, Item5

# ----
item_3 = ListItem(List=dispatch_3.ListA, Index=0, Wrap=True)  # -> Item, Item1
vec2pt = Vector2Pt(PointA=item.Item, PointB=dispatch_4.ListA, Unitize=False)  # -> Vector, Length
pt = Point(item.Item)
devec = DeconstructVector(Vector=vec2pt.Vector)  # -> XComponent, YComponent, ZComponent
line = LineSDL(Start=item_3.Item1, Direction=unitize(Vector(1, 0, 0)), Length=100000)
line_2 = LineSDL(Start=item_3.Item, Direction=unitize(Vector(1, 0, 0)), Length=100000)
vec = VectorXYZ(XComponent=devec.XComponent, YComponent=expr("x/2", devec.YComponent), ZComponent=devec.ZComponent)  # -> Vector, Length
X = UnitX(Factor=clipper_bow_2)
Y = UnitY(Factor=hollow_bow_2)
vec2pt_2 = Vector2Pt(FFootBPt=item.Item2, FFootEPt=item_2.Item3, Unitize=False)  # -> Vector, Length
devec_2 = DeconstructVector(Vector=vec.Vector)  # -> XComponent, YComponent, ZComponent
addition = Addition(A=X, B=Y)
multiplication = Multiplication(A=devec_2.ZComponent, B=forefoot_depth_2)
vec_2 = VectorXYZ(XComponent=devec_2.XComponent, YComponent=expr("x/2", devec_2.YComponent), ZComponent=multiplication)  # -> Vector, Length
eval = Evaluate(F="x/10*y", x=vec_2.Vector, y=forefoot_depth_2)
eval_2 = Evaluate(F="-x/20*y", x=vec2pt_2.Vector, y=forefoot_depth_2)
stbd_srf = StbdSrf(B=whole_srf)
merge = Merge(Data1=item.Item, Data2=item_2.Item, Data3=item_2.Item5, Data4=item.Item4)
nurbs = NurbsCurve(Vertices=merge, Degree=3, Periodic=False)  # -> SheerCrv, Length, Domain

# ---- group: Display / End points
cluster = Cluster_2(pt=dispatch_3.ListA)

# ----
layers = QueryModelLayers(Name="G-hull", AutoUpdateState=True)
mod_pts_o_2 = Object(object_3.ModPtsO)

# ---- group: Vector lines
ln = Line(StartPoint=item.Item, EndPoint=dispatch_4.ListA)
object_4 = ModelObject(Object=dispatch.ListA)  # -> Object, Name
rep = ReplaceText(Text=object_4.Name, Find="bPt", Replace="Vect", RecursiveReplace=False)

# ----
llx = LineLine(Line1=ln, Line2=line)  # -> ParamA, ParamB, PointA, PointB
llx_2 = LineLine(Line1=ln, Line2=line_2)  # -> ParamA, ParamB, PointA, PointB
bilge_intersect_pt = Point(llx_2.PointA)
chine_intersect_pt = Point(llx.PointA)
line_3 = LineSDL(Start=bilge_intersect_pt, Direction=unitize(Vector(1, 0, 0)), Length=100000)
llx_3 = LineLine(Line1=ln, Line2=line_3)  # -> ParamA, ParamB, PointA, PointB
move_2 = Move(Geometry=chine_intersect_pt, Motion=addition)  # -> Geometry, Transform
vdis = VectorDisplay(Anchor=llx_3.PointA, Vector=vec_2.Vector)

# ---- group: Always calulated
object_5 = ModelObject(Geometry=move_2.Geometry, Name="1 Chine Intsct iPt Vect")

# ----
bzspan = BezierSpan(StartPoint=llx_3.PointA, StartTangent=eval, EndPoint=item.Item3, EndTangent=eval_2)  # -> BilgeCrv, Length, Domain
eval_3 = EvaluateCurve(Curve=reparameterize(bzspan.BilgeCrv), Parameter=position)  # -> Point, Tangent, Angle
merge_2 = Merge(Data1=object_5, Data2=item_2.Item1, Data3=item_2.Item2, Data4=item.Item1)
merge_3 = Merge(Data1=bilge_intersect_pt, Data2=eval_3.Point, Data3=item.Item2, Data4=item_2.Item3, Data5=item_2.Item4, Data6=item.Item3)

# ---- group: Start of vectors
entwine = Entwine(
    Branch00=item.Item,
    Branch01=object_5,
    Branch02=item.Item1,
    Branch03=item.Item2,
    Branch04=item.Item3,
    Branch05=item.Item4,
    FlattenInputs=True)  # -> flatten(Result)

# ----
nurbs_2 = NurbsCurve(Vertices=merge_2, Degree=3, Periodic=False)  # -> ChineCrv, Length, Domain
nurbs_3 = NurbsCurve(Vertices=merge_3, Degree=3, Periodic=False)  # -> BilgeCrv, Length, Domain
panel_2 = Panel(entwine)
entwine_2 = Entwine(Branch00=nurbs.SheerCrv, Branch01=nurbs_2.ChineCrv, Branch02=nurbs_3.BilgeCrv, FlattenInputs=True)  # -> flatten(Result)

# ---- group: Display
layers_2 = QueryModelLayers(Name="G-hull-pts", AutoUpdateState=True)
layers_3 = QueryModelLayers(Name="G-hull-ctrl", AutoUpdateState=True)
panel_3 = Panel("""0 Bilge intersect Ht
1 Chine intersect Ht""")
cluster_2 = Cluster_3(cntrl_pt_o=flatten(dispatch.ListA), ts=ts)  # -> te, N, ad
cluster_3 = Cluster_3(cntrl_pt_o=[dispatch_2.ListA, object_5], ts=ts)  # -> te, N, ad
cluster_4 = Cluster_3(cntrl_pt_o=dispatch_4.ListA, ts=ts)  # -> te, N, ad
display = DisplayAttributes(DisplayColour=ColourSwatch(SwatchColor=RGB(181, 159, 207)))
display_2 = DisplayAttributes(DisplayColour=ColourSwatch(SwatchColor=RGB(157, 176, 209)))
display_3 = DisplayAttributes(DisplayColour=ColourSwatch(SwatchColor=RGB(192, 145, 204)))
display_4 = DisplayAttributes(DisplayColour=ColourSwatch(SwatchColor=RGB(123, 182, 186)))
display_5 = DisplayAttributes(DisplayColour=ColourSwatch(SwatchColor=RGB(214, 156, 156)))
object_6 = ModelObject(Geometry=cluster, Name=panel_3, Display=display_4)
object_7 = ModelObject(Geometry=ln, Name="Bow Angle V", Layer=layers_3, Display=display)
object_8 = ModelObject(Geometry=cluster_2.te, Name=cluster_2.N, Layer=layers_2, Display=display_2)
object_9 = ModelObject(Geometry=cluster_2.ad, Name=cluster_2.N, Layer=layers_2, Display=display_2)
object_10 = ModelObject(Geometry=cluster_3.te, Name=cluster_3.N, Layer=layers_2, Display=display_5)
object_11 = ModelObject(Geometry=cluster_3.ad, Name=cluster_3.N, Layer=layers_2, Display=display_5)
object_12 = ModelObject(Geometry=cluster_4.te, Name=cluster_4.N, Layer=layers_2, Display=display_3)
object_13 = ModelObject(Geometry=cluster_4.ad, Name=cluster_4.N, Layer=layers_2, Display=display_3)

# ---- group: Loft curves
midpt = CurveMiddle(Curve=entwine_2)
pl_origin = PlaneOrigin(Base=[PlaneXZ(0, 0, 0), PlaneXY(0, 0, 0), PlaneYZ(0, 0, 0)], Origin=graft(midpt))
panel_4 = Panel("""Sheer Crv
Chine Crv
Bilge Crv""")
text_entity = TextEntity(Plane=pl_origin, Text=graft(panel_4), TextSettings=ts)
display_6 = DisplayAttributes(DisplayColour=[ColourSwatch(SwatchColor=RGB(153, 201, 166)), ColourSwatch(SwatchColor=RGB(207, 201, 143)), ColourSwatch(SwatchColor=RGB(214, 160, 118))])  # -> Display, DisplayColour, DisplayMode
object_14 = ModelObject(Geometry=text_entity, Name=panel_4, Layer=layers_3, Display=display_6.Display)
object_15 = ModelObject(Geometry=entwine_2, Name=panel_4, Layer=layers_3, Display=display_6.Display)

# ---- group: Seperate panels
object_16 = ModelObject(LoftingO=object_15)
mirror = Mirror(Geometry=object_16, Plane=Plane(origin=(0, 0, 0), x=(0, 0, 1), y=(1, 0, 0)))  # -> Geometry, Transform
object_17 = ModelObject(Object=object_16)  # -> Object, Name
concat = Concatenate(FragmentA=object_17.Name, FragmentB=" p")
object_18 = ModelObject(Object=object_17.Object, Geometry=mirror.Geometry, Name=concat)
item_4 = ListItem(List=flatten(object_16), Index=0, Wrap=True)  # -> Item, Item1, Item2
item_5 = ListItem(List=flatten(object_18), Index=0, Wrap=True)  # -> Item, Item1, Item2
object_19 = ModelObject(item_4.Item)
object_20 = ModelObject(item_4.Item1)
object_21 = ModelObject(item_4.Item2)
object_22 = ModelObject(item_5.Item)
object_23 = ModelObject(item_5.Item1)

# ---- group: Transom cutting surface
cluster_5 = Cluster(loft_crv=object_16, I=whole_srf)  # -> out, R

# ----
panel_5 = Panel(cluster_5.out)
object_24 = ModelObject(item_5.Item2)

# ---- group: Aft end of sheerline
end = EndPoints(Curve=object_19)  # -> Start, End
pdecon = Deconstruct(Point=[end.Start, end.End])  # -> XComponent, YComponent, ZComponent
abs = Absolute(Value=pdecon.XComponent)
sort = SortList(Keys=abs, ValuesA=[end.Start, end.End])  # -> Keys, ValuesA
dispatch_5 = Dispatch(List=sort.ValuesA, DispatchPattern=[True, False])  # -> ListA, ListB

# ----
hull = Loft(
    Curves=[object_19, object_20, object_21, object_24, object_23, object_22],
    Options={Adjust=True, Closed=False, LoftEnds=0, LoftSimp=0, LoftType=1, Rebuild=10, Refit=0.01})
sec = BrepPlane(Brep=hull, Plane=Plane(origin=(0, 0, 0), x=(0, 0, 1), y=(1, 0, 0)))  # -> Curves, Points

# ---- group: Transom mid Pt
addition_2 = Addition(A=deck_curvature_2, B=1)
pdecon_2 = Deconstruct(Point=dispatch_5.ListB)  # -> XComponent, YComponent, ZComponent
multiplication_2 = Multiplication(A=transom_curvature_2, B=pdecon_2.ZComponent)
multiplication_3 = Multiplication(A=addition_2, B=multiplication_2)
addition_3 = Addition(A=pdecon_2.XComponent, B=multiplication_3)
addition_4 = Addition(A=pdecon_2.ZComponent, B=multiplication_2)
mirror_2 = Mirror(TransomPt=dispatch_5.ListB, Plane=PlaneXZ(0, 0, 0))  # -> Geometry, Transform
pt_2 = ConstructPoint(XCoordinate=addition_3, YCoordinate=0, ZCoordinate=addition_4)

# ---- group: Hull
dom²num = ConstructDomain²(UMin="0.5", UMax=1, VMin=0, VMax=1)
subsrf = Isotrim(Surface=reparameterize(hull), Domain=dom²num)

# ----
srfsplit = SurfaceSplit(Surface=hull, Curves=sec.Curves)
dispatch_6 = Dispatch(List=srfsplit, DispatchPattern=[True, False])  # -> ListA, ListB
debrep = DeconstructBrep(Brep=hull)  # -> Faces, Edges, Vertices
stbd_hull_srf = Surface(dispatch_6.ListA)

# ---- group: Aft end of hull
midpt_2 = CurveMiddle(Curve=debrep.Edges)
pdecon_3 = Deconstruct(Point=midpt_2)  # -> XComponent, YComponent, ZComponent
abs_2 = Absolute(Value=pdecon_3.XComponent)
sort_2 = SortList(Keys=abs_2, ValuesA=debrep.Edges)  # -> Keys, ValuesA

# ----
stbd_srf_2 = StbdSrf(B=debrep.Faces)  # disabled

# ---- group: V Crvs
debrep_2 = DeconstructBrep(Brep=stbd_hull_srf)  # -> Faces, Edges, Vertices
midpt_3 = CurveMiddle(Curve=debrep_2.Edges)
pdecon_4 = Deconstruct(Point=midpt_3)  # -> XComponent, YComponent, ZComponent
sort_3 = SortList(Keys=pdecon_4.XComponent, ValuesA=debrep_2.Edges)  # -> Keys, ValuesA
item_6 = ListItem(List=sort_3.ValuesA, Index=0, Wrap=True)
mirror_3 = Mirror(Geometry=item_6, Plane=Plane(origin=(0, 0, 0), x=(0, 0, 1), y=(1, 0, 0)))  # -> Geometry, Transform

# ----
item_7 = ListItem(List=sort_2.ValuesA, Index=0, Wrap=True)

# ---- group: Stem
flip = FlipCurve(Curve=object_19, Guide=object_22)  # -> Curve, Flag
stem_deck_crv = StemDeckCrv(f=stem_factor_2, crv_1=object_22, crv_2=flip.Curve)

# ---- group: Vector lines (continued)
ln_2 = Line(StartPoint=entwine, EndPoint=dispatch_2.ListA)
object_25 = ModelObject(Geometry=ln_2, Name=rep, Layer=layers_3, Display=display)

# ----
cntrl_vector_o = Object([object_25, object_7])
mark_pt_o = Object([object_11, object_9, object_13, object_12, object_10, object_8, object_6])
loft_crv_o = Object([object_15, object_14])

# ---- group: U Crvs
end_2 = EndPoints(Curve=sec.Curves)  # -> Start, End
Z_2 = UnitZ(Factor=0.01)
move_3 = Move(Geometry=end_2.End, Motion=Z_2)  # -> Geometry, Transform
contour = Contour(Shape=stbd_hull_srf, Point=move_3.Geometry, Direction=Vector(0, 0, 1), Distance=Slider(48, range=0..100))  # -> simplify(Contours)
end_3 = EndPoints(Curve=contour)  # -> Start, End
pdecon_5 = Deconstruct(Point=flatten(end_3.End))  # -> XComponent, YComponent, ZComponent
larger = LargerThan(FirstNumber=pdecon_5.YComponent, SecondNumber=0)  # -> LargerThan, OrEqualTo
dispatch_7 = Dispatch(List=contour, DispatchPattern=graft(larger.LargerThan))  # -> ListA, ListB
crv = Curve(flatten(dispatch_7.ListA))
cull_i = CullIndex(List=crv, Indices=0, Wrap=True)
flip_2 = FlipCurve(Curve=cull_i)  # -> Curve, Flag
mirror_4 = Mirror(Geometry=cull_i, Plane=Plane(origin=(0, 0, 0), x=(0, 0, 1), y=(1, 0, 0)))  # -> Geometry, Transform
stem_deck_crv_2 = StemDeckCrv(f=stem_factor_2, crv_1=flip_2.Curve, crv_2=mirror_4.Geometry)
flip_3 = FlipCurve(Curve=stem_deck_crv)  # -> graft(Curve), Flag
flip_4 = FlipCurve(Curve=flip_3.Curve)  # -> Curve, Flag

# ---- group: Align with forefoot
cl_hull_crv = Curve(sec.Curves)
item_8 = ListItem(List=crv, Index=0, Wrap=True)
end_4 = EndPoints(Curve=item_8)  # -> Start, End
end_5 = EndPoints(Curve=cl_hull_crv)  # -> Start, End
flip_5 = FlipCurve(Curve=cl_hull_crv)  # -> Curve, Flag
mirror_5 = Mirror(Geometry=end_4.End, Plane=Plane(origin=(0, 0, 0), x=(0, 0, 1), y=(1, 0, 0)))  # -> Geometry, Transform
eval_4 = EvaluateCurve(Curve=reparameterize(item_8), Parameter=0.999)  # -> Point, Tangent, Angle
eval_5 = EvaluateCurve(Curve=reparameterize(flip_5.Curve), Parameter=0.001)  # -> Point, Tangent, Angle
vec2pt_3 = Vector2Pt(PointA=eval_4.Point, PointB=end_4.End, Unitize=True)  # -> Vector, Length
vec2pt_4 = Vector2Pt(PointA=eval_5.Point, PointB=end_5.End, Unitize=True)  # -> Vector, Length
mirror_6 = Mirror(Geometry=vec2pt_3.Vector, Plane=Plane(origin=(0, 0, 0), x=(0, 0, 1), y=(1, 0, 0)))  # -> Geometry, Transform
multiplication_4 = Multiplication(A=vec2pt_4.Vector, _01=Slider(0.5, range=0..1))
multiplication_5 = Multiplication(A=vec2pt_3.Vector, _01=0.1)
multiplication_6 = Multiplication(A=mirror_6.Geometry, _01=0.1)
addition_5 = Addition(A=multiplication_5, B=multiplication_4)
addition_6 = Addition(A=multiplication_6, B=multiplication_4)
bzspan_2 = BezierSpan(StartPoint=end_4.End, StartTangent=addition_5, EndPoint=mirror_5.Geometry, EndTangent=addition_6)  # -> StemRootCrv, Length, Domain

# ----
vdis_2 = VectorDisplay(Anchor=end_4.End, Vector=addition_5)  # disabled
vdis_3 = VectorDisplay(Anchor=mirror_5.Geometry, Vector=multiplication_6)  # disabled
# too slow
vdis_4 = VectorDisplay(Anchor=eval_5.Point, Vector=multiplication_4)  # disabled

# ---- group: U Crvs (continued)
crv_2 = Curve(bzspan_2.StemRootCrv)
midpt_4 = CurveMiddle(Curve=[stem_deck_crv, stem_deck_crv_2, crv_2])
pdecon_6 = Deconstruct(Point=midpt_4)  # -> XComponent, YComponent, ZComponent
sort_4 = SortList(Keys=flatten(pdecon_6.ZComponent), ValuesA=flatten([stem_deck_crv, stem_deck_crv_2, crv_2]))  # -> Keys, ValuesA

# ----
netsurf = NetworkSurface(CurvesU=[mirror_3.Geometry, item_6], CurvesV=sort_4.ValuesA, Continuity=3)

# ---- group: whY? iTS A SURFACE...
object_26 = ModelObject(Geometry=netsurf, Name="Stem Stbd", Layer=layers)  # -> Object, Geometry

# ----
sec_2 = BrepPlane(Brep=object_26.Geometry, Plane=Plane(origin=(0, 0, 0), x=(0, 0, 1), y=(1, 0, 0)))  # -> Curves, Points
srfsplit_2 = SurfaceSplit(Surface=object_26.Geometry, Curves=sec_2.Curves)
dispatch_8 = Dispatch(List=srfsplit_2, DispatchPattern=[True, False])  # -> ListA, ListB
object_27 = ModelObject(Object=object_26.Object, Geometry=dispatch_8.ListA)
stem = Surface(netsurf)

# ---- group: Transom
arc = Arc3Pt(TransomCorner=dispatch_5.ListB, TransomCl=pt_2, TransomCorner_2=mirror_2.Geometry)  # -> DeckAftCrv, Plane, Radius
item_9 = ListItem(List=sort_2.ValuesA, Index=-1, Wrap=True)
transom_crv = Curve(item_9)

# ---- group: Mid transom points
number_slider = Slider(0.38, range=0..1)
eval_6 = EvaluateCurve(Curve=arc.DeckAftCrv, Parameter=1)  # -> Point, Tangent, Angle
subtraction = Subtraction(A=1, B=number_slider)
devec_3 = DeconstructVector(Vector=eval_6.Tangent)  # -> XComponent, YComponent, ZComponent
eval_7 = EvaluateCurve(Curve=reparameterize(transom_crv), Parameter=[subtraction, number_slider])  # -> Point, Tangent, Angle
vec_3 = VectorXYZ(XComponent=expr("x*2", devec_3.XComponent), YComponent=devec_3.YComponent, ZComponent=expr("x*2", devec_3.ZComponent))  # -> Vector, Length
dispatch_9 = Dispatch(List=eval_7.Point, DispatchPattern=[True, False])  # -> ListA, ListB

# ---- group: Deck/2
edgesrf = EdgeSurface(CurveA=arc.DeckAftCrv, CurveB=object_22, CurveC=stem_deck_crv, CurveD=flip.Curve)
stbd_srf_3 = StbdSrf(B=edgesrf)

# ---- group: Transom (continued)
arc_2 = ArcSED(Start=dispatch_9.ListA, End=dispatch_9.ListB, Direction=vec_3.Vector)  # -> Arc, Plane, Radius
midpt_5 = CurveMiddle(Curve=[arc.DeckAftCrv, arc_2.Arc, transom_crv])  # -> flatten(Midpoint)
nurbs_4 = NurbsCurve(Vertices=midpt_5, Degree=2, Periodic=False)  # -> Curve, Length, Domain
edgesrf_2 = EdgeSurface(CurveA=arc.DeckAftCrv, CurveB=transom_crv, CurveC=nurbs_4.Curve)
mirror_7 = Mirror(Geometry=edgesrf_2, Plane=PlaneXZ(0, 0, 0))  # -> Geometry, Transform

# ---- group: Cut surfaces w transom
dispatch_10 = Dispatch(List=stbd_hull_srf, DispatchPattern=cluster_5.R)  # -> HullStbd, ListB
dispatch_11 = Dispatch(List=stbd_srf_3, DispatchPattern=cluster_5.R)  # -> ListA, ListB
split_larger = SplitLarger(T=flatten([dispatch_11.ListB, dispatch_10.ListB]), cutting_srf=stbd_srf)  # -> larger_srf_2, smaller_srf_2, cutting_crv_2
split_larger_2 = SplitLarger(T=stbd_srf, cutting_crv=split_larger.cutting_crv_2)  # -> larger_srf_2, smaller_srf_2, cutting_crv_2
area = Area(Geometry=split_larger.larger_srf_2)  # -> Area, Centroid
dispatch_12 = Dispatch(List=mirror_7.Geometry, DispatchPattern=cluster_5.R)  # -> Transom, ListB
sort_5 = SortList(Keys=area.Centroid, ValuesA=split_larger.larger_srf_2)  # -> Keys, ValuesA
near_cl = NearCL(srf=[split_larger_2.larger_srf_2, split_larger_2.smaller_srf_2])
item_10 = ListItem(List=flatten(sort_5.ValuesA), Index=0, Wrap=False)  # -> Item, Item1

# ----
transom_srf_stbd = Surface([dispatch_12.Transom, near_cl])
deck_stbd = Surface([dispatch_11.ListA, item_10.Item1])
hull_stbd = Surface([dispatch_10.HullStbd, item_10.Item])
object_28 = ModelObject(Object=hull_stbd, Geometry=item_10.Item, Name="Topside Stbd", Layer=layers)
object_29 = ModelObject(Geometry=deck_stbd, Name="Deck Stbd", Layer=layers)
object_30 = ModelObject(Geometry=transom_srf_stbd, Name="Transom Stbd", Layer=layers)

# ---- group: Solid Vessel
clean = CleanTree(RemoveNulls=True, RemoveInvalid=True, RemoveEmpty=True, Tree=flatten([object_30, object_29, object_28]))
srf = Surface(flatten(clean))
join = BrepJoin(Breps=srf)  # -> Vessel, Closed
mirror_8 = Mirror(Geometry=join.Vessel, Plane=PlaneXZ(0, 0, 0))  # -> Geometry, Transform
join_2 = BrepJoin(Breps=flatten([mirror_8.Geometry, join.Vessel, object_26.Geometry]))  # -> Vessel, Closed
capex = CapHolesEx(Brep=flatten(join_2.Vessel))  # -> Vessel, Caps, Solid
layers_4 = QueryModelLayers(Name="G-hull", AutoUpdateState=True)
object_31 = ModelObject(Geometry=capex.Vessel, Name=trim, Layer=layers_4)

# ----
half_hull_srf = ModelObject(flatten([clean, object_27]))
half_hull_srf_2 = ModelObject(half_hull_srf)
vessel_o = Object(object_31)
solid = Solid(capex.Solid)

# ==== cluster StemDeckCrv
f = ClusterInput()
crv_2 = ClusterInput()
crv_1 = ClusterInput()
end = EndPoints(Curve=crv_1)  # -> Start, End
end_2 = EndPoints(Curve=crv_2)  # -> Start, End
pt = Point(end.End)
flip = FlipCurve(Curve=crv_2)  # -> Curve, Flag
eval = EvaluateCurve(Curve=reparameterize(crv_1), Parameter=0.001)  # -> Point, Tangent, Angle
eval_2 = EvaluateCurve(Curve=reparameterize(flip.Curve), Parameter=0.001)  # -> Point, Tangent, Angle
vec2pt = Vector2Pt(PointA=eval.Point, PointB=end.Start, Unitize=True)  # -> Vector, Length
pdecon = Deconstruct(Point=end.Start)  # -> XComponent, YComponent, ZComponent
vec2pt_2 = Vector2Pt(PointA=eval_2.Point, PointB=end_2.End, Unitize=True)  # -> Vector, Length
pdecon_2 = Deconstruct(Point=end.End)  # -> XComponent, YComponent, ZComponent; disabled
eval_3 = Evaluate(F="if(ABS(x)<ABS(y),ABS(x)*f,ABS(y)*f)", x=pdecon.YComponent, y=pdecon_2.YComponent, f=f)  # disabled
expression = Expression(ys=pdecon.YComponent, ye=pdecon_2.YComponent, f=f, Expression="if(ABS(ys)<ABS(ye),ABS(ys)*f,ABS(ye)*f)")  # disabled
multiplication = Multiplication(A=vec2pt.Vector, Mult=pdecon.YComponent)
multiplication_2 = Multiplication(A=vec2pt_2.Vector, Mult=pdecon.YComponent)
vdis = VectorDisplay(Anchor=end_2.End, Vector=vec2pt_2.Vector)
vdis_2 = VectorDisplay(Anchor=end.Start, Vector=vec2pt.Vector)
bzspan = BezierSpan(StartPoint=end.Start, StartTangent=multiplication, EndPoint=end_2.End, EndTangent=multiplication_2)  # -> StemDeckCrv, Length, Domain
stem_deck_crv = ClusterOutput(bzspan.StemDeckCrv)
panel = Panel(pdecon.YComponent)
panel_2 = Panel(pdecon_2.YComponent)
panel_3 = Panel(expression)

# ==== cluster SplitLarger
cutting_crv = ClusterInput()
cutting_srf = ClusterInput()
T = ClusterInput()
flatten = FlattenTree(Tree=T, Path="{0}")  # -> graft(Tree)
cutting_srf_2 = Surface(cutting_srf)
bbx = BrepBrep(Surface=flatten, CuttingSrf=cutting_srf_2)  # -> Curves, Points
panel = Panel("Transom does not intersect hull")  # disabled
srfsplit = SurfaceSplit(Surface=flatten, CuttingCrv=[bbx.Curves, cutting_crv])
null = NullItem(Item=flatten(bbx.Curves))  # -> NullFlags, InvalidFlags, Description; disabled
area = Area(Geometry=srfsplit)  # -> Area, Centroid
expression = Expression(N=null.NullFlags, S=panel, Expression="IF(N,Format(\"{0}\",S),\"\")")  # disabled
dispatch = Dispatch(List=area.Area, DispatchPattern=[True, False])  # -> ListA, ListB
input = DataInput(
    Destination="C:\Users\phils\Dropbox\Projects\Software\GH_subcomponents\02 YachtSoft HullZero\01 Displacement\Error Log.ghdata",
    RelativePath="C:\Users\phils\Dropbox\Projects\Software\GH_subcomponents\02 YachtSoft HullZero\01 Displacement\Error Log.ghdata",
    UpdateDelay=9223372036854775807)  # -> flatten(DataOutput); disabled
larger = LargerThan(FirstNumber=dispatch.ListA, SecondNumber=dispatch.ListB)  # -> LargerThan, OrEqualTo
entwine = Entwine(Branch00=expression, Branch01=input, FlattenInputs=True)  # disabled
not = GateNot(A=larger.LargerThan)
output = DataOutput(
    DataInput=flatten(entwine),
    Destination="C:\Users\phils\Dropbox\Projects\Software\GH_subcomponents\02 YachtSoft HullZero\01 Displacement\Error Log.ghdata",
    RelativePath="C:\Users\phils\Dropbox\Projects\Software\GH_subcomponents\02 YachtSoft HullZero\01 Displacement\Error Log.ghdata")  # disabled
dispatch_2 = Dispatch(List=srfsplit, DispatchPattern=[larger.LargerThan, not])  # -> ListA, ListB
join = JoinCurves(Curves=flatten(bbx.Curves), Preserve=False)
larger_srf = Surface(dispatch_2.ListA)
smaller_srf = Surface(dispatch_2.ListB)
smaller_srf_2 = ClusterOutput(smaller_srf)
larger_srf_2 = ClusterOutput(larger_srf)
cutting_crv_2 = ClusterOutput(join)

# ==== cluster NearCL
srf = ClusterInput()
srf_2 = Surface(srf)
area = Area(Geometry=srf_2)  # -> Area, Centroid
pdecon = Deconstruct(Point=area.Centroid)  # -> XComponent, YComponent, ZComponent
abs = Absolute(Value=pdecon.YComponent)
dispatch = Dispatch(List=abs, DispatchPattern=[True, False])  # -> ListA, ListB
smaller = SmallerThan(FirstNumber=dispatch.ListA, SecondNumber=dispatch.ListB)  # -> SmallerThan, OrEqualTo
not = GateNot(A=smaller.SmallerThan)
dispatch_2 = Dispatch(List=srf_2, DispatchPattern=[smaller.SmallerThan, not])  # -> ListA, ListB
A = ClusterOutput(dispatch_2.ListA)

# ==== cluster StbdSrf
B = ClusterInput()
sec = BrepPlane(Brep=B, Plane=Plane(origin=(0, 0, 0), x=(0, 0, 1), y=(1, 0, 0)))  # -> Curves, Points
srfsplit = SurfaceSplit(Surface=B, Curves=sec.Curves)
area = Area(Geometry=srfsplit)  # -> Area, Centroid
pdecon = Deconstruct(Point=area.Centroid)  # -> XComponent, YComponent, ZComponent
sort = SortList(Keys=pdecon.YComponent, ValuesA=srfsplit)  # -> Keys, ValuesA
item = ListItem(List=reverse(sort.ValuesA), Index=0, Wrap=True)
stbd_srf = Surface(item)
stbd_srf_2 = ClusterOutput(stbd_srf)

# ==== cluster Cluster
loft_crv = ClusterInput()
I = ClusterInput()
end = EndPoints(LoftCrv=loft_crv)  # -> Start, End
pdecon = Deconstruct(Point=[end.End, end.Start])  # -> XComponent, YComponent, ZComponent
sort = SortList(Keys=pdecon.XComponent)  # -> reverse(Keys), ValuesA
item = ListItem(List=sort.Keys, Index=0, Wrap=True)

# ---- group: Error check
debrep = DeconstructBrep(TransmSrf=I)  # -> Faces, Edges, Vertices
pdecon_2 = Deconstruct(Point=debrep.Vertices)  # -> XComponent, YComponent, ZComponent
sort_2 = SortList(Keys=pdecon_2.XComponent)  # -> Keys, ValuesA
pdecon_3 = Deconstruct(Point=debrep.Vertices)  # -> XComponent, YComponent, ZComponent
null = NullItem(Item=I)  # -> NullFlags, InvalidFlags, Description
item_2 = ListItem(List=reverse(sort_2.Keys), Index=0, Wrap=True)
sort_3 = SortList(Keys=pdecon_3.XComponent)  # -> reverse(Keys), ValuesA
item_3 = ListItem(List=sort_2.Keys, Index=0, Wrap=True)
item_4 = ListItem(List=sort_3.Keys, Index=0, Wrap=True)
larger = LargerThan(FirstNumber=item_2, SecondNumber=item)  # -> LargerThan, OrEqualTo
larger_2 = LargerThan(FirstNumber=item_3, SecondNumber=item)  # -> LargerThan, OrEqualTo
bool = Boolean(null.NullFlags)
expression = Expression(N=larger_2.LargerThan, S="Transom misses stern", Expression="IF(N,Format(\"{0}\",S),\"\")")
or = GateOr(A=larger.LargerThan, B=larger_2.LargerThan, C=bool)
expression_2 = Expression(N=larger.LargerThan, S="Transom Intersects Stern", Expression="IF(N,Format(\"{0}\",S),\"\")")
input = DataInput(
    Destination="C:\Users\phils\Dropbox\Projects\Software\GH_subcomponents\02 YachtSoft HullZero\01 Displacement\Error Log.ghdata",
    RelativePath="C:\Users\phils\Dropbox\Projects\Software\GH_subcomponents\02 YachtSoft HullZero\01 Displacement\Error Log.ghdata",
    UpdateDelay=9223372036854775807)  # -> flatten(DataOutput); disabled

# ----
entwine = Entwine(Branch00=expression, Branch01=expression_2, Branch02=input, FlattenInputs=True)  # -> flatten(Result); disabled
output = DataOutput(
    DataInput=flatten(entwine),
    Destination="C:\Users\phils\Dropbox\Projects\Software\GH_subcomponents\02 YachtSoft HullZero\01 Displacement\Error Log.ghdata",
    RelativePath="C:\Users\phils\Dropbox\Projects\Software\GH_subcomponents\02 YachtSoft HullZero\01 Displacement\Error Log.ghdata")  # disabled
out = ClusterOutput([expression, expression_2])
R = ClusterOutput(or)

# ==== cluster Cluster_2
pt = ClusterInput()
X = UnitX(Factor=[-1000, 1000])
pt_2 = Point(pt)
move = Move(Geometry=graft(pt_2), Motion=X)  # -> Geometry, Transform
dispatch = Dispatch(List=move.Geometry, DispatchPattern=[True, False])  # -> ListA, ListB
ln = Line(StartPoint=dispatch.ListA, EndPoint=dispatch.ListB)  # -> flatten(Line)
L = ClusterOutput(ln)

# ==== cluster Cluster_3
cntrl_pt_o = ClusterInput()
ts = ClusterInput()
object = ModelObject(CntrlPtO=cntrl_pt_o)  # -> Object, Geometry, Name
pl_origin = PlaneOrigin(Base=[PlaneXZ(0, 0, 0), PlaneXY(0, 0, 0), PlaneYZ(0, 0, 0)], Origin=graft(object.Geometry))
as_text = AnnotationTextSettings(TextSettings=ts)  # -> TextSettings, TextHeight

# ---- group: Upgraded : Text Dot
annotation_dot = AnnotationDot(Location=object.Geometry, PrimaryText="+", TextHeight=expr("x*2", as_text.TextHeight))

# ----
text_entity = TextEntity(Plane=pl_origin, Text=graft(object.Name), TextSettings=as_text.TextSettings)
te = ClusterOutput(text_entity)
N = ClusterOutput(object.Name)
ad = ClusterOutput(annotation_dot)
