# Grasshopper definition sandwich_mtl.gh (Grasshopper 1.0.8)
# Copyright: © SYD 2022

area_threshold = Branch06()
add_laminate = Branch07()
core_mtl = Content()
mtl = Content()
inner_t = Branch05()
core_t = Branch02()
skin_t = Branch01()
key = Keys()
larger = LargerThan(FirstNumber=core_t, SecondNumber=0)  # -> LargerThan, OrEqualTo
u_text = UserText(Content=mtl, Keys="Density", UserTextMode=1)  # -> Content, Keys, Values
u_text_2 = UserText(Content=core_mtl, Keys="Density", UserTextMode=1)  # -> Content, Keys, Values
object = ModelObject(Object=u_text_2.Content)  # -> Object, Name
dispatch = Dispatch(List="solid", DispatchPattern=invert(larger.LargerThan))  # -> ListA, ListB
dispatch_2 = Dispatch(List="cored", DispatchPattern=larger.LargerThan)  # -> ListA, ListB
entwine = Entwine(
    Branch00=u_text.Values,
    Branch01=skin_t,
    Branch02=core_t,
    Branch03=u_text_2.Values,
    Branch04=object.Name,
    Branch05=inner_t,
    Branch06=area_threshold,
    Branch07=add_laminate,
    Branch08=[dispatch_2.ListA, dispatch.ListA],
    FlattenInputs=True)
u_text_3 = UserText(Content=mtl, Keys=key, Values=flatten(entwine), UserTextMode=1)  # -> Content, Keys, Values
ma = MassAddition(Input=[skin_t, core_t, inner_t])  # -> Result, PartialResults
mtl_2 = Content(u_text_3.Content)
T = Result(ma.Result)
panel = Panel(u_text_3.Keys)
panel_2 = Panel(u_text_3.Values)
