# Grasshopper definition side_indent.gh (Grasshopper 1.0.8)
# Copyright: © 2023 SYD all rights reserved
# plug-ins: Pufferfish

x_dist = Factor()
y_dist = Factor()
z_dist = Factor()
C = Curves()
cl_pl = Plane()
Y = UnitY(Factor=y_dist)
X = UnitX(Factor=x_dist)
Z = UnitZ(Factor=z_dist)
vec = VectorXYZ(XComponent=Z, YComponent=Y, ZComponent=X)  # -> Vector, Length
join = JoinCurves(Curves=C, Preserve=False)
clscrv = CloseCurve(Curve=join, CloseType=0, Bulge=0.5, Tolerance=0)  # -> Closed, R
extr = Extrude(Base=clscrv.Closed, Direction=vec.Vector)
cap = CapHoles(Brep=extr)
mirror = Mirror(Geometry=cap, Plane=cl_pl)  # -> Geometry, Transform
B = Brep([cap, mirror.Geometry])
