# Grasshopper definition small_perimeter_2.gh (Grasshopper 1.0.8)
# Copyright: © 2023 SYD all rights reserved

B = Brep()
debrep = DeconstructBrep(Brep=B)  # -> Faces, Edges, Vertices; disabled
wires = BrepWireframe(Brep=B, Density=-1)
area = Area(Geometry=B)  # -> Area, Centroid; disabled
join = JoinCurves(Curves=wires, Preserve=False)
sort = SortList(Keys=area.Area, ValuesA=B)  # -> Keys, ValuesA; disabled
len = Length(Curve=join)
crv = Curve(join)
rint = RegionIntersection()  # disabled
srf = Surface(sort.ValuesA)  # disabled
ma = MassAddition(Input=len)  # -> Result, PartialResults
incurve = PointInCurve(Point=area.Centroid, Curve=graft(join))  # -> Relationship, Point; disabled
trim = TrimTree(Tree=crv, Depth=1)
trim_2 = TrimTree(Tree=ma.Result, Depth=2)
sort_2 = SortList(Keys=trim_2, ValuesA=B)  # -> Keys, ValuesA
equals = Equality(FirstNumber=incurve.Relationship, SecondNumber=2)  # -> Equality, Inequality; disabled
panel = Panel(equals.Equality)  # disabled
item = ListItem(List=trim_2, Index=0, Wrap=True)  # -> Item, Item1, Item2; disabled
item_2 = ListItem(List=sort_2.ValuesA, Index=0, Wrap=True)
dispatch = Dispatch(List=B, DispatchPattern=equals.Equality)  # -> ListA, ListB; disabled
gate = StreamGate(Stream=flatten(B), Gate=flatten(incurve.Relationship))  # -> Target0, Target1, Target2; disabled
crv_2 = Curve(item.Item)  # disabled
crv_3 = Curve(item.Item1)  # disabled
crv_4 = Curve(item.Item2)  # disabled
clean = CleanTree(RemoveNulls=True, RemoveInvalid=True, RemoveEmpty=False, Tree=item_2)
panel_2 = Panel(trim_2)  # disabled
panel_3 = Panel(dispatch.ListA)  # disabled
T = Tree(clean)
