# Grasshopper definition solar_array.gh (Grasshopper 1.0.8)
# Copyright: © 2023 SYD all rights reserved

cutout_srf = Surface()
solar_o = Content()
mirror = Boolean()
centre_pl = PointA()
rotation_pt = Relay()
A = Angle()
dl = VariableDl()
N = Count()
dw = VariableDw()
N_2 = Count()
mirror_2 = Boolean(mirror)
u_text = UserText(Content=solar_o, Keys="Length", UserTextMode=1)  # -> Content, Values
dist = Distance(CentrePl=centre_pl, RotatePl=rotation_pt)
u_text_2 = UserText(Content=u_text.Content, Keys="Width", UserTextMode=1)  # -> Content, Values
expression = Expression(R=dist, L=u_text.Values, Dl=dl, x=N, Expression="tan((L+Dl)/R)*x")
pl_origin = PlaneOrigin(Base=Plane(origin=(0, 0, 0), x=(0, 0, 1), y=(1, 0, 0)), Origin=rotation_pt)
pl_origin_2 = PlaneOrigin(Base=PlaneXY(0, 0, 0), Origin=centre_pl)
rotate = Rotate(Geometry=pl_origin_2, Angle=degrees(A), Plane=pl_origin)  # -> Geometry, Transform
expression_2 = Expression(R=dist, W=u_text_2.Values, Dw=dw, x=N_2, Expression="tan((W+Dw)/R)*x")
cutout_srf_2 = Surface(cutout_srf)
Z = UnitZ(Factor="-500")
pl_origin_3 = PlaneOrigin(Base=PlaneYZ(0, 0, 0), Origin=rotation_pt)
arrpolar = PolarArray(Geometry=rotate.Geometry, Plane=pl_origin, Count=N, Angle=expression)  # -> Geometry, Transform
pl_origin_4 = PlaneOrigin(Base=Plane(origin=(0, 0, 0), x=(0, 0, 1), y=(1, 0, 0)), Origin=centre_pl)
move = Move(Geometry=cutout_srf_2, Motion=Z)  # -> Geometry, Transform
arrpolar_2 = PolarArray(Geometry=arrpolar.Geometry, Plane=pl_origin_3, Count=N_2, Angle=expression_2)  # -> Geometry, Transform
amp = Amplitude(Vector=pl_origin_2, Amplitude=expr("-x*2", "-500"))

# ---- group: Central
cull_i = CullIndex(List=arrpolar_2.Geometry, Indices=0, Wrap=True)

# ---- group: Mirror
mirror_3 = Mirror(Geometry=cull_i, Plane=pl_origin_4)  # -> Geometry, Transform
dispatch = Dispatch(List=mirror_3.Geometry, DispatchPattern=mirror_2)  # -> ListA, ListB
pflip = FlipPlane(Plane=dispatch.ListA, ReverseX=False, ReverseY=True, SwapAxes=False)

# ----
extr = Extrude(Base=move.Geometry, Direction=amp)

# ---- group: Transform
pln_array = Plane(flatten([arrpolar.Geometry, cull_i, pflip]))
orient = Orient(Geometry=u_text_2.Content, Source=pl_origin_2, Target=pln_array)  # -> PanelArray, Transform
orient_2 = Orient(Geometry=extr, Source=pl_origin_2, Target=pln_array)  # -> ExtrArray, Transform

# ----
layers = QueryModelLayers(Name="Q-deck-alloy", AutoUpdateState=True)
object = ModelObject(Object=u_text.Content, Geometry=orient.PanelArray, Layer=layers)
extr_array = Geometry(orient_2.ExtrArray)
solar_array_o = Object(object)
pln_array_2 = Plane(pln_array)
