# Grasshopper definition spaherical_srf.gh (Grasshopper 1.0.8)
# Copyright: © 2023 SYD all rights reserved

crv = Curve()
Z = ZComponent()
X = XComponent()
B = B()
crv_2 = Curve(crv)
end = EndPoints(Curve=crv_2)  # -> Start, End
pl = PlaneNormal(Origin=Point(0, 0, 0), ZAxis=Vector(0, 0, 1))
vec = VectorXYZ(XComponent=expr("x*10", X), YComponent=0, ZComponent=expr("-x*10", Z))  # -> Vector, Length
pl_origin = PlaneOrigin(Base=Plane(origin=(0, 0, 0), x=(0, 0, 1), y=(1, 0, 0)), Origin=end.End)
pl_origin_2 = PlaneOrigin(Base=PlaneXY(0, 0, 0), Origin=end.End)
move = Move(Geometry=end.End, Motion=vec.Vector)  # -> Geometry, Transform
addition = Addition(A=Z, B=B)
mirror = Mirror(Geometry=crv_2, Plane=pl_origin)  # -> Geometry, Transform
join = JoinCurves(Curves=[crv_2, mirror.Geometry], Preserve=False)
sph = Sphere(Base=move.Geometry, Radius=expr("x*10", addition))
Z_2 = UnitZ(Factor=-1)
project = Project(Curve=join, Brep=sph, Direction=Z_2)
Z_3 = UnitZ(Factor=expr("x*10", addition))
srfsplit = SurfaceSplit(Surface=sph, Curves=project)
move_2 = Move(Geometry=move.Geometry, Motion=Z_3)  # -> Geometry, Transform
area = Area(Geometry=srfsplit)  # -> Area, Centroid
sort = SortList(Keys=area.Centroid, ValuesA=srfsplit)  # -> Keys, ValuesA
item = ListItem(List=sort.ValuesA, Index=0, Wrap=True)
outline = Curves(join)
spherical_srf = Item(item)
centre = Geometry(move.Geometry)
srf_centre = Geometry(move_2.Geometry)
