# Grasshopper definition split_larger.gh (Grasshopper 1.0.8)
# Copyright: © SYD 2022

cutting_srf = BrepB()
srf_o = Object()
object = ModelObject(Object=srf_o)  # -> Object, Geometry
number_slider = Slider(7, range=0..7)  # disabled
join = BrepJoin(Breps=cutting_srf)  # -> Breps, Closed
X = UnitX(Factor=1000)
srf = Surface(cutting_srf)
bbx = BrepBrep(Surface=object.Object, CuttingSrf=graft(cutting_srf))  # -> Curves, Points
extr = Extrude(Base=join.Breps, Direction=X)
item = ListItem(List=object.Object, Index=number_slider, Wrap=True)  # disabled
srfsplit = SurfaceSplit(Surface=graft(object.Geometry), CuttingCrv=bbx.Curves)  # disabled
split = SplitBrep(Brep=object.Geometry, Cutter=extr)
join_2 = JoinCurves(Curves=flatten(bbx.Curves), Preserve=False)
item_2 = ListItem(List=split, Index=0, Wrap=True)
area = Area(Geometry=srfsplit)  # -> Area, Centroid; disabled
srf_2 = Surface(item_2)
sort = SortList(Keys=area.Area, ValuesA=srfsplit)  # -> Keys, ValuesA; disabled
dispatch = Dispatch(List=sort.ValuesA, DispatchPattern=invert([True, False]))  # -> ListA, ListB; disabled
fwd_srf = Surface(dispatch.ListA)  # disabled
aft_srf = Surface(dispatch.ListB)  # disabled
object_2 = ModelObject(Object=graft(object.Object), Geometry=srf_2)
trim_srf_o = Object(object_2)
C = Curves(join_2)
