# Grasshopper definition stem_srf_corrected.gh (Grasshopper 1.0.8)
# Copyright: © SYD 2022
# Copyright: © 2023 SYD all rights reserved

# ---- group: Stem
A = A()

# ----
b = B()
B = Brep()
d1 = Data1()
d2 = Data2()
merge = Merge(Data1=d1, Data2=d2)
sec = BrepPlane(Brep=B, Plane=Plane(origin=(0, 0, 0), x=(0, 0, 1), y=(1, 0, 0)))  # -> Curves, Points
srfsplit = SurfaceSplit(Surface=B, Curves=sec.Curves)
debrep = DeconstructBrep(Brep=B)  # -> Faces, Edges, Vertices
debrep_2 = DeconstructBrep(Brep=srfsplit)  # -> Faces, Edges, Vertices
len = Length(Curve=debrep.Edges)
midpt = CurveMiddle(Curve=debrep_2.Edges)
sort = SortList(Keys=len, ValuesA=debrep.Edges)  # -> Keys, reverse(ValuesA)
pdecon = Deconstruct(Point=midpt)  # -> XComponent, YComponent, ZComponent
item = ListItem(List=sort.ValuesA, Index=0, Wrap=True)  # -> Item, Item1
sort_2 = SortList(Keys=pdecon.XComponent, ValuesA=debrep_2.Edges)  # -> Keys, ValuesA
item_2 = ListItem(List=sort_2.ValuesA, Index=0, Wrap=True)  # -> Item, Item1
dispatch = Dispatch(List=flatten(item_2.Item), DispatchPattern=[True, False])  # -> ListA, ListB
flip = FlipCurve(Curve=dispatch.ListA)  # -> Curve, Flag
aligned_front_of_hull_crv = Curve([flip.Curve, dispatch.ListB])
end = EndPoints(Curve=sec.Curves)  # -> Start, End
shatter = Shatter(Curve=reparameterize(aligned_front_of_hull_crv), Parameters=merge)
sort_pt = SortPoints(Points=[end.End, end.Start])  # -> Points, Indices
dispatch_2 = Dispatch(List=shatter, DispatchPattern=[True, False])  # -> ListA, ListB
dispatch_3 = Dispatch(List=sort_pt.Points, DispatchPattern=[True, False])  # -> ListA, ListB
crv = Curve(dispatch_2.ListB)
bow_pt = Point(dispatch_3.ListA)
pframes = PerpFrames(Curve=crv, Count=10, Align=True)  # -> Frames, Parameters
multiplication = Multiplication(A=A, _99=b)
sec_2 = BrepPlane(Brep=graft(srfsplit), Plane=pframes.Frames)  # -> simplify(Curves), Points
outer_chine = Curve(item.Item1)
inner_chine = Curve(item.Item)
trim = TrimTree(Tree=sec_2.Curves, Depth=1)
bang = ExplodeTree(Data=trim)  # -> Branch0, Branch1

# ---- group: Stem top
cluster = Cluster(stem_crv_f=multiplication, inner_chine=inner_chine, outer_chine=outer_chine)

# ---- group: Stem mid
cluster_2 = Cluster(stem_crv_f=multiplication, inner_chine=bang.Branch0, outer_chine=bang.Branch1)

# ----
flip_2 = FlipCurve(Curve=cluster)  # -> Curve, Flag
crv_2 = Curve(flatten([flip_2.Curve, cluster_2]))

# ---- group: Stem sides
reb = RebuildCurve(Curve=aligned_front_of_hull_crv, Degree=2, Count=1000, Tangents=True)  # -> flatten(StemSideCrv)

# ----
midpt_2 = CurveMiddle(Curve=crv_2)
pdecon_2 = Deconstruct(Point=midpt_2)  # -> XComponent, YComponent, ZComponent
sort_3 = SortList(Keys=pdecon_2.ZComponent, ValuesStemCrv=crv_2)  # -> Keys, ValuesStemCrv
midpt_3 = CurveMiddle(Curve=sort_3.ValuesStemCrv)
entwine = Entwine(Branch00=bow_pt, Branch01=midpt_3, FlattenInputs=True)  # -> flatten(Result)
netsurf = NetworkSurface(CurvesU=reb, CurvesV=sort_3.ValuesStemCrv, Continuity=3)  # -> flatten(StemBase)
intcrv = Interpolate(Vertices=entwine, Degree=3, Periodic=False, KnotStyle=1)  # -> ProfileCrv, Length, Domain
points = PointList(Points=entwine, Size=20)
debrep_3 = DeconstructBrep(Brep=netsurf)  # -> Faces, Edges, Vertices
item_3 = ListItem(List=debrep_3.Edges, Index=Slider(1, range=0..10), Wrap=True)
i = Item(item_3)
stem_crv = ValuesStemCrv(sort_3.ValuesStemCrv)
stem_base = Surface(netsurf)
profile_crv = Curve(intcrv.ProfileCrv)

# ==== cluster Cluster
inner_chine = ClusterInput()
outer_chine = ClusterInput()
stem_crv_f = ClusterInput()
panel = Panel("""0
0.001
0.999
1""")
inner_chine_2 = Curve(inner_chine)
outer_chine_2 = Curve(outer_chine)
eval = EvaluateCurve(Curve=reparameterize(graft(inner_chine_2)), Parameter=panel)  # -> Point, Tangent, Angle
eval_2 = EvaluateCurve(Curve=reparameterize(graft(outer_chine_2)), Parameter=panel)  # -> Point, Tangent, Angle
x_tremez = Extremes(Curve=inner_chine_2, Plane=PlaneYZ(0, 0, 0))  # -> Highest, Lowest
x_tremez_2 = Extremes(Curve=outer_chine_2, Plane=PlaneYZ(0, 0, 0))  # -> Highest, Lowest
pdecon = Deconstruct(Point=eval.Point)  # -> XComponent, YComponent, ZComponent
pdecon_2 = Deconstruct(Point=eval_2.Point)  # -> XComponent, YComponent, ZComponent
pdecon_3 = Deconstruct(Point=x_tremez.Lowest)  # -> XComponent, YComponent, ZComponent
pdecon_4 = Deconstruct(Point=x_tremez_2.Lowest)  # -> XComponent, YComponent, ZComponent
sort = SortList(Keys=pdecon_2.XComponent, ValuesA=eval_2.Point)  # -> Keys, ValuesA
sort_2 = SortList(Keys=pdecon.XComponent, ValuesA=eval.Point)  # -> Keys, ValuesA
item = ListItem(List=sort_2.ValuesA, Index=0, Wrap=True)  # -> Item, Item1
item_2 = ListItem(List=sort.ValuesA, Index=0, Wrap=True)  # -> Item, Item1
expression = Expression(y=pdecon_3.YComponent, f=stem_crv_f, Expression="ABS(y)*f")
expression_2 = Expression(y=pdecon_4.YComponent, f=stem_crv_f, Expression="ABS(y)*f")
vec2pt = Vector2Pt(PointA=item.Item1, PointB=item.Item, Unitize=True)  # -> Vector, Length
vec2pt_2 = Vector2Pt(PointA=item_2.Item1, PointB=item_2.Item, Unitize=True)  # -> Vector, Length
vdis = VectorDisplay(Anchor=item.Item, Vector=vec2pt.Vector)
vdis_2 = VectorDisplay(Anchor=item_2.Item, Vector=vec2pt_2.Vector)
multiplication = Multiplication(A=flatten(vec2pt.Vector), Mult=expression)
multiplication_2 = Multiplication(A=flatten(vec2pt_2.Vector), Mult=expression_2)
bzspan = BezierSpan(StartPoint=x_tremez.Lowest, StartTangent=multiplication, EndPoint=x_tremez_2.Lowest, EndTangent=multiplication_2)  # -> StemCrv, Length, Domain
stem_crv = ClusterOutput(bzspan.StemCrv)
