# Grasshopper definition summary__detail_cog.gh (Grasshopper 1.0.8)
# Copyright: © SYD 2022
# Copyright: © 2023 SYD all rights reserved

summary_bom = Text()
detail_bom = Text()
area_dens = ClusterInput()
volumes = Number()
lengths = Number()
material = Text()
thickness = Number()
diameter = Number()
mirror_pln = Plane()
weights = Number()
areas = Number()
N = Name()
model = Text()
O = Object()
cogs = Point()
items = Text()
pln = Plane(mirror_pln)
null = NullItem(Item=pln)  # -> NullFlags, InvalidFlags, Description
mirror = Boolean(invert(null.NullFlags))

# ---- group: Individual items
detail_bom_2 = Text(flatten(detail_bom))
items_2 = Text(flatten(items))
weights_2 = Number(flatten(weights))
volumes_2 = Number(flatten(volumes))
cogs_2 = Point(flatten(cogs))
areas_2 = Number(flatten(areas))
lengths_2 = Number(flatten(lengths))

# ---- group: Mirror Calcs
integer = Integer(expr("x+1", mirror))
cog_on_cl = CoGOnCl(P=cogs_2, mirror_pln=mirror_pln)
multiplication = Multiplication(A=lengths_2, B=integer)
multiplication_2 = Multiplication(A=volumes_2, B=integer)
multiplication_3 = Multiplication(A=areas_2, B=integer)
multiplication_4 = Multiplication(A=weights_2, B=integer)

# ----
dispatch = Dispatch(List=mirror_pln, DispatchPattern=mirror)  # -> ListA, ListB

# ---- group: Aggregate items
ma = MassAddition(Input=multiplication_4)  # -> WeightKg, PartialResults
wav = WeightedAverage(Input=cog_on_cl, Weights=weights_2)
summary_bom_2 = Text(summary_bom)
diameter_2 = Number(diameter)
material_2 = Text(material)
thickness_2 = Number(thickness)
model_2 = Text(model)

# ----
object = ModelObject(Object=wav, Name=items_2)
object_2 = ModelObject(Object=wav, Name=N)
object_3 = ModelObject(Object=O)  # -> Object, Geometry, Name, Layer
dispatch_2 = Dispatch(List=object_3.Geometry, DispatchPattern=mirror)  # -> ListA, ListB
entwine = Entwine(
    Branch00=model_2,
    Branch01=ma.WeightKg,
    Branch02=wav,
    Branch03=material_2,
    Branch04=thickness_2,
    Branch05=diameter_2,
    Branch06=summary_bom_2,
    FlattenInputs=True)
entwine_2 = Entwine(
    Branch00=items_2,
    Branch01=multiplication_4,
    Branch02=cog_on_cl,
    Branch03=multiplication_3,
    Branch04=multiplication,
    Branch05=detail_bom_2,
    FlattenInputs=True)
mirror_2 = Mirror(Geometry=dispatch_2.ListA, Plane=dispatch.ListA)  # -> Geometry, Transform
panel = Panel("""Item
Weight
CoG
Area
Length
BoM""")
panel_2 = Panel("""Model
Weight
CoG
Material
Thickness
Diameter
BoM""")
object_4 = ModelObject(Geometry=mirror_2.Geometry, Name=object_3.Name, Layer=object_3.Layer)
flip = FlipMatrix(Data=entwine)
flip_2 = FlipMatrix(Data=entwine_2)
u_text = UserText(Content=object_2, Keys=panel, Values=flip_2, UserTextMode=1)  # -> DetailO, Keys, Values
clean = CleanTree(RemoveNulls=True, RemoveInvalid=True, RemoveEmpty=False, Tree=[object_4, object_3.Object])
u_text_2 = UserText(Content=object_2, Keys=panel_2, Values=flip, UserTextMode=1)
centre_o = Content(u_text_2)
detail_o = Content(u_text.DetailO)
geom = Tree(clean)

# ==== cluster CoGOnCl
mirror_pln = ClusterInput()
P = ClusterInput()
pdecon = Deconstruct(Point=P)  # -> XComponent, YComponent, ZComponent
mirror_pln_2 = Plane(mirror_pln)
null = NullItem(Item=mirror_pln_2)  # -> NullFlags, InvalidFlags, Description
dispatch = Dispatch(List=pdecon.YComponent, DispatchPattern=null.NullFlags)  # -> ListA, ListB
pdecon_2 = Deconstruct(Point=mirror_pln_2)  # -> XComponent, YComponent, ZComponent
null_2 = NullItem(Item=dispatch.ListA)  # -> NullFlags, InvalidFlags, Description
_0 = Number(0)
dispatch_2 = Dispatch(List=pdecon_2.YComponent, DispatchPattern=null_2.NullFlags)  # -> ListA, ListB
clean = CleanTree(RemoveNulls=True, RemoveInvalid=True, RemoveEmpty=False, Tree=[dispatch.ListA, dispatch_2.ListA])
pt = ConstructPoint(XCoordinate=pdecon.XComponent, YCoordinate=clean, ZCoordinate=pdecon.ZComponent)
pt_2 = ClusterOutput(pt)
