# Grasshopper definition superstruct_control_pts.gh (Grasshopper 1.0.8)
# Copyright: © SYD 2022

crprofile_fwd_ept = Point()
crprofile_aft_ept = Point()
crprofile_fwd_pt = Point()
crpcamb_end_pt = Point()
crprofile_aft_pt = Point()
crside_fwd_pt = Point()
crside_mid_pt = Point()
crside_aft_pt = Point()
crprofile_fwd_pt_2 = Point(crprofile_fwd_pt)
crprofile_fwd_ept_2 = Point(crprofile_fwd_ept)
crprofile_aft_pt_2 = Point(crprofile_aft_pt)
crprofile_aft_ept_2 = Point(crprofile_aft_ept)
crpcamb_end_pt_2 = Point(crpcamb_end_pt)
crside_fwd_pt_2 = Point(crside_fwd_pt)
crside_mid_pt_2 = Point(crside_mid_pt)
crside_aft_pt_2 = Point(crside_aft_pt)
panel = Panel("Trebuchet")  # disabled
fonts = QueryInstalledFonts(FontFamily=panel, FontWeight=4, FontStyle=1, FontStretch=5, Symbol=False, SingleStroke=True)  # disabled
entwine = Entwine(
    Branch00=crprofile_fwd_pt_2,
    Branch01=crprofile_fwd_ept_2,
    Branch02=crprofile_aft_pt_2,
    Branch03=crprofile_aft_ept_2,
    Branch04=crpcamb_end_pt_2,
    FlattenInputs=True)  # -> flatten(CrLidPts)
entwine_2 = Entwine(Branch00=crside_fwd_pt_2, Branch01=crside_mid_pt_2, Branch02=crside_aft_pt_2, FlattenInputs=True)  # -> flatten(CrSidePts)
panel_2 = Panel("""0 CrProfile fwd Pt
1 CrProfile fwd ePt
2 CrProfile aft Pt
3 CrProfile aft ePt
4 CrPcamb end Pt""")
panel_3 = Panel("""0 CrSide fwd Pt
1 CrSide mid Pt
2 CrSide aft Pt""")
font = ModelFont(Font=fonts, FontWeight=3, FontStretch=6)  # disabled
panel_4 = Panel("1")  # disabled
as_text = AnnotationTextSettings(Font=font, TextHeight=panel_4, ViewOriented=False)  # disabled
layers = QueryModelLayers(Name="G-phse-pts", AutoUpdateState=True)
panel_5 = Panel("G-anno")  # disabled
layers_2 = QueryModelLayers(Name=panel_5, AutoUpdateState=True)  # disabled
pl_origin = PlaneOrigin(
    Base=graft([PlaneXY(0, 0, 0), PlaneYZ(0, 0, 0), Plane(origin=(0, 0, 0), x=(0, 0, 1), y=(1, 0, 0))]),
    Origin=[crprofile_fwd_pt_2, entwine, entwine_2])  # disabled
display = DisplayAttributes(DisplayColour=ColourSwatch(SwatchColor=RGB(255, 0, 0)))
display_2 = DisplayAttributes(DisplayColour=ColourSwatch(SwatchColor=RGB(0, 255, 8)))
display_3 = DisplayAttributes(DisplayColour=ColourSwatch(SwatchColor=RGB(0, 212, 255)))
text_entity = TextEntity(Plane=pl_origin, Text=["Base Pt", panel_2, panel_3], TextSettings=as_text)  # disabled
object = ModelObject(Geometry=entwine, Name=panel_2, Layer=layers, Display=display_2)  # -> flatten(CrLidPtO)
object_2 = ModelObject(Geometry=crprofile_fwd_pt_2, Name="Base Pt", Layer=layers, Display=display)  # -> flatten(BasePtO)
object_3 = ModelObject(Geometry=entwine_2, Name=panel_3, Layer=layers, Display=display_3)  # -> flatten(CrSidePtO)
object_4 = ModelObject(Geometry=text_entity, Name=["Base Pt", panel_2, panel_3], Layer=layers_2)  # disabled
crlid_pt_o = Object([object, object_3, object_2])
panel_6 = Panel(object_4)
