# Grasshopper definition transom_surface.gh (Grasshopper 1.0.8)
# Copyright: © 2023 SYD all rights reserved

curve_amount = Integer()
tr_profile = Curve()
B = YCoordinate()

# ---- group: Top point on Cl
x_tremez = Extremes(Curve=tr_profile, Plane=PlaneXY(0, 0, 0))  # -> Highest, Lowest
pdecon = Deconstruct(Point=x_tremez.Highest)  # -> XComponent, YComponent, ZComponent
pt = ConstructPoint(XCoordinate=pdecon.XComponent, YCoordinate=0, ZCoordinate=pdecon.ZComponent)

# ----
curve_amount_2 = Integer(curve_amount)

# ---- group: Plan view Crv
subtraction = Subtraction(A=pdecon.XComponent, CrvAmt=curve_amount_2)
pt_2 = ConstructPoint(XCoordinate=pdecon.XComponent, YCoordinate=expr("x/200", B), ZCoordinate=pdecon.ZComponent)  # disabled
pt_3 = ConstructPoint(XCoordinate=subtraction, YCoordinate=B, ZCoordinate=pdecon.ZComponent)
mirror = Mirror(Geometry=pt_3, Plane=Plane(origin=(0, 0, 0), x=(0, 0, 1), y=(1, 0, 0)))  # -> Geometry, Transform
nurbs = NurbsCurve(Vertices=[pt_3, pt, mirror.Geometry], Degree=2, Periodic=False)  # -> Curve, Length, Domain

# ----
extrcrv = ExtrudeAlong(TopCrv=nurbs.Curve, TrProfile=tr_profile)
trans_srf = Extrusion(extrcrv)
