# Grasshopper definition transom_surface_solid_blend_remove.gh (Grasshopper 1.0.8)
# Copyright: © 2023 SYD all rights reserved

curve_amount = Integer()
tr_profile = Curve()
B = YCoordinate()

# ---- group: Top point on Cl
x_tremez = Extremes(Curve=tr_profile, Plane=PlaneXY(0, 0, 0))  # -> Highest, Lowest
pdecon = Deconstruct(Point=[x_tremez.Highest, x_tremez.Lowest])  # -> XComponent, YComponent, ZComponent
pt = ConstructPoint(XCoordinate=pdecon.XComponent, YCoordinate=0, ZCoordinate=pdecon.ZComponent)

# ----
curve_amount_2 = Integer(curve_amount)

# ---- group: Plan view Crv
subtraction = Subtraction(A=pdecon.XComponent, CrvAmt=curve_amount_2)
pt_2 = ConstructPoint(XCoordinate=subtraction, YCoordinate=B, ZCoordinate=pdecon.ZComponent)  # -> graft(Point)
mirror = Mirror(Geometry=pt_2, Plane=Plane(origin=(0, 0, 0), x=(0, 0, 1), y=(1, 0, 0)))  # -> Geometry, Transform
entwine = Entwine(Branch00=pt_2, Branch01=graft(pt), Branch02=mirror.Geometry, FlattenInputs=True)
flip = FlipMatrix(Data=entwine)
nurbs = NurbsCurve(Vertices=flip, Degree=2, Periodic=False)  # -> Curve, Length, Domain

# ----
extrcrv = ExtrudeAlong(TopCrv=nurbs.Curve, TrProfile=tr_profile)
area = Area(Geometry=extrcrv)  # -> Area, Centroid
crv = Curve(nurbs.Curve)
pdecon_2 = Deconstruct(Point=area.Centroid)  # -> XComponent, YComponent, ZComponent
sort = SortList(Keys=flatten(pdecon_2.ZComponent), ValuesA=flatten(extrcrv))  # -> Keys, ValuesA
item = ListItem(List=sort.ValuesA, Index=0, Wrap=True)
trans_brep = Brep(item)
srf = Surface(item)
trans_brep_2 = Brep(trans_brep)
