# Grasshopper definition vert_cutout.gh (Grasshopper 1.0.8)
# Copyright: © 2023 SYD all rights reserved

crv = Geometry()
cl_pl = Plane()
mirror = Mirror(Geometry=crv, Plane=cl_pl)  # -> Geometry, Transform
Z = UnitZ(Factor=500)
join = JoinCurves(Curves=[crv, mirror.Geometry], Preserve=False)
extr = Extrude(Base=join, Direction=Z)
cap = CapHoles(Brep=extr)
B = Brep(cap)
