# Grasshopper definition wood.gh (Grasshopper 1.0.8)
# Copyright: © SYD 2022

type = Type({"Concrete": 0, "Steel": 1, "Timber": 2, "Aluminium": 3, "Masonry": 4, "FRP": 5, "Glass": 6, "Fabric": 7, "Rebar": 8, "Tendon": 9, "ColdFormed": 10, "Other": 11}, selected="FRP")  # disabled
eglassepoxy = Panel("EglassEpoxy")  # disabled
panel = Panel("3")  # disabled
panel_2 = Panel("0.39")  # disabled
panel_3 = Panel("1300")  # disabled
merge = Merge(Data1=eglassepoxy, Data2=panel_3, Data3=type)  # disabled
panel_4 = Panel("""Type
Density
Tensile strength""")
type_2 = Type({"Concrete": 0, "Steel": 1, "Timber": 2, "Aluminium": 3, "Masonry": 4, "FRP": 5, "Glass": 6, "Fabric": 7, "Rebar": 8, "Tendon": 9, "ColdFormed": 10, "Other": 11, "StructuralCore": 12}, selected="StructuralCore")
type_3 = Type({"Concrete": 0, "Steel": 1, "Timber": 2, "Aluminium": 3, "Masonry": 4, "FRP": 5, "Glass": 6, "Fabric": 7, "Rebar": 8, "Tendon": 9, "ColdFormed": 10, "Other": 11}, selected="FRP")  # disabled
type_4 = Type({"Concrete": 0, "Steel": 1, "Timber": 2, "Aluminium": 3, "Masonry": 4, "FRP": 5, "Glass": 6, "Fabric": 7, "Rebar": 8, "Tendon": 9, "ColdFormed": 10, "Other": 11, "StructuralCore": 12}, selected="Timber")
type_5 = Type({"Concrete": 0, "Steel": 1, "Timber": 2, "Aluminium": 3, "Masonry": 4, "FRP": 5, "Glass": 6, "Fabric": 7, "Rebar": 8, "Tendon": 9, "ColdFormed": 10, "Other": 11, "StructuralCore": 12}, selected="Timber")
type_6 = Type({"Concrete": 0, "Steel": 1, "Timber": 2, "Aluminium": 3, "Masonry": 4, "FRP": 5, "Glass": 6, "Fabric": 7, "Rebar": 8, "Tendon": 9, "ColdFormed": 10, "Other": 11, "StructuralCore": 12}, selected="Timber")
type_7 = Type({"Concrete": 0, "Steel": 1, "Timber": 2, "Aluminium": 3, "Masonry": 4, "FRP": 5, "Glass": 6, "Fabric": 7, "Rebar": 8, "Tendon": 9, "ColdFormed": 10, "Other": 11, "StructuralCore": 12}, selected="Other")
panel_5 = Panel("CrossLinked PVC 130")  # disabled
panel_6 = Panel("1300")  # disabled
panel_7 = Panel("CrossLinked PVC 80")  # disabled
panel_8 = Panel("CrossLinked PVC 100")  # disabled
panel_9 = Panel("CrossLinked PVC 200")  # disabled
eglassepoxy_2 = Panel("EglassEpoxy")  # disabled
panel_10 = Panel("200")  # disabled
panel_11 = Panel("130")  # disabled
panel_12 = Panel("80")  # disabled
panel_13 = Panel("100")  # disabled
entwine = Entwine(Branch00=type_7, Branch01="2500", Branch02=0, FlattenInputs=True)
entwine_2 = Entwine(Branch00=type_6, Branch01="900", Branch02=0, FlattenInputs=True)
entwine_3 = Entwine(Branch00=type_5, Branch01="600", Branch02=0, FlattenInputs=True)
entwine_4 = Entwine(Branch00=type_2, Branch01=panel_10, Branch02=0, FlattenInputs=True)  # disabled
entwine_5 = Entwine(Branch00=type_4, Branch01="780", Branch02=0, FlattenInputs=True)
entwine_6 = Entwine(Branch00=type_2, Branch01=panel_11, Branch02=0, FlattenInputs=True)  # disabled
object = ModelObject(Object="Glass", Name="Glass")
object_2 = ModelObject(Object="MDF", Name="MDF")
object_3 = ModelObject(Object="Pine Plywood", Name="Pine Plywood")
entwine_7 = Entwine(Branch00=type_2, Branch01=panel_12, Branch02=0, FlattenInputs=True)  # disabled
entwine_8 = Entwine(Branch00=type_2, Branch01=panel_13, Branch02=0, FlattenInputs=True)  # disabled
entwine_9 = Entwine(Branch00=type_3, Branch01=panel_6, Branch02=0, FlattenInputs=True)  # disabled
object_4 = ModelObject(Object=panel_9, Name=panel_9)  # disabled
object_5 = ModelObject(Object="Marine Plywood", Name="Marine Plywood")
object_6 = ModelObject(Object=panel_5, Name=panel_5)  # disabled
object_7 = ModelObject(Object=panel_7, Name=panel_7)  # disabled
object_8 = ModelObject(Object=panel_8, Name=panel_8)  # disabled
object_9 = ModelObject(Object=eglassepoxy_2, Name=eglassepoxy_2)  # disabled
u_text = UserText(Content=object_2, Keys=panel_4, Values=flatten(entwine_2), UserTextMode=1)  # -> Content, Keys, Values
u_text_2 = UserText(Content=object, Keys=panel_4, Values=flatten(entwine), UserTextMode=1)  # -> Content, Keys, Values
u_text_3 = UserText(Content=object_3, Keys=panel_4, Values=flatten(entwine_3), UserTextMode=1)  # -> PinePlywood, Keys, Values
u_text_4 = UserText(Content=object_4, Keys=panel_4, Values=flatten(entwine_4), UserTextMode=1)  # -> CCrossLinkedPVC200, Keys, Values; disabled
u_text_5 = UserText(Content=object_5, Keys=panel_4, Values=flatten(entwine_5), UserTextMode=1)  # -> MarinePlywood, Keys, Values
u_text_6 = UserText(Content=object_6, Keys=panel_4, Values=flatten(entwine_6), UserTextMode=1)  # -> CCrossLinkedPVC130, Keys, Values; disabled
u_text_7 = UserText(Content=object_7, Keys=panel_4, Values=flatten(entwine_7), UserTextMode=1)  # -> CCrossLinkedPVC80, Keys, Values; disabled
u_text_8 = UserText(Content=object_8, Keys=panel_4, Values=flatten(entwine_8), UserTextMode=1)  # -> CCrossLinkedPVC100, Keys, Values; disabled
u_text_9 = UserText(Content=object_9, Keys=panel_4, Values=flatten(entwine_9), UserTextMode=1)  # -> Content, Keys, Values; disabled
marine_plywood = Content(u_text_5.MarinePlywood)
pine_plywood = Content(u_text_3.PinePlywood)
mdf = Content(u_text.Content)
glass = Content(u_text_2.Content)
