# Grasshopper definition wt_bhd.gh (Grasshopper 1.0.8)
# Copyright: © 2023 SYD all rights reserved

E = Edges()
O = Object()
object = ModelObject(Object=O)  # -> Object, Geometry, Name, Layer
boundary = BoundarySurfaces(Edges=[object.Geometry, E])
u_text = UserText(Content=object.Object, UserTextMode=1)  # -> Content, Keys, Values
object_2 = ModelObject(Object=boundary, Name=object.Name, Layer=object.Layer)
u_text_2 = UserText(Content=object_2, Keys=flatten(u_text.Keys), Values=flatten(u_text.Values), UserTextMode=1)  # -> Content, Keys, Values
O_2 = Object(object.Object)
srf_o = Content(u_text_2.Content)
